# Dynamo graph Room Finish Script V1.0.dyn (Dynamo 2.6.1.8786)
# packages: Clockwork for Dynamo 2.x 2.3.0, archi-lab.net 2021.25.19

# group: Input： Select Rooms
# note: Room Finish Script
# Package download: Clockwork
# Step 1: Create Room Schedule in Revit
# Step 2: Add "Name" to schedule fields, and create 28 new Project Parameters in "Text" type with name of
# "Floor Finish Area","Floor Finish Material",
# "Ceiling Finish Area","Ceiling Finish Material",
# "Wall 1 Area","Wall 1 Material","Wall 1 Orientation",
# "Wall 2 Area","Wall 2 Material","Wall 2 Orientation"...
# (create 8 sets of numbered wall parameters)
# Step 3: Run the script
categories = Categories("OST_Rooms")  # graph input
all_elements_of_category = ElementsOfCategory(Category=categories)

# group: Get Room Finish Area/Material/Facetype
# note: Clockwork
finishes = Custom[Room.Finishes](room=all_elements_of_category)  # package Clockwork for Dynamo 2.x; Returns all room bounding faces and their materials
watch = Watch(finishes.revitFaces)
watch_2 = Watch(finishes.areas)
watch_3 = Watch(finishes.faceTypes)
watch_4 = Watch(finishes.finishMaterials)

# group: Filter Floor Area
code_block = CodeBlock { "Bottom"; }
eq = watch_3 == code_block
filterByBoolMask = List.FilterByBoolMask(list=watch_2, mask=eq)
watch_5 = Watch(filterByBoolMask.in)

# group: Output Floor Area into Schedule
code_block_2 = CodeBlock { "Floor Finish Area"; }
setParameterByName = Element.SetParameterByName(element=all_elements_of_category, parameterName=code_block_2, value=watch_5)
watch_6 = Watch(setParameterByName)

# group: Filter Floor Material
eq_2 = watch_3 == code_block
filterByBoolMask_2 = List.FilterByBoolMask(list=watch_4, mask=eq_2)
watch_7 = Watch(filterByBoolMask_2.in)

# group: Output Floor Material into Schedule
code_block_3 = CodeBlock { "Floor Finish Material"; }
name = Element.Name(element=watch_7)
setParameterByName_2 = Element.SetParameterByName(element=all_elements_of_category, parameterName=code_block_3, value=name)
watch_8 = Watch(setParameterByName_2)

# group: Filter Ceiling Area
code_block_4 = CodeBlock { "Top"; }
eq_3 = watch_3 == code_block_4
filterByBoolMask_3 = List.FilterByBoolMask(list=watch_2, mask=eq_3)
watch_9 = Watch(filterByBoolMask_3.in)

# group: Output Ceiling Area into Schedule
code_block_5 = CodeBlock { "Ceiling Finish Area"; }
setParameterByName_3 = Element.SetParameterByName(element=all_elements_of_category, parameterName=code_block_5, value=watch_9)
watch_10 = Watch(setParameterByName_3)

# group: Filter Ceiling Material
eq_4 = watch_3 == code_block_4
filterByBoolMask_4 = List.FilterByBoolMask(list=watch_4, mask=eq_4)
watch_11 = Watch(filterByBoolMask_4.in)

# group: Output Ceiling Material into Schedule
code_block_6 = CodeBlock { "Ceiling Finish Material"; }
name_2 = Element.Name(element=watch_11)
setParameterByName_4 = Element.SetParameterByName(element=all_elements_of_category, parameterName=code_block_6, value=name_2)
watch_12 = Watch(setParameterByName_4)

# group: Get Wall Orientation
wall_orientation_python = Python(IN[0]=all_elements_of_category)
# ---------- wall_orientation_python.python (80 lines) ----------
import sys
import clr
clr.AddReference('ProtoGeometry')
from Autodesk.DesignScript.Geometry import *
clr.AddReference('RevitAPI')
clr.AddReference('RevitServices')

from Autodesk.Revit.DB import *
import Autodesk
from RevitServices.Persistence import DocumentManager

clr.AddReference('RevitNodes')
import Revit
clr.ImportExtensions(Revit.Elements)
clr.ImportExtensions(Revit.GeometryConversion)


def getOrientation(vecTrueNorth, vecTrueEast, solidFace):
	faceNorm = solidFace.FaceNormal
	dotP_N = round(faceNorm.DotProduct(vecTrueNorth), 3)
	dotP_E = round(faceNorm.DotProduct(vecTrueEast), 3)
	#0.707 = Pi / 4 or (45°)
	if  dotP_N > 0.707 and abs(dotP_E) <= 0.707:
		return "North"
	elif dotP_N < -0.707 and abs(dotP_E) <= 0.707:
		return "South"
	elif dotP_E > 0.707 and abs(dotP_N) <= 0.707:
		return "East"		
	elif dotP_E < -0.707 and abs(dotP_N) <= 0.707:
		return "West"
	elif dotP_N == 0.707 and dotP_E == 0.707:
		return "Northeast"
	elif dotP_N == 0.707 and dotP_E == -0.707:
		return "Northwest"
	elif dotP_N == -0.707 and dotP_E == 0.707:
		return "Southeast"
	elif dotP_N == -0.707 and dotP_E == -0.707:
		return "Southwest"
	else:
		return None
		
rooms = UnwrapElement(IN[0])

doc = DocumentManager.Instance.CurrentDBDocument
currentLocation = doc.ActiveProjectLocation
origin = XYZ(0, 0, 0)
projectPosition = currentLocation.GetProjectPosition(origin)
angleToNorth = projectPosition.Angle
vecNorth = XYZ.BasisY 
vecEast = XYZ.BasisX 
rotTransf = Transform.CreateRotation(XYZ.BasisZ,  - angleToNorth)
vecTrueNorth = rotTransf.OfVector(vecNorth)
vecTrueEast = rotTransf.OfVector(vecEast)

calculator = SpatialElementGeometryCalculator(doc)

elementMaterial = list()

for room in rooms:
	if calculator.CanCalculateGeometry(room):
		results = calculator.CalculateSpatialElementGeometry(room)

		roomSolid = results.GetGeometry()
		roomMaterial = list()
		for face in roomSolid.Faces:
			for subface in results.GetBoundaryFaceInfo(face):
				if subface.SubfaceType == SubfaceType.Side:		
					boundingElement = subface.GetBoundingElementFace()
					elementId = boundingElement.MaterialElementId
					material = doc.GetElement(elementId)
					if material is not None :
						surfaceDs = face.ToProtoType()
						nameOrient = getOrientation(vecTrueNorth, vecTrueEast, face)
						materialName = material.Name
						roomMaterial.append([nameOrient])
									
						
		elementMaterial.append([room, roomMaterial])
	
OUT =  elementMaterial
# ----------------------------------------
watch_13 = Watch(wall_orientation_python)
flatten = List.Flatten()  # unwired: list
map = List.Map(list=wall_orientation_python, f_x=flatten)
watch_14 = Watch(map)

# group: Filter Wall Material
code_block_7 = CodeBlock { "Side"; }
eq_5 = watch_3 == code_block_7
filterByBoolMask_5 = List.FilterByBoolMask(list=watch_4, mask=eq_5)
watch_15 = Watch(filterByBoolMask_5.in)

# group: Get Door Host
code_block_8 = CodeBlock { "Side"; }
eq_6 = watch_3 == code_block_8
filterByBoolMask_6 = List.FilterByBoolMask(list=finishes.elements, mask=eq_6)
watch_16 = Watch(filterByBoolMask_6.in)
doors = Custom[Room.Doors](room=all_elements_of_category)  # package Clockwork for Dynamo 2.x; Retrieves all doors that are associated with a room (hosted in walls and roofs).
boolean = BoolSelector(false)  # graph input
clean = List.Clean(list=doors, preserveIndices=boolean)
getHost = FamilyInstance.GetHost(familyInstance=clean)
code_block_9 = CodeBlock { 1; }
flatten_2 = List.Flatten(list=getHost, amt=code_block_9)
indexOf = List.IndexOf(list=flatten_2, element=watch_16)
flatten_3 = List.Flatten(list=clean, amt=code_block_9)

# group: Get Window Host
windows = Custom[Room.Windows](room=all_elements_of_category)  # package Clockwork for Dynamo 2.x; Retrieves all windows that are associated with a room (hosted in walls and roofs).
boolean_2 = BoolSelector(false)  # graph input
clean_2 = List.Clean(list=windows, preserveIndices=boolean_2)
getHost_2 = FamilyInstance.GetHost(familyInstance=clean_2)
code_block_10 = CodeBlock { 1; }
flatten_4 = List.Flatten(list=getHost_2, amt=code_block_10)
indexOf_2 = List.IndexOf(list=flatten_4, element=watch_16)
flatten_5 = List.Flatten(list=clean_2, amt=code_block_10)

# group: Filter Wall Area
code_block_11 = CodeBlock { "Side"; }
eq_7 = watch_3 == code_block_11
filterByBoolMask_7 = List.FilterByBoolMask(list=watch_2, mask=eq_7)
watch_17 = Watch(filterByBoolMask_7.in)

# group: Get Door Area
getItemAtIndex = List.GetItemAtIndex(list=flatten_3, index=indexOf)
type = archilab.Revit.Elements.Elements.Type(element=getItemAtIndex)
code_block_12 = CodeBlock { "Height"; "Width"; }
getParameterValueByName = Element.GetParameterValueByName(element=type, parameterName=code_block_12.out0)
getParameterValueByName_2 = Element.GetParameterValueByName(element=type, parameterName=code_block_12.out1)
mul = getParameterValueByName * getParameterValueByName_2

# group: Minus the area of doors
code_block_13 = CodeBlock(x=indexOf) { x!=-1; }
code_block_14 = CodeBlock { "0"; }
isNull = Object.IsNull()  # unwired: obj
replaceByCondition = Replace(item=mul, replaceWith=code_block_14, condition=isNull)
sub = watch_17 - replaceByCondition
if_ = If(test=code_block_13, true=sub, false=watch_17)

# group: Get Window Area
getItemAtIndex_2 = List.GetItemAtIndex(list=flatten_5, index=indexOf_2)
type_2 = archilab.Revit.Elements.Elements.Type(element=getItemAtIndex_2)
code_block_15 = CodeBlock { "Height"; "Width"; }
getParameterValueByName_3 = Element.GetParameterValueByName(element=type_2, parameterName=code_block_15.out0)
getParameterValueByName_4 = Element.GetParameterValueByName(element=type_2, parameterName=code_block_15.out1)
mul_2 = getParameterValueByName_3 * getParameterValueByName_4

# group: Minus the area of windows
code_block_16 = CodeBlock(x=indexOf_2) { x!=-1; }
code_block_17 = CodeBlock { "0"; }
isNull_2 = Object.IsNull()  # unwired: obj
replaceByCondition_2 = Replace(item=mul_2, replaceWith=code_block_17, condition=isNull_2)
sub_2 = if_ - replaceByCondition_2
if_2 = If(test=code_block_16, true=sub_2, false=if_)

# group: Merge same wall area
name_3 = Element.Name(element=watch_15)
code_block_18 = CodeBlock { 0; }
removeItemAtIndex = List.RemoveItemAtIndex(list=watch_14@@L2, indices=code_block_18)
code_block_19 = CodeBlock(a=name_3, b=removeItemAtIndex) { a+"/"+b; }
watch_18 = Watch(code_block_19)
python_script = Python(IN[0]=watch_18)
# ---------- python_script.python (19 lines) ----------
def isUnique(item, list):
	count = 0;
	for i in list:
		if item == i:
			count += 1
	return count == 1

#The inputs to this node will be stored as a list in the IN variables.
list = IN[0]
boolList = []

for sublist in list:
	boolSublist = []
	boolList.append(boolSublist)
	for item in sublist:
		boolSublist.append(isUnique(item, sublist))
	
#Assign your output to the OUT variable.
OUT = boolList
# ----------------------------------------
watch_19 = Watch(python_script)
room_wall_area_minus_door_window = Watch(if_2)
code_block_20 = CodeBlock { false; }
eq_8 = watch_19 == code_block_20
filterByBoolMask_8 = List.FilterByBoolMask(list=room_wall_area_minus_door_window, mask=eq_8)
sum = Math.Sum(values=filterByBoolMask_8.in@L2)
if_3 = If(test=watch_19, true=room_wall_area_minus_door_window, false=sum)
code_block_21 = CodeBlock(a=if_3, b=watch_18) { a+"/"+b; }
uniqueItems = List.UniqueItems(list=code_block_21@L2)
code_block_22 = CodeBlock { "/"; }
split = String.Split(str=uniqueItems, separator0=code_block_22)

# group: Create Wall Area List
code_block_23 = CodeBlock { 0; }
getItemAtIndex_3 = List.GetItemAtIndex(list=split@@L2, index=code_block_23, lacing=Longest)
watch_20 = Watch(getItemAtIndex_3)

# group: Output Wall Area to schedule
watch_21 = Watch(all_elements_of_category)
code_block_24 = CodeBlock { "Wall 1 Area"; "Wall 2 Area"; "Wall 3 Area"; "Wall 4 Area"; "Wall 5 Area"; "Wall 6 Area"; "Wall 7 Area"; "Wall 8 Area"; }
list_create = List.Create(item0=code_block_24.out0, item1=code_block_24.out1, item2=code_block_24.out2, item3=code_block_24.out3, item4=code_block_24.out4, item5=code_block_24.out5, item6=code_block_24.out6, item7=code_block_24.out7)
code_block_25 = CodeBlock { "-"; }
list_create_2 = List.Create(item0=code_block_25, item1=code_block_25, item2=code_block_25, item3=code_block_25, item4=code_block_25, item5=code_block_25, item6=code_block_25, item7=code_block_25)
addItemToEnd = List.AddItemToEnd(item=list_create_2, list=watch_20@L2)
code_block_26 = CodeBlock { 1; }
flatten_6 = List.Flatten(list=addItemToEnd, amt=code_block_26, lacing=Longest)
setParameterByName_5 = Element.SetParameterByName(element=watch_21, parameterName=list_create@L2, value=flatten_6@L2, lacing=Longest)

# group: Create Wall Material List
code_block_27 = CodeBlock { 1; }
getItemAtIndex_4 = List.GetItemAtIndex(list=split@@L2, index=code_block_27, lacing=Longest)
watch_22 = Watch(getItemAtIndex_4)

# group: Output Wall Material to schedule
watch_23 = Watch(all_elements_of_category)
code_block_28 = CodeBlock()
# ---------- code_block_28.designscript (8 lines) ----------
"Wall 1 Material";
"Wall 2 Material";
"Wall 3 Material";
"Wall 4 Material";
"Wall 5 Material";
"Wall 6 Material";
"Wall 7 Material";
"Wall 8 Material";
# ----------------------------------------
list_create_3 = List.Create(item0=code_block_28.out0, item1=code_block_28.out1, item2=code_block_28.out2, item3=code_block_28.out3, item4=code_block_28.out4, item5=code_block_28.out5, item6=code_block_28.out6, item7=code_block_28.out7)
code_block_29 = CodeBlock { "-"; }
list_create_4 = List.Create(item0=code_block_29, item1=code_block_29, item2=code_block_29, item3=code_block_29, item4=code_block_29, item5=code_block_29, item6=code_block_29, item7=code_block_29)
addItemToEnd_2 = List.AddItemToEnd(item=list_create_4, list=watch_22@L2)
code_block_30 = CodeBlock { 1; }
flatten_7 = List.Flatten(list=addItemToEnd_2, amt=code_block_30, lacing=Longest)
setParameterByName_6 = Element.SetParameterByName(element=watch_23, parameterName=list_create_3@L2, value=flatten_7@L2, lacing=Longest)

# group: Create Wall Orientation List
code_block_31 = CodeBlock { 2; }
getItemAtIndex_5 = List.GetItemAtIndex(list=split@@L2, index=code_block_31, lacing=Longest)
watch_24 = Watch(getItemAtIndex_5)

# group: Wall Orientation output to schedule
watch_25 = Watch(all_elements_of_category)
code_block_32 = CodeBlock()
# ---------- code_block_32.designscript (8 lines) ----------
"Wall 1 Orientation";
"Wall 2 Orientation";
"Wall 3 Orientation";
"Wall 4 Orientation";
"Wall 5 Orientation";
"Wall 6 Orientation";
"Wall 7 Orientation";
"Wall 8 Orientation";
# ----------------------------------------
list_create_5 = List.Create(item0=code_block_32.out0, item1=code_block_32.out1, item2=code_block_32.out2, item3=code_block_32.out3, item4=code_block_32.out4, item5=code_block_32.out5, item6=code_block_32.out6, item7=code_block_32.out7)
code_block_33 = CodeBlock { "-"; }
list_create_6 = List.Create(item0=code_block_33, item1=code_block_33, item2=code_block_33, item3=code_block_33, item4=code_block_33, item5=code_block_33, item6=code_block_33, item7=code_block_33)
addItemToEnd_3 = List.AddItemToEnd(item=list_create_6, list=watch_24@L2)
code_block_34 = CodeBlock { 1; }
flatten_8 = List.Flatten(list=addItemToEnd_3, amt=code_block_34, lacing=Longest)
setParameterByName_7 = Element.SetParameterByName(element=watch_25, parameterName=list_create_5@L2, value=flatten_8@L2, lacing=Longest)
