# Dynamo graph ArchSmarter_01 Create Levels from Excel.dyn (Dynamo 2.13.1.3887)
# author: ArchSmarter
# Create levels from Excel data

# group: Get Data from Excel
# Select Excel file and read data
file_path = Filename(".\ArchSmarter_01 Floor Levels.xlsx")  # graph input
fromPath = FileObject(path=file_path)  # "File.FromPath"
code_block = CodeBlock { "Sheet1"; }
importExcel = Data.ImportExcel(file=fromPath, sheetName=code_block)

# group: Remove Header and Format List
# Use this collection of nodes to remove the header row from the Excel data
code_block_2 = CodeBlock { 0; }
removeItemAtIndex = List.RemoveItemAtIndex(list=importExcel, indices=code_block_2)
transpose = List.Transpose(lists=removeItemAtIndex)

# group: Get Name & Elevation then Create Levels
# Get the name and elevation data and create the levels
code_block_3 = CodeBlock { 0; 1; }
getItemAtIndex = List.GetItemAtIndex(list=transpose, index=code_block_3.out1)
getItemAtIndex_2 = List.GetItemAtIndex(list=transpose, index=code_block_3.out0)
byElevationAndName = Level.ByElevationAndName(elevation=getItemAtIndex, name=getItemAtIndex_2)
