# Dynamo graph ArchSmarter_02 Calculate FAR and GSF.dyn (Dynamo 2.13.1.3887)
# author: ArchSmarter
# Calculate GSF from areas and calculate FAR from site area

# group: Get All Areas
# Get all area elements from the current model
code_block = CodeBlock { "Areas"; }
byName = Category.ByName(name=code_block)
all_elements_of_category = ElementsOfCategory(Category=byName)

# group: Filter for Gross Area
code_block_2 = CodeBlock { "Area Scheme Id"; }
getParameterValueByName = Element.GetParameterValueByName(element=all_elements_of_category, parameterName=code_block_2)
name = Element.Name(element=getParameterValueByName)
code_block_3 = CodeBlock { "Gross Building"; }
eq = name == code_block_3
filterByBoolMask = List.FilterByBoolMask(list=all_elements_of_category, mask=eq)

# group: Group Areas By Level
code_block_4 = CodeBlock { "Level"; }
getParameterValueByName_2 = Element.GetParameterValueByName(parameterName=code_block_4)  # unwired: element
groupByFunction = List.GroupByFunction(list=filterByBoolMask.in, groupFunction=getParameterValueByName_2)

# group: Calculate Gross Area By Level Then Total
code_block_5 = CodeBlock { "Area"; }
getParameterValueByName_3 = Element.GetParameterValueByName(element=groupByFunction, parameterName=code_block_5)
# note: Gross Area By Level
sum = Math.Sum(values=getParameterValueByName_3)
# note: Total Gross Area
sum_2 = Math.Sum(values=sum)

# group: Get Site Area
element_types = ElementTypes("PropertyLine")  # graph input
all_elements_of_type = ElementsOfType(element_class=element_types)
code_block_6 = CodeBlock { "Area"; }
getParameterValueByName_4 = Element.GetParameterValueByName(element=all_elements_of_type, parameterName=code_block_6)

# group: Output GSF and FAR
# note: GSF Output
watch = Watch(sum_2)
div = sum_2 / getParameterValueByName_4
# note: FAR Output
watch_2 = Watch(div)
