# Dynamo graph ArchSmarter_03 Export Element Parameters to Excel.dyn (Dynamo 2.13.1.3887)
# author: ArchSmarter
# Export door parameter values to Excel

# group: Get All Doors
# This example uses doors but change the category to export other element data
categories = Categories("OST_Doors")  # graph input
all_elements_of_category = ElementsOfCategory(Category=categories)

# group: Sort Doors By "Mark" Value
code_block = CodeBlock { "Mark"; }
getParameterValueByName = Element.GetParameterValueByName(parameterName=code_block)  # unwired: element
sortByFunction = List.SortByFunction(list=all_elements_of_category, sortFunction=getParameterValueByName)

# group: Get Door Instance Parameters
code_block_2 = CodeBlock { "Mark"; "Level"; "HW Group"; }
getParameterValueByName_2 = Element.GetParameterValueByName(element=sortByFunction, parameterName=code_block_2.out0)
getParameterValueByName_3 = Element.GetParameterValueByName(element=sortByFunction, parameterName=code_block_2.out1)
name = Level.Name(level=getParameterValueByName_3)
name_2 = FamilyType.Name(familyType=sortByFunction)
getParameterValueByName_4 = Element.GetParameterValueByName(element=sortByFunction, parameterName=code_block_2.out2)

# group: Get Door Type Parameters
elementType = Element.ElementType(element=sortByFunction)
code_block_3 = CodeBlock { "Height"; "Width"; }
getParameterValueByName_5 = Element.GetParameterValueByName(element=elementType, parameterName=code_block_3.out0)
getParameterValueByName_6 = Element.GetParameterValueByName(element=elementType, parameterName=code_block_3.out1)

# group: Put the Parameter Values into a List
create = List.Create(item0=getParameterValueByName_2, item1=name, item2=name_2, item3=getParameterValueByName_5, item4=getParameterValueByName_6, item5=getParameterValueByName_4)
transpose = List.Transpose(lists=create)

# group: Add Column Headers for Excel
code_block_4 = CodeBlock { "Mark"; "Level"; "Type"; "Height"; "Width"; "HW Group"; }
create_2 = List.Create(item0=code_block_4.out0, item1=code_block_4.out1, item2=code_block_4.out2, item3=code_block_4.out3, item4=code_block_4.out4, item5=code_block_4.out5)
addItemToFront = List.AddItemToFront(item=create_2, list=transpose)

# group: Export Data to Excel
file_path = Filename(".\test.xlsx")  # graph input
code_block_5 = CodeBlock { "Sheet 1"; 0; true; }
exportExcel = Data.ExportExcel(filePath=file_path, sheetName=code_block_5.out0, startRow=code_block_5.out1, startColumn=code_block_5.out1, data=addItemToFront, overWrite=code_block_5.out2)
