# Dynamo graph ArchSmarter_04 Dimension Grid Lines.dyn (Dynamo 2.13.1.3887)
# author: ArchSmarter
# Automatically dimension column grid lines based on line in the model

# group: Get All Grid Lines and Extract Curve
element_types = ElementTypes("Grid")  # graph input
all_elements_of_type = ElementsOfType(element_type=element_types)
curve = Grid.Curve(grid=all_elements_of_type)

# group: Select Line That Intersects Grid Lines
# note: The line is also used to determine the location of the dimension strings
select_model_element = DSModelElementSelection()  # 1 picked in the model; graph input
curves = Element.Curves(element=select_model_element)

# group: Add Points Along Line
# note: Use a higher number if some grid lines do not get dimensions
number_slider = DoubleSlider(20, range=0..250 step 1)  # graph input
pointsAtEqualChordLength = Curve.PointsAtEqualChordLength(curve=curves, divisions=number_slider)

# group: Create Upper and Lower Points
code_block = CodeBlock { 1000; }
byCoordinates = Vector.ByCoordinates(z=code_block)
subtract = Point.Subtract(point=pointsAtEqualChordLength, vectorToSubtract=byCoordinates)
add = Point.Add(point=pointsAtEqualChordLength, vectorToAdd=byCoordinates)

# group: Create Cylinders and Look for Intersection with Line
number = DoubleInput(1000)  # graph input
byPointsRadius = Cylinder.ByPointsRadius(startPoint=subtract, endPoint=add, radius=number)
flatten = List.Flatten(list=byPointsRadius)
doesIntersect = Geometry.DoesIntersect(geometry=flatten, other=curve, lacing=CrossProduct)

# group: Get Index Number of Intersecting Grid Lines
boolean = BoolSelector(true)  # graph input
firstIndexOf = List.FirstIndexOf(list=doesIntersect@L2, item=boolean)
uniqueItems = List.UniqueItems(list=firstIndexOf)

# group: Remove Empty Values and Get Grid Lines
code_block_2 = CodeBlock { -1; }
firstIndexOf_2 = List.FirstIndexOf(list=uniqueItems, item=code_block_2)
removeItemAtIndex = List.RemoveItemAtIndex(list=uniqueItems, indices=firstIndexOf_2)
getItemAtIndex = List.GetItemAtIndex(list=all_elements_of_type, index=removeItemAtIndex)

# group: Place Dimensions
current = Document.Current()
activeView = Document.ActiveView(document=current)
byElements = Dimension.ByElements(view=activeView, referenceElements=getItemAtIndex, line=curves)
