# Dynamo graph ArchSmarter_09 Batch Upgrade Families.dyn (Dynamo 2.13.1.3887)
# author: ArchSmarter
# Upgrade a folder of family files to a new Revit version
# packages: Rhythm 2022.7.2

# group: Get All Files in Directory
directory_path = Directory("C:\Users\micha\Google Drive\Courses\C2017-010_Dynamo for Busy People\Scripts\Paid\18 - Batch Upgrade Families\Doors")  # graph input
fromPath = DirectoryObject(path=directory_path)  # "Directory.FromPath"
getDirectoryContents = FileSystem.GetDirectoryContents(directory=fromPath)

# group: Open then Close and Save File
# note: Custom Node: Rhythm v.2022.7.2
ʳʰʸᵗʰᵐ_applications = Rhythm.Revit.Application.Applications.OpenDocumentFile(filePath=getDirectoryContents.files)
boolean = BoolSelector(true)  # graph input
ʳʰʸᵗʰᵐ_applications_2 = Rhythm.Revit.Application.Applications.CloseDocument(document=ʳʰʸᵗʰᵐ_applications, save=boolean)

watch = Watch(ʳʰʸᵗʰᵐ_applications_2)
# note: Custom Node: Rhythm v.2022.7.2
upgradeFamilies = Rhythm.Revit.Tools.Batch.UpgradeFamilies()  # unwired: directoryPath
