# Dynamo graph ArchSmarter_10 MEP from Lines.dyn (Dynamo 2.13.1.3887)
# author: ArchSmarter
# Create MEP elements (pipes, ducts, conduit) from lines
# packages: MEPover 2022.1.1

# group: Get All Lines
element_types = ElementTypes("CurveElement")  # graph input
all_elements_of_type = ElementsOfType(element_class=element_types)

# group: Filter for Model Lines
name = Element.Name(element=all_elements_of_type)
string = StringInput("Model Lines")  # graph input
eq = name == string
filterByBoolMask = List.FilterByBoolMask(list=all_elements_of_type, mask=eq)

# group: Filter for Specific Line Style
string_2 = StringInput("Line Style")  # graph input
getParameterValueByName = Element.GetParameterValueByName(element=filterByBoolMask.in, parameterName=string_2)
name_2 = Element.Name(element=getParameterValueByName)
string_3 = StringInput("Wide Lines")  # graph input
eq_2 = name_2 == string_3
filterByBoolMask_2 = List.FilterByBoolMask(list=filterByBoolMask.in, mask=eq_2)

# group: Get All Pipe Types
element_types_2 = ElementTypes("PipeType")  # graph input
all_elements_of_type_2 = ElementsOfType(element_class=element_types_2)

# group: Filter for Specific Type
name_3 = Element.Name(element=all_elements_of_type_2)
string_4 = StringInput("Standard")  # graph input
firstIndexOf = List.FirstIndexOf(list=name_3, item=string_4)
getItemAtIndex = List.GetItemAtIndex(list=all_elements_of_type_2, index=firstIndexOf)

# group: Get All MEP System Types
element_types_3 = ElementTypes("MEPSystemType")  # graph input
all_elements_of_type_3 = ElementsOfType(element_class=element_types_3)

# group: Filter for Specific Type
name_4 = Element.Name(element=all_elements_of_type_3)
string_5 = StringInput("Domestic Hot Water")  # graph input
firstIndexOf_2 = List.FirstIndexOf(list=name_4, item=string_5)
getItemAtIndex_2 = List.GetItemAtIndex(list=all_elements_of_type_3, index=firstIndexOf_2)

# group: Create Pipes
curve = CurveElement.Curve(curveElement=filterByBoolMask_2.in)
levels = Levels("Level 1")  # graph input
number = DoubleInput(6)  # graph input
# note: Custom Node: MEPover v.2022.1.1
byLines = Custom[Pipe.ByLines](Lines=curve, PipeType=getItemAtIndex, SystemType=getItemAtIndex_2, level=levels, Diameter=number)  # package MEPover; Creates a pipe by Line, PipeType, SystemType, Level and Diameter

# note: Custom Node: MEPover v.2022.1.1
byLines_2 = Custom[Conduit.ByLines]()  # package MEPover; Creates conduits by Line, ConduitType, Level and Diameter; unwired: Lines, ConduitType, level, Diameter
byLines_3 = Custom[DuctRectangular.ByLines]()  # package MEPover; Create ducts by Lines, DuctType, MechanicalFittingType, Level, Width and Height; unwired: Lines, DuctType, MechanicalSystemType, level, Width, Height
