# Dynamo graph ArchSmarter_11 Change Text Case.dyn (Dynamo 2.13.1.3887)
# author: ArchSmarter
# Change text (sheet name, text note, room name) to upper or lower case

# group: Get Rooms
categories = Categories("OST_Rooms")  # graph input
all_elements_of_category = ElementsOfCategory(Category=categories)

# group: Get Room Names and Room Numbers
name = Room.Name(room=all_elements_of_category)
number = Room.Number(room=all_elements_of_category)

# group: Replace Room Number and set to Upper (or Lower)
string = StringInput(" ")  # graph input
replace = String.Replace(string=name, searchFor=number, replaceWith=string)
trimWhitespace = String.TrimWhitespace(string=replace)
toUpper = String.ToUpper(string=trimWhitespace)
toLower = String.ToLower()  # unwired: string

# group: Update Room Name
setName = Room.SetName(room=all_elements_of_category, value=toUpper)

# group: Get Text Notes
categories_2 = Categories("OST_TextNotes")  # graph input
all_elements_of_category_2 = ElementsOfCategory(Category=categories_2)
text = TextNote.Text(textNote=all_elements_of_category_2)

# group: Change Text Case
toUpper_2 = String.ToUpper(string=text)
toLower_2 = String.ToLower()  # unwired: string

# group: Update Text
setText = TextNote.SetText(textNote=all_elements_of_category_2, value=toUpper_2)

# group: Get Sheets and Sheet Names
categories_3 = Categories("OST_Sheets")  # graph input
all_elements_of_category_3 = ElementsOfCategory(Category=categories_3)
sheetName = Sheet.SheetName(sheet=all_elements_of_category_3)

# group: Change Text Case
toUpper_3 = String.ToUpper(string=sheetName)
toLower_3 = String.ToLower()  # unwired: string

# group: Update Sheet Name Parameter
string_2 = StringInput("Sheet Name")  # graph input
setParameterByName = Element.SetParameterByName(element=all_elements_of_category_3, parameterName=string_2, value=toUpper_3)
