# Dynamo graph ArchSmarter_12 Change Family Type By Name.dyn (Dynamo 2.13.1.3887)
# author: ArchSmarter
# Change family type by matching a specific keyword in the type name

# group: Get Elements and Element Type Name
categories = Categories("OST_Doors")  # graph input
all_elements_of_category = ElementsOfCategory(Category=categories)
name = Element.Name(element=all_elements_of_category)

# group: Filter for Elements Having Type Name
# Filter instances by type name containing the text specified in the Code Block
code_block = CodeBlock { "800"; }
contains = String.Contains(string=name, searchFor=code_block)
filterByBoolMask = List.FilterByBoolMask(list=all_elements_of_category, mask=contains)

# group: Get Family Types from Instance
getFamily = FamilyInstance.GetFamily(familyInstance=filterByBoolMask.in)
types = Family.Types(family=getFamily)
name_2 = Element.Name(element=types)

# group: Replace Type Name With New Height
name_3 = Element.Name(element=filterByBoolMask.in)
code_block_2 = CodeBlock { "700"; }
replace = String.Replace(string=name_3, searchFor=code_block, replaceWith=code_block_2)

# group: Set New Family Type
code_block_3 = CodeBlock { "Type"; }
eq = name_2 == replace
filterByBoolMask_2 = List.FilterByBoolMask(list=types@L2, mask=eq@L2)
setParameterByName = Element.SetParameterByName(element=filterByBoolMask.in, parameterName=code_block_3, value=filterByBoolMask_2.in)
