# Dynamo graph ProjectSetup-AutoGenerate_3D_Views.dyn (Dynamo 2.5.0.7460)
# packages: Clockwork for Dynamo 2.x 2.3.0, Rhythm 2020.2.13

# group: AUTO-GENERATE 3D VIEWS
# note: This script auto generates a number of 3D views a team wants and sets the View Name and the Section Box using X,Y,Z coordinates using an imported Excel file.
# NOTES:
# 1.  Additional  Packages: Clockwork, Rhythm
# 2. User to update supplemental spreasheet first before running script
# 3.  User to update View Names, X-min, Y-min, Z-min, X-max, Y-max, and Z-max

# group: USER INPUT/USER CONTROL - SET EXCEL FILE FOR IMPORT AND DEFAULT 3D VIEW TO DUPLICATE IN REVIT
# note: Per Project:
# 1. Setup supplemental Excel file (ProjectName-ViewsCreation-User_Input.xlsx) first
# 2. Initial  3D view to duplicate in script must be created in Revit prior to running script

# group: USER INPUT - POINT TO SHEET TO GET MAXIMUM COORDINATES FOR SECTION BOX PARAMETER
# note: GETS USER SPECIFIED MINIMUM COORDINATES FOR SECTION BOX BOUNDARY (LOWER LEFT & BOTTOM PLANE) FROM EXCEL FILE
# NOTE:
# DIMENSIONS FROM PROJECT ORIGIN

# group: USER INPUT - POINT TO SHEET TO GET MINIMUM COORDINATES FOR SECTION BOX PARAMETER
# note: GETS USER SPECIFIED MINIMUM COORDINATES FOR SECTION BOX BOUNDARY (LOWER LEFT & BOTTOM PLANE) FROM EXCEL FILE
# NOTE:
# DIMENSIONS FROM PROJECT ORIGIN

# group: USER CONTROL - REVIT
# note: SELECT SOURCE 3D VIEW TO COPY IN REVIT
views = Views()  # nothing selected; graph input

# group: USER CONTROL - EXCEL FILE IMPORT
# note: SELECT TARGET FILE FOR IMPORT
file_path = Filename(".\Setup-3DViews-MLVL_SecBox-USER INPUT.xlsx")  # graph input

# group: USER CONTROL - EXCEL FILE IMPORT
# note: USER INPUT- SELECT FILE LOCATION FOR VIEW NAMES
fromPath = FileObject(path=file_path)  # "File.FromPath"
string = StringInput("View_Name")  # graph input
importExcel = Data.ImportExcel(file=fromPath, sheetName=string)

# group: BACKEND PROCESS - CREATE NEW VIEWS
# note: 3D VIEW CREATION AND NAMING BY READ IN FROM EXCEL FILE
# note: NUMBER OF VIEWS TO CREATE
count = List.Count(list=importExcel)
# note: GENERATES NUMBER OF TIMES TO ITERATE OVER LIST
cycle = List.Cycle(list=views, amount=count)
flatten = List.Flatten(list=importExcel)
# note: Clockwork Package
# note: DUPLICATES A VIEW AND UPDATES NAME
duplicate = Custom[View.Duplicate](view=cycle, name=flatten)  # package Clockwork for Dynamo 2.x; Duplicates a given view

# group: USER INPUT - POINT TO SHEET TO GET MINIMUM X-COORDINATE (EASTING) FOR SECTION BOX PARAMETER
fromPath_2 = FileObject(path=file_path)  # "File.FromPath"
string_2 = StringInput("X-Min")  # graph input
importExcel_2 = Data.ImportExcel(file=fromPath_2, sheetName=string_2)

flatten_2 = List.Flatten(list=importExcel_2)

# group: USER INPUT - POINT TO SHEET TO GET MINIMUM Y-COORDINATE (NORTHING) FOR SECTION BOX PARAMETER
fromPath_3 = FileObject(path=file_path)  # "File.FromPath"
string_3 = StringInput("Y-Min")  # graph input
importExcel_3 = Data.ImportExcel(file=fromPath_3, sheetName=string_3)

flatten_3 = List.Flatten(list=importExcel_3)

# group: USER INPUT - POINT TO SHEET TO GET MINIMUM Z-COORDINATE (ELEVATION) FOR SECTION BOX PARAMETER
fromPath_4 = FileObject(path=file_path)  # "File.FromPath"
string_4 = StringInput("Z-Min")  # graph input
importExcel_4 = Data.ImportExcel(file=fromPath_4, sheetName=string_4)

# group: USER INPUT - POINT TO SHEET TO GET MAXIMUM X-COORDINATE (EASTING) FOR SECTION BOX PARAMETER
fromPath_5 = FileObject(path=file_path)  # "File.FromPath"
string_5 = StringInput("X-Max")  # graph input
importExcel_5 = Data.ImportExcel(file=fromPath_5, sheetName=string_5)

flatten_4 = List.Flatten(list=importExcel_5)

# group: USER INPUT - POINT TO SHEET TO GET MAXIMUM Y-COORDINATE (NORTHING) FOR SECTION BOX PARAMETER
fromPath_6 = FileObject(path=file_path)  # "File.FromPath"
string_6 = StringInput("Y-Max")  # graph input
importExcel_6 = Data.ImportExcel(file=fromPath_6, sheetName=string_6)

flatten_5 = List.Flatten(list=importExcel_6)

# group: USER INPUT - POINT TO SHEET TO GET MAXIMUM Z-COORDINATE (ELEVATION) FOR SECTION BOX PARAMETER
fromPath_7 = FileObject(path=file_path)  # "File.FromPath"
string_7 = StringInput("Z-Max")  # graph input
importExcel_7 = Data.ImportExcel(file=fromPath_7, sheetName=string_7)

# group: BACKEND PROCESS - SET SECTION BOX DIMENSIONS FOR VIEW
flatten_6 = List.Flatten(list=importExcel_4)
# note: SETTING SECTION BOX DIMENSIONS PER 3D VIEW CREATED
# INPUT: MIN & MAX COORDINATES FROM EXCEL FILE
#                                        |
#                                        |
#                                       \/
# OUTPUT: BOUNDING BOX TO CREATE SECTION BOX IN 3D VIEW
# note: GET COORDINATES FOR MINIMUM POINT FROM EXCEL FILE
byCoordinates = Point.ByCoordinates(x=flatten_2, y=flatten_3, z=flatten_6)
flatten_7 = List.Flatten(list=importExcel_7)
# note: GET COORDINATES FOR MAXIMUM POINT FROM EXCEL FILE
byCoordinates_2 = Point.ByCoordinates(x=flatten_4, y=flatten_5, z=flatten_7)
# note: CREATES BOUNDING BOX USING COORDINATES OF LOWER LEFT (MIN) AND UPPER RIGHT (MAX)
byCorners = BoundingBox.ByCorners(min=byCoordinates, max=byCoordinates_2)

# group: Output to UI
# note: APPLY SECTION BOX TO 3D VIEWS BY LEVEL
# note: Rhythm Package
ʳʰʸᵗʰᵐ_view3d_setsectionbox = Rhythm.Revit.Views.View3D.SetSectionBox(view3D=duplicate, bBox=byCorners)

# group: Monitor Output Status
# note: SEE RESULT PARAMETERS OF ADDED VIEWS TO PROJET
watch = Watch(ʳʰʸᵗʰᵐ_view3d_setsectionbox.success)
