# Dynamo graph Place Detail Items.dyn (Dynamo 2.12.1.8246)

select_model_elements = DSModelElementsSelection()  # 1 picked in the model
python_script = Python(IN[0]=select_model_elements)  # IronPython2
# ---------- python_script.python (38 lines) ----------
import clr
clr.AddReference('ProtoGeometry')
from Autodesk.DesignScript.Geometry import *

# Import DocumentManager and TransactionManager
clr.AddReference("RevitServices")
import RevitServices
from RevitServices.Persistence import DocumentManager
from RevitServices.Transactions import TransactionManager

# Import RevitAPI
clr.AddReference("RevitAPI")
import Autodesk
from Autodesk.Revit.DB import *

clr.AddReference("RevitNodes")
import Revit
# Import ToProtoType, ToRevitType geometry conversion extension methods
clr.ImportExtensions(Revit.GeometryConversion)


shafts = UnwrapElement(IN[0])

opt = Options()
opt.ComputeReferences = True
opt.IncludeNonVisibleObjects = True
#opt.View = doc.ActiveView
opt.DetailLevel = ViewDetailLevel.Medium

geo = shafts.get_Geometry(opt)


results = []

for item in geo:
	results.append(item)

OUT = results[0].ToProtoType()
# ----------------------------------------
separate = Solid.Separate(solid=python_script)
centroid = Solid.Centroid(solid=separate)
python_script_2 = Python(IN[0]=select_model_elements)  # IronPython2
# ---------- python_script_2.python (38 lines) ----------
import clr
clr.AddReference('ProtoGeometry')
from Autodesk.DesignScript.Geometry import *

# Import DocumentManager and TransactionManager
clr.AddReference("RevitServices")
import RevitServices
from RevitServices.Persistence import DocumentManager
from RevitServices.Transactions import TransactionManager

# Import RevitAPI
clr.AddReference("RevitAPI")
import Autodesk
from Autodesk.Revit.DB import *

clr.AddReference("RevitNodes")
import Revit
# Import ToProtoType, ToRevitType geometry conversion extension methods
clr.ImportExtensions(Revit.GeometryConversion)


shafts = UnwrapElement(IN[0])

opt = Options()
opt.ComputeReferences = True
opt.IncludeNonVisibleObjects = True
#opt.View = doc.ActiveView
opt.DetailLevel = ViewDetailLevel.Medium


solid = shafts.get_Geometry(opt)

faces = []

for f in solid:
	faces.append(f.Faces)

OUT = faces
# ----------------------------------------
family_types = FamilyTypes("OpeningDL:OpeningDL")
explode = Geometry.Explode(geometry=separate)
code_block = CodeBlock { 0.5; }
pointAtParameter = Surface.PointAtParameter(surface=explode, u=code_block, v=code_block)
normalAtPoint = Surface.NormalAtPoint(surface=explode, point=pointAtParameter)
ZAxis = Vector.ZAxis()
isAlmostEqualTo = Vector.IsAlmostEqualTo(vector=normalAtPoint, otherVector=ZAxis)
filterByBoolMask = List.FilterByBoolMask(list=explode, mask=isAlmostEqualTo@L2, lacing=Longest)
code_block_2 = CodeBlock { 0.5; }
pointAtParameter_2 = Surface.PointAtParameter(surface=filterByBoolMask.in, u=code_block_2, v=code_block_2)
levels = Levels("Level 1")
byPointAndLevel = FamilyInstance.ByPointAndLevel(familyType=family_types, point=pointAtParameter_2, level=levels)
flatten = List.Flatten(list=byPointAndLevel)
code_block_3 = CodeBlock { ["w","h","Comments"]; }
perimeterCurves = Surface.PerimeterCurves(surface=filterByBoolMask.in)
length = Curve.Length(curve=perimeterCurves)
code_block_4 = CodeBlock { 2; }
takeItems = List.TakeItems(list=length@L2, amount=code_block_4)
python_script_3 = Python(IN[0]=takeItems)  # IronPython2
# ---------- python_script_3.python (10 lines) ----------
input = IN[0]

results = []

for i in input:
	temp = "{} x {}".format(int(i[0]), int(i[1]))
	results.append(temp)

# Assign your output to the OUT variable.
OUT = results
# ----------------------------------------
addItemToEnd = List.AddItemToEnd(item=python_script_3, list=takeItems, lacing=Longest)
setParameterByName = Element.SetParameterByName(element=flatten, parameterName=code_block_3@L2, value=addItemToEnd, lacing=Longest)
