# Dynamo graph Make Scope Box Views for Element-test.dyn (Dynamo 2.6.1.8786)
# packages: QuasarII 2021.25.101, Quasar 2.1.3, bimorphNodes 3.0.3, Genius Loci 2021.6.16, ViewSectionBoxFromBoundingBox 0.0.1, Clockwork for Dynamo 2.x 2.3.0

# group: Script 1
select_model_elements = DSModelElementsSelection()  # 4 picked in the model

# group: Get Boxes
boundingBox = Element.BoundingBox(element=select_model_elements)
minPoint = BoundingBox.MinPoint(boundingBox=boundingBox)
code_block = CodeBlock { 0; }
code_block_2 = CodeBlock(a=code_block) { -a; }
byCoordinates = Vector.ByCoordinates(x=code_block_2, y=code_block_2, z=code_block_2)
add = Point.Add(point=minPoint, vectorToAdd=byCoordinates)
maxPoint = BoundingBox.MaxPoint(boundingBox=boundingBox)
byCoordinates_2 = Vector.ByCoordinates(x=code_block, y=code_block, z=code_block)
add_2 = Point.Add(point=maxPoint, vectorToAdd=byCoordinates_2)

# group: Output View
python_script = Python(IN[0]=add, IN[1]=add_2)  # frozen
# ---------- python_script.python (59 lines) ----------
#python nodes in dynamo 1.0
#proposed by Julien Benoit @jbenoit44 
#http://aecuandme.wordpress.com/
import clr
clr.AddReference('ProtoGeometry')
from Autodesk.DesignScript.Geometry import *
# Import ToDSType(bool) extension method
clr.AddReference("RevitNodes")
import Revit
clr.ImportExtensions(Revit.Elements)
# Import geometry conversion extension methods
clr.ImportExtensions(Revit.GeometryConversion)
# Import DocumentManager and TransactionManager
clr.AddReference("RevitServices")
import RevitServices
from RevitServices.Persistence import DocumentManager
from RevitServices.Transactions import TransactionManager
from System.Collections.Generic import *
# Import RevitAPI
clr.AddReference("RevitAPI")
import Autodesk
from Autodesk.Revit.DB import *

doc = DocumentManager.Instance.CurrentDBDocument
uiapp = DocumentManager.Instance.CurrentUIApplication
app = uiapp.Application
uidoc=DocumentManager.Instance.CurrentUIApplication.ActiveUIDocument

Min=[]
Max=[]
viewlist=[]
bbox=[]
for i in IN[0]:
	Min.append(UnwrapElement(i.ToXyz(True)))
for i in IN[1]:
	Max.append(UnwrapElement(i.ToXyz(True)))



# Start Transaction
TransactionManager.Instance.EnsureInTransaction(doc)
activeview=doc.ActiveView
typeid=View.GetTypeId(activeview)

count = 0
while (count < len(Min)):
	b=View3D.CreateIsometric(doc, typeid)
	viewlist.append(b)
	box = app.Create.NewBoundingBoxXYZ()
	box.Min = Min[count]
	box.Max = Max[count]
	bbox.append(box)
	a=View3D.SetSectionBox(b,box)
	count = count + 1
	

# End Transaction
TransactionManager.Instance.TransactionTaskDone()
OUT=viewlist
# ----------------------------------------

# group: Add Name String
string = StringInput("Comments")  # graph input
getParameterValueByName = Element.GetParameterValueByName(element=select_model_elements, parameterName=string)
string_2 = StringInput("-")  # graph input
string_3 = StringInput("Clash check")  # graph input
join = String.Join(separator=string_2, string0=string_3)  # unwired: string1
map = List.Map(list=getParameterValueByName, f_x=join)

# group: Rename View
string_4 = StringInput("View Name")  # graph input
create = List.Create(item0=string_4)
watch = Watch(python_script)
count = List.Count(list=watch)
cycle = List.Cycle(list=create, amount=count)
setParameterByName = Element.SetParameterByName(element=python_script, parameterName=cycle, value=map)
watch_2 = Watch(setParameterByName)

# group: Input-select multi elements (selected elements should added comments first)
select_model_elements_2 = DSModelElementsSelection()  # 3 picked in the model; frozen

geometry = Element.Geometry(element=select_model_elements_2)
flatten = List.Flatten(list=geometry)
byGeometry = BoundingBox.ByGeometry(geom=flatten)

# group: Get Boxes
boundingBox_2 = Element.BoundingBox(element=geometry)
minPoint_2 = BoundingBox.MinPoint(boundingBox=byGeometry)
code_block_3 = CodeBlock { 0; }
code_block_4 = CodeBlock(a=code_block_3) { -a; }
byCoordinates_3 = Vector.ByCoordinates(x=code_block_4, y=code_block_4, z=code_block_4)
add_3 = Point.Add(point=minPoint_2, vectorToAdd=byCoordinates_3)
maxPoint_2 = BoundingBox.MaxPoint(boundingBox=byGeometry)
byCoordinates_4 = Vector.ByCoordinates(x=code_block_3, y=code_block_3, z=code_block_3)
add_4 = Point.Add(point=maxPoint_2, vectorToAdd=byCoordinates_4)

# group: Output View
python_script_2 = Python(IN[0]=add_3, IN[1]=add_4)  # unwired: IN[2], IN[3]; same code as python_script

# group: Add Name String
string_5 = StringInput("Comments")  # graph input
getParameterValueByName_2 = Element.GetParameterValueByName(element=select_model_elements_2, parameterName=string_5)
string_6 = StringInput("-")  # graph input
string_7 = StringInput("Clash check")  # graph input
join_2 = String.Join(separator=string_6, string0=string_7)  # unwired: string1
map_2 = List.Map(list=getParameterValueByName_2, f_x=join_2)

# group: Rename View
string_8 = StringInput("View Name")  # graph input
create_2 = List.Create(item0=string_8)
watch_3 = Watch(python_script_2)
count_2 = List.Count(list=watch_3)
cycle_2 = List.Cycle(list=create_2, amount=count_2)
setParameterByName_2 = Element.SetParameterByName(element=python_script_2, parameterName=cycle_2, value=map_2)
watch_4 = Watch(setParameterByName_2)

categories = Categories("OST_Rooms")
all_elements_of_category = ElementsOfCategory(Category=categories)
name = Room.Name(room=all_elements_of_category)
name_2 = Room.Name(room=all_elements_of_category)
code_block_5 = CodeBlock(number=name, name=name_2) { number+"_"+name; }
threed_viewfamilytypes = ThreeDVFTypeUIDropDown("3D View")
code_block_6 = CodeBlock { 50; 500; }
createThreeDViewsByRooms = QuasarII.ViewUtility.CreateThreeDViewsByRooms(Rooms=all_elements_of_category, Names=code_block_5, viewFamilyType=threed_viewfamilytypes, Scale=code_block_6.out0, Offset=code_block_6.out1)  # frozen
categories_2 = Categories("OST_Rooms")
all_elements_of_category_2 = ElementsOfCategory(Category=categories_2)
name_3 = Room.Name(room=all_elements_of_category_2)
code_block_7 = CodeBlock { 50; 500; }
threeDViewByRoom = Quasar.ViewUtility.ThreeDViewByRoom(Rooms=all_elements_of_category_2, Names=name_3, Offset=code_block_7.out1)  # frozen
python_script_3 = Python(IN[0]=all_elements_of_category_2, IN[1]=name_3, IN[2]=code_block_7.out1)  # frozen
# ---------- python_script_3.python (86 lines) ----------
import clr
clr.AddReference("RevitAPI")
clr.AddReference("RevitServices")
 
from Autodesk.Revit.DB import *
from RevitServices.Persistence import DocumentManager
from RevitServices.Transactions import TransactionManager
# instantiate current document
doc = DocumentManager.Instance.CurrentDBDocument
 
rooms = IN[0]
names = IN[1]
offset = IN[2]/304.8  # mm to ft
results = []
 
# check list for rooms
if isinstance(IN[0], list):
    rooms = UnwrapElement(IN[0])
else:
    rooms = [UnwrapElement(IN[0])]
# check list for name
if isinstance(IN[1],list):
    names = IN[1]
else:
    names = [IN[1]]
 
 
def crop_box(bbox, offset):
    # modify x,y,z point of bbox
    minX = bbox.Min.X - offset
    minY = bbox.Min.Y - offset
    minZ = bbox.Min.Z - offset
    maxX = bbox.Max.X + offset
    maxY = bbox.Max.Y + offset
    maxZ = bbox.Max.Z + offset
    # create new bbox
    newbox = BoundingBoxXYZ()
    newbox.Min = XYZ(minX,minY, minZ)
    newbox.Max = XYZ(maxX, maxY, maxZ)
    return newbox
     
def createNewSectionBox(elem,viewName,offset):
    # collect view type in document
    viewTypes = FilteredElementCollector(doc).OfClass(ViewFamilyType)
    #loop view types
    for i in viewTypes:
        # floor plane view type
        if i.ViewFamily == ViewFamily.ThreeDimensional:
            # get type id
            viewTypeId = i.Id
            # break the loop
            break
    # create new bbox by current bbox and offset
    bbox = crop_box(elem.BoundingBox[doc.ActiveView],offset)
     
    # create 3D View
    view = View3D.CreateIsometric(doc, viewType.Id)
    # set view name
    view.Name = viewName
    # set sectionbox to bbox
    view.SetSectionBox(bbox)
    # set cropbox active
    view.CropBoxActive = True
    # set cropbox visibility
    view.CropBoxVisible = True
    # set view scale
    view.Scale = 50
    # set detail level to fine
    view.DetailLevel = ViewDetailLevel.Fine
    # set detail style to shading
    view.DisplayStyle = DisplayStyle.Shading
    # return view
    return view
 
# start Transaction
TransactionManager.Instance.EnsureInTransaction(doc)
# loop element and name together
for element,name in zip(rooms,names):
    # call function with element, name and offset arguments
    # and append it to results
    results.append(createNewSectionBox(element,name,offset))
     
# end Transaction
TransactionManager.Instance.TransactionTaskDone()
# output results
OUT = results
# ----------------------------------------
python_script_4 = Python(IN[0]=all_elements_of_category_2, IN[1]=name_3, IN[2]=code_block_7.out1)  # frozen; unwired: IN[3]
# ---------- python_script_4.python (94 lines) ----------
#Copyright(c) 2015, Konrad K Sobon
# @arch_laboratory, http://archi-lab.net

import clr
clr.AddReference('ProtoGeometry')
from Autodesk.DesignScript.Geometry import *

# Import DocumentManager and TransactionManager
clr.AddReference("RevitServices")
import RevitServices
from RevitServices.Persistence import DocumentManager
from RevitServices.Transactions import TransactionManager

doc = DocumentManager.Instance.CurrentDBDocument
uiapp = DocumentManager.Instance.CurrentUIApplication
app = uiapp.Application

# Import ToDSType(bool) extension method
clr.AddReference("RevitNodes")
import Revit
clr.ImportExtensions(Revit.Elements)

# Import RevitAPI
clr.AddReference("RevitAPI")
import Autodesk
from Autodesk.Revit.DB import *

#The inputs to this node will be stored as a list in the IN variable.
dataEnteringNode = IN

rooms = UnwrapElement(IN[0])
namePrefix = IN[1]
bboxOffset = IN[2]
runMe = IN[3]

def OffsetBBox(bbox, offset):
	bboxMinX = bbox.Min.X - offset
	bboxMinY = bbox.Min.Y - offset
	bboxMinZ = bbox.Min.Z - offset
	bboxMaxX = bbox.Max.X + offset
	bboxMaxY = bbox.Max.Y + offset
	bboxMaxZ = bbox.Max.Z + offset
	newBbox = BoundingBoxXYZ()
	newBbox.Min = XYZ(bboxMinX, bboxMinY, bboxMinZ)
	newBbox.Max = XYZ(bboxMaxX, bboxMaxY, bboxMaxZ)
	return newBbox

if runMe:
	viewTypes = FilteredElementCollector(doc).OfClass(ViewFamilyType)
	for i in viewTypes:
		if i.ViewFamily == ViewFamily.FloorPlan:
			viewTypeId = i.Id
			break
		else:
			continue
	existingPlans = FilteredElementCollector(doc).OfClass(View).ToElements()
	existingPlanNames, existingPlanElements = [], []
	for i in existingPlans:
		if not i.IsTemplate:
			if i.ViewType == ViewType.FloorPlan:
				existingPlanNames.append(i.ToDSType(True).Name)
				existingPlanElements.append(i)
				
	# Start Transaction
	doc = DocumentManager.Instance.CurrentDBDocument
	TransactionManager.Instance.EnsureInTransaction(doc)
	
	floorPlans = []
	for i in rooms:
		levelId = i.LevelId
		bbox = i.BoundingBox[doc.ActiveView]
		newBbox = OffsetBBox(bbox, bboxOffset)
		viewName = namePrefix + "-" + i.get_Parameter("Number").AsString() + "-" + i.get_Parameter("Name").AsString()
		if viewName in existingPlanNames:
			view = existingPlanElements[existingPlanNames.index(viewName)]
			view.CropBox = newBbox
			view.CropBoxActive = True
			view.CropBoxVisible = False
			floorPlans.append(view)
		else:
			view = ViewPlan.Create(doc, viewTypeId, levelId)
			view.Name = viewName
			view.CropBox = newBbox
			view.CropBoxActive = True
			view.CropBoxVisible = False
			floorPlans.append(view)

	# End Transaction
	TransactionManager.Instance.TransactionTaskDone()
else:
	floorPlans = "Run Me set to False"

#Assign your output to the OUT variable
OUT = floorPlans
# ----------------------------------------

# group: Script 1
select_model_elements_3 = DSModelElementsSelection()  # 3 picked in the model; frozen

# group: Get Boxes
boundingBox_3 = Element.BoundingBox(element=select_model_elements_3)
minPoint_3 = BoundingBox.MinPoint(boundingBox=boundingBox_3)
code_block_8 = CodeBlock { 0; }
code_block_9 = CodeBlock(a=code_block_8) { -a; }
byCoordinates_5 = Vector.ByCoordinates(x=code_block_9, y=code_block_9, z=code_block_9)
add_5 = Point.Add(point=minPoint_3, vectorToAdd=byCoordinates_5)
maxPoint_3 = BoundingBox.MaxPoint(boundingBox=boundingBox_3)
byCoordinates_6 = Vector.ByCoordinates(x=code_block_8, y=code_block_8, z=code_block_8)
add_6 = Point.Add(point=maxPoint_3, vectorToAdd=byCoordinates_6)

# group: Output View
python_script_5 = Python(IN[0]=add_5, IN[1]=add_6)  # frozen; unwired: IN[2]; same code as python_script

# group: Add Name String
string_9 = StringInput("Comments")  # graph input
getParameterValueByName_3 = Element.GetParameterValueByName(element=select_model_elements_3, parameterName=string_9)
string_10 = StringInput("-")  # graph input
string_11 = StringInput("Clash check")  # graph input
join_3 = String.Join(separator=string_10, string0=string_11)  # unwired: string1
map_3 = List.Map(list=getParameterValueByName_3, f_x=join_3)

# group: Rename View
string_12 = StringInput("View Name")  # graph input
create_3 = List.Create(item0=string_12)
watch_5 = Watch(python_script_5)
count_3 = List.Count(list=watch_5)
cycle_3 = List.Cycle(list=create_3, amount=count_3)
setParameterByName_3 = Element.SetParameterByName(element=python_script_5, parameterName=cycle_3, value=map_3)
watch_6 = Watch(setParameterByName_3)

code_block_10 = CodeBlock { 50; }
byCoordinates_7 = Point.ByCoordinates(x=code_block_10, y=code_block_10, z=code_block_10)
byCorners = BoundingBox.ByCorners(max=byCoordinates_7)
select_model_elements_4 = DSModelElementsSelection()  # 2 picked in the model
getElementsInside = Revit.BoundingBox.GetElementsInside(boundingBox=select_model_elements_4, elements=select_model_elements_4)
n3dview_create = Custom[3DView Create]()  # frozen; package Genius Loci; Creates a new isometric View3D in the given document.

# group: Get Boxes
boundingBox_4 = Element.BoundingBox(element=select_model_elements_4)  # frozen
minPoint_4 = BoundingBox.MinPoint(boundingBox=boundingBox_4)
code_block_11 = CodeBlock { 0; }
code_block_12 = CodeBlock(a=code_block_11) { -a; }
byCoordinates_8 = Vector.ByCoordinates(x=code_block_12, y=code_block_12, z=code_block_12)
add_7 = Point.Add(point=minPoint_4, vectorToAdd=byCoordinates_8)
maxPoint_4 = BoundingBox.MaxPoint(boundingBox=boundingBox_4)
byCoordinates_9 = Vector.ByCoordinates(x=code_block_11, y=code_block_11, z=code_block_11)
add_8 = Point.Add(point=maxPoint_4, vectorToAdd=byCoordinates_9)

byCorners_2 = BoundingBox.ByCorners(min=add_7, max=add_8)

# group: Bounding box 1
select_model_elements_5 = DSModelElementsSelection()  # 4 picked in the model
boundingBox_5 = Element.BoundingBox(element=select_model_elements_5)
code_block_13 = CodeBlock { 0.5; }
code_block_14 = CodeBlock { -1; }
mul = code_block_13 * code_block_14
code_block_15 = CodeBlock(bbox=boundingBox_5, b=mul)
# ---------- code_block_15.designscript (7 lines) ----------
a=bbox.MinPoint;
xmin=List.MinimumItem(a.X);
ymin=List.MinimumItem(a.Y);
zmin=List.MinimumItem(a.Z);
offset=b;

Point.ByCoordinates(xmin+b,ymin+b,zmin+b);
# ----------------------------------------
code_block_16 = CodeBlock(bbox=boundingBox_5, b=code_block_13)
# ---------- code_block_16.designscript (7 lines) ----------
a=bbox.MaxPoint;
xmax=List.MaximumItem(a.X);
ymax=List.MaximumItem(a.Y);
zmax=List.MaximumItem(a.Z);
offset=b;

Point.ByCoordinates(xmax+b,ymax+b,zmax+b);
# ----------------------------------------
byCorners_3 = Cuboid.ByCorners(lowPoint=code_block_15.out5, highPoint=code_block_16.out5)
byGeometry_2 = BoundingBox.ByGeometry(geom=byCorners_3)

original_python_script = Python(IN[0]=byGeometry_2)  # frozen
# ---------- original_python_script.python (38 lines) ----------
import clr
clr.AddReference('RevitAPI')
from Autodesk.Revit.DB import *

clr.AddReference('RevitNodes')
import Revit
clr.ImportExtensions(Revit.GeometryConversion)
clr.ImportExtensions(Revit.Elements)

clr.AddReference('RevitServices')
import RevitServices
from RevitServices.Persistence import DocumentManager
from RevitServices.Transactions import TransactionManager

#The input to this node will be stored as a list in the IN variable.
detaEnteringNode = IN

bbox=IN[0]


doc=DocumentManager.Instance.CurrentDBDocument
myview=doc.ActiveView
try:
    TransactionManager.Instance.EnsureInTransaction(doc)
    
    newmax=UnwrapElement(bbox.MaxPoint).ToRevitType()
    newmin=UnwrapElement(bbox.MinPoint).ToRevitType()
    newbox=BoundingBoxXYZ()
    newbox.Max=newmax
    newbox.Min=newmin
    
    z=myview.SetSectionBox(newbox)
    
    TransactionManager.Instance.TransactionTaskDone()
    
    OUT= "succes"
except:
    OUT = "Faild..."
# ----------------------------------------
viewSectionBoxFromBoundingBox = Custom[ViewSectionBoxFromBoundingBox]()  # package ViewSectionBoxFromBoundingBox; Set SectionBox of 3D View From BoundingBox; unwired: View, BoundingBox
string_13 = StringInput("Clash check YS")  # graph input
python_script_v2_0 = Python(IN[0]=byGeometry_2, IN[1]=string_13)  # frozen
# ---------- python_script_v2_0.python (48 lines) ----------
import clr
clr.AddReference("RevitAPI")
import Autodesk
from Autodesk.Revit.DB import *

clr.AddReference("RevitNodes")
import Revit
clr.ImportExtensions(Revit.GeometryConversion)
clr.ImportExtensions(Revit.Elements)

clr.AddReference("RevitServices")
import RevitServices
from RevitServices.Persistence import DocumentManager
from RevitServices.Transactions import TransactionManager

doc = DocumentManager.Instance.CurrentDBDocument

def tolist(obj1):
    if hasattr(obj1,"__iter__"): return obj1
    else: return [obj1]

bboxs = tolist(IN[0])
viewNames = tolist(IN[1])
views=[]
#get ViewFamilyType for a 3D View
collector = FilteredElementCollector(doc)
viewTypeColl = collector.OfClass(ViewFamilyType)
for i in viewTypeColl:
	if i.ViewFamily == ViewFamily.ThreeDimensional:
		viewType = i
	else:
		continue

for bbox,viewName in zip(bboxs,viewNames):
	newmax = UnwrapElement(bbox.MaxPoint).ToRevitType()
	newmin = UnwrapElement(bbox.MinPoint).ToRevitType()
	newbox = BoundingBoxXYZ()
	newbox.Max = newmax
	newbox.Min = newmin
	
	TransactionManager.Instance.EnsureInTransaction(doc)
	view = View3D.CreateIsometric(doc, viewType.Id)
	view.Name = viewName
	view.SetSectionBox(newbox)
	views.append(view)
	TransactionManager.Instance.TransactionTaskDone()

OUT = views
# ----------------------------------------
insert = String.Insert()  # unwired: str, index, toInsert
element_types = ElementTypes("View3D")
all_elements_of_type = ElementsOfType(element_type=element_types)
name_4 = Element.Name(element=all_elements_of_type)
name_5 = Element.Name()  # unwired: element
eq = name_4 == name_5
anyTrue = Custom[Booleans.AnyTrue](seq=eq)  # package Clockwork for Dynamo 2.x; Returns true if any item in a list of booleans is true.
code_block_17 = CodeBlock { 2; }
if_ = If(test=anyTrue, true=code_block_17)  # unwired: false
watch_7 = Watch(if_)

# group: Bounding box 2
select_model_elements_6 = DSModelElementsSelection()  # 9 picked in the model
boundingBox_6 = Element.BoundingBox(element=select_model_elements_6)
code_block_18 = CodeBlock { 0.5; }
code_block_19 = CodeBlock { -1; }
mul_2 = code_block_18 * code_block_19
code_block_20 = CodeBlock(bbox=boundingBox_6, b=mul_2)  # same code as code_block_15
code_block_21 = CodeBlock(bbox=boundingBox_6, b=code_block_18)  # same code as code_block_16
byCorners_4 = Cuboid.ByCorners(lowPoint=code_block_20.out5, highPoint=code_block_21.out5)
byGeometry_3 = BoundingBox.ByGeometry(geom=byCorners_4)

list_create = List.Create(item0=byGeometry_2, item1=byGeometry_3)
python_script_v2_2_test_multi = Python(IN[0]=list_create, IN[1]=string_13)  # "Python Script V2.2 test multi-input"; frozen
# ---------- python_script_v2_2_test_multi.python (52 lines) ----------
import clr
clr.AddReference("RevitAPI")
import Autodesk
from Autodesk.Revit.DB import *

clr.AddReference("RevitNodes")
import Revit
clr.ImportExtensions(Revit.GeometryConversion)
clr.ImportExtensions(Revit.Elements)

clr.AddReference("RevitServices")
import RevitServices
from RevitServices.Persistence import DocumentManager
from RevitServices.Transactions import TransactionManager

doc = DocumentManager.Instance.CurrentDBDocument

def tolist(obj1):
    if hasattr(obj1,"__iter__"): return obj1
    else: return [obj1]

bboxs = tolist(IN[0])
viewNames = tolist(IN[1])
views=[]

#get ViewFamilyType for a 3D View
collector = FilteredElementCollector(doc)
viewTypeColl = collector.OfClass(ViewFamilyType)
for i in viewTypeColl:
	if i.ViewFamily == ViewFamily.ThreeDimensional:
		viewType = i
	else:
		continue
		
count = 0
while (count < len(bboxs)): 
 for bbox,viewName in zip(bboxs,viewNames):
	newmax = UnwrapElement(bbox.MaxPoint).ToRevitType()
	newmin = UnwrapElement(bbox.MinPoint).ToRevitType()
	newbox = BoundingBoxXYZ()
	newbox.Max = newmax
	newbox.Min = newmin
	
	TransactionManager.Instance.EnsureInTransaction(doc)
	view = View3D.CreateIsometric(doc, viewType.Id)
	view.Name = viewName + " - " + str(count)
	view.SetSectionBox(newbox)
	views.append(view)
	TransactionManager.Instance.TransactionTaskDone()
	count =count + 1

OUT = views
# ----------------------------------------
loopWhile = LoopWhile(init=anyTrue)  # unwired: continueWhile, loopBody
python_script_v2_1_test_if = Python(IN[0]=byGeometry_2, IN[1]=string_13, IN[2]=name_4)  # frozen
# ---------- python_script_v2_1_test_if.python (54 lines) ----------
import clr
clr.AddReference("RevitAPI")
import Autodesk
from Autodesk.Revit.DB import *

clr.AddReference("RevitNodes")
import Revit
clr.ImportExtensions(Revit.GeometryConversion)
clr.ImportExtensions(Revit.Elements)

clr.AddReference("RevitServices")
import RevitServices
from RevitServices.Persistence import DocumentManager
from RevitServices.Transactions import TransactionManager

doc = DocumentManager.Instance.CurrentDBDocument

def tolist(obj1):
    if hasattr(obj1,"__iter__"): return obj1
    else: return [obj1]

bboxs = tolist(IN[0])
viewNames = tolist(IN[1])
views=[]
ExistViews = tolist(IN[2])
#get ViewFamilyType for a 3D View
collector = FilteredElementCollector(doc)
viewTypeColl = collector.OfClass(ViewFamilyType)
for i in viewTypeColl:
	if i.ViewFamily == ViewFamily.ThreeDimensional:
		viewType = i
	else:
		continue
		
count = 0
for bbox,viewName,ExistViews in zip(bboxs,viewNames,ExistViews):
	newmax = UnwrapElement(bbox.MaxPoint).ToRevitType()
	newmin = UnwrapElement(bbox.MinPoint).ToRevitType()
	newbox = BoundingBoxXYZ()
	newbox.Max = newmax
	newbox.Min = newmin
	
	TransactionManager.Instance.EnsureInTransaction(doc)
	view = View3D.CreateIsometric(doc, viewType.Id)
	view.Name = viewName + " - " + str(count)
	  if view.Name in ExistViews
	    count = count + 1
	    view.Name = viewName + " - " + str(count)
	  else:
	view.SetSectionBox(newbox)
	views.append(view)
	TransactionManager.Instance.TransactionTaskDone()

OUT = views
# ----------------------------------------
python_script_v2_2_test_multi_2 = Python(IN[0]=list_create, IN[1]=string_13)  # "Python Script V2.2 test multi-input"
# ---------- python_script_v2_2_test_multi_2.python (52 lines) ----------
import clr
clr.AddReference("RevitAPI")
import Autodesk
from Autodesk.Revit.DB import *

clr.AddReference("RevitNodes")
import Revit
clr.ImportExtensions(Revit.GeometryConversion)
clr.ImportExtensions(Revit.Elements)

clr.AddReference("RevitServices")
import RevitServices
from RevitServices.Persistence import DocumentManager
from RevitServices.Transactions import TransactionManager

doc = DocumentManager.Instance.CurrentDBDocument

def tolist(obj1):
    if hasattr(obj1,"__iter__"): return obj1
    else: return [obj1]

bboxs = tolist(IN[0])
viewNames = tolist(IN[1])
views=[]

#get ViewFamilyType for a 3D View
collector = FilteredElementCollector(doc)
viewTypeColl = collector.OfClass(ViewFamilyType)
for i in viewTypeColl:
	if i.ViewFamily == ViewFamily.ThreeDimensional:
		viewType = i
	else:
		continue
		
count = 0
while (count < len(bboxs)): 
 for bbox,viewName in zip(bboxs,viewNames):
	newmax = UnwrapElement(bbox.MaxPoint).ToRevitType()
	newmin = UnwrapElement(bbox.MinPoint).ToRevitType()
	newbox = BoundingBoxXYZ()
	newbox.Max = newmax[count]
	newbox.Min = newmin[count]
	
	TransactionManager.Instance.EnsureInTransaction(doc)
	view = View3D.CreateIsometric(doc, viewType.Id)
	view.Name = viewName + " - " + str(count)
	view.SetSectionBox(newbox)
	views.append(view)
	TransactionManager.Instance.TransactionTaskDone()
	count =count + 1

OUT = views
# ----------------------------------------
