# Dynamo graph Super Align.dyn "AlignDistribute" (Dynamo 2.6.2.15705)

prev_align_everything = Python()
# ---------- prev_align_everything.python (689 lines) ----------
import sys
from operator import attrgetter
from itertools import product
import math
import clr
import System
import os
from System import Array
from System.Collections.Generic import *

clr.AddReference('ProtoGeometry')
from Autodesk.DesignScript.Geometry import *

clr.AddReference('RevitAPI')
import Autodesk
from Autodesk.Revit.DB import *

clr.AddReference("RevitAPIUI")
import Autodesk 
from Autodesk.Revit.UI import TaskDialog, IExternalEventHandler, ExternalEvent
from Autodesk.Revit.UI.Selection import ObjectType

clr.AddReference("RevitServices")
import RevitServices
from RevitServices.Persistence import DocumentManager
from RevitServices.Transactions import TransactionManager

clr.AddReference('System.Drawing')
clr.AddReference('System.Windows.Forms')
import System.Drawing
import System.Windows.Forms

from System.Drawing import *
from System.Reflection import Assembly
from System.Windows.Forms import *

class alignEvent(IExternalEventHandler):
	def __init__(self):
		self.alignment = ""
		self.distribute_x = False
		self.distribute_y = False

	def Execute(self, uiapp):
		try:
			alignment = self.alignment
			uidoc = uiapp.ActiveUIDocument
			if uidoc:
				doc = uidoc.Document
				if doc:
					activeView = doc.ActiveView
					picked_obj_ids = List[ElementId]()
					if uidoc.Selection.GetElementIds().Count == 0:
						#Nothing selected, let the user select
						try:
							picked_obj_ids = self.pickobject(uidoc)
						except Exception as e:
							pass
					else:
						picked_obj_ids = uidoc.Selection.GetElementIds()
					if activeView.ViewType == ViewType.Schedule:
						if not objForm.IsDisposed:
							objForm.Hide()
						task2 = Autodesk.Revit.UI.TaskDialog("Align & Distribute")
						task2.MainInstruction = "Align & Distribute cannot be run in a schedule view. Please, change your current view."
						task2.Show()
						if not objForm.IsDisposed:
							objForm.Show()
					elif picked_obj_ids.Count == 0:
						if not objForm.IsDisposed:
							objForm.Hide()
						task2 = Autodesk.Revit.UI.TaskDialog("Align & Distribute")
						task2.MainInstruction = "No elements were selected. Please, select them before or after running."
						task2.Show()
						if not objForm.IsDisposed:
							objForm.Show()
					elif picked_obj_ids.Count == 1:
						if not objForm.IsDisposed:
							objForm.Hide()
						task2 = Autodesk.Revit.UI.TaskDialog("Align & Distribute")
						task2.MainInstruction = "You need to select at least two elements. Please, select them before or after running."
						task2.Show()
						if not objForm.IsDisposed:
							objForm.Show()
					else:
						total_count = picked_obj_ids.Count
						picked_obj = [doc.GetElement(x) for x in picked_obj_ids]
						first_loc = getElementLocation(doc, picked_obj[0], activeView)
						min_upleft = first_loc.Upleft
						max_upright = first_loc.Upright
						max_upright_up = first_loc.Upright
						min_downright_down = first_loc.Downright
						#Extract minimum and maximum coordinates
						list_ele_loc = []
						list_centers = []
						for elemento in picked_obj:	
							ele_loc = getElementLocation(doc, elemento, activeView)
							#X left
							if ele_loc.Upleft.X < min_upleft.X:
								min_upleft = ele_loc.Upleft
							#X right
							if ele_loc.Upright.X > max_upright.X:
								max_upright = ele_loc.Upright
							#Y top
							if ele_loc.Upright.Y > max_upright_up.Y:
								max_upright_up = ele_loc.Upright
							#Y bottom
							if ele_loc.Downright.Y < min_downright_down.Y:
								min_downright_down = ele_loc.Downright
							list_centers.append(ele_loc.Center)
							list_ele_loc.append(ele_loc)
						x_center = (min_upleft+max_upright)/2
						y_center = (max_upright_up+min_downright_down)/2
						#X distribute
						ordered_list_centers = sorted(list_centers, key=lambda item: item.X, reverse=False)
						min_x_center = ordered_list_centers[0]
						max_x_center = ordered_list_centers[-1]
						x_total_distance_centers = min_x_center.DistanceTo(XYZ(max_x_center.X, min_x_center.Y, 0))
						step_distance_x = x_total_distance_centers/float(total_count-1)
						#Y distribute
						ordered_list_centers = sorted(list_centers, key=lambda item: item.Y, reverse=False)
						min_y_center = ordered_list_centers[0]
						max_y_center = ordered_list_centers[-1]
						y_total_distance_centers = min_y_center.DistanceTo(XYZ(min_y_center.X, max_y_center.Y, 0))
						step_distance_y = y_total_distance_centers/float(total_count-1)
						#Create list all Xs and Ys to distribute
						dstri_x_positions=[]
						dstri_y_positions=[]
						for indx in range(total_count):
							dstri_x_positions.append(min_x_center.X + (step_distance_x*float(indx)))
							dstri_y_positions.append(min_y_center.Y + (step_distance_y*float(indx)))
						#Order list centers
						ordered_list_x = zip([item.X for item in list_centers], range(len(list_centers)))
						ordered_list_x = sorted(ordered_list_x)
						#ordered_list_x.sort()
						ordered_list_y = zip([item.Y for item in list_centers], range(len(list_centers)))
						ordered_list_y = sorted(ordered_list_y)
						#ordered_list_y.sort()
						TransactionManager.Instance.ForceCloseTransaction()
						t = Transaction(doc, "Align and Distribute " + alignment)
						t.Start()
						#Align elements
						for elemento in list_ele_loc:	
							#Move elements X axis
							if str(HorizontalTextAlignment.Left) == alignment:
								resulting_po = XYZ(min_upleft.X, elemento.Upleft.Y, 0)
								vx = resulting_po-elemento.Upleft
								move_element(doc, elemento.Element, vx, elemento)
							elif str(HorizontalTextAlignment.Right) == alignment:
								resulting_po = XYZ(max_upright.X, elemento.Upright.Y, 0)
								vx = resulting_po-elemento.Upright
								move_element(doc, elemento.Element, vx, elemento)
							elif str(HorizontalTextAlignment.Center) == alignment:
								mid_point_ele = elemento.Center
								resulting_po = XYZ(x_center.X, mid_point_ele.Y, 0)
								vx = resulting_po-mid_point_ele
								move_element(doc, elemento.Element, vx, elemento)					
							#Move elements Y axis
							elif str(VerticalTextAlignment.Top) == alignment:
								resulting_po = XYZ(elemento.Upright.X, max_upright_up.Y, 0)
								vy = resulting_po-elemento.Upright
								move_element(doc, elemento.Element, vy, elemento)
							elif str(VerticalTextAlignment.Bottom) == alignment:
								resulting_po = XYZ(elemento.Downright.X, min_downright_down.Y, 0)
								vy = resulting_po-elemento.Downright
								move_element(doc, elemento.Element, vy, elemento)
							elif str(VerticalTextAlignment.Middle) == alignment:
								mid_point_ele = elemento.Center
								resulting_po = XYZ(mid_point_ele.X, y_center.Y, 0)
								vy = resulting_po-mid_point_ele
								move_element(doc, elemento.Element, vy, elemento)	
							#Distribute X
							elif alignment == "Horizontally":
								#Get index element 
								indx_elemento = list_ele_loc.IndexOf(elemento)
								for index_x, value in enumerate(ordered_list_x): 
									vl, i = value
									if i == indx_elemento:
										#Move element to new_x
										mid_point_ele = elemento.Center
										new_x = dstri_x_positions[index_x]
										pt_initial = XYZ(mid_point_ele.X,0,0)
										distance=pt_initial.DistanceTo(XYZ(new_x, 0, 0))
										vx = (XYZ(new_x, 0, 0)- pt_initial).Normalize() * distance
										move_element(doc, elemento.Element, vx, elemento)
										break	
							#Distribute Y
							elif alignment == "Vertically":
								#Get index element 
								indx_elemento = list_ele_loc.IndexOf(elemento)
								for index_y, value in enumerate(ordered_list_y): 
									vl, i = value
									if i == indx_elemento:
										#Move element to new_x
										mid_point_ele = elemento.Center
										new_y = dstri_y_positions[index_y]
										pt_initial = XYZ(0,mid_point_ele.Y,0)
										distance=pt_initial.DistanceTo(XYZ(0, new_y, 0))
										vy = (XYZ(0, new_y, 0)-pt_initial).Normalize() * distance
										move_element(doc, elemento.Element, vy, elemento)
										break
						t.Commit()
						if isinstance(picked_obj_ids[0], Reference):
							coll_ids = List[ElementId]()
							for x in picked_obj_ids:
								coll_ids.Add(x.ElementId)
							uidoc.Selection.SetElementIds(coll_ids)
						else:
							uidoc.Selection.SetElementIds(picked_obj_ids)
		except Exception as e:
			if not objForm.IsDisposed:
				objForm.Hide()
			task2 = Autodesk.Revit.UI.TaskDialog("Align & Distribute Exception")
			task2.MainInstruction = str(e)
			task2.Show()
			if not objForm.IsDisposed:
				objForm.Show()
			uidoc = uiapp.ActiveUIDocument
			if uidoc:
				uidoc.Selection.SetElementIds(List[ElementId]())	
	def pickobject(self, uidoc):
		picked = uidoc.Selection.PickObjects(ObjectType.Element)
		return picked	
		
	def GetName(self):
		return "Align and Distribute"
		
class Form24(Form):
	def __init__(self, hand_event, ex_eve):
		self.Font = Font(self.Font.FontFamily, 16, FontStyle.Regular, GraphicsUnit.Pixel)
		self.TopMost = True
		self.hand_event = hand_event
		self.event = ex_eve
		self.InitializeComponent()
	
	def InitializeComponent(self):
		self._spr_top     = System.Windows.Forms.Label()
		self._buttonLeft = System.Windows.Forms.Button()
		self._buttonRight = System.Windows.Forms.Button()
		self._buttonCenter = System.Windows.Forms.Button()
		self._buttonUp = System.Windows.Forms.Button()
		self._buttonDown = System.Windows.Forms.Button()
		self._buttonMiddle = System.Windows.Forms.Button()
		self._buttonDisHori = System.Windows.Forms.Button()
		self._buttonDisVer = System.Windows.Forms.Button()
		self._panel = System.Windows.Forms.GroupBox();
		self._panelVert = System.Windows.Forms.GroupBox();
		self._panelDist = System.Windows.Forms.GroupBox();
		self.toolTip1 = System.Windows.Forms.ToolTip();
		self.SuspendLayout()
		# 
		# Separator Top
		# 
		self._spr_top.Anchor     = System.Windows.Forms.AnchorStyles.Top | System.Windows.Forms.AnchorStyles.Left | System.Windows.Forms.AnchorStyles.Right
		self._spr_top.Location   = System.Drawing.Point(0, 0)
		self._spr_top.Name       = "spr_top"
		self._spr_top.Size       = System.Drawing.Size(2000, 2)
		self._spr_top.BackColor  = Color.FromArgb(82, 53, 239)
		# 
		# Panel1
		# 
		self._panel.Location = Point(10,5)
		self._panel.Name = "panel_radBtn"
		self._panel.Size = System.Drawing.Size(150, 113)
		self._panel.Text = "Align Horizontal"
		# 
		# Panel2
		# 
		self._panelVert.Location = Point(170,5)
		self._panelVert.Name = "panel_radVert"
		self._panelVert.Size = System.Drawing.Size(150, 113)
		self._panelVert.Text = "Align Vertical"
		# 
		# Panel3
		# 
		self._panelDist.Location = Point(330,5)
		self._panelDist.Name = "panel_dist"
		self._panelDist.Size = System.Drawing.Size(150, 113)
		self._panelDist.Text = "Distribute"
		# 
		# button1
		# 
		self._buttonLeft.Anchor = System.Windows.Forms.AnchorStyles.Top | System.Windows.Forms.AnchorStyles.Left
		self._buttonLeft.TextAlign = ContentAlignment.BottomLeft
		self._buttonLeft.Location = System.Drawing.Point(5, 20)
		self._buttonLeft.Name = "button1"
		self._buttonLeft.Size = System.Drawing.Size(140, 27)
		self._buttonLeft.TabIndex = 0
		self._buttonLeft.Text = "  ⬱ Align Left"
		self._buttonLeft.UseVisualStyleBackColor = True
		self._buttonLeft.Click += self.Button1Click
		self.toolTip1.SetToolTip(self._buttonLeft, "Align all selected elements/tags/... to the left.")
		self._buttonLeft.Tag = str(HorizontalTextAlignment.Left)
		# 
		# button2
		# 
		self._buttonRight.Anchor = System.Windows.Forms.AnchorStyles.Top | System.Windows.Forms.AnchorStyles.Left
		self._buttonRight.TextAlign = ContentAlignment.BottomLeft
		self._buttonRight.Location = System.Drawing.Point(5, 50)
		self._buttonRight.Name = "button2"
		self._buttonRight.Size = System.Drawing.Size(140, 27)
		self._buttonRight.TabIndex = 1
		self._buttonRight.Text = "  ⇶ Align Right"
		self._buttonRight.UseVisualStyleBackColor = True
		self._buttonRight.Click += self.Button1Click
		self.toolTip1.SetToolTip(self._buttonRight, "Align all selected elements/tags/... to the right.")
		self._buttonRight.Tag = str(HorizontalTextAlignment.Right)
		# 
		# button3
		# 
		self._buttonCenter.Anchor = System.Windows.Forms.AnchorStyles.Top | System.Windows.Forms.AnchorStyles.Left
		self._buttonCenter.TextAlign = ContentAlignment.BottomLeft
		self._buttonCenter.Location = System.Drawing.Point(5, 80)
		self._buttonCenter.Name = "button3"
		self._buttonCenter.Size = System.Drawing.Size(140, 27)
		self._buttonCenter.TabIndex = 2
		self._buttonCenter.Text = "  ≣  Align Center"
		self._buttonCenter.UseVisualStyleBackColor = True
		self._buttonCenter.Click += self.Button1Click
		self.toolTip1.SetToolTip(self._buttonCenter, "Align all selected elements/tags/... to the horizontal midpoint.")
		self._buttonCenter.Tag = str(HorizontalTextAlignment.Center)
		# 
		# button4
		# 
		self._buttonUp.Anchor = System.Windows.Forms.AnchorStyles.Top | System.Windows.Forms.AnchorStyles.Left
		self._buttonUp.TextAlign = ContentAlignment.BottomLeft
		self._buttonUp.Location = System.Drawing.Point(5, 20)
		self._buttonUp.Name = "button4"
		self._buttonUp.Size = System.Drawing.Size(140, 27)
		self._buttonUp.TabIndex = 2
		self._buttonUp.Text = "  ⥣  Align Up"
		self._buttonUp.UseVisualStyleBackColor = True
		self._buttonUp.Click += self.Button1Click
		self.toolTip1.SetToolTip(self._buttonUp, "Align all selected elements/tags/... to the top.")
		self._buttonUp.Tag = str(VerticalTextAlignment.Top)
		# 
		# button5
		# 
		self._buttonDown.Anchor = System.Windows.Forms.AnchorStyles.Top | System.Windows.Forms.AnchorStyles.Left
		self._buttonDown.TextAlign = ContentAlignment.BottomLeft
		self._buttonDown.Location = System.Drawing.Point(5, 50)
		self._buttonDown.Name = "button4"
		self._buttonDown.Size = System.Drawing.Size(140, 27)
		self._buttonDown.TabIndex = 3
		self._buttonDown.Text = "  ⥥  Align Down"
		self._buttonDown.UseVisualStyleBackColor = True
		self._buttonDown.Click += self.Button1Click
		self.toolTip1.SetToolTip(self._buttonDown, "Align all selected elements/tags/... to the bottom.")
		self._buttonDown.Tag = str(VerticalTextAlignment.Bottom)
		# 
		# button6
		# 
		self._buttonMiddle.Anchor = System.Windows.Forms.AnchorStyles.Top | System.Windows.Forms.AnchorStyles.Left
		self._buttonMiddle.TextAlign = ContentAlignment.BottomLeft
		self._buttonMiddle.Location = System.Drawing.Point(5, 80)
		self._buttonMiddle.Name = "button5"
		self._buttonMiddle.Size = System.Drawing.Size(140, 27)
		self._buttonMiddle.TabIndex = 4
		self._buttonMiddle.Text = "  〣Align Middle"
		self._buttonMiddle.UseVisualStyleBackColor = True
		self._buttonMiddle.Click += self.Button1Click
		self.toolTip1.SetToolTip(self._buttonMiddle, "Align all selected elements/tags/... to the vertical midpoint.")
		self._buttonMiddle.Tag = str(VerticalTextAlignment.Middle)
		# 
		# button7
		# 
		self._buttonDisHori.Anchor = System.Windows.Forms.AnchorStyles.Top | System.Windows.Forms.AnchorStyles.Left
		self._buttonDisHori.TextAlign = ContentAlignment.BottomLeft
		self._buttonDisHori.Location = System.Drawing.Point(5, 20)
		self._buttonDisHori.Name = "button4"
		self._buttonDisHori.Size = System.Drawing.Size(140, 27)
		self._buttonDisHori.TabIndex = 5
		self._buttonDisHori.Text = "  ↔ Horizontally"
		self._buttonDisHori.UseVisualStyleBackColor = True
		self._buttonDisHori.Click += self.Button1Click
		self.toolTip1.SetToolTip(self._buttonDisHori, "Distribute elements/tags/... with equal distances horizontally.")
		self._buttonDisHori.Tag = "Horizontally"
		# 
		# button8
		# 
		self._buttonDisVer.Anchor = System.Windows.Forms.AnchorStyles.Top | System.Windows.Forms.AnchorStyles.Left
		self._buttonDisVer.TextAlign = ContentAlignment.BottomLeft
		self._buttonDisVer.Location = System.Drawing.Point(5, 50)
		self._buttonDisVer.Name = "button4"
		self._buttonDisVer.Size = System.Drawing.Size(140, 27)
		self._buttonDisVer.TabIndex = 6
		self._buttonDisVer.Text = "  ↕   Vertically"
		self._buttonDisVer.UseVisualStyleBackColor = True
		self._buttonDisVer.Click += self.Button1Click
		self.toolTip1.SetToolTip(self._buttonDisVer, "Distribute elements/tags/... with equal distances vertically.")
		self._buttonDisVer.Tag = "Vertically"
		# 
		# Form24
		# 
		self.ClientSize = System.Drawing.Size(490, 125)
		self.MaximizeBox = 0
		self.MinimizeBox = 0
		self.CenterToScreen() 
		self.FormBorderStyle = FormBorderStyle.FixedSingle
		self._panel.Controls.Add(self._buttonLeft)
		self._panel.Controls.Add(self._buttonRight)
		self._panel.Controls.Add(self._buttonCenter)
		self._panelVert.Controls.Add(self._buttonUp)
		self._panelVert.Controls.Add(self._buttonDown)
		self._panelVert.Controls.Add(self._buttonMiddle)
		self._panelDist.Controls.Add(self._buttonDisHori)
		self._panelDist.Controls.Add(self._buttonDisVer)
		self.Controls.Add(self._spr_top)
		self.Controls.Add(self._panel)
		self.Controls.Add(self._panelVert)
		self.Controls.Add(self._panelDist)
		self.Name = "Align & Distribute"
		self.Text = "Align & Distribute"
		iconFilename = 'C:\\NONICAPRO\\OtherFiles\\System\\Nonicafavicon.ICO'
		if not os.path.exists(iconFilename):
			iconFilename = 'C:\\NONICA\\OtherFiles\\System\\Nonicafavicon.ICO'
		icon = Icon(iconFilename)
		self.Icon = icon
		self.ResumeLayout(False)
		
	def Button1Click(self, sender, e):
		self.hand_event.alignment = sender.Tag
		self.event.Raise()
		
class elementLocation():
	def __init__(self, elemento, upleft, upright, downleft, downright, displacementVc):
		self.Element = elemento
		self.Id = elemento.Id
		self.Upleft = upleft
		self.Upright = upright
		self.Downleft = downleft
		self.Downright = downright
		self.Center = (self.Upright + self.Downleft)/2
		self.DisplacementVc = displacementVc
	
def getElementLocation(doc, elemento, ownerView):
	TransactionManager.Instance.EnsureInTransaction(doc)
	trans = SubTransaction(doc)
	trans.Start()
	if doc.GetElement(elemento.OwnerViewId) != None:
		ownerView = doc.GetElement(elemento.OwnerViewId)
	else:
		ownerView = doc.ActiveView
	displacementVc = XYZ(0,0,0)
	plane = Plane.CreateByNormalAndOrigin(ownerView.ViewDirection, ownerView.Origin)
	if isinstance(elemento, IndependentTag):
		elemento.HasLeader = False
	elif isinstance(elemento, TextNote):
		elemento.RemoveLeaders()
	elif isinstance(elemento, SpatialElementTag):
		if elemento.HasLeader:
			displacementVc = elemento.LeaderEnd - elemento.TagHeadPosition
			elemento.HasLeader = False
	doc.Regenerate()
	bbox = elemento.get_BoundingBox(ownerView)
	gb_Max = bbox.Max
	gb_Min = bbox.Min	
	#Displacement Vector
	if not displacementVc.IsAlmostEqualTo(XYZ(0,0,0)):
		gb_Max = bbox.Max - displacementVc;
		gb_Min = bbox.Min - displacementVc;
	#Project
	dist_proj = projectDist(plane, gb_Min, gb_Max)
	alternateMax = XYZ(gb_Max.X, gb_Min.Y, gb_Max.Z);
	alternateMin = XYZ(gb_Min.X, gb_Max.Y, gb_Min.Z);
	alt_dist_proj = projectDist(plane, alternateMin, alternateMax)
    #Check alter. opposite points
	if alt_dist_proj > dist_proj:
		gb_Max = alternateMax
		gb_Min = alternateMin
	activeViewTransform = ownerView.CropBox.Transform
	max_trans = activeViewTransform.Inverse.OfPoint(gb_Max)
	min_trans = activeViewTransform.Inverse.OfPoint(gb_Min) 
	UpLeft = XYZ(min(min_trans.X, max_trans.X), max(max_trans.Y, min_trans.Y), 0)
	UpRight = XYZ(max(min_trans.X, max_trans.X), max(max_trans.Y, min_trans.Y), 0)
	DownLeft = XYZ(min(min_trans.X, max_trans.X), min(max_trans.Y, min_trans.Y), 0)
	DownRight = XYZ(max(min_trans.X, max_trans.X), min(max_trans.Y, min_trans.Y), 0)
	trans.RollBack()
	TransactionManager.Instance.TransactionTaskDone()
	return elementLocation(elemento, UpLeft, UpRight, DownLeft, DownRight, displacementVc)
    
def projectDist(plane, point1, point2):
	projected_point1 = projectToPlane(plane, point1)
	projected_point2 = projectToPlane(plane, point2)
	return projected_point1.DistanceTo(projected_point2)

def projectToPlane(plane, point):
	pl_or = plane.Origin
	pl_nr = plane.Normal.Normalize()
	return point - pl_nr.Multiply(pl_nr.DotProduct(point - pl_or))

def getMinCoordElement(elemento):
	return min(elemento.Upleft.X, elemento.Downleft.X), min(elemento.Downleft.Y, elemento.Downright.Y)
	
def getMaxCoordElement(elemento):
	return max(elemento.Upright.X, elemento.Downright.X), max(elemento.Upright.Y, elemento.Upleft.Y)

def isclose(a, b, rel_tol=1e-09, abs_tol=0.0):
	return abs(a-b) <= max(rel_tol * max(abs(a), abs(b)), abs_tol)

def move_element(doc, elemento, vector, ele_loc):
	if not vector.IsAlmostEqualTo(XYZ(0,0,0)):
		if doc.GetElement(elemento.OwnerViewId) != None:
			ownerView = doc.GetElement(elemento.OwnerViewId)
		else:
			ownerView = doc.ActiveView	
		tr = Transform.CreateTranslation(ownerView.CropBox.Transform.OfVector(vector))
		versionNum = int(doc.Application.VersionNumber)
		#Move Tags
		if isinstance(elemento, IndependentTag):
			if elemento.HasLeader and elemento.LeaderEndCondition == LeaderEndCondition.Free:
				#Before RVT 2022
				if versionNum < 2022:
					leaderEnd = elemento.LeaderEnd
				else:
					refEle = elemento.GetTaggedReferences()
					if refEle.Count > 0:
						leaderEnd = elemento.GetLeaderEnd(refEle[0])
			elemento.TagHeadPosition = tr.OfPoint(elemento.TagHeadPosition)
			if elemento.HasLeader and elemento.LeaderEndCondition == LeaderEndCondition.Free:
				#Before RVT 2022
				if versionNum < 2022:
					elemento.LeaderEnd = leaderEnd
				else:
					refEle = elemento.GetTaggedReferences()
					if refEle.Count > 0:
						elemento.SetLeaderEnd(refEle[0], leaderEnd)
		#Move TextNotes and not leaders
		elif isinstance(elemento, TextNote):
			list_ldrs = []
			if elemento.LeaderCount != 0:
				for ld in elemento.GetLeaders():
					list_ldrs.Add([ld.End, ld.Elbow])
			elemento.Coord = tr.OfPoint(elemento.Coord)
			if elemento.LeaderCount != 0:
				for indx, leader in enumerate(elemento.GetLeaders()):
					leader.End = list_ldrs[indx][0]
					leader.Elbow = list_ldrs[indx][1]
					
		#Move SpatialElementTags
		elif isinstance(elemento, SpatialElementTag):
			leaderEnd = XYZ(0,0,0)
			if elemento.HasLeader:
				leaderEnd = elemento.LeaderEnd

			if isinstance(elemento, AreaTag):
				bbox = elemento.Area.get_BoundingBox(ownerView)
				trans_point = tr.OfPoint(elemento.Location.Point)
				#Check tag point is in
				if bbox.Min.X < trans_point.X and bbox.Min.Y < trans_point.Y and bbox.Max.X > trans_point.X and bbox.Max.Y > trans_point.Y:
					elemento.Location.Point = tr.OfPoint(elemento.Location.Point)
				else:
					elemento.Location.Point = tr.OfPoint(elemento.Location.Point)
					elemento.HasLeader = True
			else:
				elemento.Location.Move(ownerView.CropBox.Transform.OfVector(vector))

			if elemento.IsOrphaned==False and elemento.HasLeader == False:
				#RoomTag
				if isinstance(elemento, Architecture.RoomTag):
					if not elemento.Room.IsPointInRoom(elemento.TagHeadPosition):
						elemento.HasLeader = True
				#SpaceTag
				if isinstance(elemento, Mechanical.SpaceTag):
					if not elemento.Space.IsPointInSpace(elemento.TagHeadPosition):
						elemento.HasLeader = True
					
			if not leaderEnd.IsAlmostEqualTo(XYZ(0,0,0)):
				if elemento.HasLeader==True:
					try:
						elemento.LeaderEnd = leaderEnd
					except:
						pass
		else:
			elemento.Location.Move(ownerView.CropBox.Transform.OfVector(vector))

event_handler = alignEvent()
ext_event = ExternalEvent.Create(event_handler)
objForm = Form24(event_handler, ext_event)
result_win = objForm.Show()			
OUT = 0

"""
This script is based on Align by BIM42. 
All original code is licensed under MIT License, however all modifications and improvements are licensed under a different license agreement included below:
################################
MIT License
Copyright (c) 2018 Simon Moreau
Permission is hereby granted, free of charge, to any person obtaining a copy
of this software and associated documentation files (the "Software"), to deal
in the Software without restriction, including without limitation the rights
to use, copy, modify, merge, publish, distribute, sublicense, and/or sell
copies of the Software, and to permit persons to whom the Software is
furnished to do so, subject to the following conditions:

The above copyright notice and this permission notice shall be included in all
copies or substantial portions of the Software.

THE SOFTWARE IS PROVIDED "AS IS", WITHOUT WARRANTY OF ANY KIND, EXPRESS OR
IMPLIED, INCLUDING BUT NOT LIMITED TO THE WARRANTIES OF MERCHANTABILITY,
FITNESS FOR A PARTICULAR PURPOSE AND NONINFRINGEMENT. IN NO EVENT SHALL THE
AUTHORS OR COPYRIGHT HOLDERS BE LIABLE FOR ANY CLAIM, DAMAGES OR OTHER
LIABILITY, WHETHER IN AN ACTION OF CONTRACT, TORT OR OTHERWISE, ARISING FROM,
OUT OF OR IN CONNECTION WITH THE SOFTWARE OR THE USE OR OTHER DEALINGS IN THE
SOFTWARE.
################################
License Agreement
For the use of this script
This License Agreement (this “Agreement” of this “License Agreement”) is made and effective as of the current date (the “Commencement Date”) by and between Nonica by Estudio Alonso Candau SLP a company organized and existing in Spain with a registered address at Avd.Chafarinas 16 Puerto Rey Vera, Almeria (“Licensor”) and yourself (“Licensee”).
WHEREAS:
1.	Licensee wishes to obtain access and use this script (hereinafter, the “Asset”), and
2.	Licensor is willing to grant to the Licensee a non-exclusive, non-transferable License to use the Asset for the term and specific purpose set forth in this Agreement,
NOW, THEREFORE, your access to and use of the Service is conditioned on your acceptance of and compliance with these Terms and Conditions. These Terms and Conditions apply to all visitors, users and others who access or use this script.
1. Definitions
1.1 “Agreement” means this License Agreement including the attached Schedule.
1.2 “Confidential Information” means information that:
a. is by its nature confidential;
b. is designated in writing by Licensor as confidential;
c. the Licensee knows or reasonably ought to know is confidential;
d. Information comprised in or relating to any Intellectual Property Rights of Licensor.
1.3 “Asset” means the Asset provided by Licensor as specified in Item 6 of the Schedule in the form as stated in Item 7 of the Schedule.
1.4 “Intellectual Property Rights” means all rights in and to any copyright, trademark, trading name, design, patent, know how (trade secrets) and all other rights resulting from intellectual activity in the industrial, scientific, literary or artistic field and any application or right to apply for registration of any of these rights and any right to protect or enforce any of these rights, as further specified in clause 5.
1.5 “Party” means a person or business entity who has executed this Agreement; details of the Parties are specified in Item 2 of the Schedule.
1.6 “Term” means the term of this Agreement commencing on the Commencement Date as specified in Item 4 of the Schedule and expiring on the Expiry Date specified in Item 5 of the Schedule.
2. License Grant
2.1 Licensor grants to the Licensee a non-exclusive, non-transferable License for the Term to use the Asset for the specific purpose specified in this Agreement, subject to the terms and conditions set out in this Agreement.
3. Charges
3.1 In consideration of the Licensor providing the License under clause 2 of this License Agreement, the Licensee agrees to pay Licensor the amount of the License Charge as specified in Item 9 of the Schedule.
4. Licensee’s Obligations
4.1 The Licensee cannot use the Asset, for purposes other than as specified in this Agreement and in Item 8 of the Schedule.
4.2 The Licensee may permit its employees to use the Asset for the purposes described in Item 8, provided that the Licensee takes all necessary steps and imposes the necessary conditions to ensure that all employees using the Asset do not commercialise or disclose the contents of it to any third person, or use it other than in accordance with the terms of this Agreement.
4.3 The Licensee will not distribute, sell, License or sub-License, let, trade or expose for sale the Asset to a third party.
4.4 No copies of the Asset are to be made other than as expressly approved by Licensor.
4.5 No changes to the Asset or its content may be made by Licensee.
4.6 The Licensee will provide technological and security measures to ensure that the Asset which the Licensee is responsible for is physically and electronically secure from unauthorised use or access.
4.7 Licensee shall ensure that the Asset retains all Licensor copyright notices and other proprietary legends and all trademarks or service marks of Licensor.
5. Intellectual Property Rights
5.1 All Intellectual Property Rights over and in respect of the Asset are owned by Licensor. The Licensee does not acquire any rights of ownership in the Asset.
6. Limitation of Liability
6.1 The Licensee acknowledges and agrees that neither Licensor nor its board members, officers, employees or agents, will be liable for any loss or damage arising out of or resulting from Licensor’s provision of the Asset under this Agreement, or any use of the Asset by the Licensee or its employees; and Licensee hereby releases Licensor to the fullest extent from any such liability, loss, damage or claim.
7. Confidentiality
7.1 Neither Party may use, disclose or make available to any third party the other Party’s Confidential Information, unless such use or disclosure is done in accordance with the terms of this Agreement.
7.2 Each Party must hold the other Party’s Confidential Information secure and in confidence, except to the extent that such Confidential Information:
a. is required to be disclosed according to the requirements of any law, judicial or legislative body or government agency; or
b. was approved for release in writing by the other Party, but only to the extent of and subject to such conditions as may be imposed in such written authorisation.
7.3 This clause 7 will survive termination of this Agreement.
8. Disclaimers & Release
8.1 To the extent permitted by law, Licensor will in no way be liable to the Licensee or any third party for any loss or damage, however caused (including through negligence) which may be directly or indirectly suffered in connection with any use of the Asset.
8.2 The Asset is provided by Licensor on an “as is” basis.
8.3 Licensor will not be held liable by the Licensee in any way, for any loss, damage or injury suffered by the Licensee or by any other person related to any use of the Asset or any part thereof.
8.4 Notwithstanding anything contained in this Agreement, in no event shall Licensor be liable for any claims, damages or loss which may arise from the modification, combination, operation or use of the Asset with Licensee computer programs.
8.5 Licensor does not warrant that the Asset will function in any environment.
8.6 The Licensee acknowledges that: a. The Asset has not been prepared to meet any specific requirements of any party, including any requirements of Licensee; and b. it is therefore the responsibility of the Licensee to ensure that the Asset meets its own individual requirements.
8.7 To the extent permitted by law, no express or implied warranty, term, condition or undertaking is given or assumed by Licensor, including any implied warranty of merchantability or fitness for a particular purpose.
9. Indemnification
9.1 The Licensee must indemnify, defend and hold harmless Licensor, its board members, officers, employees and agents from and against any and all claims (including third party claims), demands, actions, suits, expenses (including attorney’s fees) and damages (including indirect or consequential loss) resulting in any way from:
a. Licensee’s and Licensee’s employee’s use or reliance on the Asset,
b. any breach of the terms of this License Agreement by the Licensee or any Licensee employee, and
c. any other act of Licensee.
9.2 This clause 9 will survive termination of this Agreement.
10. Waiver
10.1 Any failure or delay by either Party to exercise any right, power or privilege hereunder or to insist upon observance or performance by the other of the provisions of this License Agreement shall not operate or be construed as a waiver thereof.
11. Governing Law
11.1 This Agreement will be construed by and governed in accordance with the laws of Spain. The Parties submit to exclusive jurisdiction of the courts of Spain.
12. Termination
12.1 This Agreement and the License granted herein commences upon the Commencement Date and is granted for the Term, unless otherwise terminated by Licensor in the event of any of the following:
a. if the Licensee is in breach of any term of this License Agreement and has not corrected such breach to Licensor’s reasonable satisfaction within 7 days of Licensor’s notice of the same;
b. if the Licensee becomes insolvent, or institutes (or there is instituted against it) proceedings in bankruptcy, insolvency, reorganization or dissolution, or makes an assignment for the benefit of creditors; or
c. the Licensee is in breach of clause 5 or 7 of this Agreement.
12.2 Termination under this clause shall not affect any other rights or remedies Licensor may have.
14. Assignment
14.1 Licensee shall not assign any rights of this License Agreement, without the prior written consent of Licensor.
15. Notices
15.1 All notices required under this Agreement shall be in writing and shall be deemed given (i) when delivered personally; (ii) five (5) days after mailing, when sent certified mail, return receipt requested and postage prepaid; or (iii) one (1) business day after dispatch, when sent via a commercial overnight carrier, fees prepaid. All notices given by either Party must be sent to the address of the other as first written above (unless otherwise changed by written notice).
16. Counterparts
16.1 This Agreement may be executed in any number of counterparts, each of which shall be deemed to be an original and all of which taken together shall constitute one instrument.
17. Severability
17.1 The Parties recognize the uncertainty of the law with respect to certain provisions of this Agreement and expressly stipulate that this Agreement will be construed in a manner that renders its provisions valid and enforceable to the maximum extent possible under applicable law. To the extent that any provisions of this Agreement are determined by a court of competent jurisdiction to be invalid or unenforceable, such provisions will be deleted from this Agreement or modified so as to make them enforceable and the validity and enforceability of the remainder of such provisions and of this Agreement will be unaffected.
18. Entire Agreement
18.1 This Agreement contains the entire agreement between the Parties and supersedes any previous understanding, commitments or agreements, oral or written. Further, this Agreement may not be modified, changed, or otherwise altered in any respect except by a written agreement signed by both Parties.
IN WITNESS WHEREOF, this Agreement, including the attached Schedule, was signed by the Parties under the hands of their duly authorized representatives and made effective as of the current date.
Nonica by Estudio Alonso Candau SLP,
Signature
02/05/2021
Jaime Alonso Candau
Please contact hello@nonica.io with any further doubt/request.
Your signatureby using and accessing this script.
Signed by accepting these terms.
Current date.
"""
# ----------------------------------------
