# Dynamo graph Join in Views.dyn "JoinInView" (Dynamo 2.6.2.15705)

join_elements = Python()
# ---------- join_elements.python (1015 lines) ----------
import sys
import clr
import os
import ctypes
from ctypes import wintypes
from ctypes.wintypes import MAX_PATH

from System import Array
from System.Collections.Generic import *

from operator import attrgetter

clr.AddReference('ProtoGeometry')
from Autodesk.DesignScript.Geometry import *

clr.AddReference('RevitAPI')
import Autodesk
from Autodesk.Revit.DB import *

clr.AddReference("RevitAPIUI")
import Autodesk 
from Autodesk.Revit.UI import TaskDialog, IExternalEventHandler, ExternalEvent
from Autodesk.Revit.UI.Selection import *

clr.AddReference("RevitServices")
import RevitServices
from RevitServices.Persistence import DocumentManager
from RevitServices.Transactions import TransactionManager

clr.AddReference('RevitAPIIFC')
from Autodesk.Revit.DB.IFC import *

clr.AddReference('System.Drawing')
clr.AddReference('System.Windows.Forms')
import System.Drawing
import System.Windows.Forms
from System.Drawing import *
from System.Reflection import Assembly
from System.Windows.Forms import *

clr.AddReference('System.Data')
from System.Data import *

class UnsubcribeDocChange(IExternalEventHandler):
	def __init__(self):
		pass
		
	def Execute(self, uiapp):
		try:
			uiapp.ViewActivated -= new_sub
		except Exception as e:
			pass
			
	def GetName(self):
		return "Unsubscribe Document Changed Event"

class joinElements(IExternalEventHandler):
	def __init__(self, pri_cat):
		self.cat_priorities = pri_cat

	def Execute(self, uiapp):
		try:
			cat_names, cat_builtin = extractListsPriorities()
			if len(cat_names) != 0:
				self.cat_priorities = cat_builtin
			ui_doc = uiapp.ActiveUIDocument
			global new_doc
			new_doc = ui_doc.Document
			views_sel = [item['Value'] for item in objForm.checkedListBox1.CheckedItems]
			categories_sel = [item['Value'] for item in objForm.checkedListBox2.CheckedItems]
			#If selection
			if objForm.checkBox1.Checked == True:
				selected_ids = uidoc.Selection.GetElementIds()
				if len(selected_ids) == 0:
					try:
						#Change text in button join elements
						objForm.button2.Text = "Select in Revit"
						objForm.button2.Enabled = False
						sel_refs = uidoc.Selection.PickObjects(ObjectType.Element, "Select Elements in Revit")
						objForm.button2.Enabled = True
						objForm.button2.Text = "Join Elements!"
						#Filter elements and count
						ids_ele = [x.ElementId for x in sel_refs]
						fil_eles = self.filteredElementsCategories(ids_ele, categories_sel)
						if len(fil_eles) > 1:
							uiapp.Application.FailuresProcessing += failureProc
							self.executeJoinElements(fil_eles, None, categories_sel)
							uiapp.Application.FailuresProcessing -= failureProc
						else:
							self.windowNothingSelected()
					except Exception as exc:
						objForm.button2.Enabled = True
						objForm.button2.Text = "Join Elements!"
						self.windowNothingSelected()
				else:
					#Filter elements and count
					fil_eles = self.filteredElementsCategories(selected_ids, categories_sel)
					if len(fil_eles) > 1:
						uiapp.Application.FailuresProcessing += failureProc
						self.executeJoinElements(fil_eles, None, categories_sel)
						uiapp.Application.FailuresProcessing -= failureProc
					else:
						self.windowNothingSelected()
			else:
				#Get Elements in views
				uiapp.Application.FailuresProcessing += failureProc
				showed_window = False
				should_show = False
				number_views = len(views_sel)
				#ProgressBar
				countIssues = 0
				progressForm = FormWithProgresBar()
				progressForm._progressBar.Minimum = 0
				progressForm._progressBar.Maximum = number_views
				progressForm._progressBar.Step = 1
				objForm.Hide()
				progressForm.Show()
				with TransactionGroup(new_doc, "Join in Views") as tg:
					tg.Start()
					for vw_id in views_sel:
						progressForm._txtBlock2.Text = str(countIssues) + " / " + str(number_views) + " Views Processed"
						progressForm._progressBar.PerformStep()
						progressForm.Refresh()
						Application.DoEvents()
						if progressForm.interrupt == True:
							break
						countIssues+= 1
						all_ele_in_view = self.getAllElementsToJoin(categories_sel, vw_id)
						if len(all_ele_in_view) > 1:
							self.executeJoinElements(all_ele_in_view, vw_id, categories_sel)
							showed_window = True
						else:
							should_show = True
					if should_show and showed_window == False:
						showed_window = True
						progressForm.Hide()
						Autodesk.Revit.UI.TaskDialog.Show("Join In Views","Please, select view/s that at least have 2 elements of the selected categories to join.")
					#Cancelled process
					if progressForm.interrupt == True:
						tg.RollBack()
						progressForm.Close()
						Autodesk.Revit.UI.TaskDialog.Show("Process Cancelled","The process has been interrupted. Any change done during the process was undo.")
					else:
						tg.Assimilate()
				progressForm.Close()						
				objForm.Show()
				uiapp.Application.FailuresProcessing -= failureProc
		except Exception as e:
			Autodesk.Revit.UI.TaskDialog.Show("Exception",str(e))
			
	def executeJoinElements(self, joinable_elements, view_id, sel_cats):
		try:
			joined_elements = {}
			if view_id:
				view_ele = new_doc.GetElement(view_id)
			else:
				view_ele = None
				countIssues = 0
				progressForm = FormWithProgresBar()
				number_ele = len(joinable_elements)
				progressForm._progressBar.Minimum = 0
				progressForm._progressBar.Maximum = number_ele
				progressForm._progressBar.Step = 1
				progressForm._txtBlock2.Text = "0 / " + str(number_ele) + " Elements Processed"
				objForm.Hide()
				progressForm.Show()
			with Transaction(new_doc, "Join Elements") as trans:
				trans.Start() 
				for element in joinable_elements:
					bbox = element.get_BoundingBox(view_ele)
					if bbox:
						outline_ele = Outline(bbox.Min, bbox.Max)
						filter_inters = BoundingBoxIntersectsFilter(outline_ele)
						if view_ele:
							all_inter_ele = self.getIntersectingElementsToJoin(sel_cats, view_ele, filter_inters)
						else:
							progressForm._txtBlock2.Text = str(countIssues) + " / " + str(number_ele) + " Elements Processed"
							progressForm._progressBar.PerformStep()
							progressForm.Refresh()
							Application.DoEvents()
							if progressForm.interrupt == True:
								break
							countIssues+= 1
							all_inter_ele = self.getIntersectingSelectionToJoin(sel_cats, filter_inters, joinable_elements)
						if len(all_inter_ele) > 0:
							for inter_ele in all_inter_ele:
								continue_processing = True
								#If elements already joined in previous iteration
								if element.Id == inter_ele.Id:
									continue_processing = False
								elif joined_elements.ContainsKey(element.Id):
									if inter_ele.Id in joined_elements[element.Id]:
										continue_processing = False
								try:
									areElementsJoined = JoinGeometryUtils.AreElementsJoined(doc, element, inter_ele)
									if continue_processing and not areElementsJoined:
										JoinGeometryUtils.JoinGeometry(doc, element, inter_ele)
										if joined_elements.ContainsKey(inter_ele.Id):
											joined_elements[inter_ele.Id].Add(element.Id)
										else:
											joined_elements.Add(inter_ele.Id, [element.Id])
										#Check join order and switch if needed
										self.checkOrderJoints(element, inter_ele, self.cat_priorities)
								except Exception as exc:
									pass
				if view_ele:
					trans.Commit()
				else:
					if progressForm.interrupt == True:
						trans.RollBack()
						progressForm.Close()
						Autodesk.Revit.UI.TaskDialog.Show("Process Cancelled","The process has been interrupted. Any change done during the process was undo.")
						objForm.Show()
					else:
						trans.Commit()
						progressForm.Close()
						objForm.Show()
		except Exception as exc:
			Autodesk.Revit.UI.TaskDialog.Show("Exception Joining Process", str(exc) + " - " + str(sys.exc_info()[-1].tb_lineno))
			
	def filteredElementsCategories(self, sel_ids, categories_sel):
		ids_categories = [ElementId(x) for x in categories_sel]
		if ElementId(BuiltInCategory.OST_Walls) in ids_categories:
			ids_categories.Add(ElementId(BuiltInCategory.OST_StackedWalls))
		filtered_selection = List[Element]()
		for id in sel_ids:
			ele = new_doc.GetElement(id)
			if ele.Category:
				if ele.Category.Id in ids_categories:
					filtered_selection.Add(ele)
		return filtered_selection
	
	def windowNothingSelected(self):
		objForm.Hide()
		Autodesk.Revit.UI.TaskDialog.Show("Join In Views","Please, select at least 2 elements of the checked categories to join.")
		objForm.Show()

	def getAllElementsToJoin(self, categories, id_view):
		filtered_elements = List[Element]()
		for category in categories:
			if category == BuiltInCategory.OST_Walls:
				filtered_elements.AddRange(FilteredElementCollector(new_doc, id_view).OfCategory(BuiltInCategory.OST_StackedWalls))
			filtered_elements.AddRange(FilteredElementCollector(new_doc, id_view).OfCategory(category))
		return filtered_elements
	
	def getIntersectingElementsToJoin(self, categories, view, inters_filter):
		filtered_elements = List[Element]()
		for category in categories:
			if category == BuiltInCategory.OST_Walls:
				filtered_elements.AddRange(FilteredElementCollector(new_doc, view.Id).OfCategory(BuiltInCategory.OST_StackedWalls).WherePasses(inters_filter))
			filtered_elements.AddRange(FilteredElementCollector(new_doc, view.Id).OfCategory(category).WherePasses(inters_filter))
		return filtered_elements
	
	def getIntersectingSelectionToJoin(self, categories, inters_filter, list_eles):
		list_ids = List[ElementId]()
		for ele in list_eles:
			list_ids.Add(ele.Id)
		filtered_elements = List[Element]()
		for category in categories:
			if category == BuiltInCategory.OST_Walls:
				filtered_elements.AddRange(FilteredElementCollector(new_doc, list_ids).OfCategory(BuiltInCategory.OST_StackedWalls).WherePasses(inters_filter))
			filtered_elements.AddRange(FilteredElementCollector(new_doc, list_ids).OfCategory(category).WherePasses(inters_filter))
		return filtered_elements
		
	def checkOrderJoints(self, ele1, ele2, categories):
		cat_1 = ele1.Category.Id
		if cat_1 == ElementId(BuiltInCategory.OST_StackedWalls):
			cat_1 = ElementId(BuiltInCategory.OST_Walls)
		cat_2 = ele2.Category.Id
		if cat_2 == ElementId(BuiltInCategory.OST_StackedWalls):
			cat_2 = ElementId(BuiltInCategory.OST_Walls)
		priority_1 = 0
		priority_2 = 0
		for index, bic_cat in enumerate(categories):
			cat = ElementId(bic_cat)
			if cat == cat_1:
				priority_1 = index
			if cat == cat_2:
				priority_2 = index
				
		if priority_1 != priority_2:
			if (JoinGeometryUtils.IsCuttingElementInJoin(new_doc, ele1, ele2)) == (priority_1 < priority_2):
				return False
			else:
				#Reorder joint
				JoinGeometryUtils.SwitchJoinOrder(new_doc, ele1, ele2)
				return True
		return False
		
	def GetName(self):
		return "Join Elements"

class FormWithProgresBar(Form):
	def __init__(self):
		self.Font = Font("Arial", 15, FontStyle.Regular, GraphicsUnit.Pixel)
		self.interrupt = False
		self.numberItems = 5
		self.TopMost = True
		self.Closing += self.closingevent
		self.InitializeComponent()
		
	def InitializeComponent(self):
		self._spr_top     = System.Windows.Forms.Label()
		self._progressBar = System.Windows.Forms.ProgressBar()
		self._button1 = System.Windows.Forms.Button()
		self._txtBlock2 = System.Windows.Forms.Label()
		self.SuspendLayout()
		# 
		# Separator Top
		# 
		self._spr_top.Anchor     = System.Windows.Forms.AnchorStyles.Top | System.Windows.Forms.AnchorStyles.Left | System.Windows.Forms.AnchorStyles.Right
		self._spr_top.Location   = System.Drawing.Point(0, 0)
		self._spr_top.Name       = "spr_top"
		self._spr_top.Size       = System.Drawing.Size(2000, 2)
		self._spr_top.BackColor  = Color.FromArgb(82, 53, 239)
		# 
		# TextBlock2
		# 
		self._txtBlock2.Anchor = System.Windows.Forms.AnchorStyles.Top | System.Windows.Forms.AnchorStyles.Left
		self._txtBlock2.TextAlign = ContentAlignment.MiddleCenter
		self._txtBlock2.Location = System.Drawing.Point(0, 5)
		self._txtBlock2.Name = "txtBlock2"
		self._txtBlock2.Size = System.Drawing.Size(250, 20)
		self._txtBlock2.TabIndex = 1
		self._txtBlock2.Text = "0 / 0 Views Processed"
		# 
		# ProgressBar
		# 
		self._progressBar.Anchor = System.Windows.Forms.AnchorStyles.Bottom | System.Windows.Forms.AnchorStyles.Left
		self._progressBar.Location = System.Drawing.Point(15, 30)
		self._progressBar.Name = "progressBar"
		self._progressBar.Size = System.Drawing.Size(220, 15)
		self._progressBar.Value = 1
		self._progressBar.TabIndex = 1
		# 
		# button1
		# 
		self._button1.Anchor = System.Windows.Forms.AnchorStyles.Bottom | System.Windows.Forms.AnchorStyles.Right
		self._button1.Location = System.Drawing.Point(14, 50)
		self._button1.Name = "button1"
		self._button1.Size = System.Drawing.Size(222, 20)
		self._button1.TabIndex = 2
		self._button1.Text = "Interrupt / Cancel"
		self._button1.UseVisualStyleBackColor = True
		self._button1.Click += self.Button1Click
		# 
		# Form24
		# 
		self.ClientSize = System.Drawing.Size(250, 85)
		self.MaximizeBox = 0
		self.MinimizeBox = 0
		self.CenterToScreen() 
		self.FormBorderStyle = FormBorderStyle.FixedSingle
		self.Controls.Add(self._spr_top)
		self.Controls.Add(self._txtBlock2)
		self.Controls.Add(self._button1)
		self.Controls.Add(self._progressBar)
		self.Name = "Joining Elements..."
		self.Text = "Joining Elements..."
		iconFilename = 'C:\\NONICAPRO\\OtherFiles\\System\\Nonicafavicon.ICO'
		if not os.path.exists(iconFilename):
			iconFilename = 'C:\\NONICA\\OtherFiles\\System\\Nonicafavicon.ICO'
		icon = Icon(iconFilename)
		self.Icon = icon
		self.ResumeLayout(False)
	def Button1Click(self, sender, e):
		self.interrupt = True
	def closingevent(self, sender, e):
		self.interrupt = True

class Form_Joining(Form):
	def __init__(self, names_cat, categories_to_join, ordered_view_names, ordered_view_ids, join_ev, names_categories_pri, categories_priority, ev_unsubscribe):
		self.Font = Font("Arial", 15, FontStyle.Regular, GraphicsUnit.Pixel)
		self.doc_sub_eve = ev_unsubscribe
		self.selectionhistory = []
		self.selectionhistory2 = []
		self.cat_pri = categories_priority
		self.cat_nam = names_categories_pri
		self.ev_join = join_ev
		self._tableData = DataTable("Data")
		self._tableData.Columns.Add("Key", System.String)
		self._tableData.Columns.Add("Value", System.Object)
		[self._tableData.Rows.Add(key_, value_ ) for key_, value_ in zip(names_cat, categories_to_join)]
		self._tableDataViews = DataTable("Data")
		self._tableDataViews.Columns.Add("Key", System.String)
		self._tableDataViews.Columns.Add("Value", System.Object)
		[self._tableDataViews.Rows.Add(key_, value_ ) for key_, value_ in zip(ordered_view_names, ordered_view_ids)]
		self.InitializeComponent()
	
	def InitializeComponent(self):
		self._spr_top     = System.Windows.Forms.Label()
		self.checkedListBox1 = System.Windows.Forms.CheckedListBox()
		self.label1 = Label()
		self.checkBox1 = CheckBox()
		self.checkedListBox2 = System.Windows.Forms.CheckedListBox()
		self.label2 = Label()
		self.button2 = Button()
		self.button1 = Button()
		self.toolTip1 = System.Windows.Forms.ToolTip()
		self.SuspendLayout()
		# 
		# Separator Top
		# 
		self._spr_top.Anchor     = System.Windows.Forms.AnchorStyles.Top | System.Windows.Forms.AnchorStyles.Left | System.Windows.Forms.AnchorStyles.Right
		self._spr_top.Location   = System.Drawing.Point(0, 0)
		self._spr_top.Name       = "spr_top"
		self._spr_top.Size       = System.Drawing.Size(2000, 2)
		self._spr_top.BackColor  = Color.FromArgb(82, 53, 239)
		# 
		# label1
		# 
		self.label1.AutoSize = True
		self.label1.Location = Point(12, 9)
		self.label1.Name = "label1"
		self.label1.Size = Size(164, 20)
		self.label1.TabIndex = 1
		self.label1.Text = "Views To Join Elements:"
		# 
		# checkedListBox1
		# 
		self.checkedListBox1.Anchor = System.Windows.Forms.AnchorStyles.Top |  System.Windows.Forms.AnchorStyles.Left | System.Windows.Forms.AnchorStyles.Right | System.Windows.Forms.AnchorStyles.Bottom
		self.checkedListBox1.FormattingEnabled = True
		self.checkedListBox1.CheckOnClick = True
		self.checkedListBox1.Location = Point(12, 32)
		self.checkedListBox1.Name = "checkedListBox2"
		self.checkedListBox1.Size = Size(312, 203)
		self.checkedListBox1.TabIndex = 0
		self.checkedListBox1.DataSource = self._tableDataViews
		self.checkedListBox1.DisplayMember = "Key"
		self.checkedListBox1.SelectedIndexChanged += self.changeSelection
		self.checkedListBox1.HorizontalScrollbar = True
		# 
		# checkBox1
		# 
		self.checkBox1.Anchor =  System.Windows.Forms.AnchorStyles.Bottom |  System.Windows.Forms.AnchorStyles.Left
		self.checkBox1.AutoSize = True
		self.checkBox1.Location = Point(12, 233)
		self.checkBox1.Name = "checkBox1"
		self.checkBox1.Size = Size(239, 24)
		self.checkBox1.TabIndex = 2
		self.checkBox1.Text = "Only Join Elements Selected in Revit."
		self.checkBox1.UseVisualStyleBackColor = True
		self.checkBox1.CheckedChanged += self.ClickedOnlySelection
		self.toolTip1.SetToolTip(self.checkBox1, "Check this option to only join the elements you select in Revit.")
		# 
		# checkedListBox2
		# 
		self.checkedListBox2.Anchor = System.Windows.Forms.AnchorStyles.Bottom |  System.Windows.Forms.AnchorStyles.Left |  System.Windows.Forms.AnchorStyles.Right
		self.checkedListBox2.FormattingEnabled = True
		self.checkedListBox2.CheckOnClick = True
		self.checkedListBox2.Location = Point(12, 281)
		self.checkedListBox2.Name = "checkedListBox2"
		self.checkedListBox2.Size = Size(312, 180)
		self.checkedListBox2.TabIndex = 3
		self.checkedListBox2.DataSource = self._tableData
		self.checkedListBox2.DisplayMember = "Key"
		self.checkedListBox2.SelectedIndexChanged += self.changeSelection2
		# 
		# label2
		# 
		self.label2.Anchor = System.Windows.Forms.AnchorStyles.Bottom |  System.Windows.Forms.AnchorStyles.Left
		self.label2.AutoSize = True
		self.label2.Location = Point(12, 258)
		self.label2.Name = "label2"
		self.label2.Size = Size(133, 20)
		self.label2.TabIndex = 4
		self.label2.Text = "Categories To Join:"
		# 
		# button2
		# 
		self.button2.Anchor = System.Windows.Forms.AnchorStyles.Bottom |  System.Windows.Forms.AnchorStyles.Left |  System.Windows.Forms.AnchorStyles.Right
		self.button2.Location = Point(12, 462)
		self.button2.Name = "button2"
		self.button2.Size = Size(272, 29)
		self.button2.TabIndex = 6
		self.button2.Text = "Join Elements!"
		self.button2.UseVisualStyleBackColor = True
		self.button2.Click += self.JoinElements
		# 
		# button1
		# 
		self.button1.Anchor = System.Windows.Forms.AnchorStyles.Bottom |  System.Windows.Forms.AnchorStyles.Right
		self.button1.Location = Point(290, 462)
		self.button1.Name = "button1"
		self.button1.Size = Size(34, 29)
		self.button1.TabIndex = 7
		self.button1.Text = "↑ ↓"
		self.button1.UseVisualStyleBackColor = True
		self.button1.Click += self.openPriorities
		self.toolTip1.SetToolTip(self.button1, "Set up the Joining Order of which category should cut the others.")
		# 
		# Form24
		# 
		self.Load += self.Preselection
		self.TopMost = True
		self.ShowInTaskbar = False
		self.ClientSize = System.Drawing.Size(334, 505)
		self.MaximizeBox = 0
		self.MinimizeBox = 0
		self.CenterToScreen()
		self.FormBorderStyle = FormBorderStyle.Sizable
		self.SizeGripStyle = System.Windows.Forms.SizeGripStyle.Show
		self.Controls.Add(self._spr_top)
		self.Controls.Add(self.button1)
		self.Controls.Add(self.button2)
		self.Controls.Add(self.label2)
		self.Controls.Add(self.checkedListBox2)
		self.Controls.Add(self.checkBox1)
		self.Controls.Add(self.label1)
		self.Controls.Add(self.checkedListBox1)
		self.ShowInTaskbar = True
		self.MaximizeBox = True
		self.MinimizeBox = True   
		self.Closing += self.closingEvent		
		self.Name = "Join In Views"
		self.Text = "Join In Views"
		iconFilename = 'C:\\NONICAPRO\\OtherFiles\\System\\Nonicafavicon.ICO'
		if not os.path.exists(iconFilename):
			iconFilename = 'C:\\NONICA\\OtherFiles\\System\\Nonicafavicon.ICO'
		icon = Icon(iconFilename)
		self.Icon = icon
		self.ResumeLayout(False)
		
	def closingEvent(self, sender, e):
		isActive = 0
		self.doc_sub_eve.Raise()
		
	def JoinElements(self, sender, e):
		if len(self.checkedListBox2.CheckedItems) == 0:
			self.Hide()
			Autodesk.Revit.UI.TaskDialog.Show("Join In Views","Please, select one category to join at least.")
			self.Show()
		if len(self.checkedListBox1.CheckedItems) == 0 and self.checkBox1.Checked == False:
			self.Hide()
			Autodesk.Revit.UI.TaskDialog.Show("Join In Views","Please, select one view to join at least.")
			self.Show()
		else:
			self.ev_join.Raise()
	
	def openPriorities(self, sender, e):
		names, built_cat = extractListsPriorities()
		if len(names) == 0:
			priorityForm = Form_Order(self.cat_nam, self.cat_pri, self.cat_nam, self.cat_pri)
		else:
			priorityForm = Form_Order(names, built_cat, self.cat_nam, self.cat_pri)
		priorityForm.Show()		
	
	def ClickedOnlySelection(self, sender, e):
		if sender.Checked == True:
			self.checkedListBox1.Enabled = False
			self.checkedListBox1.BackColor = Color.LightGray
			self.checkedListBox1.SelectedIndex = -1
		else:
			self.checkedListBox1.Enabled = True
			self.checkedListBox1.BackColor = Color.White
	
	def Preselection(self, sender, e):
		for indx in range(0,6):
			self.checkedListBox2.SetItemCheckState(indx, CheckState.Checked);
			
	def changeSelection(self, sender, e):
		actualcount = len(self.selectionhistory)
		if actualcount > 0:
			if Control.ModifierKeys == Keys.Shift:
				lastindex = self.selectionhistory[0]
				currentIndex = self.checkedListBox1.SelectedIndex
				step = 1
				if currentIndex < lastindex:
					step = -1
				for i in range(lastindex, currentIndex, step):
					if i != lastindex:
						if self.checkedListBox1.GetItemCheckState(i) == CheckState.Checked:
							self.checkedListBox1.SetItemCheckState(i, CheckState.Unchecked);
						else:
							self.checkedListBox1.SetItemCheckState(i, CheckState.Checked);
			self.selectionhistory.Clear()
			self.selectionhistory.Add(self.checkedListBox1.SelectedIndex) 
		else:
			self.selectionhistory.Clear()
			self.selectionhistory.Add(self.checkedListBox1.SelectedIndex) 

	def changeSelection2(self, sender, e):
		actualcount = len(self.selectionhistory2)
		if actualcount > 0:
			if Control.ModifierKeys == Keys.Shift:
				lastindex = self.selectionhistory2[0]
				currentIndex = self.checkedListBox2.SelectedIndex
				step = 1
				if currentIndex < lastindex:
					step = -1
				for i in range(lastindex, currentIndex, step):
					if i != lastindex:
						if self.checkedListBox2.GetItemCheckState(i) == CheckState.Checked:
							self.checkedListBox2.SetItemCheckState(i, CheckState.Unchecked);
						else:
							self.checkedListBox2.SetItemCheckState(i, CheckState.Checked);
			self.selectionhistory2.Clear()
			self.selectionhistory2.Add(self.checkedListBox2.SelectedIndex) 
		else:
			self.selectionhistory2.Clear()
			self.selectionhistory2.Add(self.checkedListBox1.SelectedIndex) 
			
class Form_Order(Form):
	def __init__(self, cate_names, cate_priority, def_names, def_values):
		self.Font = Font("Arial", 15, FontStyle.Regular, GraphicsUnit.Pixel)
		self.cat_nam = cate_names
		self.cat_pri = cate_priority
		self.def_cat_nam = def_names
		self.def_cat_pri = def_values
		self._tableData = DataTable("Data")
		self._tableData.Columns.Add("Key", System.String)
		self._tableData.Columns.Add("Value", System.Object)
		[self._tableData.Rows.Add(key_, value_ ) for key_, value_ in zip(self.cat_nam, self.cat_pri)]
		self.InitializeComponent()
	
	def InitializeComponent(self):
		self._spr_top     = System.Windows.Forms.Label()
		self.listBox1 = System.Windows.Forms.ListBox()
		self.label1 = Label()
		self.label2 = Label()
		self.label3 = Label()
		self.button1 = Button()
		self.button2 = Button()
		self.button3 = Button()
		self.SuspendLayout()
		# 
		# Separator Top
		# 
		self._spr_top.Anchor     = System.Windows.Forms.AnchorStyles.Top | System.Windows.Forms.AnchorStyles.Left | System.Windows.Forms.AnchorStyles.Right
		self._spr_top.Location   = System.Drawing.Point(0, 0)
		self._spr_top.Name       = "spr_top"
		self._spr_top.Size       = System.Drawing.Size(2000, 2)
		self._spr_top.BackColor  = Color.FromArgb(82, 53, 239)
		# 
		# label1
		# 
		self.label1.AutoSize = True
		self.label1.Location = Point(12, 9)
		self.label1.Name = "label1"
		self.label1.Size = Size(164, 20)
		self.label1.TabIndex = 0
		self.label1.Text = "Joining Order:"
		# 
		# label2
		# 
		self.label2.AutoSize = True
		self.label2.Location = Point(12, 34)
		self.label2.Name = "label2"
		self.label2.Size = Size(164, 20)
		self.label2.TabIndex = 1
		self.label2.Text = "(Higher position, Higher cut priority)."
		# 
		# ListBox1
		# 
		self.listBox1.Anchor = System.Windows.Forms.AnchorStyles.Top | System.Windows.Forms.AnchorStyles.Left | System.Windows.Forms.AnchorStyles.Right | System.Windows.Forms.AnchorStyles.Bottom
		self.listBox1.FormattingEnabled = True
		self.listBox1.Location = Point(12, 59)
		self.listBox1.Name = "ListBox1"
		self.listBox1.Size = Size(270, 150)
		self.listBox1.TabIndex = 2
		self.listBox1.DataSource = self._tableData
		self.listBox1.DisplayMember = "Key"
		self.listBox1.HorizontalScrollbar = True
		# 
		# label3
		# 
		self.label3.AutoSize = True
		self.label3.Location = Point(12, 205)
		self.label3.Name = "label3"
		self.label3.Size = Size(164, 20)
		self.label3.TabIndex = 1
		self.label3.Text = "This configuration is Auto-Saved."
		# 
		# button1 Default
		# 
		self.button1.Anchor = System.Windows.Forms.AnchorStyles.Bottom |  System.Windows.Forms.AnchorStyles.Right
		self.button1.Location = Point(12, 230)
		self.button1.Name = "button1"
		self.button1.Size = Size(90, 29)
		self.button1.TabIndex = 3
		self.button1.Text = "Default"
		self.button1.UseVisualStyleBackColor = True
		self.button1.Click += self.defaultSettings
		# 
		# button2 Move Down
		# 
		self.button2.Anchor = System.Windows.Forms.AnchorStyles.Bottom |  System.Windows.Forms.AnchorStyles.Right
		self.button2.Location = Point(102, 230)
		self.button2.Name = "button1"
		self.button2.Size = Size(90, 29)
		self.button2.TabIndex = 3
		self.button2.Text = "↓ Down"
		self.button2.UseVisualStyleBackColor = True
		self.button2.Click += self.moveDown
		# 
		# button3 Move Up
		# 
		self.button3.Anchor = System.Windows.Forms.AnchorStyles.Bottom |  System.Windows.Forms.AnchorStyles.Right
		self.button3.Location = Point(192, 230)
		self.button3.Name = "button1"
		self.button3.Size = Size(90, 29)
		self.button3.TabIndex = 3
		self.button3.Text = "↑ Up"
		self.button3.UseVisualStyleBackColor = True
		self.button3.Click += self.moveUp
		# 
		# Form24
		# 
		self.TopMost = True
		self.ShowInTaskbar = False
		self.ClientSize = System.Drawing.Size(294, 270)
		self.MaximizeBox = 0
		self.MinimizeBox = 0
		self.CenterToScreen()
		self.FormBorderStyle = FormBorderStyle.FixedSingle
		self.SizeGripStyle = System.Windows.Forms.SizeGripStyle.Show
		self.Controls.Add(self._spr_top)
		self.Controls.Add(self.label1)
		self.Controls.Add(self.label2)
		self.Controls.Add(self.label3)
		self.Controls.Add(self.listBox1)
		self.Controls.Add(self.button1)
		self.Controls.Add(self.button2)
		self.Controls.Add(self.button3)
		self.ShowInTaskbar = True
		self.MaximizeBox = False
		self.MinimizeBox = False            
		self.Name = "Joining Order"
		self.Text = "Joining Order"
		iconFilename = 'C:\\NONICAPRO\\OtherFiles\\System\\Nonicafavicon.ICO'
		if not os.path.exists(iconFilename):
			iconFilename = 'C:\\NONICA\\OtherFiles\\System\\Nonicafavicon.ICO'
		icon = Icon(iconFilename)
		self.Icon = icon
		self.ResumeLayout(False)
	
	def moveDown(self, sender, e):
		num_items = len(self.listBox1.Items)
		sel_indx = self.listBox1.SelectedIndex
		if sel_indx < (num_items - 1):
			selected = self._tableData.Rows[sel_indx]
			key_sel = selected['Key']
			val_sel = selected['Value']
			dr = self._tableData.NewRow()
			dr['Key'] = key_sel
			dr['Value'] = val_sel
			self._tableData.Rows.RemoveAt(sel_indx)
			self._tableData.Rows.InsertAt(dr, sel_indx + 1)
			self.listBox1.SetSelected(sel_indx + 1, True)
			self.saveToFile()
			
	def moveUp(self, sender, e):
		sel_indx = self.listBox1.SelectedIndex
		if sel_indx > 0:
			selected = self._tableData.Rows[sel_indx]
			key_sel = selected['Key']
			val_sel = selected['Value']
			dr = self._tableData.NewRow()
			dr['Key'] = key_sel
			dr['Value'] = val_sel
			self._tableData.Rows.RemoveAt(sel_indx)
			self._tableData.Rows.InsertAt(dr, sel_indx - 1)
			self.listBox1.SetSelected(sel_indx - 1, True)
			self.saveToFile()
	
	def defaultSettings(self, sender, e):
		self._tableData = DataTable("Data")
		self._tableData.Columns.Add("Key", System.String)
		self._tableData.Columns.Add("Value", System.Object)
		[self._tableData.Rows.Add(key_, value_ ) for key_, value_ in zip(self.def_cat_nam, self.def_cat_pri)]
		self.listBox1.DataSource = self._tableData
		self.saveToFile()
		
	def saveToFile(self):
		try:
			with open(dir_path + "/" + "settingsJoinElementsNonica.txt","w") as file:
				for rw in self._tableData.Rows:
					file.write(str(rw['Value'])+"\n")
					#file.write(str(int(rw['Value']))+"\n")
		except Exception as e:
			pass
	
def getDocumentsFolder():
    dll = ctypes.windll.shell32
    buf = ctypes.create_unicode_buffer(MAX_PATH + 1)
    if dll.SHGetSpecialFolderPathW(None, buf, 0x0005, False):
        return buf.value
    else:
        return 0   
	        
def loadFromFile():
	#Default value
	categories = []
	try:
		with open(dir_path + "/" + "settingsJoinElementsNonica.txt","r") as file:
			all_lines = file.readlines()
			for line_txt in all_lines:
				categories.Add(line_txt.strip())
		return categories
	except Exception as e:
		return []

def extractListsPriorities():
	list_pri = loadFromFile()
	if len(list_pri) != 0:
		names = []
		builtin = []
		for pri in list_pri:
			builtin.Add(getattr(BuiltInCategory, pri))
			names.Add(dict_cat[pri])
		return names, builtin
	else:
		return [],[]

def OnViewActivated(sender, e):
	new_docView = e.CurrentActiveView.Document
	if new_docView:
		new_uiapp = new_docView.Application
		if isActive == 1:
			if objForm:
				if not new_docView.Equals(doc):
					objForm.Close()
				else:
					return

def OnFailuresProcessing(sender, e):
	try:
		a = e.GetFailuresAccessor()
		failures = a.GetFailureMessages()
		for f in failures:
			try:
				failID = f.GetFailureDefinitionId()
				if failID == BuiltInFailures.JoinElementsFailures.JoiningDisjointWarn or failID == BuiltInFailures.JoinElementsFailures.JoiningDisjoint or str(failID.Guid) == "1b9dacf3-db22-45d5-b071-42516278ffb1" or failID == BuiltInFailures.CutFailures.CannotCutJoinedElement:
					a.ResolveFailures(failures)
					e.SetProcessingResult(FailureProcessingResult.ProceedWithCommit)
			except:
				pass
		return e.SetProcessingResult(FailureProcessingResult.Continue)
	except Exception as exc:
		pass


uiapp = DocumentManager.Instance.CurrentUIApplication.Application
global doc
doc = DocumentManager.Instance.CurrentDBDocument
uidoc = DocumentManager.Instance.CurrentUIApplication.ActiveUIDocument
app = doc.Application
global dir_path
dir_path = getDocumentsFolder()

#Protect against change of document
isActive = 1
new_sub = System.EventHandler[Autodesk.Revit.UI.Events.ViewActivatedEventArgs](OnViewActivated)
DocumentManager.Instance.CurrentUIApplication.ViewActivated += new_sub
event_handler_doc = UnsubcribeDocChange()
ext_event_doc = ExternalEvent.Create(event_handler_doc)

#FailuresProcessing
global failureProc
failureProc = System.EventHandler[Autodesk.Revit.DB.Events.FailuresProcessingEventArgs](OnFailuresProcessing)

#Categories to join order
categories_priority = [
BuiltInCategory.OST_StructuralFoundation,
BuiltInCategory.OST_StructuralColumns,
BuiltInCategory.OST_Columns,
BuiltInCategory.OST_Walls,
BuiltInCategory.OST_Floors,
BuiltInCategory.OST_StructuralFraming,
BuiltInCategory.OST_Ceilings,
BuiltInCategory.OST_Roofs]

names_categories_pri = [
"↕ Structural Foundation",
"↕ Structural Columns",
"↕ Architectural Columns",
"↕ Walls",
"↕ Floors",
"↕ Structural Framing",
"↕ Ceilings",
"↕ Roofs"]

global dict_cat
dict_cat={}
for cat_name, cat_built in zip(names_categories_pri, categories_priority):
	dict_cat[cat_built.ToString()] = cat_name

#Categories to select
categories_to_join = [
BuiltInCategory.OST_Columns,
BuiltInCategory.OST_Floors,
BuiltInCategory.OST_StructuralColumns,
BuiltInCategory.OST_StructuralFoundation,
BuiltInCategory.OST_StructuralFraming,
BuiltInCategory.OST_Walls,
BuiltInCategory.OST_Ceilings,
BuiltInCategory.OST_Roofs]

names_categories = [
"Architectural Columns",
"Floors",
"Structural Columns",
"Structural Foundation",
"Structural Framing",
"Walls",
"Ceilings",
"Roofs"]

#Get all views and order them
collector = FilteredElementCollector(doc).OfCategory(BuiltInCategory.OST_Views).ToElements()
view_ids = []
view_names = []
for view in collector:
	if view and not view.IsTemplate and view.ViewType != ViewType.Legend and view.ViewType != ViewType.Rendering and view.ViewType != ViewType.DraftingView:
		view_names.Add(view.Title)
		view_ids.Add(view.Id)
zip_names_ids = zip(view_names, view_ids)
zip_ordered = sorted(zip_names_ids, key = lambda x: x[0])
ordered_view_names = [x[0] for x in zip_ordered]
ordered_view_ids = [x[1] for x in zip_ordered]

event_handler_joinEle = joinElements(categories_priority)
ext_event_join = ExternalEvent.Create(event_handler_joinEle)

objForm = Form_Joining(names_categories, categories_to_join, ordered_view_names, ordered_view_ids, ext_event_join, names_categories_pri, categories_priority, ext_event_doc)
objForm.Show()

OUT = 0

"""
License Agreement
For the use of this script
This License Agreement (this “Agreement” of this “License Agreement”) is made and effective as of the current date (the “Commencement Date”) by and between Nonica by Estudio Alonso Candau SLP a company organized and existing in Spain with a registered address at Avd.Chafarinas 16 Puerto Rey Vera, Almeria (“Licensor”) and yourself (“Licensee”).
WHEREAS:
1.    Licensee wishes to obtain access and use this script (hereinafter, the “Asset”), and
2.    Licensor is willing to grant to the Licensee a non-exclusive, non-transferable License to use the Asset for the term and specific purpose set forth in this Agreement,
NOW, THEREFORE, your access to and use of the Service is conditioned on your acceptance of and compliance with these Terms and Conditions. These Terms and Conditions apply to all visitors, users and others who access or use this script.
1. Definitions
1.1 “Agreement” means this License Agreement including the attached Schedule.
1.2 “Confidential Information” means information that:
a. is by its nature confidential;
b. is designated in writing by Licensor as confidential;
c. the Licensee knows or reasonably ought to know is confidential;
d. Information comprised in or relating to any Intellectual Property Rights of Licensor.
1.3 “Asset” means the Asset provided by Licensor as specified in Item 6 of the Schedule in the form as stated in Item 7 of the Schedule.
1.4 “Intellectual Property Rights” means all rights in and to any copyright, trademark, trading name, design, patent, know how (trade secrets) and all other rights resulting from intellectual activity in the industrial, scientific, literary or artistic field and any application or right to apply for registration of any of these rights and any right to protect or enforce any of these rights, as further specified in clause 5.
1.5 “Party” means a person or business entity who has executed this Agreement; details of the Parties are specified in Item 2 of the Schedule.
1.6 “Term” means the term of this Agreement commencing on the Commencement Date as specified in Item 4 of the Schedule and expiring on the Expiry Date specified in Item 5 of the Schedule.
2. License Grant
2.1 Licensor grants to the Licensee a non-exclusive, non-transferable License for the Term to use the Asset for the specific purpose specified in this Agreement, subject to the terms and conditions set out in this Agreement.
3. Charges
3.1 In consideration of the Licensor providing the License under clause 2 of this License Agreement, the Licensee agrees to pay Licensor the amount of the License Charge as specified in Item 9 of the Schedule.
4. Licensee’s Obligations
4.1 The Licensee cannot use the Asset, for purposes other than as specified in this Agreement and in Item 8 of the Schedule.
4.2 The Licensee may permit its employees to use the Asset for the purposes described in Item 8, provided that the Licensee takes all necessary steps and imposes the necessary conditions to ensure that all employees using the Asset do not commercialise or disclose the contents of it to any third person, or use it other than in accordance with the terms of this Agreement.
4.3 The Licensee will not distribute, sell, License or sub-License, let, trade or expose for sale the Asset to a third party.
4.4 No copies of the Asset are to be made other than as expressly approved by Licensor.
4.5 No changes to the Asset or its content may be made by Licensee.
4.6 The Licensee will provide technological and security measures to ensure that the Asset which the Licensee is responsible for is physically and electronically secure from unauthorised use or access.
4.7 Licensee shall ensure that the Asset retains all Licensor copyright notices and other proprietary legends and all trademarks or service marks of Licensor.
5. Intellectual Property Rights
5.1 All Intellectual Property Rights over and in respect of the Asset are owned by Licensor. The Licensee does not acquire any rights of ownership in the Asset.
6. Limitation of Liability
6.1 The Licensee acknowledges and agrees that neither Licensor nor its board members, officers, employees or agents, will be liable for any loss or damage arising out of or resulting from Licensor’s provision of the Asset under this Agreement, or any use of the Asset by the Licensee or its employees; and Licensee hereby releases Licensor to the fullest extent from any such liability, loss, damage or claim.
7. Confidentiality
7.1 Neither Party may use, disclose or make available to any third party the other Party’s Confidential Information, unless such use or disclosure is done in accordance with the terms of this Agreement.
7.2 Each Party must hold the other Party’s Confidential Information secure and in confidence, except to the extent that such Confidential Information:
a. is required to be disclosed according to the requirements of any law, judicial or legislative body or government agency; or
b. was approved for release in writing by the other Party, but only to the extent of and subject to such conditions as may be imposed in such written authorisation.
7.3 This clause 7 will survive termination of this Agreement.
8. Disclaimers & Release
8.1 To the extent permitted by law, Licensor will in no way be liable to the Licensee or any third party for any loss or damage, however caused (including through negligence) which may be directly or indirectly suffered in connection with any use of the Asset.
8.2 The Asset is provided by Licensor on an “as is” basis.
8.3 Licensor will not be held liable by the Licensee in any way, for any loss, damage or injury suffered by the Licensee or by any other person related to any use of the Asset or any part thereof.
8.4 Notwithstanding anything contained in this Agreement, in no event shall Licensor be liable for any claims, damages or loss which may arise from the modification, combination, operation or use of the Asset with Licensee computer programs.
8.5 Licensor does not warrant that the Asset will function in any environment.
8.6 The Licensee acknowledges that: a. The Asset has not been prepared to meet any specific requirements of any party, including any requirements of Licensee; and b. it is therefore the responsibility of the Licensee to ensure that the Asset meets its own individual requirements.
8.7 To the extent permitted by law, no express or implied warranty, term, condition or undertaking is given or assumed by Licensor, including any implied warranty of merchantability or fitness for a particular purpose.
9. Indemnification
9.1 The Licensee must indemnify, defend and hold harmless Licensor, its board members, officers, employees and agents from and against any and all claims (including third party claims), demands, actions, suits, expenses (including attorney’s fees) and damages (including indirect or consequential loss) resulting in any way from:
a. Licensee’s and Licensee’s employee’s use or reliance on the Asset,
b. any breach of the terms of this License Agreement by the Licensee or any Licensee employee, and
c. any other act of Licensee.
9.2 This clause 9 will survive termination of this Agreement.
10. Waiver
10.1 Any failure or delay by either Party to exercise any right, power or privilege hereunder or to insist upon observance or performance by the other of the provisions of this License Agreement shall not operate or be construed as a waiver thereof.
11. Governing Law
11.1 This Agreement will be construed by and governed in accordance with the laws of Spain. The Parties submit to exclusive jurisdiction of the courts of Spain.
12. Termination
12.1 This Agreement and the License granted herein commences upon the Commencement Date and is granted for the Term, unless otherwise terminated by Licensor in the event of any of the following:
a. if the Licensee is in breach of any term of this License Agreement and has not corrected such breach to Licensor’s reasonable satisfaction within 7 days of Licensor’s notice of the same;
b. if the Licensee becomes insolvent, or institutes (or there is instituted against it) proceedings in bankruptcy, insolvency, reorganization or dissolution, or makes an assignment for the benefit of creditors; or
c. the Licensee is in breach of clause 5 or 7 of this Agreement.
12.2 Termination under this clause shall not affect any other rights or remedies Licensor may have.
14. Assignment
14.1 Licensee shall not assign any rights of this License Agreement, without the prior written consent of Licensor.
15. Notices
15.1 All notices required under this Agreement shall be in writing and shall be deemed given (i) when delivered personally; (ii) five (5) days after mailing, when sent certified mail, return receipt requested and postage prepaid; or (iii) one (1) business day after dispatch, when sent via a commercial overnight carrier, fees prepaid. All notices given by either Party must be sent to the address of the other as first written above (unless otherwise changed by written notice).
16. Counterparts
16.1 This Agreement may be executed in any number of counterparts, each of which shall be deemed to be an original and all of which taken together shall constitute one instrument.
17. Severability
17.1 The Parties recognize the uncertainty of the law with respect to certain provisions of this Agreement and expressly stipulate that this Agreement will be construed in a manner that renders its provisions valid and enforceable to the maximum extent possible under applicable law. To the extent that any provisions of this Agreement are determined by a court of competent jurisdiction to be invalid or unenforceable, such provisions will be deleted from this Agreement or modified so as to make them enforceable and the validity and enforceability of the remainder of such provisions and of this Agreement will be unaffected.
18. Entire Agreement
18.1 This Agreement contains the entire agreement between the Parties and supersedes any previous understanding, commitments or agreements, oral or written. Further, this Agreement may not be modified, changed, or otherwise altered in any respect except by a written agreement signed by both Parties.
IN WITNESS WHEREOF, this Agreement, including the attached Schedule, was signed by the Parties under the hands of their duly authorized representatives and made effective as of the current date.
Nonica by Estudio Alonso Candau SLP,
Signature
02/05/2021
Jaime Alonso Candau
Please contact hello@nonica.io with any further doubt/request.
Your signatureby using and accessing this script.
Signed by accepting these terms.
Current date.

"""
# ----------------------------------------
