# Dynamo graph Extended To 3D View.dyn "ExtendedTo 3D View" (Dynamo 2.6.2.15705)

default_extra_size_in_feet = DoubleInput(0.5)
extended = Python(IN[0]=default_extra_size_in_feet)
# ---------- extended.python (497 lines) ----------
import sys
import clr
import math
import System
from System import Array
from System.Collections.Generic import *

clr.AddReference('ProtoGeometry')
from Autodesk.DesignScript.Geometry import *

clr.AddReference("RevitAPIUI")
import Autodesk 
from Autodesk.Revit.UI import *

import os.path

clr.AddReference("RevitServices")
import RevitServices		
from RevitServices.Persistence import DocumentManager 
from RevitServices.Transactions import TransactionManager 

clr.AddReference("RevitAPI")
import Autodesk 
from Autodesk.Revit.DB import *

from System.Collections.Generic import List

clr.AddReference('System.Drawing')
clr.AddReference('System.Windows.Forms')
import System.Drawing
import System.Windows.Forms

from System.Drawing import *
from System.Reflection import Assembly
from System.Windows.Forms import *

clr.AddReference('System.Data')
from System.Data import *

clr.AddReference("System.Core")
import System.Linq
clr.ImportExtensions(System.Linq)

class Form24(Form):
	def __init__(self, lstDdwnames, lstDdwids):
		self.Font = Font(self.Font.FontFamily, 16, FontStyle.Regular, GraphicsUnit.Pixel)
		self.autoName = "Create New 3D View"
		lstDdwnames.Add(self.autoName)
		lstDdwids.Add(self.autoName)
		self.listNames = lstDdwnames
		self._tableData = DataTable("Data")
		self._tableData.Columns.Add("Key", System.String)
		self._tableData.Columns.Add("Value", System.Object)
		[self._tableData.Rows.Add(key_, value_ ) for key_, value_ in zip(lstDdwnames, lstDdwids)]
		self.out = []
		self.InitializeComponent()
	
	def InitializeComponent(self):
		self._spr_top     = System.Windows.Forms.Label()
		self._comboBox1 = System.Windows.Forms.ComboBox()
		self._checkBoxSelect = System.Windows.Forms.CheckBox()
		self._button1 = System.Windows.Forms.Button()
		self._txtBlock2 = System.Windows.Forms.Label()
		self._txtBlock3 = System.Windows.Forms.Label()
		self._textBox1 = System.Windows.Forms.NumericUpDown()
		self.SuspendLayout()
		# 
		# Separator Top
		# 
		self._spr_top.Anchor     = System.Windows.Forms.AnchorStyles.Top | System.Windows.Forms.AnchorStyles.Left | System.Windows.Forms.AnchorStyles.Right
		self._spr_top.Location   = System.Drawing.Point(0, 0)
		self._spr_top.Name       = "spr_top"
		self._spr_top.Size       = System.Drawing.Size(2000, 2)
		self._spr_top.BackColor  = Color.FromArgb(82, 53, 239)
		# 
		# checkedListBox1
		# 
		self._comboBox1.Anchor = System.Windows.Forms.AnchorStyles.Top |  System.Windows.Forms.AnchorStyles.Left | System.Windows.Forms.AnchorStyles.Bottom | System.Windows.Forms.AnchorStyles.Right
		self._comboBox1.FormattingEnabled = True
		self._comboBox1.Location = System.Drawing.Point(225, 12)
		self._comboBox1.Name = "comboBox1"
		self._comboBox1.DataSource = self._tableData 
		self._comboBox1.DisplayMember = "Key"
		self._comboBox1.Size = System.Drawing.Size(175, 244)
		self._comboBox1.TabIndex = 0
		self._comboBox1.DropDownStyle = ComboBoxStyle.DropDownList
		width = 195
		for item in self.listNames:
			temp = TextRenderer.MeasureText(item, self.Font).Width
			if width < temp:
				width = temp
		self._comboBox1.DropDownWidth = width
		# 
		# textBox1
		# 
		self._textBox1.Anchor = System.Windows.Forms.AnchorStyles.Top |  System.Windows.Forms.AnchorStyles.Left | System.Windows.Forms.AnchorStyles.Bottom | System.Windows.Forms.AnchorStyles.Right
		self._textBox1.Location = System.Drawing.Point(225, 47)
		self._textBox1.Name = "textBox1"
		self._textBox1.Size = System.Drawing.Size(175, 244)
		self._textBox1.DecimalPlaces = 2
		self._textBox1.TabIndex = 0
		self._textBox1.Value = IN[0]
		self._textBox1.Increment = IN[0]
		self._textBox1.Maximum = 999999999
		# 
		# checkBoxSelectAll
		# 
		self._checkBoxSelect.Anchor = System.Windows.Forms.AnchorStyles.Bottom | System.Windows.Forms.AnchorStyles.Left
		self._checkBoxSelect.Location = System.Drawing.Point(14, 80)
		self._checkBoxSelect.Name = "checkBoxSelectAll"
		self._checkBoxSelect.Size = System.Drawing.Size(395,24)
		self._checkBoxSelect.TabIndex = 1
		self._checkBoxSelect.Text = "Add 3D view to side. Closes any other open view!"
		self._checkBoxSelect.UseVisualStyleBackColor = True
		# 
		# button1
		# 
		self._button1.Anchor = System.Windows.Forms.AnchorStyles.Bottom | System.Windows.Forms.AnchorStyles.Right
		self._button1.Location = System.Drawing.Point(12, 110)
		self._button1.Name = "button1"
		self._button1.Size = System.Drawing.Size(388, 27)
		self._button1.TabIndex = 2
		self._button1.Text = "Create Section Box in 3D View"
		self._button1.UseVisualStyleBackColor = True
		self._button1.Click += self.Button1Click
		# 
		# TextBlock2
		# 
		self._txtBlock2.Anchor = System.Windows.Forms.AnchorStyles.Top | System.Windows.Forms.AnchorStyles.Left
		self._txtBlock2.Location = System.Drawing.Point(12, 15)
		self._txtBlock2.Name = "txtBlock2"
		self._txtBlock2.Size = System.Drawing.Size(200, 20)
		self._txtBlock2.TabIndex = 1
		self._txtBlock2.Text = "Select 3D View:"
		# 
		# TextBlock3
		# 
		self._txtBlock3.Anchor = System.Windows.Forms.AnchorStyles.Top | System.Windows.Forms.AnchorStyles.Left
		self._txtBlock3.Location = System.Drawing.Point(12, 50)
		self._txtBlock3.Name = "txtBlock3"
		self._txtBlock3.Size = System.Drawing.Size(210, 20)
		self._txtBlock3.TabIndex = 1
		self._txtBlock3.Text = "Extra Size Section Box (ft):"
		# 
		# Form24
		# 
		self.ClientSize = System.Drawing.Size(415, 150)
		self.CenterToScreen() 
		self.FormBorderStyle = FormBorderStyle.FixedDialog
		self.MaximizeBox = False
		self.MinimizeBox = False
		self.Controls.Add(self._spr_top)
		self.Controls.Add(self._button1)
		self.Controls.Add(self._checkBoxSelect)
		self.Controls.Add(self._comboBox1)
		self.Controls.Add(self._textBox1)
		self.Controls.Add(self._txtBlock2)
		self.Controls.Add(self._txtBlock3)
		self.Name = "To 3D View Extended"
		self.Text = "To 3D View Extended"
		iconFilename = 'C:\\NONICAPRO\\OtherFiles\\System\\Nonicafavicon.ICO'
		if not os.path.exists(iconFilename):
			iconFilename = 'C:\\NONICA\\OtherFiles\\System\\Nonicafavicon.ICO'
		icon = Icon(iconFilename)
		self.Icon = icon
		self.ResumeLayout(False)		
			
	def Button1Click(self, sender, e):
		try:
			if self._comboBox1.Text != self.autoName:
				sel_item = self._comboBox1.SelectedItem['Value']
			else:
				sel_item = -1
			self.sel_cmb = sel_item
			self.extra_size = self._textBox1.Value
			self.add_to_side = self._checkBoxSelect.CheckState
			self.DialogResult = DialogResult.Yes
			self.Close()
		except:
			pass

def pickobject():
	from Autodesk.Revit.UI.Selection import ObjectType
	picked = uidoc.Selection.PickObjects(ObjectType.Element)
	return picked

def isclose(a, b, rel_tol=1e-09, abs_tol=0.0):
	return abs(a-b) <= max(rel_tol * max(abs(a), abs(b)), abs_tol)

def compareXYZ(firstpoint, secondpoint):
	if isclose(firstpoint.X, secondpoint.X) and isclose(firstpoint.Y, secondpoint.Y) and isclose(firstpoint.Z, secondpoint.Z):
		return 1
	else:
		return 0

extra_size=IN[0]
doc = DocumentManager.Instance.CurrentDBDocument
app = doc.Application
uiapp = DocumentManager.Instance.CurrentUIApplication
uidoc = uiapp.ActiveUIDocument

picked_obj = List[ElementId]()
if uidoc.Selection.GetElementIds().Count == 0:
	#Nothing selected, let the user select
	try:
		picked_obj = pickobject()
	except:
		pass
else:
	picked_obj = uidoc.Selection.GetElementIds()
	
if picked_obj.Count == 0:
	#Indicate user, no element has been selected
	task2 = Autodesk.Revit.UI.TaskDialog("To 3D View Extended")
	task2.MainInstruction = "No elements were selected. Please, select them before or after running."
	task2.Show()
else:
	#Get all 3dviews and ids
	all_3dviews = FilteredElementCollector(doc).OfClass(View3D).ToElements()
	list_names =[]
	list_ids=[]
	for view in all_3dviews:
		if view.IsTemplate == False:
			list_names.append(view.Title)
			list_ids.append(view.Id)
	zipeo = zip(list_names,list_ids)
	zipeo = sorted(zipeo, key = lambda x: x[0])
	list_names = [x for x,y in zipeo]
	list_ids = [y for x,y in zipeo]
	#Create window
	objForm = Form24(list_names, list_ids)
	result_win = objForm.ShowDialog()
	if result_win == DialogResult.Cancel:
		OUT=0
	else:
		#To 3d view
		old_activeView = doc.ActiveView
		#Get values from window
		if objForm.sel_cmb != -1:
			default_threeD_view = doc.GetElement(objForm.sel_cmb)
		else:
			defaultname = "Default 3D View with SectionBox"
			counter = 0
			while True:
				views_model = [x for x in FilteredElementCollector(doc).OfClass(Autodesk.Revit.DB.View).ToElements() if x.ViewType == ViewType.ThreeD and x.Name == defaultname]
				if len(views_model) == 0:
					break
				else:
					counter+=1
					defaultname = "Default 3D View with SectionBox(" + str(counter) + ")"
			#TransactionManager.Instance.EnsureInTransaction(doc)
			with Transaction(doc, "To 3D View: Create View") as t:
				t.Start()
				default_threeD_view = View3D.CreateIsometric(doc, doc.GetDefaultElementTypeId(ElementTypeGroup.ViewType3D))
				default_threeD_view.Name = defaultname
				t.Commit()
			#TransactionManager.Instance.TransactionTaskDone()
		#TransactionManager.Instance.ForceCloseTransaction();
		uidoc.RequestViewChange(default_threeD_view)
		#Hide current section box
		#TransactionManager.Instance.EnsureInTransaction(doc)
		with Transaction(doc, "To 3D View: Prepare View") as t:
			t.Start()
			default_threeD_view.IsSectionBoxActive = False	
			t.Commit()
		#TransactionManager.Instance.TransactionTaskDone()
		Max_XList = []
		Min_XList = []
		Max_YList = []
		Min_YList = []
		Max_ZList = []
		Min_ZList = []
		list_ele = List[ElementId]()
		eleSet = ElementSet()
		for obj in picked_obj:
			elem = doc.GetElement(obj)
			list_ele.Add(elem.Id)
			eleSet.Insert(elem)
			try:
				bbox = elem.get_BoundingBox(default_threeD_view)
				Max_XList.append(bbox.Max.X)
				Min_XList.append(bbox.Min.X)
				Max_YList.append(bbox.Max.Y)
				Min_YList.append(bbox.Min.Y)
				Max_ZList.append(bbox.Max.Z)
				Min_ZList.append(bbox.Min.Z)
			except:
				pass
		extra_size = objForm.extra_size
		box_created=0
		#Get max and min coord
		try:
			X_Max = max(Max_XList)
			X_Min = min(Min_XList)
			Y_Max = max(Max_YList)
			Y_Min = min(Min_YList)
			Z_Max = max(Max_ZList)
			Z_Min = min(Min_ZList)
			max_coord = XYZ(X_Max+extra_size, Y_Max+extra_size, Z_Max+extra_size)
			min_coord = XYZ(X_Min-extra_size, Y_Min-extra_size, Z_Min-extra_size)
			for elemento_id in list_ele:
				elemento = doc.GetElement(elemento_id)
				if elemento.Category != None:
					if elemento.Category.Id == ElementId(BuiltInCategory.OST_VolumeOfInterest):
						bbox = elemento.get_BoundingBox(None)
						if isclose(bbox.Max.X, X_Max) ==1 and isclose(bbox.Max.Y, Y_Max) ==1 and isclose(bbox.Max.Z, Z_Max) ==1 and isclose(bbox.Min.X, X_Min) ==1 and isclose(bbox.Min.Y, Y_Min) ==1 and isclose(bbox.Min.Z, Z_Min) ==1:
							#Scope Box is larger element, check if rotated
							#Scope box geometry					
							opt = app.Create.NewGeometryOptions()
							geo = elemento.get_Geometry(opt)
							list_all_points = []
							list_lower_points = []
							#Find z
							max_z = bbox.Max.Z
							min_z = bbox.Min.Z
							normal_vectors = []
							ortho_box=0
							#Find 8 points of scope and lower face points
							for obj in geo:
								p=obj.GetEndPoint(0)
								q=obj.GetEndPoint(1)
								if not obj.Direction.IsAlmostEqualTo(XYZ(0,0,-1)) and not obj.Direction.IsAlmostEqualTo(XYZ(0,0,1)):
									normal_vectors.Add(obj.Direction)
									if obj.Direction.IsAlmostEqualTo(XYZ(0,-1,0)) or obj.Direction.IsAlmostEqualTo(XYZ(0,1,0)) or obj.Direction.IsAlmostEqualTo(XYZ(-1,0,0)) or obj.Direction.IsAlmostEqualTo(XYZ(1,0,0)):
										ortho_box=1
								checker_initial = 0
								checker_end = 0
								for other_point in list_all_points:
									if compareXYZ(p, other_point)==1:
										checker_initial=1
									if compareXYZ(q, other_point)==1:
										checker_end=1
								if checker_initial==0:
									list_all_points.append(p)
									if isclose(p.Z, min_z):
										list_lower_points.append(p)
								if checker_end==0:
									list_all_points.append(q)
									if isclose(q.Z, min_z):
										list_lower_points.append(q)
							#Find size of box
							#Get edge sizes
							for point in list_lower_points:
								if isclose(point.X, X_Min)==1:
									punto1=point
								if isclose(point.Y, Y_Min)==1:
									punto2=point
								if isclose(point.X, X_Max)==1:
									punto3=point
							edge1=punto2.DistanceTo(punto1)
							edge2=punto2.DistanceTo(punto3)
							#Find angle
							axis_y = XYZ(0,1,0)
							vector = punto3-punto2
							angle_to_rotate = axis_y.AngleTo(vector)
							#Check box is not orthogonal
							if ortho_box==1:
								myBox = BoundingBoxXYZ()
								myBox.Min = min_coord
								myBox.Max = max_coord
								box_created=1
							else:
								myBox = BoundingBoxXYZ()
								myBox.Min = XYZ(punto2.X-edge1-extra_size-extra_size, Y_Min, Z_Min)
								myBox.Max = XYZ(punto2.X, punto2.Y+edge2+extra_size+extra_size, Z_Max+extra_size+extra_size)
								axis_z = XYZ(0,0,1)
								rotate = Transform.CreateRotationAtPoint(axis_z, -angle_to_rotate, punto2)
								myBox.Transform = myBox.Transform.Multiply(rotate)
								box_created=1
								#Center axisX
								vectorX = (punto2-punto1).Normalize() * extra_size
								transx =Transform.CreateTranslation(vectorX)
								myBox.Transform = myBox.Transform.Multiply(transx)
								#Center axisY
								vectorY = (punto2-punto3).Normalize() * extra_size
								transY =Transform.CreateTranslation(vectorY)
								myBox.Transform = myBox.Transform.Multiply(transY)
								#Center axisZ
								vectorZ = XYZ(0,0,-1) * extra_size
								transZ =Transform.CreateTranslation(vectorZ)
								myBox.Transform = myBox.Transform.Multiply(transZ)
			if box_created==0:
				myBox = BoundingBoxXYZ()
				myBox.Min = min_coord
				myBox.Max = max_coord	
			#AsignasBoundingBox
			#TransactionManager.Instance.EnsureInTransaction(doc)
			with Transaction(doc, "To 3D View Extended") as t:
				t.Start()
				default_threeD_view.SetSectionBox(myBox)
				t.Commit()
				#TransactionManager.Instance.TransactionTaskDone()
			uidoc.ShowElements(eleSet)
			uidoc.Selection.SetElementIds(list_ele)
			#Side by side
			if objForm.add_to_side == CheckState.Checked:
				#Close all other Windows but current and 3D
				for openVw in uidoc.GetOpenUIViews():
					view=doc.GetElement(openVw.ViewId)
					if str(openVw.ViewId) != str(default_threeD_view.Id) and str(openVw.ViewId) != str(old_activeView.Id):
						openVw.Close()				
				#Call side by side postcommand
				commandId = RevitCommandId.LookupPostableCommandId(PostableCommand.TileViews)
				if uiapp.CanPostCommand(commandId):
					uiapp.PostCommand(commandId)
		except Exception as e:
			task2 = Autodesk.Revit.UI.TaskDialog("To 3D View Extended")
			task2.MainInstruction = "Section Box cannot be created for this element/s."
			task2.Show()
OUT=0
"""
You agreed to the following license terms and conditions. They are also applicable to obtaining and using this script:
License Agreement
For use of NonicaTab PRO.
This License Agreement (this “Agreement” of this “License Agreement”) is made and effective as of the current date (the “Commencement Date”) by and between Nonica by Nonica Enterprise SL a company organized and existing in Spain with a registered address at Avd.Chafarinas 16 Spain (“Licensor”) and yourself (“Licensee”).
WHEREAS:
1.	Licensee wishes to obtain access and use this script (hereinafter, the “Asset”), and
2.	Licensor is willing to grant to the Licensee a non-exclusive, non-transferable License to use the Asset for the term and specific purpose set forth in this Agreement,
NOW, THEREFORE, your access to and use of the Service is conditioned on your acceptance of and compliance with these Terms and Conditions. These Terms and Conditions apply to all visitors, users and others who access or use NonicaTab PRO and its derivative files and scripts.
1. Definitions
1.1 “Agreement” means this License Agreement including the attached Schedule.
1.2 “Confidential Information” means information that:
a. is by its nature confidential;
b. is designated in writing by Licensor as confidential;
c. the Licensee knows or reasonably ought to know is confidential;
d. Information comprised in or relating to any Intellectual Property Rights of Licensor.
1.3 “Asset” means the Asset provided by Licensor as specified in Item 6 of the Schedule in the form as stated in Item 7 of the Schedule.
1.4 “Intellectual Property Rights” means all rights in and to any copyright, trademark, trading name, design, patent, know how (trade secrets) and all other rights resulting from intellectual activity in the industrial, scientific, literary or artistic field and any application or right to apply for registration of any of these rights and any right to protect or enforce any of these rights, as further specified in clause 5.
1.5 “Party” means a person or business entity who has executed this Agreement; details of the Parties are specified in Item 2 of the Schedule.
1.6 “Term” means the term of this Agreement commencing on the Commencement Date as specified in Item 4 of the Schedule and expiring on the Expiry Date specified in Item 5 of the Schedule.
2. License Grant
2.1 Licensor grants to the Licensee a non-exclusive, non-transferable License for the Term to use the Asset for the specific purpose specified in this Agreement, subject to the terms and conditions set out in this Agreement.
3. Charges
3.1 In consideration of the Licensor providing the License under clause 2 of this License Agreement, the Licensee agrees to pay Licensor the amount of the License Charge as specified in Item 9 of the Schedule.
4. Licensee’s Obligations
4.1 The Licensee cannot use the Asset, for purposes other than as specified in this Agreement and in Item 8 of the Schedule.
4.2 The Licensee may permit its employees to use the Asset for the purposes described in Item 8, provided that the Licensee takes all necessary steps and imposes the necessary conditions to ensure that all employees using the Asset do not commercialise or disclose the contents of it to any third person, or use it other than in accordance with the terms of this Agreement.
4.3 The Licensee will not distribute, sell, License or sub-License, let, trade or expose for sale the Asset to a third party.
4.4 No copies of the Asset are to be made other than as expressly approved by Licensor.
4.5 No changes to the Asset or its content may be made by Licensee.
4.6 The Licensee will provide technological and security measures to ensure that the Asset which the Licensee is responsible for is physically and electronically secure from unauthorised use or access.
4.7 Licensee shall ensure that the Asset retains all Licensor copyright notices and other proprietary legends and all trademarks or service marks of Licensor.
5. Intellectual Property Rights
5.1 All Intellectual Property Rights over and in respect of the Asset are owned by Licensor. The Licensee does not acquire any rights of ownership in the Asset.
6. Limitation of Liability
6.1 The Licensee acknowledges and agrees that neither Licensor nor its board members, officers, employees or agents, will be liable for any loss or damage arising out of or resulting from Licensor’s provision of the Asset under this Agreement, or any use of the Asset by the Licensee or its employees; and Licensee hereby releases Licensor to the fullest extent from any such liability, loss, damage or claim.
7. Confidentiality
7.1 Neither Party may use, disclose or make available to any third party the other Party’s Confidential Information, unless such use or disclosure is done in accordance with the terms of this Agreement.
7.2 Each Party must hold the other Party’s Confidential Information secure and in confidence, except to the extent that such Confidential Information:
a. is required to be disclosed according to the requirements of any law, judicial or legislative body or government agency; or
b. was approved for release in writing by the other Party, but only to the extent of and subject to such conditions as may be imposed in such written authorisation.
7.3 This clause 7 will survive termination of this Agreement.
8. Disclaimers & Release
8.1 To the extent permitted by law, Licensor will in no way be liable to the Licensee or any third party for any loss or damage, however caused (including through negligence) which may be directly or indirectly suffered in connection with any use of the Asset.
8.2 The Asset is provided by Licensor on an “as is” basis.
8.3 Licensor will not be held liable by the Licensee in any way, for any loss, damage or injury suffered by the Licensee or by any other person related to any use of the Asset or any part thereof.
8.4 Notwithstanding anything contained in this Agreement, in no event shall Licensor be liable for any claims, damages or loss which may arise from the modification, combination, operation or use of the Asset with Licensee computer programs.
8.5 Licensor does not warrant that the Asset will function in any environment.
8.6 The Licensee acknowledges that: a. The Asset has not been prepared to meet any specific requirements of any party, including any requirements of Licensee; and b. it is therefore the responsibility of the Licensee to ensure that the Asset meets its own individual requirements.
8.7 To the extent permitted by law, no express or implied warranty, term, condition or undertaking is given or assumed by Licensor, including any implied warranty of merchantability or fitness for a particular purpose.
9. Indemnification
9.1 The Licensee must indemnify, defend and hold harmless Licensor, its board members, officers, employees and agents from and against any and all claims (including third party claims), demands, actions, suits, expenses (including attorney’s fees) and damages (including indirect or consequential loss) resulting in any way from:
a. Licensee’s and Licensee’s employee’s use or reliance on the Asset,
b. any breach of the terms of this License Agreement by the Licensee or any Licensee employee, and
c. any other act of Licensee.
9.2 This clause 9 will survive termination of this Agreement.
10. Waiver
10.1 Any failure or delay by either Party to exercise any right, power or privilege hereunder or to insist upon observance or performance by the other of the provisions of this License Agreement shall not operate or be construed as a waiver thereof.
11. Governing Law
11.1 This Agreement will be construed by and governed in accordance with the laws of Spain. The Parties submit to exclusive jurisdiction of the courts of Spain.
12. Termination
12.1 This Agreement and the License granted herein commences upon the Commencement Date and is granted for the Term, unless otherwise terminated by Licensor in the event of any of the following:
a. if the Licensee is in breach of any term of this License Agreement and has not corrected such breach to Licensor’s reasonable satisfaction within 7 days of Licensor’s notice of the same;
b. if the Licensee becomes insolvent, or institutes (or there is instituted against it) proceedings in bankruptcy, insolvency, reorganization or dissolution, or makes an assignment for the benefit of creditors; or
c. the Licensee is in breach of clause 5 or 7 of this Agreement.
12.2 Termination under this clause shall not affect any other rights or remedies Licensor may have.
14. Assignment
14.1 Licensee shall not assign any rights of this License Agreement, without the prior written consent of Licensor.
15. Notices
15.1 All notices required under this Agreement shall be in writing and shall be deemed given (i) when delivered personally; (ii) five (5) days after mailing, when sent certified mail, return receipt requested and postage prepaid; or (iii) one (1) business day after dispatch, when sent via a commercial overnight carrier, fees prepaid. All notices given by either Party must be sent to the address of the other as first written above (unless otherwise changed by written notice).
15.2 Autodesk username, Autodesk Internal ID number and unique identifiers of hardware in your computer are stored in a speciliazed third party cloud server for licensing purposes. This information is neccessary for using NonicaTab PRO. The licensee maintains its full right to delete/remove such information if declining the renewal of the software. NonicaTab PRO will not shared that information with any third party company unless it is required judicially by law. Please contact hello@nonica.io with any further doubt/request.
16. Counterparts
16.1 This Agreement may be executed in any number of counterparts, each of which shall be deemed to be an original and all of which taken together shall constitute one instrument.
17. Severability
17.1 The Parties recognize the uncertainty of the law with respect to certain provisions of this Agreement and expressly stipulate that this Agreement will be construed in a manner that renders its provisions valid and enforceable to the maximum extent possible under applicable law. To the extent that any provisions of this Agreement are determined by a court of competent jurisdiction to be invalid or unenforceable, such provisions will be deleted from this Agreement or modified so as to make them enforceable and the validity and enforceability of the remainder of such provisions and of this Agreement will be unaffected.
18. Entire Agreement
18.1 This Agreement contains the entire agreement between the Parties and supersedes any previous understanding, commitments or agreements, oral or written. Further, this Agreement may not be modified, changed, or otherwise altered in any respect except by a written agreement signed by both Parties.
IN WITNESS WHEREOF, this Agreement, including the attached Schedule, was signed by the Parties under the hands of their duly authorized representatives and made effective as of the current date.
Nonica by Nonica Enterprise SL,
Signature
10/04/2025
Jaime Alonso Candau
Please contact hello@nonica.io with any further doubt/request.
Your signatureby using and accessing this script.
Signed by accepting these terms.
Current date.
"""
# ----------------------------------------
