# Dynamo graph Numberer.dyn (Dynamo 2.6.2.15705)

version = Python()
# ---------- version.python (8 lines) ----------
from System.Reflection import Assembly
dynamo = Assembly.Load('DynamoCore')
#Get Dynamo version
ver = str(dynamo.GetName().Version)
if ver:
    OUT = int(ver.Split(".")[0])
else:
    OUT = 0
# ----------------------------------------
prev_Window = Python(IN[0]=version)
# ---------- prev_Window.python (673 lines) ----------
input = IN[0]
if input == 2:
	import ctypes
	from ctypes import wintypes
	from ctypes.wintypes import MAX_PATH
	import time
	import os
	import random
	
	import sys
	import clr
	clr.AddReference('ProtoGeometry')
	from Autodesk.DesignScript.Geometry import *
	
	clr.AddReference('RevitAPI')
	import Autodesk
	from Autodesk.Revit.DB import *
	
	clr.AddReference("RevitAPIUI")
	import Autodesk 
	from Autodesk.Revit.UI import *
	from Autodesk.Revit.UI.Selection import *
	
	clr.AddReference('System.Drawing')
	clr.AddReference('System.Windows.Forms')
	import System.Drawing
	import System.Windows.Forms
	
	from System.Drawing import *
	from System.Reflection import Assembly
	from System.Windows.Forms import *
	
	clr.AddReference('System.Data')
	from System.Data import *
	
	clr.AddReference("System.Core")
	import System.Linq
	clr.ImportExtensions(System.Linq)
	
	clr.AddReference("RevitServices")
	import RevitServices
	from RevitServices.Persistence import DocumentManager
	from RevitServices.Transactions import TransactionManager
	
	#Import win32api to simulate keyboard pressing escape when closing window
	user32 = ctypes.WinDLL('user32', use_last_error=True)
	INPUT_MOUSE    = 0
	INPUT_KEYBOARD = 1
	INPUT_HARDWARE = 2
	KEYEVENTF_EXTENDEDKEY = 0x0001
	KEYEVENTF_KEYUP       = 0x0002
	KEYEVENTF_UNICODE     = 0x0004
	KEYEVENTF_SCANCODE    = 0x0008
	MAPVK_VK_TO_VSC = 0
	VK_TAB  = 0x09
	VK_MENU = 0x12
	wintypes.ULONG_PTR = wintypes.WPARAM
	class KEYBDINPUT(ctypes.Structure):
		_fields_ = (("wVk",         wintypes.WORD),("wScan",       wintypes.WORD),("dwFlags",     wintypes.DWORD),("time",        wintypes.DWORD),("dwExtraInfo", wintypes.ULONG_PTR))
	
		def __init__(self, *args, **kwds):
			super(KEYBDINPUT, self).__init__(*args, **kwds)
			if not self.dwFlags & KEYEVENTF_UNICODE:
				self.wScan = user32.MapVirtualKeyExW(self.wVk, MAPVK_VK_TO_VSC, 0)
	            
	class HARDWAREINPUT(ctypes.Structure):
		_fields_ = (("uMsg",    wintypes.DWORD),("wParamL", wintypes.WORD),("wParamH", wintypes.WORD))
	                
	class MOUSEINPUT(ctypes.Structure):
		_fields_ = (("dx",          wintypes.LONG),("dy",          wintypes.LONG),("mouseData",   wintypes.DWORD),("dwFlags",     wintypes.DWORD),("time",        wintypes.DWORD),("dwExtraInfo", wintypes.ULONG_PTR))
	
	class INPUT(ctypes.Structure):
		class _INPUT(ctypes.Union):
			_fields_ = (("ki", KEYBDINPUT),("mi", MOUSEINPUT), ("hi", HARDWAREINPUT))
		_anonymous_ = ("_input",)
		_fields_ = (("type",   wintypes.DWORD),("_input", _INPUT))
	
	LPINPUT = ctypes.POINTER(INPUT)
	
	def _check_count(result, func, args):
		if result == 0:
			raise ctypes.WinError(ctypes.get_last_error())
		return args
	
	user32.SendInput.errcheck = _check_count
	user32.SendInput.argtypes = (wintypes.UINT, LPINPUT, ctypes.c_int) 
	
	def PressKey(hexKeyCode):
		x = INPUT(type=INPUT_KEYBOARD,ki=KEYBDINPUT(wVk=hexKeyCode))
		user32.SendInput(1, ctypes.byref(x), ctypes.sizeof(x))
	
	def ReleaseKey(hexKeyCode):
		x = INPUT(type=INPUT_KEYBOARD,ki=KEYBDINPUT(wVk=hexKeyCode,dwFlags=KEYEVENTF_KEYUP))
		user32.SendInput(1, ctypes.byref(x), ctypes.sizeof(x))
	
	class RoomSelectionFilter(ISelectionFilter):  
		def __init__(self, category):
			self.typeOfFilt=category
			
		def AllowElement(self, element):
			if element.Category.Id.IntegerValue==self.typeOfFilt or self.typeOfFilt==0:
				return True
			else:
				return False
	
		def AllowReference(self, refer, point):
			return False
				
	class Form24(Form):
		def __init__(self, lstSchedule, lstValue, _doc, RVTver, par_options):
			self.Font = Font(self.Font.FontFamily, 15, FontStyle.Regular, GraphicsUnit.Pixel)
			list_par = []
			list_values = []
			self.width_par = 1
			self._tableData = DataTable("Data")
			self._tableData.Columns.Add("Key", System.String)
			self._tableData.Columns.Add("Value", System.Object)
			self._tableData2 = DataTable("Data")
			self._tableData2.Columns.Add("Key", System.String)
			self._tableData2.Columns.Add("Value", System.Object)
			self.Filter = RoomSelectionFilter(int(BuiltInCategory.OST_Rooms))
			[self._tableData.Rows.Add(key_, value_ ) for key_, value_ in zip(lstSchedule, lstValue)]
			[self._tableData2.Rows.Add(key_, value_ ) for key_, value_ in zip(par_options[0], par_options[0])]
			self.out = []
			self.InitializeComponent()
		
		def InitializeComponent(self):
			self._spr_top = System.Windows.Forms.Label()
			self._types = System.Windows.Forms.ComboBox()
			self._button1 = System.Windows.Forms.Button()
			self._txtBox = System.Windows.Forms.ComboBox()
			self._txtBox2 = System.Windows.Forms.TextBox()
			self._txtBox3 = System.Windows.Forms.TextBox()
			self._txtBox4 = System.Windows.Forms.TextBox()
			self._txtBlock2 = System.Windows.Forms.Label()
			self._txtBlock3 = System.Windows.Forms.Label()
			self._txtBlock4 = System.Windows.Forms.Label()
			self._txtBlock5 = System.Windows.Forms.Label()
			self._txtBlock6 = System.Windows.Forms.Label()
			self._txtBlock7 = System.Windows.Forms.Label()
			self.SuspendLayout()
			# 
			# Separator Top
			# 
			self._spr_top.Anchor     = System.Windows.Forms.AnchorStyles.Top | System.Windows.Forms.AnchorStyles.Left | System.Windows.Forms.AnchorStyles.Right
			self._spr_top.Location   = System.Drawing.Point(0, 0)
			self._spr_top.Name       = "spr_top"
			self._spr_top.Size       = System.Drawing.Size(2000, 2)
			self._spr_top.BackColor  = Color.FromArgb(82, 53, 239)
			# 
			# comboBox1
			# 
			self._types.Anchor = System.Windows.Forms.AnchorStyles.Top | System.Windows.Forms.AnchorStyles.Bottom | System.Windows.Forms.AnchorStyles.Left | System.Windows.Forms.AnchorStyles.Right
			self._types.Location = System.Drawing.Point(135, 7)
			self._types.Name = "dropDown"
			self._types.DataSource = self._tableData 
			self._types.DisplayMember = "Key"
			self._types.Size = System.Drawing.Size(197, 244)
			self._types.DropDownWidth = 150
			self._types.DropDownStyle = ComboBoxStyle.DropDownList
			self._types.SelectedIndexChanged += self.UpdateFilter
			# 
			# button1
			# 
			self._button1.Anchor = System.Windows.Forms.AnchorStyles.Bottom | System.Windows.Forms.AnchorStyles.Right
			self._button1.Location = System.Drawing.Point(12, 188)
			self._button1.Name = "button1"
			self._button1.Size = System.Drawing.Size(320, 27)
			self._button1.Text = "PRESS ESC TO CLOSE"
			self._button1.UseVisualStyleBackColor = True
			self._button1.BackColor = Color.White
			self._button1.Enabled = False
			# 
			# TextBlock2
			# 
			self._txtBlock2.Anchor = System.Windows.Forms.AnchorStyles.Bottom | System.Windows.Forms.AnchorStyles.Left
			self._txtBlock2.Location = System.Drawing.Point(12, 10)
			self._txtBlock2.Name = "txtBlock2"
			self._txtBlock2.Size = System.Drawing.Size(130, 20)
			self._txtBlock2.Text = "Type of Elements:"
			# 
			# TextBlock3
			# 
			self._txtBlock3.Anchor = System.Windows.Forms.AnchorStyles.Bottom | System.Windows.Forms.AnchorStyles.Left
			self._txtBlock3.Location = System.Drawing.Point(12, 38)
			self._txtBlock3.Name = "txtBlock3"
			self._txtBlock3.Size = System.Drawing.Size(130, 20)
			self._txtBlock3.Text = "Parameter (Any!):"
			# 
			# _drp_txtBox1
			# 		
			self._txtBox.Anchor = System.Windows.Forms.AnchorStyles.Top | System.Windows.Forms.AnchorStyles.Bottom | System.Windows.Forms.AnchorStyles.Left | System.Windows.Forms.AnchorStyles.Right
			self._txtBox.Location = System.Drawing.Point(135, 35)
			self._txtBox.Name = "drp_txtBox"
			self._txtBox.Size = System.Drawing.Size(197, 244)
			self._txtBox.DataSource = self._tableData2 
			self._txtBox.DisplayMember = "Key"
			self._txtBox.DropDownWidth = 150
			self._txtBox.AutoCompleteSource = AutoCompleteSource.ListItems
			self._txtBox.AutoCompleteMode   = AutoCompleteMode.SuggestAppend
			self._txtBox.DropDownStyle      = ComboBoxStyle.DropDown
			# 
			# TextBlock4
			# 
			self._txtBlock4.Anchor = System.Windows.Forms.AnchorStyles.Bottom | System.Windows.Forms.AnchorStyles.Left
			self._txtBlock4.Location = System.Drawing.Point(12, 66)
			self._txtBlock4.Name = "txtBlock4"
			self._txtBlock4.Size = System.Drawing.Size(120, 20)
			self._txtBlock4.Text = "Prefix:"
			# 
			# _txtBox2
			# 		
			self._txtBox2.Anchor = System.Windows.Forms.AnchorStyles.Top | System.Windows.Forms.AnchorStyles.Bottom | System.Windows.Forms.AnchorStyles.Left | System.Windows.Forms.AnchorStyles.Right
			self._txtBox2.Location = System.Drawing.Point(135, 63)
			self._txtBox2.Name = "txtBox2"
			self._txtBox2.Size = System.Drawing.Size(197, 244)
			# 
			# TextBlock5
			# 
			self._txtBlock5.Anchor = System.Windows.Forms.AnchorStyles.Bottom | System.Windows.Forms.AnchorStyles.Left
			self._txtBlock5.Location = System.Drawing.Point(12, 94)
			self._txtBlock5.Name = "txtBlock5"
			self._txtBlock5.Size = System.Drawing.Size(120, 20)
			self._txtBlock5.Text = "Suffix:"
			# 
			# _txtBox3
			# 		
			self._txtBox3.Anchor = System.Windows.Forms.AnchorStyles.Top | System.Windows.Forms.AnchorStyles.Bottom | System.Windows.Forms.AnchorStyles.Left | System.Windows.Forms.AnchorStyles.Right
			self._txtBox3.Location = System.Drawing.Point(135, 91)
			self._txtBox3.Name = "txtBox3"
			self._txtBox3.Size = System.Drawing.Size(197, 244)
			# 
			# TextBlock6
			# 
			self._txtBlock6.Anchor = System.Windows.Forms.AnchorStyles.Bottom | System.Windows.Forms.AnchorStyles.Left
			self._txtBlock6.Location = System.Drawing.Point(12, 122)
			self._txtBlock6.Name = "txtBlock6"
			self._txtBlock6.Size = System.Drawing.Size(120, 20)
			self._txtBlock6.Text = "Next Number:"
			# 
			# TextBlock7
			# 
			self._txtBlock7.Anchor = System.Windows.Forms.AnchorStyles.Bottom | System.Windows.Forms.AnchorStyles.Left
			self._txtBlock7.Location = System.Drawing.Point(12, 150)
			self._txtBlock7.Name = "txtBlock7"
			self._txtBlock7.Size = System.Drawing.Size(330, 35)
			self._txtBlock7.TextAlign = ContentAlignment.TopCenter
			self._txtBlock7.Text = "This is a dynamic updater!\nSelect elements to update parameters."
			# 
			# _txtBox4
			# 		
			self._txtBox4.Anchor = System.Windows.Forms.AnchorStyles.Top | System.Windows.Forms.AnchorStyles.Bottom | System.Windows.Forms.AnchorStyles.Left | System.Windows.Forms.AnchorStyles.Right
			self._txtBox4.Location = System.Drawing.Point(135, 119)
			self._txtBox4.Name = "txtBox4"
			self._txtBox4.Size = System.Drawing.Size(197, 244)
			self._txtBox4.Text = "01"
			self._txtBox4.KeyPress += self.reviewKeys
			# 
			# Tab switcher
			# 
			self._txtBox2.TabIndex = 1
			self._txtBox3.TabIndex = 2
			self._txtBox4.TabIndex = 3
			self._types.TabStop    = False
			self._txtBox.TabStop   = False
			self._txtBox2.TabStop  = True
			self._txtBox3.TabStop  = True
			self._txtBox4.TabStop  = True
			self.KeyDown += self.MyOnKeyDown
			self.KeyPreview = True
			self.TabStop = False
			# 
			# Form24
			# 
			self.ShowInTaskbar = False
			self.ClientSize = System.Drawing.Size(344, 229)
			self.MaximizeBox = 0
			self.MinimizeBox = 0
			self.CenterToScreen() 
			self.MouseLeave += self.mouseleaveWindow
			self.FormBorderStyle = FormBorderStyle.FixedSingle
			self.Controls.Add(self._spr_top)
			self.Controls.Add(self._button1)
			self.Controls.Add(self._txtBox)
			self.Controls.Add(self._txtBox2)
			self.Controls.Add(self._txtBox3)
			self.Controls.Add(self._txtBox4)
			self.Controls.Add(self._types)
			self.Controls.Add(self._txtBlock2)
			self.Controls.Add(self._txtBlock3)
			self.Controls.Add(self._txtBlock4)
			self.Controls.Add(self._txtBlock5)
			self.Controls.Add(self._txtBlock6)
			self.Controls.Add(self._txtBlock7)
			self.ControlBox = False
			for cntrl in self.Controls:
				cntrl.MouseLeave += self.mouseleaveWindow
			self.Name = "Number Elements(Rooms, Grids, ...)"
			self.Text = "Number Elements(Rooms, Grids, ...)"
			iconFilename = 'C:\\NONICAPRO\\OtherFiles\\System\\Nonicafavicon.ICO'
			if not os.path.exists(iconFilename):
				iconFilename = 'C:\\NONICA\\OtherFiles\\System\\Nonicafavicon.ICO'
			icon = Icon(iconFilename)
			self.Icon = icon
			self.TopMost= True
			self.Closing += self.escapeEvent
			self.ResumeLayout(False)
			
		def MyOnKeyDown(self, sender, e):
			try:
				if self.ActiveControl.Name != "drp_txtBox":
					if e.KeyCode == System.Windows.Forms.Keys.Tab:  # Check if the Tab key was pressed
						self.SwitchFocus(e.Shift)
						e.Handled = True 
						e.SuppressKeyPress = True
					elif Control.ModifierKeys == Keys.Shift and e.KeyCode == System.Windows.Forms.Keys.C:
						if isinstance(self.ActiveControl, TextBox) and self.ActiveControl.SelectionLength > 0:
							self.CopyValue()
							e.Handled = True  
							e.SuppressKeyPress = True
						elif not isinstance(self.ActiveControl, TextBox):
							self.CopyValue()
							e.Handled = True  
							e.SuppressKeyPress = True
					elif Control.ModifierKeys == Keys.Shift and e.KeyCode == System.Windows.Forms.Keys.V:
						if System.Windows.Forms.Clipboard.GetText() != "":
							self.PasteValue()
							e.Handled = True 
							e.SuppressKeyPress = True
					elif e.KeyCode == System.Windows.Forms.Keys.Enter and isinstance(self.ActiveControl, Button):
						self.ActiveControl.PerformClick()
						e.Handled = True 
						e.SuppressKeyPress = True
			except Exception as exc:
				pass
	
		def SwitchFocus(self, shiftPressed):
			current_control = self.ActiveControl
			focusable_controls = [ctrl for ctrl in self.Controls if ctrl.TabStop and ctrl.Enabled and ctrl.Visible]
			focusable_controls.sort(key=lambda ctrl: ctrl.TabIndex)
			current_index = focusable_controls.index(current_control) if current_control in focusable_controls else -1
			if shiftPressed:  # Shift + Tab: move backward
				next_index = (current_index - 1) % len(focusable_controls)
			else:  # Tab: move forward
				next_index = (current_index + 1) % len(focusable_controls)
			next_control = focusable_controls[next_index]
			next_control.Focus()
		
		def CopyValue(self):
			current_control = self.ActiveControl
			if isinstance(current_control, System.Windows.Forms.NumericUpDown):
				System.Windows.Forms.Clipboard.SetText(str(current_control.Value))
			elif isinstance(current_control, System.Windows.Forms.TextBox):
				System.Windows.Forms.Clipboard.SetText(str(current_control.SelectedText))
	
		def PasteValue(self):
			current_control = self.ActiveControl
			if isinstance(current_control, System.Windows.Forms.NumericUpDown):
				clipboard_text = System.Windows.Forms.Clipboard.GetText()
				try:
					new_value = float(clipboard_text)
					current_control.Value = max(min(new_value, current_control.Maximum), current_control.Minimum)
				except:
					pass
			if isinstance(current_control, System.Windows.Forms.TextBox):
				clipboard_text = System.Windows.Forms.Clipboard.GetText()
				try:
					position_cursor = current_control.SelectionStart
					current_control.Text = current_control.Text.Insert(current_control.SelectionStart, clipboard_text)
					current_control.SelectionStart = position_cursor + len(clipboard_text)
				except:
					pass
		
		def mouseleaveWindow(self, sender, e):
			if self.ClientRectangle.Contains(self.PointToClient(Cursor.Position)):
				return 0
			else:
				user32.SetFocus(DocumentManager.Instance.CurrentUIApplication.MainWindowHandle)
	
		def reviewKeys(self, sender, e):
			if e.KeyChar != chr(8):
				if str(e.KeyChar).isdigit()==False:
					e.Handled = True
		
		def UpdateFilter(self, sender, e):
			#Update selection filter
			category = sender.SelectedItem['Value']
			if sender.SelectedIndex == 0:
				category = 0
			self.Filter.typeOfFilt = category
			#Loose focus
			user32.SetFocus(DocumentManager.Instance.CurrentUIApplication.MainWindowHandle)
			#Update parameter list
			self.switchParameters(dict_seq[sender.SelectedItem['Key']])
			
		def addOne(self):
			try:
				old_val = self._txtBox4.Text
				totalLen = len(old_val)
				ini_val = int(old_val)
				ad_val = str(ini_val+1)
				self._txtBox4.Text = ad_val.zfill(totalLen)
			except:
				pass
		
		def radioButton_CheckedChanged(self, sender, e):
			if sender.Name.startswith("value"):
				self._txtBox.Enabled = sender.Checked
				self._units_value.Enabled = sender.Checked
			elif sender.Name.startswith("param"):
				self._drp_parameter.Enabled = sender.Checked
	
		def escapeEvent(self, sender, e):
			close=1
			self.saveToFile(directory)
			
		def pickobject(self):
			picked = uidoc.Selection.PickObject(ObjectType.Element, self.Filter, "Select in Revit")
			return picked
		
		def composeValue(self, asType=0):
			try:
				final_val=None
				pre_val = self._txtBox2.Text
				suf_val = self._txtBox3.Text
				num_val = self._txtBox4.Text
				if asType==0:
					final_val = int(pre_val + num_val + suf_val)
				else:
					final_val = pre_val + num_val + suf_val
				return final_val
			except:
				return None
				
		def switchParameters(self, indx):
			currentitems = []
			for item in self._txtBox.Items:
				currentitems.Add(item['Value'])
			new_sq = par_options[indx]
			if new_sq != currentitems:
				dataTable = DataTable("Data")
				dataTable.Columns.Add("Key", System.String)
				dataTable.Columns.Add("Value", System.Object)
				if self._txtBox.Text in entire_list or self._txtBox.Text =="":
					[dataTable.Rows.Add(key_, value_ ) for key_, value_ in zip(new_sq, new_sq)]
				self._txtBox.DataSource = dataTable			
	
		def saveToFile(self, dir_path):
			try:
				with open(dir_path + "/" + "settingsNumberingNonica.txt","w") as file:
					file.write(str(self._types.SelectedIndex)+"\n")
					file.write(self._txtBox.Text+"\n")
					file.write(self._txtBox2.Text+"\n")
					file.write(self._txtBox3.Text+"\n")
					file.write(self._txtBox4.Text+"\n")
			except:
				pass
				
		def loadFromFile(self, dir_path):
			#Default value
			self._types.SelectedIndex = 5
			try:
				with open(dir_path + "/" + "settingsNumberingNonica.txt","r") as file:
					all_lines = file.readlines()
					self._types.SelectedIndex = int(all_lines[0].strip())
					par_val = all_lines[1].strip()
					if par_val != "":
						self._txtBox.SelectedIndex = -1
						self._txtBox.Text = par_val
					self._txtBox2.Text = all_lines[2].strip()
					self._txtBox3.Text = all_lines[3].strip()
					next_number_val = all_lines[4].strip()
					if next_number_val != "":
						self._txtBox4.Text = next_number_val
			except Exception as e:
				pass
						
	def getDocumentsFolder():
		dll = ctypes.windll.shell32
		buf = ctypes.create_unicode_buffer(MAX_PATH + 1)
		if dll.SHGetSpecialFolderPathW(None, buf, 0x0005, False):
			return buf.value
		else:
			return 0
	
	doc = DocumentManager.Instance.CurrentDBDocument
	uidoc = DocumentManager.Instance.CurrentUIApplication.ActiveUIDocument
	app = doc.Application
	version = int(app.VersionNumber)
	language = app.Language
	
	directory = getDocumentsFolder()
	list_drop=["Any Element", "Areas","Doors", "Grids", "Levels", "Rooms", "Spaces", "Windows"]
	dict_seq={}
	for x,y in zip(list_drop,[1,0,1,2,2,0,0,1]):
		dict_seq.Add(x,y)
	
	wnd_hand = DocumentManager.Instance.CurrentUIApplication.MainWindowHandle 
	nativeWindow = NativeWindow()
	nativeWindow.AssignHandle(wnd_hand)
	if language == Autodesk.Revit.ApplicationServices.LanguageType.Spanish:
		entire_list = ["Nombre","Número","Comentarios","Marca"]
		par_options = [["Nombre","Número","Comentarios"], ["Marca","Comentarios"], ["Nombre"]]
	elif language == Autodesk.Revit.ApplicationServices.LanguageType.German:
		entire_list = ["Name","Nummer","Kommentare","Kennzeichen"]
		par_options = [["Name","Nummer","Kommentare"], ["Kennzeichen","Kommentare"], ["Name"]]
	elif language == Autodesk.Revit.ApplicationServices.LanguageType.French:
		entire_list = ["Nom","Numéro","Commentaires","Identifiant"]
		par_options = [["Nom","Numéro","Commentaires"], ["Identifiant","Commentaires"], ["Nom"]]
	elif language == Autodesk.Revit.ApplicationServices.LanguageType.Italian:
		entire_list = ["Nome","Numero","Commenti","Contrassegno"]
		par_options = [["Nome","Numero","Commenti"], ["Contrassegno","Commenti"], ["Nome"]]
	else:
		entire_list = ["Name","Number","Comments","Mark"]
		par_options = [["Name","Number","Comments"], ["Mark","Comments"], ["Name"]]
	objForm = Form24(list_drop, [0,int(BuiltInCategory.OST_Areas),int(BuiltInCategory.OST_Doors),int(BuiltInCategory.OST_Grids),int(BuiltInCategory.OST_Levels),int(BuiltInCategory.OST_Rooms),int(BuiltInCategory.OST_MEPSpaces),int(BuiltInCategory.OST_Windows)], doc, version, par_options)
	#Check if settings file exists to load
	objForm.Show(nativeWindow)
	try:
		objForm.loadFromFile(directory)
	except:
		pass
	close=0
	while close==0:
		try:
			#Select element
			sel_ref = objForm.pickobject()
			sel_ele = doc.GetElement(sel_ref)
			#TransactionManager.Instance.EnsureInTransaction(doc)
			with Transaction(doc, "Number Elements(Rooms, Grids, ...)") as t:
				t.Start()
				#Get parameter by name from object
				wndw_par = objForm._txtBox.Text
				if wndw_par != "":
					pars = sel_ele.GetParameters(wndw_par)
					if len(pars) > 0:
						#Parameter read only
						par = pars[0]
						if par.IsReadOnly ==False:
							type_par = par.StorageType
							if StorageType.Integer == type_par:
								#Compose parameter value
								value = objForm.composeValue(0)
								if value != None:
									par.Set(value)
								objForm.addOne()
							elif StorageType.String == type_par:
								#Compose parameter value
								value = objForm.composeValue(1)
								if value != None:
									par.Set(value)
								objForm.addOne()
							else:
								objForm.Hide()
								task2 = Autodesk.Revit.UI.TaskDialog("Number Elements(Rooms, Grids, ...)")
								task2.MainInstruction = "The specified parameter is not defined as integer or string. Please, change the Type of Parameter"
								task2.Show()
								objForm.Show()
						else:
							objForm.Hide()
							task2 = Autodesk.Revit.UI.TaskDialog("Number Elements(Rooms, Grids, ...)")
							task2.MainInstruction = "The specified parameter is read-only."
							task2.Show()
							objForm.Show()
					else:
						objForm.Hide()
						task2 = Autodesk.Revit.UI.TaskDialog("Number Elements(Rooms, Grids, ...)")
						task2.MainInstruction = "The specified parameter does not exists in the selected element."
						task2.Show()
						objForm.Show()
				else:
					objForm.Hide()
					task2 = Autodesk.Revit.UI.TaskDialog("Number Elements(Rooms, Grids, ...)")
					task2.MainInstruction = "No parameter was specified to number. Please, define it."
					task2.Show()
					objForm.Show()
				t.Commit()
			#TransactionManager.Instance.TransactionTaskDone()
			doc.Regenerate()
		except Autodesk.Revit.Exceptions.OperationCanceledException as e:
			close=1
			objForm.Close()
		except Exception as ex:
			pass
OUT = 0

"""
You agreed to the following license terms and conditions. They are also applicable to obtaining and using this script:
License Agreement
For use of NonicaTab PRO.
This License Agreement (this “Agreement” of this “License Agreement”) is made and effective as of the current date (the “Commencement Date”) by and between Nonica by Nonica Enterprise SL a company organized and existing in Spain with a registered address at Avd.Chafarinas 16 Spain (“Licensor”) and yourself (“Licensee”).
WHEREAS:
1.	Licensee wishes to obtain access and use this script (hereinafter, the “Asset”), and
2.	Licensor is willing to grant to the Licensee a non-exclusive, non-transferable License to use the Asset for the term and specific purpose set forth in this Agreement,
NOW, THEREFORE, your access to and use of the Service is conditioned on your acceptance of and compliance with these Terms and Conditions. These Terms and Conditions apply to all visitors, users and others who access or use NonicaTab PRO and its derivative files and scripts.
1. Definitions
1.1 “Agreement” means this License Agreement including the attached Schedule.
1.2 “Confidential Information” means information that:
a. is by its nature confidential;
b. is designated in writing by Licensor as confidential;
c. the Licensee knows or reasonably ought to know is confidential;
d. Information comprised in or relating to any Intellectual Property Rights of Licensor.
1.3 “Asset” means the Asset provided by Licensor as specified in Item 6 of the Schedule in the form as stated in Item 7 of the Schedule.
1.4 “Intellectual Property Rights” means all rights in and to any copyright, trademark, trading name, design, patent, know how (trade secrets) and all other rights resulting from intellectual activity in the industrial, scientific, literary or artistic field and any application or right to apply for registration of any of these rights and any right to protect or enforce any of these rights, as further specified in clause 5.
1.5 “Party” means a person or business entity who has executed this Agreement; details of the Parties are specified in Item 2 of the Schedule.
1.6 “Term” means the term of this Agreement commencing on the Commencement Date as specified in Item 4 of the Schedule and expiring on the Expiry Date specified in Item 5 of the Schedule.
2. License Grant
2.1 Licensor grants to the Licensee a non-exclusive, non-transferable License for the Term to use the Asset for the specific purpose specified in this Agreement, subject to the terms and conditions set out in this Agreement.
3. Charges
3.1 In consideration of the Licensor providing the License under clause 2 of this License Agreement, the Licensee agrees to pay Licensor the amount of the License Charge as specified in Item 9 of the Schedule.
4. Licensee’s Obligations
4.1 The Licensee cannot use the Asset, for purposes other than as specified in this Agreement and in Item 8 of the Schedule.
4.2 The Licensee may permit its employees to use the Asset for the purposes described in Item 8, provided that the Licensee takes all necessary steps and imposes the necessary conditions to ensure that all employees using the Asset do not commercialise or disclose the contents of it to any third person, or use it other than in accordance with the terms of this Agreement.
4.3 The Licensee will not distribute, sell, License or sub-License, let, trade or expose for sale the Asset to a third party.
4.4 No copies of the Asset are to be made other than as expressly approved by Licensor.
4.5 No changes to the Asset or its content may be made by Licensee.
4.6 The Licensee will provide technological and security measures to ensure that the Asset which the Licensee is responsible for is physically and electronically secure from unauthorised use or access.
4.7 Licensee shall ensure that the Asset retains all Licensor copyright notices and other proprietary legends and all trademarks or service marks of Licensor.
5. Intellectual Property Rights
5.1 All Intellectual Property Rights over and in respect of the Asset are owned by Licensor. The Licensee does not acquire any rights of ownership in the Asset.
6. Limitation of Liability
6.1 The Licensee acknowledges and agrees that neither Licensor nor its board members, officers, employees or agents, will be liable for any loss or damage arising out of or resulting from Licensor’s provision of the Asset under this Agreement, or any use of the Asset by the Licensee or its employees; and Licensee hereby releases Licensor to the fullest extent from any such liability, loss, damage or claim.
7. Confidentiality
7.1 Neither Party may use, disclose or make available to any third party the other Party’s Confidential Information, unless such use or disclosure is done in accordance with the terms of this Agreement.
7.2 Each Party must hold the other Party’s Confidential Information secure and in confidence, except to the extent that such Confidential Information:
a. is required to be disclosed according to the requirements of any law, judicial or legislative body or government agency; or
b. was approved for release in writing by the other Party, but only to the extent of and subject to such conditions as may be imposed in such written authorisation.
7.3 This clause 7 will survive termination of this Agreement.
8. Disclaimers & Release
8.1 To the extent permitted by law, Licensor will in no way be liable to the Licensee or any third party for any loss or damage, however caused (including through negligence) which may be directly or indirectly suffered in connection with any use of the Asset.
8.2 The Asset is provided by Licensor on an “as is” basis.
8.3 Licensor will not be held liable by the Licensee in any way, for any loss, damage or injury suffered by the Licensee or by any other person related to any use of the Asset or any part thereof.
8.4 Notwithstanding anything contained in this Agreement, in no event shall Licensor be liable for any claims, damages or loss which may arise from the modification, combination, operation or use of the Asset with Licensee computer programs.
8.5 Licensor does not warrant that the Asset will function in any environment.
8.6 The Licensee acknowledges that: a. The Asset has not been prepared to meet any specific requirements of any party, including any requirements of Licensee; and b. it is therefore the responsibility of the Licensee to ensure that the Asset meets its own individual requirements.
8.7 To the extent permitted by law, no express or implied warranty, term, condition or undertaking is given or assumed by Licensor, including any implied warranty of merchantability or fitness for a particular purpose.
9. Indemnification
9.1 The Licensee must indemnify, defend and hold harmless Licensor, its board members, officers, employees and agents from and against any and all claims (including third party claims), demands, actions, suits, expenses (including attorney’s fees) and damages (including indirect or consequential loss) resulting in any way from:
a. Licensee’s and Licensee’s employee’s use or reliance on the Asset,
b. any breach of the terms of this License Agreement by the Licensee or any Licensee employee, and
c. any other act of Licensee.
9.2 This clause 9 will survive termination of this Agreement.
10. Waiver
10.1 Any failure or delay by either Party to exercise any right, power or privilege hereunder or to insist upon observance or performance by the other of the provisions of this License Agreement shall not operate or be construed as a waiver thereof.
11. Governing Law
11.1 This Agreement will be construed by and governed in accordance with the laws of Spain. The Parties submit to exclusive jurisdiction of the courts of Spain.
12. Termination
12.1 This Agreement and the License granted herein commences upon the Commencement Date and is granted for the Term, unless otherwise terminated by Licensor in the event of any of the following:
a. if the Licensee is in breach of any term of this License Agreement and has not corrected such breach to Licensor’s reasonable satisfaction within 7 days of Licensor’s notice of the same;
b. if the Licensee becomes insolvent, or institutes (or there is instituted against it) proceedings in bankruptcy, insolvency, reorganization or dissolution, or makes an assignment for the benefit of creditors; or
c. the Licensee is in breach of clause 5 or 7 of this Agreement.
12.2 Termination under this clause shall not affect any other rights or remedies Licensor may have.
14. Assignment
14.1 Licensee shall not assign any rights of this License Agreement, without the prior written consent of Licensor.
15. Notices
15.1 All notices required under this Agreement shall be in writing and shall be deemed given (i) when delivered personally; (ii) five (5) days after mailing, when sent certified mail, return receipt requested and postage prepaid; or (iii) one (1) business day after dispatch, when sent via a commercial overnight carrier, fees prepaid. All notices given by either Party must be sent to the address of the other as first written above (unless otherwise changed by written notice).
15.2 Autodesk username, Autodesk Internal ID number and unique identifiers of hardware in your computer are stored in a speciliazed third party cloud server for licensing purposes. This information is neccessary for using NonicaTab PRO. The licensee maintains its full right to delete/remove such information if declining the renewal of the software. NonicaTab PRO will not shared that information with any third party company unless it is required judicially by law. Please contact hello@nonica.io with any further doubt/request.
16. Counterparts
16.1 This Agreement may be executed in any number of counterparts, each of which shall be deemed to be an original and all of which taken together shall constitute one instrument.
17. Severability
17.1 The Parties recognize the uncertainty of the law with respect to certain provisions of this Agreement and expressly stipulate that this Agreement will be construed in a manner that renders its provisions valid and enforceable to the maximum extent possible under applicable law. To the extent that any provisions of this Agreement are determined by a court of competent jurisdiction to be invalid or unenforceable, such provisions will be deleted from this Agreement or modified so as to make them enforceable and the validity and enforceability of the remainder of such provisions and of this Agreement will be unaffected.
18. Entire Agreement
18.1 This Agreement contains the entire agreement between the Parties and supersedes any previous understanding, commitments or agreements, oral or written. Further, this Agreement may not be modified, changed, or otherwise altered in any respect except by a written agreement signed by both Parties.
IN WITNESS WHEREOF, this Agreement, including the attached Schedule, was signed by the Parties under the hands of their duly authorized representatives and made effective as of the current date.
Nonica by Nonica Enterprise SL,
Signature
02/05/2021
Jaime Alonso Candau
Please contact hello@nonica.io with any further doubt/request.
Your signatureby using and accessing this script.
Signed by accepting these terms.
Current date.
"""
# ----------------------------------------
n2025_Window = Python(IN[0]=version)  # "2025_Window"
# ---------- n2025_Window.python (673 lines) ----------
input = IN[0]
if input == 3:
    import ctypes
    from ctypes import wintypes
    from ctypes.wintypes import MAX_PATH
    import time
    import os
    import random
    
    import sys
    import clr
    clr.AddReference('ProtoGeometry')
    from Autodesk.DesignScript.Geometry import *
    
    clr.AddReference('RevitAPI')
    import Autodesk
    from Autodesk.Revit.DB import *
    
    clr.AddReference("RevitAPIUI")
    import Autodesk 
    from Autodesk.Revit.UI import *
    from Autodesk.Revit.UI.Selection import *
    
    clr.AddReference('System.Drawing')
    clr.AddReference('System.Windows.Forms')
    import System.Drawing
    import System.Windows.Forms
    
    from System.Drawing import *
    from System.Reflection import Assembly
    from System.Windows.Forms import *
    
    clr.AddReference('System.Data')
    from System.Data import *
    
    clr.AddReference("System.Core")
    import System.Linq
    clr.ImportExtensions(System.Linq)
    
    clr.AddReference("RevitServices")
    import RevitServices
    from RevitServices.Persistence import DocumentManager
    from RevitServices.Transactions import TransactionManager
    
    #Import win32api to simulate keyboard pressing escape when closing window
    user32 = ctypes.WinDLL('user32', use_last_error=True)
    INPUT_MOUSE    = 0
    INPUT_KEYBOARD = 1
    INPUT_HARDWARE = 2
    KEYEVENTF_EXTENDEDKEY = 0x0001
    KEYEVENTF_KEYUP       = 0x0002
    KEYEVENTF_UNICODE     = 0x0004
    KEYEVENTF_SCANCODE    = 0x0008
    MAPVK_VK_TO_VSC = 0
    VK_TAB  = 0x09
    VK_MENU = 0x12
    wintypes.ULONG_PTR = wintypes.WPARAM
    class KEYBDINPUT(ctypes.Structure):
        _fields_ = (("wVk",         wintypes.WORD),("wScan",       wintypes.WORD),("dwFlags",     wintypes.DWORD),("time",        wintypes.DWORD),("dwExtraInfo", wintypes.ULONG_PTR))
    
        def __init__(self, *args, **kwds):
            super(KEYBDINPUT, self).__init__(*args, **kwds)
            if not self.dwFlags & KEYEVENTF_UNICODE:
                self.wScan = user32.MapVirtualKeyExW(self.wVk, MAPVK_VK_TO_VSC, 0)
                
    class HARDWAREINPUT(ctypes.Structure):
        _fields_ = (("uMsg",    wintypes.DWORD),("wParamL", wintypes.WORD),("wParamH", wintypes.WORD))
                    
    class MOUSEINPUT(ctypes.Structure):
        _fields_ = (("dx",          wintypes.LONG),("dy",          wintypes.LONG),("mouseData",   wintypes.DWORD),("dwFlags",     wintypes.DWORD),("time",        wintypes.DWORD),("dwExtraInfo", wintypes.ULONG_PTR))
    
    class INPUT(ctypes.Structure):
        class _INPUT(ctypes.Union):
            _fields_ = (("ki", KEYBDINPUT),("mi", MOUSEINPUT), ("hi", HARDWAREINPUT))
        _anonymous_ = ("_input",)
        _fields_ = (("type",   wintypes.DWORD),("_input", _INPUT))
    
    LPINPUT = ctypes.POINTER(INPUT)
    
    def _check_count(result, func, args):
        if result == 0:
            raise ctypes.WinError(ctypes.get_last_error())
        return args
    
    user32.SendInput.errcheck = _check_count
    user32.SendInput.argtypes = (wintypes.UINT, LPINPUT, ctypes.c_int) 
    
    def PressKey(hexKeyCode):
        x = INPUT(type=INPUT_KEYBOARD,ki=KEYBDINPUT(wVk=hexKeyCode))
        user32.SendInput(1, ctypes.byref(x), ctypes.sizeof(x))
    
    def ReleaseKey(hexKeyCode):
        x = INPUT(type=INPUT_KEYBOARD,ki=KEYBDINPUT(wVk=hexKeyCode,dwFlags=KEYEVENTF_KEYUP))
        user32.SendInput(1, ctypes.byref(x), ctypes.sizeof(x))
    
    class RoomSelectionFilter(ISelectionFilter):  
        def __init__(self, category):
            self.typeOfFilt = category
            
        def AllowElement(self, element):
            if element.Category.Id == self.typeOfFilt or self.typeOfFilt==ElementId.InvalidElementId:
                return True
            else:
                return False
    
        def AllowReference(self, refer, point):
            return False
    
    class Form24(Form):
        def __init__(self, lstSchedule, lstValue, _doc, RVTver, par_options):
            self.Font = Font(self.Font.FontFamily, 15, FontStyle.Regular, GraphicsUnit.Pixel)
            list_par = []
            list_values = []
            self.width_par = 1
            self._tableData = DataTable("Data")
            self._tableData.Columns.Add("Key", System.String)
            self._tableData.Columns.Add("Value", System.Object)
            self._tableData2 = DataTable("Data")
            self._tableData2.Columns.Add("Key", System.String)
            self._tableData2.Columns.Add("Value", System.Object)
            self.Filter = RoomSelectionFilter(ElementId(BuiltInCategory.OST_Rooms))
            [self._tableData.Rows.Add(key_, value_ ) for key_, value_ in zip(lstSchedule, lstValue)]
            [self._tableData2.Rows.Add(key_, value_ ) for key_, value_ in zip(par_options[0], par_options[0])]
            self.out = []
            self.InitializeComponent()
        
        def InitializeComponent(self):
            self._spr_top = System.Windows.Forms.Label()
            self._types = System.Windows.Forms.ComboBox()
            self._button1 = System.Windows.Forms.Button()
            self._txtBox = System.Windows.Forms.ComboBox()
            self._txtBox2 = System.Windows.Forms.TextBox()
            self._txtBox3 = System.Windows.Forms.TextBox()
            self._txtBox4 = System.Windows.Forms.TextBox()
            self._txtBlock2 = System.Windows.Forms.Label()
            self._txtBlock3 = System.Windows.Forms.Label()
            self._txtBlock4 = System.Windows.Forms.Label()
            self._txtBlock5 = System.Windows.Forms.Label()
            self._txtBlock6 = System.Windows.Forms.Label()
            self._txtBlock7 = System.Windows.Forms.Label()
            self.SuspendLayout()
            # 
            # Separator Top
            # 
            self._spr_top.Anchor     = System.Windows.Forms.AnchorStyles.Top | System.Windows.Forms.AnchorStyles.Left | System.Windows.Forms.AnchorStyles.Right
            self._spr_top.Location   = System.Drawing.Point(0, 0)
            self._spr_top.Name       = "spr_top"
            self._spr_top.Size       = System.Drawing.Size(2000, 2)
            self._spr_top.BackColor  = Color.FromArgb(82, 53, 239)
            # 
            # comboBox1
            # 
            self._types.Anchor = System.Windows.Forms.AnchorStyles.Top | System.Windows.Forms.AnchorStyles.Bottom | System.Windows.Forms.AnchorStyles.Left | System.Windows.Forms.AnchorStyles.Right
            self._types.Location = System.Drawing.Point(135, 7)
            self._types.Name = "dropDown"
            self._types.DataSource = self._tableData 
            self._types.DisplayMember = "Key"
            self._types.Size = System.Drawing.Size(197, 244)
            self._types.DropDownWidth = 150
            self._types.DropDownStyle = ComboBoxStyle.DropDownList
            self._types.SelectedIndexChanged += self.UpdateFilter
            # 
            # button1
            # 
            self._button1.Anchor = System.Windows.Forms.AnchorStyles.Bottom | System.Windows.Forms.AnchorStyles.Right
            self._button1.Location = System.Drawing.Point(12, 193)
            self._button1.Name = "button1"
            self._button1.Size = System.Drawing.Size(320, 27)
            self._button1.Text = "PRESS ESC TO CLOSE"
            self._button1.UseVisualStyleBackColor = True
            self._button1.BackColor = Color.White
            self._button1.Enabled = False
            # 
            # TextBlock2
            # 
            self._txtBlock2.Anchor = System.Windows.Forms.AnchorStyles.Bottom | System.Windows.Forms.AnchorStyles.Left
            self._txtBlock2.Location = System.Drawing.Point(12, 10)
            self._txtBlock2.Name = "txtBlock2"
            self._txtBlock2.Size = System.Drawing.Size(130, 20)
            self._txtBlock2.Text = "Type of Elements:"
            # 
            # TextBlock3
            # 
            self._txtBlock3.Anchor = System.Windows.Forms.AnchorStyles.Bottom | System.Windows.Forms.AnchorStyles.Left
            self._txtBlock3.Location = System.Drawing.Point(12, 38)
            self._txtBlock3.Name = "txtBlock3"
            self._txtBlock3.Size = System.Drawing.Size(130, 20)
            self._txtBlock3.Text = "Parameter (Any!):"
            # 
            # _drp_txtBox1
            #         
            self._txtBox.Anchor = System.Windows.Forms.AnchorStyles.Top | System.Windows.Forms.AnchorStyles.Bottom | System.Windows.Forms.AnchorStyles.Left | System.Windows.Forms.AnchorStyles.Right
            self._txtBox.Location = System.Drawing.Point(135, 35)
            self._txtBox.Name = "drp_txtBox"
            self._txtBox.Size = System.Drawing.Size(197, 244)
            self._txtBox.DataSource = self._tableData2 
            self._txtBox.DisplayMember = "Key"
            self._txtBox.DropDownWidth = 150    
            self._txtBox.AutoCompleteSource =AutoCompleteSource.ListItems
            self._txtBox.AutoCompleteMode =AutoCompleteMode.SuggestAppend
            self._txtBox.DropDownStyle = ComboBoxStyle.DropDown
            # 
            # TextBlock4
            # 
            self._txtBlock4.Anchor = System.Windows.Forms.AnchorStyles.Bottom | System.Windows.Forms.AnchorStyles.Left
            self._txtBlock4.Location = System.Drawing.Point(12, 66)
            self._txtBlock4.Name = "txtBlock4"
            self._txtBlock4.Size = System.Drawing.Size(120, 20)
            self._txtBlock4.Text = "Prefix:"
            # 
            # _txtBox2
            #         
            self._txtBox2.Anchor = System.Windows.Forms.AnchorStyles.Top | System.Windows.Forms.AnchorStyles.Bottom | System.Windows.Forms.AnchorStyles.Left | System.Windows.Forms.AnchorStyles.Right
            self._txtBox2.Location = System.Drawing.Point(135, 63)
            self._txtBox2.Name = "txtBox2"
            self._txtBox2.Size = System.Drawing.Size(197, 244)
            # 
            # TextBlock5
            # 
            self._txtBlock5.Anchor = System.Windows.Forms.AnchorStyles.Bottom | System.Windows.Forms.AnchorStyles.Left
            self._txtBlock5.Location = System.Drawing.Point(12, 94)
            self._txtBlock5.Name = "txtBlock5"
            self._txtBlock5.Size = System.Drawing.Size(120, 20)
            self._txtBlock5.Text = "Suffix:"
            # 
            # _txtBox3
            #         
            self._txtBox3.Anchor = System.Windows.Forms.AnchorStyles.Top | System.Windows.Forms.AnchorStyles.Bottom | System.Windows.Forms.AnchorStyles.Left | System.Windows.Forms.AnchorStyles.Right
            self._txtBox3.Location = System.Drawing.Point(135, 91)
            self._txtBox3.Name = "txtBox3"
            self._txtBox3.Size = System.Drawing.Size(197, 244)
            # 
            # TextBlock6
            # 
            self._txtBlock6.Anchor = System.Windows.Forms.AnchorStyles.Bottom | System.Windows.Forms.AnchorStyles.Left
            self._txtBlock6.Location = System.Drawing.Point(12, 122)
            self._txtBlock6.Name = "txtBlock6"
            self._txtBlock6.Size = System.Drawing.Size(120, 20)
            self._txtBlock6.Text = "Next Number:"
            # 
            # TextBlock7
            # 
            self._txtBlock7.Anchor = System.Windows.Forms.AnchorStyles.Bottom | System.Windows.Forms.AnchorStyles.Left
            self._txtBlock7.Location = System.Drawing.Point(12, 150)
            self._txtBlock7.Name = "txtBlock7"
            self._txtBlock7.Size = System.Drawing.Size(330, 40)
            self._txtBlock7.TextAlign = ContentAlignment.TopCenter
            self._txtBlock7.Text = "This is a dynamic updater!\nSelect elements to update parameters."
            # 
            # _txtBox4
            #         
            self._txtBox4.Anchor = System.Windows.Forms.AnchorStyles.Top | System.Windows.Forms.AnchorStyles.Bottom | System.Windows.Forms.AnchorStyles.Left | System.Windows.Forms.AnchorStyles.Right
            self._txtBox4.Location = System.Drawing.Point(135, 119)
            self._txtBox4.Name = "txtBox4"
            self._txtBox4.Size = System.Drawing.Size(197, 244)
            self._txtBox4.Text = "01"
            self._txtBox4.KeyPress += self.reviewKeys
            # 
            # Tab switcher
            # 
            self._txtBox2.TabIndex = 1
            self._txtBox3.TabIndex = 2
            self._txtBox4.TabIndex = 3
            self._types.TabStop    = False
            self._txtBox.TabStop   = False
            self._txtBox2.TabStop  = True
            self._txtBox3.TabStop  = True
            self._txtBox4.TabStop  = True
            self.KeyDown += self.MyOnKeyDown
            self.KeyPreview = True
            self.TabStop = False
            # 
            # Form24
            # 
            self.ShowInTaskbar = False
            self.ClientSize = System.Drawing.Size(344, 234)
            self.MaximizeBox = 0
            self.MinimizeBox = 0
            self.CenterToScreen() 
            self.MouseLeave += self.mouseleaveWindow
            self.FormBorderStyle = FormBorderStyle.FixedSingle
            self.Controls.Add(self._spr_top)
            self.Controls.Add(self._button1)
            self.Controls.Add(self._txtBox)
            self.Controls.Add(self._txtBox2)
            self.Controls.Add(self._txtBox3)
            self.Controls.Add(self._txtBox4)
            self.Controls.Add(self._types)
            self.Controls.Add(self._txtBlock2)
            self.Controls.Add(self._txtBlock3)
            self.Controls.Add(self._txtBlock4)
            self.Controls.Add(self._txtBlock5)
            self.Controls.Add(self._txtBlock6)
            self.Controls.Add(self._txtBlock7)
            self.ControlBox = False
            for cntrl in self.Controls:
                cntrl.MouseLeave += self.mouseleaveWindow
            self.Name = "Number Elements(Rooms, Grids, ...)"
            self.Text = "Number Elements(Rooms, Grids, ...)"
            iconFilename = 'C:\\NONICAPRO\\OtherFiles\\System\\Nonicafavicon.ICO'
            if not os.path.exists(iconFilename):
                iconFilename = 'C:\\NONICA\\OtherFiles\\System\\Nonicafavicon.ICO'
            icon = Icon(iconFilename)
            self.Icon = icon
            self.TopMost= True
            self.Closing += self.escapeEvent
            self.ResumeLayout(False)
            
        def MyOnKeyDown(self, sender, e):
            try:
	            if self.ActiveControl.Name != "drp_txtBox":
	                if e.KeyCode == System.Windows.Forms.Keys.Tab:
	                    self.SwitchFocus(e.Shift)
	                    e.Handled = True 
	                    e.SuppressKeyPress = True
	                elif Control.ModifierKeys == Keys.Shift and e.KeyCode == System.Windows.Forms.Keys.C:
	                    if isinstance(self.ActiveControl, TextBox) and self.ActiveControl.SelectionLength > 0:
	                        self.CopyValue()
	                        e.Handled = True  
	                        e.SuppressKeyPress = True
	                    elif not isinstance(self.ActiveControl, TextBox):
	                        self.CopyValue()
	                        e.Handled = True  
	                        e.SuppressKeyPress = True
	                elif Control.ModifierKeys == Keys.Shift and e.KeyCode == System.Windows.Forms.Keys.V:
	                    if System.Windows.Forms.Clipboard.GetText() != "":
	                        self.PasteValue()
	                        e.Handled = True 
	                        e.SuppressKeyPress = True
	                elif e.KeyCode == System.Windows.Forms.Keys.Enter and isinstance(self.ActiveControl, Button):
	                    self.ActiveControl.PerformClick()
	                    e.Handled = True 
	                    e.SuppressKeyPress = True
            except Exception as exc:
                pass
        
        def SwitchFocus(self, shiftPressed):
            current_control = self.ActiveControl
            focusable_controls = [ctrl for ctrl in self.Controls if ctrl.TabStop and ctrl.Enabled and ctrl.Visible]
            focusable_controls.sort(key=lambda ctrl: ctrl.TabIndex)
            current_index = focusable_controls.index(current_control) if current_control in focusable_controls else -1
            if shiftPressed:  # Shift + Tab: move backward
                next_index = (current_index - 1) % len(focusable_controls)
            else:  # Tab: move forward
                next_index = (current_index + 1) % len(focusable_controls)
            next_control = focusable_controls[next_index]
            next_control.Focus()
        
        def CopyValue(self):
            current_control = self.ActiveControl
            if isinstance(current_control, System.Windows.Forms.NumericUpDown):
                System.Windows.Forms.Clipboard.SetText(str(current_control.Value))
            elif isinstance(current_control, System.Windows.Forms.TextBox):
                System.Windows.Forms.Clipboard.SetText(str(current_control.SelectedText))
    
        def PasteValue(self):
            current_control = self.ActiveControl
            if isinstance(current_control, System.Windows.Forms.NumericUpDown):
                clipboard_text = System.Windows.Forms.Clipboard.GetText()
                try:
                    new_value = float(clipboard_text)
                    current_control.Value = max(min(new_value, current_control.Maximum), current_control.Minimum)
                except:
                    pass
            if isinstance(current_control, System.Windows.Forms.TextBox):
                clipboard_text = System.Windows.Forms.Clipboard.GetText()
                try:
                    position_cursor = current_control.SelectionStart
                    current_control.Text = current_control.Text.Insert(current_control.SelectionStart, clipboard_text)
                    current_control.SelectionStart = position_cursor + len(clipboard_text)
                except:
                    pass
        
        def mouseleaveWindow(self, sender, e):
            if self.ClientRectangle.Contains(self.PointToClient(Cursor.Position)):
                return 0
            else:
                user32.SetFocus(DocumentManager.Instance.CurrentUIApplication.MainWindowHandle)
    
        def reviewKeys(self, sender, e):
            if e.KeyChar != chr(8):
                if str(e.KeyChar).isdigit()==False:
                    e.Handled = True
        
        def UpdateFilter(self, sender, e):
            #Update selection filter
            category = sender.SelectedItem['Value']
            if sender.SelectedIndex == 0:
                category = ElementId.InvalidElementId
            self.Filter.typeOfFilt = category
            #Loose focus
            user32.SetFocus(DocumentManager.Instance.CurrentUIApplication.MainWindowHandle)
            #Update parameter list
            self.switchParameters(dict_seq[sender.SelectedItem['Key']])
            
        def addOne(self):
            try:
                old_val = self._txtBox4.Text
                totalLen = len(old_val)
                ini_val = int(old_val)
                ad_val = str(ini_val+1)
                self._txtBox4.Text = ad_val.zfill(totalLen)
            except:
                pass
        
        def radioButton_CheckedChanged(self, sender, e):
            if sender.Name.startswith("value"):
                self._txtBox.Enabled = sender.Checked
                self._units_value.Enabled = sender.Checked
            elif sender.Name.startswith("param"):
                self._drp_parameter.Enabled = sender.Checked
    
        def escapeEvent(self, sender, e):
            close=1
            self.saveToFile(directory)
            
        def pickobject(self):
            picked = uidoc.Selection.PickObject(ObjectType.Element, self.Filter, "Select in Revit")
            return picked
        
        def composeValue(self, asType=0):
            try:
                final_val=None
                pre_val = self._txtBox2.Text
                suf_val = self._txtBox3.Text
                num_val = self._txtBox4.Text
                if asType==0:
                    final_val = int(pre_val + num_val + suf_val)
                else:
                    final_val = pre_val + num_val + suf_val
                return final_val
            except:
                return None
                
        def switchParameters(self, indx):
            currentitems = []
            for item in self._txtBox.Items:
                currentitems.Add(item['Value'])
            new_sq = par_options[indx]
            if new_sq != currentitems:
                dataTable = DataTable("Data")
                dataTable.Columns.Add("Key", System.String)
                dataTable.Columns.Add("Value", System.Object)
                if self._txtBox.Text in entire_list or self._txtBox.Text =="":
                    [dataTable.Rows.Add(key_, value_ ) for key_, value_ in zip(new_sq, new_sq)]
                self._txtBox.DataSource = dataTable            
    
        def saveToFile(self, dir_path):
            try:
                with open(dir_path + "/" + "settingsNumberingNonica.txt","w") as file:
                    file.write(str(self._types.SelectedIndex)+"\n")
                    file.write(self._txtBox.Text+"\n")
                    file.write(self._txtBox2.Text+"\n")
                    file.write(self._txtBox3.Text+"\n")
                    file.write(self._txtBox4.Text+"\n")
            except:
                pass
                
        def loadFromFile(self, dir_path):
            #Default value
            self._types.SelectedIndex = 5
            try:
                with open(dir_path + "/" + "settingsNumberingNonica.txt","r") as file:
                    all_lines = file.readlines()
                    self._types.SelectedIndex = int(all_lines[0].strip())
                    par_val = all_lines[1].strip()
                    if par_val != "":
                        self._txtBox.SelectedIndex = -1
                        self._txtBox.Text = par_val
                    self._txtBox2.Text = all_lines[2].strip()
                    self._txtBox3.Text = all_lines[3].strip()
                    next_number_val = all_lines[4].strip()
                    if next_number_val != "":
                        self._txtBox4.Text = next_number_val
            except Exception as e:
                pass
                        
    def getDocumentsFolder():
        dll = ctypes.windll.shell32
        buf = ctypes.create_unicode_buffer(MAX_PATH + 1)
        if dll.SHGetSpecialFolderPathW(None, buf, 0x0005, False):
            return buf.value
        else:
            return 0
    
    doc = DocumentManager.Instance.CurrentDBDocument
    uidoc = DocumentManager.Instance.CurrentUIApplication.ActiveUIDocument
    app = doc.Application
    version = int(app.VersionNumber)
    language = app.Language
    
    directory = getDocumentsFolder()
    list_drop=["Any Element", "Areas","Doors", "Grids", "Levels", "Rooms", "Spaces", "Windows"]
    dict_seq={}
    for x,y in zip(list_drop,[1,0,1,2,2,0,0,1]):
        dict_seq.Add(x,y)
    
    wnd_hand = DocumentManager.Instance.CurrentUIApplication.MainWindowHandle 
    nativeWindow = NativeWindow()
    nativeWindow.AssignHandle(wnd_hand)
    if language == Autodesk.Revit.ApplicationServices.LanguageType.Spanish:
        entire_list = ["Nombre","Número","Comentarios","Marca"]
        par_options = [["Nombre","Número","Comentarios"], ["Marca","Comentarios"], ["Nombre"]]
    elif language == Autodesk.Revit.ApplicationServices.LanguageType.German:
        entire_list = ["Name","Nummer","Kommentare","Kennzeichen"]
        par_options = [["Name","Nummer","Kommentare"], ["Kennzeichen","Kommentare"], ["Name"]]
    elif language == Autodesk.Revit.ApplicationServices.LanguageType.French:
        entire_list = ["Nom","Numéro","Commentaires","Identifiant"]
        par_options = [["Nom","Numéro","Commentaires"], ["Identifiant","Commentaires"], ["Nom"]]
    elif language == Autodesk.Revit.ApplicationServices.LanguageType.Italian:
        entire_list = ["Nome","Numero","Commenti","Contrassegno"]
        par_options = [["Nome","Numero","Commenti"], ["Contrassegno","Commenti"], ["Nome"]]
    else:
        entire_list = ["Name","Number","Comments","Mark"]
        par_options = [["Name","Number","Comments"], ["Mark","Comments"], ["Name"]]
    objForm = Form24(list_drop, [ElementId.InvalidElementId, ElementId(BuiltInCategory.OST_Areas), ElementId(BuiltInCategory.OST_Doors), ElementId(BuiltInCategory.OST_Grids), ElementId(BuiltInCategory.OST_Levels), ElementId(BuiltInCategory.OST_Rooms), ElementId(BuiltInCategory.OST_MEPSpaces), ElementId(BuiltInCategory.OST_Windows)], doc, version, par_options)
    #Check if settings file exists to load
    objForm.Show(nativeWindow)
    try:
        objForm.loadFromFile(directory)
    except:
        pass
    close=0
    while close==0:
        try:
            #Select element
            sel_ref = objForm.pickobject()
            sel_ele = doc.GetElement(sel_ref)
            #TransactionManager.Instance.EnsureInTransaction(doc)
            with Transaction(doc, "Number Elements(Rooms, Grids, ...)") as t:
                t.Start()
                #Get parameter by name from object
                wndw_par = objForm._txtBox.Text
                if wndw_par != "":
                    pars = sel_ele.GetParameters(wndw_par)
                    if len(pars) > 0:
                        #Parameter read only
                        par = pars[0]
                        if par.IsReadOnly ==False:
                            type_par = par.StorageType
                            if StorageType.Integer == type_par:
                                #Compose parameter value
                                value = objForm.composeValue(0)
                                if value != None:
                                    par.Set(value)
                                objForm.addOne()
                            elif StorageType.String == type_par:
                                #Compose parameter value
                                value = objForm.composeValue(1)
                                if value != None:
                                    par.Set(value)
                                objForm.addOne()
                            else:
                                objForm.Hide()
                                task2 = Autodesk.Revit.UI.TaskDialog("Number Elements(Rooms, Grids, ...)")
                                task2.MainInstruction = "The specified parameter is not defined as integer or string. Please, change the Type of Parameter"
                                task2.Show()
                                objForm.Show()
                        else:
                            objForm.Hide()
                            task2 = Autodesk.Revit.UI.TaskDialog("Number Elements(Rooms, Grids, ...)")
                            task2.MainInstruction = "The specified parameter is read-only."
                            task2.Show()
                            objForm.Show()
                    else:
                        objForm.Hide()
                        task2 = Autodesk.Revit.UI.TaskDialog("Number Elements(Rooms, Grids, ...)")
                        task2.MainInstruction = "The specified parameter does not exists in the selected element."
                        task2.Show()
                        objForm.Show()
                else:
                    objForm.Hide()
                    task2 = Autodesk.Revit.UI.TaskDialog("Number Elements(Rooms, Grids, ...)")
                    task2.MainInstruction = "No parameter was specified to number. Please, define it."
                    task2.Show()
                    objForm.Show()
                t.Commit()
            #TransactionManager.Instance.TransactionTaskDone()
            doc.Regenerate()
        except Autodesk.Revit.Exceptions.OperationCanceledException as e:
            close=1
            objForm.Close()
        except Exception as ex:
            pass
OUT = 0

"""
You agreed to the following license terms and conditions. They are also applicable to obtaining and using this script:
License Agreement
For use of NonicaTab PRO.
This License Agreement (this “Agreement” of this “License Agreement”) is made and effective as of the current date (the “Commencement Date”) by and between Nonica by Nonica Enterprise SL a company organized and existing in Spain with a registered address at Avd.Chafarinas 16 Spain (“Licensor”) and yourself (“Licensee”).
WHEREAS:
1.    Licensee wishes to obtain access and use this script (hereinafter, the “Asset”), and
2.    Licensor is willing to grant to the Licensee a non-exclusive, non-transferable License to use the Asset for the term and specific purpose set forth in this Agreement,
NOW, THEREFORE, your access to and use of the Service is conditioned on your acceptance of and compliance with these Terms and Conditions. These Terms and Conditions apply to all visitors, users and others who access or use NonicaTab PRO and its derivative files and scripts.
1. Definitions
1.1 “Agreement” means this License Agreement including the attached Schedule.
1.2 “Confidential Information” means information that:
a. is by its nature confidential;
b. is designated in writing by Licensor as confidential;
c. the Licensee knows or reasonably ought to know is confidential;
d. Information comprised in or relating to any Intellectual Property Rights of Licensor.
1.3 “Asset” means the Asset provided by Licensor as specified in Item 6 of the Schedule in the form as stated in Item 7 of the Schedule.
1.4 “Intellectual Property Rights” means all rights in and to any copyright, trademark, trading name, design, patent, know how (trade secrets) and all other rights resulting from intellectual activity in the industrial, scientific, literary or artistic field and any application or right to apply for registration of any of these rights and any right to protect or enforce any of these rights, as further specified in clause 5.
1.5 “Party” means a person or business entity who has executed this Agreement; details of the Parties are specified in Item 2 of the Schedule.
1.6 “Term” means the term of this Agreement commencing on the Commencement Date as specified in Item 4 of the Schedule and expiring on the Expiry Date specified in Item 5 of the Schedule.
2. License Grant
2.1 Licensor grants to the Licensee a non-exclusive, non-transferable License for the Term to use the Asset for the specific purpose specified in this Agreement, subject to the terms and conditions set out in this Agreement.
3. Charges
3.1 In consideration of the Licensor providing the License under clause 2 of this License Agreement, the Licensee agrees to pay Licensor the amount of the License Charge as specified in Item 9 of the Schedule.
4. Licensee’s Obligations
4.1 The Licensee cannot use the Asset, for purposes other than as specified in this Agreement and in Item 8 of the Schedule.
4.2 The Licensee may permit its employees to use the Asset for the purposes described in Item 8, provided that the Licensee takes all necessary steps and imposes the necessary conditions to ensure that all employees using the Asset do not commercialise or disclose the contents of it to any third person, or use it other than in accordance with the terms of this Agreement.
4.3 The Licensee will not distribute, sell, License or sub-License, let, trade or expose for sale the Asset to a third party.
4.4 No copies of the Asset are to be made other than as expressly approved by Licensor.
4.5 No changes to the Asset or its content may be made by Licensee.
4.6 The Licensee will provide technological and security measures to ensure that the Asset which the Licensee is responsible for is physically and electronically secure from unauthorised use or access.
4.7 Licensee shall ensure that the Asset retains all Licensor copyright notices and other proprietary legends and all trademarks or service marks of Licensor.
5. Intellectual Property Rights
5.1 All Intellectual Property Rights over and in respect of the Asset are owned by Licensor. The Licensee does not acquire any rights of ownership in the Asset.
6. Limitation of Liability
6.1 The Licensee acknowledges and agrees that neither Licensor nor its board members, officers, employees or agents, will be liable for any loss or damage arising out of or resulting from Licensor’s provision of the Asset under this Agreement, or any use of the Asset by the Licensee or its employees; and Licensee hereby releases Licensor to the fullest extent from any such liability, loss, damage or claim.
7. Confidentiality
7.1 Neither Party may use, disclose or make available to any third party the other Party’s Confidential Information, unless such use or disclosure is done in accordance with the terms of this Agreement.
7.2 Each Party must hold the other Party’s Confidential Information secure and in confidence, except to the extent that such Confidential Information:
a. is required to be disclosed according to the requirements of any law, judicial or legislative body or government agency; or
b. was approved for release in writing by the other Party, but only to the extent of and subject to such conditions as may be imposed in such written authorisation.
7.3 This clause 7 will survive termination of this Agreement.
8. Disclaimers & Release
8.1 To the extent permitted by law, Licensor will in no way be liable to the Licensee or any third party for any loss or damage, however caused (including through negligence) which may be directly or indirectly suffered in connection with any use of the Asset.
8.2 The Asset is provided by Licensor on an “as is” basis.
8.3 Licensor will not be held liable by the Licensee in any way, for any loss, damage or injury suffered by the Licensee or by any other person related to any use of the Asset or any part thereof.
8.4 Notwithstanding anything contained in this Agreement, in no event shall Licensor be liable for any claims, damages or loss which may arise from the modification, combination, operation or use of the Asset with Licensee computer programs.
8.5 Licensor does not warrant that the Asset will function in any environment.
8.6 The Licensee acknowledges that: a. The Asset has not been prepared to meet any specific requirements of any party, including any requirements of Licensee; and b. it is therefore the responsibility of the Licensee to ensure that the Asset meets its own individual requirements.
8.7 To the extent permitted by law, no express or implied warranty, term, condition or undertaking is given or assumed by Licensor, including any implied warranty of merchantability or fitness for a particular purpose.
9. Indemnification
9.1 The Licensee must indemnify, defend and hold harmless Licensor, its board members, officers, employees and agents from and against any and all claims (including third party claims), demands, actions, suits, expenses (including attorney’s fees) and damages (including indirect or consequential loss) resulting in any way from:
a. Licensee’s and Licensee’s employee’s use or reliance on the Asset,
b. any breach of the terms of this License Agreement by the Licensee or any Licensee employee, and
c. any other act of Licensee.
9.2 This clause 9 will survive termination of this Agreement.
10. Waiver
10.1 Any failure or delay by either Party to exercise any right, power or privilege hereunder or to insist upon observance or performance by the other of the provisions of this License Agreement shall not operate or be construed as a waiver thereof.
11. Governing Law
11.1 This Agreement will be construed by and governed in accordance with the laws of Spain. The Parties submit to exclusive jurisdiction of the courts of Spain.
12. Termination
12.1 This Agreement and the License granted herein commences upon the Commencement Date and is granted for the Term, unless otherwise terminated by Licensor in the event of any of the following:
a. if the Licensee is in breach of any term of this License Agreement and has not corrected such breach to Licensor’s reasonable satisfaction within 7 days of Licensor’s notice of the same;
b. if the Licensee becomes insolvent, or institutes (or there is instituted against it) proceedings in bankruptcy, insolvency, reorganization or dissolution, or makes an assignment for the benefit of creditors; or
c. the Licensee is in breach of clause 5 or 7 of this Agreement.
12.2 Termination under this clause shall not affect any other rights or remedies Licensor may have.
14. Assignment
14.1 Licensee shall not assign any rights of this License Agreement, without the prior written consent of Licensor.
15. Notices
15.1 All notices required under this Agreement shall be in writing and shall be deemed given (i) when delivered personally; (ii) five (5) days after mailing, when sent certified mail, return receipt requested and postage prepaid; or (iii) one (1) business day after dispatch, when sent via a commercial overnight carrier, fees prepaid. All notices given by either Party must be sent to the address of the other as first written above (unless otherwise changed by written notice).
15.2 Autodesk username, Autodesk Internal ID number and unique identifiers of hardware in your computer are stored in a speciliazed third party cloud server for licensing purposes. This information is neccessary for using NonicaTab PRO. The licensee maintains its full right to delete/remove such information if declining the renewal of the software. NonicaTab PRO will not shared that information with any third party company unless it is required judicially by law. Please contact hello@nonica.io with any further doubt/request.
16. Counterparts
16.1 This Agreement may be executed in any number of counterparts, each of which shall be deemed to be an original and all of which taken together shall constitute one instrument.
17. Severability
17.1 The Parties recognize the uncertainty of the law with respect to certain provisions of this Agreement and expressly stipulate that this Agreement will be construed in a manner that renders its provisions valid and enforceable to the maximum extent possible under applicable law. To the extent that any provisions of this Agreement are determined by a court of competent jurisdiction to be invalid or unenforceable, such provisions will be deleted from this Agreement or modified so as to make them enforceable and the validity and enforceability of the remainder of such provisions and of this Agreement will be unaffected.
18. Entire Agreement
18.1 This Agreement contains the entire agreement between the Parties and supersedes any previous understanding, commitments or agreements, oral or written. Further, this Agreement may not be modified, changed, or otherwise altered in any respect except by a written agreement signed by both Parties.
IN WITNESS WHEREOF, this Agreement, including the attached Schedule, was signed by the Parties under the hands of their duly authorized representatives and made effective as of the current date.
Nonica by Nonica Enterprise SL,
Signature
10/04/2025
Jaime Alonso Candau
Please contact hello@nonica.io with any further doubt/request.
Your signatureby using and accessing this script.
Signed by accepting these terms.
Current date.
"""
# ----------------------------------------
