# Dynamo graph ReNamer.dyn (Dynamo 2.6.2.15705)

default_prefix = StringInput("")
default_suffix = StringInput("")
renaming = Python(IN[0]=default_prefix, IN[1]=default_suffix)
# ---------- renaming.python (721 lines) ----------
import sys
import clr

clr.AddReference('ProtoGeometry')
from Autodesk.DesignScript.Geometry import *

import os.path

from random import randint

import inspect

import unicodedata 

clr.AddReference("RevitServices")
import RevitServices
from RevitServices.Persistence import DocumentManager
from RevitServices.Transactions import TransactionManager
from System.Collections.Generic import*

clr.AddReference("RevitAPIUI")
import Autodesk 
from Autodesk.Revit.UI import TaskDialog, IExternalEventHandler, ExternalEvent, DockablePanes, DockablePane

clr.AddReference('RevitAPI')
import Autodesk
from Autodesk.Revit.DB import *
from Autodesk.Revit.DB import BuiltInCategory

clr.AddReference('System.Drawing')
clr.AddReference('System.Windows.Forms')
import System.Drawing
import System.Windows.Forms

from System.Drawing import *
from System.Reflection import Assembly, BindingFlags
from System.Windows.Forms import *

clr.AddReference('System.Data')
from System.Data import *

from System import Array
from System.Collections.Generic import *

class UnsubcribeDocChange(IExternalEventHandler):
	def __init__(self):
		pass
		
	def Execute(self, uiapp):
		try:
			uiapp.ViewActivated -= new_sub
		except Exception as e:
			pass
			
	def GetName(self):
		return "Unsubscribe Document Changed Event"

class Renaming(IExternalEventHandler):
	def __init__(self):
		pass
		
	def Execute(self, uiapp):
		try:
			doc = uiapp.ActiveUIDocument.Document
			prefix = str(wndw._txtBox_pre.Text)
			suffix = str(wndw._txtBox_suf.Text)
			tx_from = str(wndw._txtBox_rplFr.Text)
			tx_to = str(wndw._txtBox_rplTo.Text)
			with Transaction(doc, "ReNamer") as t:
				t.Start()
				for item_vw in wndw._listBox1.CheckedItems:
					item = item_vw['Value']._view
					#Get initial name
					initial_name = Element.Name.__get__(item)
					if isinstance(item, Architecture.Room) or isinstance(item, Area) or isinstance(item, Mechanical.Space):
						initial_name = item.get_Parameter(Autodesk.Revit.DB.BuiltInParameter.ROOM_NAME).AsString()
					#Get number if it is number	
					if wndw._categories.SelectedItem['Key'].endswith("Numbers") == True:
						if isinstance(item, Architecture.Room) or isinstance(item, Area) or isinstance(item, Mechanical.Space):
							initial_name = item.Number
						else:
							initial_name = item.SheetNumber
					#Replace default no valid values and replaceFromTo
					existing_name = initial_name.Replace("{", "").Replace("}", "")
					if tx_from != "":
						existing_name = existing_name.Replace(tx_from, tx_to)
					#Compose
					finalname = prefix + existing_name + suffix
					try:
						#Attach value to object
						if wndw._categories.SelectedItem['Key'].endswith("Numbers") == True:
							if isinstance(item, Architecture.Room) or isinstance(item, Area) or isinstance(item, Mechanical.Space):
								item.Number = finalname
							else:
								item.SheetNumber = finalname
						else:
							item.Name = finalname
					except Exception as e:
						wndw.TopMost = False
						Autodesk.Revit.UI.TaskDialog.Show("Warning",str(e))
						wndw.TopMost = True
				t.Commit()
			if wndw._categories.SelectedItem['Key'].endswith("Numbers"):
				dpId = DockablePanes.BuiltInDockablePanes.ProjectBrowser
				dP = DockablePane(dpId)
				dP.Show()
			wndw.refreshViews()
		except Exception as e:
			pass
		wndw.ActDeaItems(True)
			
	def GetName(self):
		return "Renaming"

class MyCheckedListBox(CheckedListBox):
	@property
	def ItemHeight(self):
		return 20
	
	@ItemHeight.setter
	def ItemHeight(self, value):
		self._item_height = value	

class view_info():
	def __init__(self, view):
		self._view = view
		self._id = view.Id
		self._name = strip_accents(Element.Name.__get__(view))
		#Get complete name for rooms ...
		if isinstance(view, Architecture.Room) or isinstance(view, Area) or isinstance(view, Mechanical.Space):
			self._name = view.get_Parameter(Autodesk.Revit.DB.BuiltInParameter.ROOM_NAME).AsString()
		if isinstance(view, GroupType):
			pretitle = "Model Group: "
			if view.Category.Id == ElementId(BuiltInCategory.OST_IOSDetailGroups):
				pretitle = "Detail Group: "
			self._title = pretitle + self._name
		elif isinstance(view, Architecture.Room) or isinstance(view, Area) or isinstance(view, Mechanical.Space):
			self._number = view.Number
			self._title = self._number
		elif hasattr(view, 'Title'):
			self._title = strip_accents(view.Title)
			if view.IsTemplate:
				self._title = "View Template: " + strip_accents(view.Title)
			if hasattr(view, 'SheetNumber'):
				self._number = view.SheetNumber
		else:
			self._title = self._name

def strip_accents(text):
	return ''.join(char for char in unicodedata.normalize('NFKD', text) if unicodedata.category(char) != 'Mn')
					
class Form_cats(Form):
	def __init__(self, ext_ev, doc_sub):
		self.Font = Font(self.Font.FontFamily, 15, FontStyle.Regular, GraphicsUnit.Pixel)
		self.past_cat = ""
		self.doc_sub_eve = doc_sub
		self.Load += self.form_load
		self.selectionhistory = []
		self.event = ext_ev
		self.name_cat = ["Area Names", "Area Numbers", "Grids", "Groups", "Levels", "Room Names", "Room Numbers","Schedules", "Sheet Names", "Sheet Numbers", "Space Names", "Space Numbers", "Views & Legends"]
		self.categs = [BuiltInCategory.OST_Areas, BuiltInCategory.OST_Areas, BuiltInCategory.OST_Grids, [BuiltInCategory.OST_IOSDetailGroups, BuiltInCategory.OST_IOSModelGroups],BuiltInCategory.OST_Levels ,BuiltInCategory.OST_Rooms, BuiltInCategory.OST_Rooms, BuiltInCategory.OST_Schedules, BuiltInCategory.OST_Sheets, BuiltInCategory.OST_Sheets, BuiltInCategory.OST_MEPSpaces,  BuiltInCategory.OST_MEPSpaces, BuiltInCategory.OST_Views]
		self._tableData = DataTable("Data")
		self._tableData.Columns.Add("Key", System.String)
		self._tableData.Columns.Add("Value", System.Object)
		[self._tableData.Rows.Add(key_, value_ ) for key_, value_ in zip(self.name_cat, self.categs)]
		self.InitializeComponent()
		
	def form_load(self, sender, e):	
		try:
			ids = uidoc.Selection.GetElementIds()
			if ids.Count > 1:
				list_cat = []
				ele = doc.GetElement(ids[0])
				if isinstance(ele, Autodesk.Revit.DB.Area):
					#Update Window First
					self.presetWindow(ids, 2, 1)
					#
					self.presetWindow(ids, 0)
				elif isinstance(ele, Autodesk.Revit.DB.Grid):
					self.presetWindow(ids, 2)
				elif isinstance(ele, Autodesk.Revit.DB.GroupType):
					self.presetWindow(ids, 3)
				elif isinstance(ele, Autodesk.Revit.DB.Level):
					self.presetWindow(ids, 4)
				elif isinstance(ele, Autodesk.Revit.DB.Architecture.Room):
					self.presetWindow(ids, 5)
				elif isinstance(ele, Autodesk.Revit.DB.View):
					if ele.ViewType == ViewType.Schedule:
						self.presetWindow(ids, 7)
					elif ele.ViewType == ViewType.DrawingSheet:
						self.presetWindow(ids, 8)
					else:
						self.presetWindow(ids, 12)
				elif isinstance(ele, Autodesk.Revit.DB.Mechanical.Space):
					self.presetWindow(ids, 10)
				else:
					self.presetWindow(ids, 12, 1)
			else:
				self.presetWindow(ids, 12, 1)
		except Exception as e:
			self.presetWindow(None, 12, 1)
	
	def presetWindow(self, ids, number, asignChecks=0):
		self.setCategoriesAndViews(self.categs[number])
		self._categories.SelectedIndex = number
		if asignChecks == 0:
			self.selIdsWindow(ids)

	def selIdsWindow(self, ids):
		for id in ids:
			for indx in range(0,len(self._listBox1.Items)):
				if self._listBox1.Items[indx]['Value']._id == id:
					self._listBox1.SetItemChecked(indx, True)
					self._listBox1.SelectedIndex = indx
					break
					
	def InitializeComponent(self):
		self._spr_top      = System.Windows.Forms.Label()
		self._categories   = System.Windows.Forms.ComboBox()
		self._listBox1     = MyCheckedListBox()
		#System.Windows.Forms.CheckedListBox()
		self._button1      = System.Windows.Forms.Button()
		self._txtBlock2    = System.Windows.Forms.Label()
		self._txtBlock3    = System.Windows.Forms.Label()
		self._txtBlock4    = System.Windows.Forms.Label()
		self._txtBox_rplFr = System.Windows.Forms.TextBox()
		self._txtBlock5    = System.Windows.Forms.Label()
		self._txtBox_pre   = System.Windows.Forms.TextBox()
		self._txtBlock6    = System.Windows.Forms.Label()
		self._txtBox_suf   = System.Windows.Forms.TextBox()
		self._txtBlock7    = System.Windows.Forms.Label()
		self._txtBox_rplTo = System.Windows.Forms.TextBox()
		self.SuspendLayout()
		# 
		# Separator Top
		# 
		self._spr_top.Anchor     = System.Windows.Forms.AnchorStyles.Top | System.Windows.Forms.AnchorStyles.Left | System.Windows.Forms.AnchorStyles.Right
		self._spr_top.Location   = System.Drawing.Point(0, 0)
		self._spr_top.Name       = "spr_top"
		self._spr_top.Size       = System.Drawing.Size(2000, 2)
		self._spr_top.BackColor  = Color.FromArgb(82, 53, 239)
		# 
		# TextBlock2
		# 
		self._txtBlock2.Anchor = System.Windows.Forms.AnchorStyles.Top | System.Windows.Forms.AnchorStyles.Left
		self._txtBlock2.Location = System.Drawing.Point(12, 10)
		self._txtBlock2.Name = "txtBlock2"
		self._txtBlock2.Size = System.Drawing.Size(120, 20)
		self._txtBlock2.Text = "Category:"
		# 
		# comboBox1 Cat
		# 
		self._categories.Anchor = System.Windows.Forms.AnchorStyles.Top | System.Windows.Forms.AnchorStyles.Left | System.Windows.Forms.AnchorStyles.Right
		self._categories.Location = System.Drawing.Point(12, 32)
		self._categories.Name = "dropDown"
		self._categories.DataSource = self._tableData 
		self._categories.DisplayMember = "Key"
		self._categories.Size = System.Drawing.Size(430, 244)
		self._categories.DropDownWidth = 150
		self._categories.DropDownStyle = ComboBoxStyle.DropDownList
		self._categories.SelectedIndexChanged += self.UpdateFilter
		# 
		# TextBlock3
		# 
		self._txtBlock3.Anchor = System.Windows.Forms.AnchorStyles.Top | System.Windows.Forms.AnchorStyles.Left
		self._txtBlock3.Location = System.Drawing.Point(12, 63)
		self._txtBlock3.Name = "txtBlock3"
		self._txtBlock3.Size = System.Drawing.Size(160, 20)
		self._txtBlock3.Text = "Elements Of Category:"
		# 
		# checkedListBox1
		# 
		self._listBox1.Anchor = System.Windows.Forms.AnchorStyles.Top |  System.Windows.Forms.AnchorStyles.Left | System.Windows.Forms.AnchorStyles.Bottom | System.Windows.Forms.AnchorStyles.Right
		self._listBox1.FormattingEnabled = True
		self._listBox1.CheckOnClick = True
		self._listBox1.HorizontalScrollbar = True
		self._listBox1.Name = "checkedListBox1"
		self._listBox1.Location = System.Drawing.Point(12, 85)
		self._listBox1.DrawMode = DrawMode.OwnerDrawVariable
		self._listBox1.DisplayMember = "Key"
		self._listBox1.Size = System.Drawing.Size(430, 270)
		self._listBox1.SelectedIndexChanged += self.changeSelection
		# 
		# TextBlock4
		# 
		self._txtBlock4.Anchor = System.Windows.Forms.AnchorStyles.Bottom | System.Windows.Forms.AnchorStyles.Left
		self._txtBlock4.Location = System.Drawing.Point(12, 363)
		self._txtBlock4.Name = "txtBlock4"
		self._txtBlock4.Size = System.Drawing.Size(115, 20)
		self._txtBlock4.Text = "Replace From:"
		# 
		# TextBox Replace From
		# 
		self._txtBox_rplFr.Anchor = System.Windows.Forms.AnchorStyles.Bottom | System.Windows.Forms.AnchorStyles.Left | System.Windows.Forms.AnchorStyles.Right
		self._txtBox_rplFr.Location = System.Drawing.Point(135, 360)
		self._txtBox_rplFr.Name = "txt_box"
		self._txtBox_rplFr.Size = System.Drawing.Size(307, 294)
		self._txtBox_rplFr.KeyPress += self.previewPref
		# 
		# TextBlock5
		# 
		self._txtBlock5.Anchor = System.Windows.Forms.AnchorStyles.Bottom | System.Windows.Forms.AnchorStyles.Left
		self._txtBlock5.Location = System.Drawing.Point(12, 393)
		self._txtBlock5.Name = "txtBlock5"
		self._txtBlock5.Size = System.Drawing.Size(115, 20)
		self._txtBlock5.Text = "Replace To:"
		# 
		# TextBox Replace To
		# 
		self._txtBox_rplTo.Anchor = System.Windows.Forms.AnchorStyles.Bottom | System.Windows.Forms.AnchorStyles.Left | System.Windows.Forms.AnchorStyles.Right
		self._txtBox_rplTo.Location = System.Drawing.Point(135, 390)
		self._txtBox_rplTo.Name = "txt_box2"
		self._txtBox_rplTo.Size = System.Drawing.Size(307, 294)
		self._txtBox_rplTo.KeyPress += self.previewPref
		# 
		# TextBlock6
		# 
		self._txtBlock6.Anchor = System.Windows.Forms.AnchorStyles.Bottom | System.Windows.Forms.AnchorStyles.Left
		self._txtBlock6.Location = System.Drawing.Point(12, 423)
		self._txtBlock6.Name = "txtBlock6"
		self._txtBlock6.Size = System.Drawing.Size(110, 20)
		self._txtBlock6.Text = "Add Prefix:"
		# 
		# TextBox Prefix
		# 
		self._txtBox_pre.Anchor = System.Windows.Forms.AnchorStyles.Bottom | System.Windows.Forms.AnchorStyles.Left | System.Windows.Forms.AnchorStyles.Right
		self._txtBox_pre.Location = System.Drawing.Point(135, 420)
		self._txtBox_pre.Name = "txt_box3"
		self._txtBox_pre.Size = System.Drawing.Size(307, 294)
		self._txtBox_pre.Text = IN[0]
		self._txtBox_pre.KeyPress += self.previewPref
		# 
		# TextBlock7
		# 
		self._txtBlock7.Anchor = System.Windows.Forms.AnchorStyles.Bottom | System.Windows.Forms.AnchorStyles.Left
		self._txtBlock7.Location = System.Drawing.Point(12, 453)
		self._txtBlock7.Name = "txtBlock7"
		self._txtBlock7.Size = System.Drawing.Size(110, 20)
		self._txtBlock7.Text = "Add Suffix:"
		# 
		# TextBox Suffix
		# 
		self._txtBox_suf.Anchor = System.Windows.Forms.AnchorStyles.Bottom | System.Windows.Forms.AnchorStyles.Left | System.Windows.Forms.AnchorStyles.Right
		self._txtBox_suf.Location = System.Drawing.Point(135, 450)
		self._txtBox_suf.Name = "txt_box4"
		self._txtBox_suf.Size = System.Drawing.Size(307, 294)
		self._txtBox_suf.Text = IN[1]
		self._txtBox_suf.KeyPress += self.previewPref
		# 
		# button1
		# 
		self._button1.Anchor = System.Windows.Forms.AnchorStyles.Bottom | System.Windows.Forms.AnchorStyles.Left | System.Windows.Forms.AnchorStyles.Right
		self._button1.Location = System.Drawing.Point(12, 482)
		self._button1.Name = "button1"
		self._button1.Size = System.Drawing.Size(432, 27)
		self._button1.Text = "ReName Selected"
		self._button1.UseVisualStyleBackColor = True
		self._button1.Click += self.Button1Click
		# 
		# Tab switcher
		# 
		self._categories.TabIndex   = 1
		self._listBox1.TabIndex     = 2
		self._txtBox_rplFr.TabIndex = 3
		self._txtBox_rplTo.TabIndex = 4
		self._txtBox_pre.TabIndex   = 5
		self._txtBox_suf.TabIndex   = 6
		self._button1.TabIndex      = 7
		self._categories.TabStop    = True
		self._listBox1.TabStop      = True
		self._txtBox_rplFr.TabStop  = True
		self._txtBox_rplTo.TabStop  = True
		self._txtBox_pre.TabStop    = True
		self._txtBox_suf.TabStop    = True
		self._button1.TabStop       = True
		self.KeyDown += self.MyOnKeyDown
		self.KeyPreview = True
		self.TabStop = False
		# 
		# Form24
		# 
		self.TopMost = True
		self.ShowInTaskbar = False
		self.ClientSize = System.Drawing.Size(454, 520)
		self.MaximizeBox = 0
		self.MinimizeBox = 0
		self.CenterToScreen() 
		self.FormBorderStyle = FormBorderStyle.Sizable
		self.SizeGripStyle = SizeGripStyle.Show
		self.ShowInTaskbar = True
		self.MaximizeBox = True
		self.MinimizeBox = True	
		self.Controls.Add(self._spr_top)
		self.Controls.Add(self._button1)
		self.Controls.Add(self._categories)
		self.Controls.Add(self._txtBlock2)
		self.Controls.Add(self._txtBlock3)
		self.Controls.Add(self._txtBlock4)
		self.Controls.Add(self._txtBlock5)
		self.Controls.Add(self._txtBox_rplFr)
		self.Controls.Add(self._txtBox_rplTo)
		self.Controls.Add(self._txtBlock6)
		self.Controls.Add(self._txtBox_pre)
		self.Controls.Add(self._txtBlock7)
		self.Controls.Add(self._txtBox_suf)
		self.Controls.Add(self._listBox1)
		self.Name = "ReNamer"
		self.Text = "ReNamer"
		iconFilename = 'C:\\NONICAPRO\\OtherFiles\\System\\Nonicafavicon.ICO'
		if not os.path.exists(iconFilename):
			iconFilename = 'C:\\NONICA\\OtherFiles\\System\\Nonicafavicon.ICO'
		icon = Icon(iconFilename)
		self.Icon = icon
		self.ResumeLayout(False)
			
	def ActDeaItems(self, IsActive):
		self._categories.Enabled   = IsActive
		self._listBox1.Enabled     = IsActive
		self._txtBox_rplFr.Enabled = IsActive
		self._txtBox_rplTo.Enabled = IsActive
		self._txtBox_pre.Enabled   = IsActive
		self._txtBox_suf.Enabled   = IsActive
		self._button1.Enabled      = IsActive
		if IsActive == True:
			self._button1.Text = "ReName Selected"
		else:
			self._button1.Text = "Revit is Blocked (Other command was being run). Press Esc"
	
	def MyOnKeyDown(self, sender, e):
		try:
			if e.KeyCode == System.Windows.Forms.Keys.Tab:  # Check if the Tab key was pressed
				self.SwitchFocus(e.Shift)
				e.Handled = True 
				e.SuppressKeyPress = True
			elif Control.ModifierKeys == Keys.Shift and e.KeyCode == System.Windows.Forms.Keys.C:
				if isinstance(self.ActiveControl, TextBox):
					if self.ActiveControl.SelectionLength > 0:
						self.CopyValue()
						e.Handled = True  
						e.SuppressKeyPress = True
				else:
					self.CopyValue()
					e.Handled = True  
					e.SuppressKeyPress = True
			elif Control.ModifierKeys == Keys.Shift and e.KeyCode == System.Windows.Forms.Keys.V:
				if System.Windows.Forms.Clipboard.GetText() != "":
					self.PasteValue()
					e.Handled = True 
					e.SuppressKeyPress = True
			elif e.KeyCode == System.Windows.Forms.Keys.Enter and isinstance(self.ActiveControl, Button):
				self.ActiveControl.PerformClick()
				e.Handled = True 
				e.SuppressKeyPress = True
		except Exception as exc:
			pass
	
	def SwitchFocus(self, shiftPressed):
		current_control = self.ActiveControl
		focusable_controls = [ctrl for ctrl in self.Controls if ctrl.TabStop and ctrl.Enabled and ctrl.Visible]
		focusable_controls.sort(key=lambda ctrl: ctrl.TabIndex)
		current_index = focusable_controls.index(current_control) if current_control in focusable_controls else -1
		if shiftPressed:  # Shift + Tab: move backward
			next_index = (current_index - 1) % len(focusable_controls)
		else:  # Tab: move forward
			next_index = (current_index + 1) % len(focusable_controls)
		next_control = focusable_controls[next_index]
		next_control.Focus()
	
	def CopyValue(self):
		current_control = self.ActiveControl
		if isinstance(current_control, System.Windows.Forms.NumericUpDown):
			System.Windows.Forms.Clipboard.SetText(str(current_control.Value))
		elif isinstance(current_control, System.Windows.Forms.TextBox):
			System.Windows.Forms.Clipboard.SetText(str(current_control.SelectedText))

	def PasteValue(self):
		current_control = self.ActiveControl
		if isinstance(current_control, System.Windows.Forms.NumericUpDown):
			clipboard_text = System.Windows.Forms.Clipboard.GetText()
			try:
				new_value = float(clipboard_text)
				current_control.Value = max(min(new_value, current_control.Maximum), current_control.Minimum)
			except:
				pass
		if isinstance(current_control, System.Windows.Forms.TextBox):
			clipboard_text = System.Windows.Forms.Clipboard.GetText()
			try:
				position_cursor = current_control.SelectionStart
				current_control.Text = current_control.Text.Insert(current_control.SelectionStart, clipboard_text)
				current_control.SelectionStart = position_cursor + len(clipboard_text)
			except:
				pass
		
	def changeSelection(self, sender, e):
		actualcount = len(self.selectionhistory)
		if actualcount > 0:
			if Control.ModifierKeys == Keys.Shift:
				lastindex = self.selectionhistory[0]
				currentIndex = self._listBox1.SelectedIndex
				step = 1
				if currentIndex < lastindex:
					step = -1
				for i in range(lastindex, currentIndex, step):
					if i != lastindex:
						if self._listBox1.GetItemCheckState(i) == CheckState.Checked:
							self._listBox1.SetItemCheckState(i, CheckState.Unchecked);
						else:
							self._listBox1.SetItemCheckState(i, CheckState.Checked);
			self.selectionhistory.Clear()
			self.selectionhistory.Add(self._listBox1.SelectedIndex) 
		else:
			self.selectionhistory.Clear()
			self.selectionhistory.Add(self._listBox1.SelectedIndex) 
			
	def closingEvent(self, sender, e):
		isActive = 0
		self.doc_sub_eve.Raise()	
		
	def previewPref(self, sender, e):
		non_allow = ['[','{','}','[',']','|',';','<','>','`','~',']',"\\","?", ":"]
		if e.KeyChar in non_allow:
			e.Handled = 1
			
	def Button1Click(self, sender, e):
		if self._listBox1.Items.Count > 0:
			if self._listBox1.CheckedItems.Count > 0:
				self.ActDeaItems(False)
				self.event.Raise()
										    	
	def UpdateFilter(self, sender, e):
		sel_cat = sender.SelectedItem['Value']
		#Get All Checked Item Ids
		checked_items = []
		if len(self._listBox1.DataSource.Rows) != 0:
			for ind, row in enumerate(self._listBox1.DataSource.Rows):
				if row:
					if self._listBox1.GetItemCheckState(ind) == CheckState.Checked:
						checked_items.Add(row['Value'])
		self.setCategoriesAndViews(sel_cat, checked_items)
		self.past_cat = sender.SelectedItem['Key']
			
	def refreshViews(self):
		#Get old checkeditems
		oldchecked = [x['Value']._id for x in self._listBox1.CheckedItems]
		#Update
		self.setCategoriesAndViews(self._categories.SelectedItem['Value'])
		#Maintain old selection
		for indx in range(len(self._listBox1.Items)):
			if self._listBox1.Items[indx]['Value']._id in oldchecked:
				self._listBox1.SetItemChecked(indx, True)
				self._listBox1.SelectedIndex = indx
		self._listBox1.SelectedIndex = -1				
		
	def setCategoriesAndViews(self, bic_category, checked_ids = []):
		try:
			list_views = []
			if isinstance(bic_category, list):
				collector = FilteredElementCollector(doc).OfCategory(bic_category[0]).WhereElementIsElementType().ToElements()
				collector.AddRange(FilteredElementCollector(doc).OfCategory(bic_category[1]).WhereElementIsElementType().ToElements())
			elif bic_category == BuiltInCategory.OST_Schedules:
				ini_collector = FilteredElementCollector(doc).OfCategory(bic_category).WhereElementIsNotElementType().ToElements()	
				collector = []
				for indx in range(len(ini_collector)):
					if not ini_collector[indx].IsTitleblockRevisionSchedule:
						collector.Add(ini_collector[indx])
			else:
				collector = FilteredElementCollector(doc).OfCategory(bic_category).WhereElementIsNotElementType().ToElements()	
				
			for ele in collector:
				list_views.Add(view_info(ele))
			list_views = sorted(list_views, key = lambda x: x._title.upper())
			
			if bic_category == BuiltInCategory.OST_Sheets or bic_category == BuiltInCategory.OST_Rooms or bic_category == BuiltInCategory.OST_Areas or bic_category == BuiltInCategory.OST_MEPSpaces:
				#Sheet Names
				if self._categories.SelectedItem['Key'].endswith("Numbers"):
					names_views = ["(" + x._name + ") " + x._number for x in list_views]
				#Sheet Numbers
				else:				
					names_views = ["(" + x._number + ") " + x._name for x in list_views]
			else:
				names_views = [x._title for x in list_views]
			self._tableData2 = DataTable("Data")
			self._tableData2.Columns.Add("Key", System.String)
			self._tableData2.Columns.Add("Value", System.Object)
			[self._tableData2.Rows.Add(key_, value_ ) for key_, value_ in zip(names_views, list_views)]	
			self._listBox1.DataSource = self._tableData2
			self._listBox1.DisplayMember = "Key"
			#Delete old selections
			for indx in range(len(self._listBox1.Items)):
				self._listBox1.SetItemChecked(indx, False)
			#Select old ids if similar category name
			if len(checked_ids) > 1:
				if self.past_cat != "":
					if self.past_cat[:3] == self._categories.SelectedItem['Key'][:3]:
						checked_indeces = []
						for checked_item in checked_ids:
							for indx, item in enumerate(self._listBox1.Items):
								if checked_item._id == item.Row['Value']._id:
									checked_indeces.Add(indx)
									break
						for indx in checked_indeces:
							self._listBox1.SetItemChecked(indx, True)
							self._listBox1.SelectedIndex = indx
		except Exception as ex:
			pass
													
def OnViewActivated(sender, e):
	new_doc = e.CurrentActiveView.Document
	if new_doc:
		new_uiapp = new_doc.Application
		if isActive == 1:
			if wndw:
				if not new_doc.Equals(doc):
					wndw.Close()
				else:
					return

doc = DocumentManager.Instance.CurrentDBDocument
uidoc = DocumentManager.Instance.CurrentUIApplication.ActiveUIDocument
app = doc.Application
version = int(app.VersionNumber)
uiapp = DocumentManager.Instance.CurrentUIApplication
#Window
isActive = 1
new_sub = System.EventHandler[Autodesk.Revit.UI.Events.ViewActivatedEventArgs](OnViewActivated)
uiapp.ViewActivated += new_sub
event_handler_doc = UnsubcribeDocChange()
ext_event_doc = ExternalEvent.Create(event_handler_doc)
####
event_handler = Renaming()
ext_event = ExternalEvent.Create(event_handler)
wndw = Form_cats(ext_event, ext_event_doc)
wndw.Show()
OUT = 0
"""
You agreed to the following license terms and conditions. They are also applicable to obtaining and using this script:
License Agreement
For use of NonicaTab PRO.
This License Agreement (this “Agreement” of this “License Agreement”) is made and effective as of the current date (the “Commencement Date”) by and between Nonica by Nonica Enterprise SL a company organized and existing in Spain with a registered address at Avd.Chafarinas 16, Spain (“Licensor”) and yourself (“Licensee”).
WHEREAS:
1.	Licensee wishes to obtain access and use this script (hereinafter, the “Asset”), and
2.	Licensor is willing to grant to the Licensee a non-exclusive, non-transferable License to use the Asset for the term and specific purpose set forth in this Agreement,
NOW, THEREFORE, your access to and use of the Service is conditioned on your acceptance of and compliance with these Terms and Conditions. These Terms and Conditions apply to all visitors, users and others who access or use NonicaTab PRO and its derivative files and scripts.
1. Definitions
1.1 “Agreement” means this License Agreement including the attached Schedule.
1.2 “Confidential Information” means information that:
a. is by its nature confidential;
b. is designated in writing by Licensor as confidential;
c. the Licensee knows or reasonably ought to know is confidential;
d. Information comprised in or relating to any Intellectual Property Rights of Licensor.
1.3 “Asset” means the Asset provided by Licensor as specified in Item 6 of the Schedule in the form as stated in Item 7 of the Schedule.
1.4 “Intellectual Property Rights” means all rights in and to any copyright, trademark, trading name, design, patent, know how (trade secrets) and all other rights resulting from intellectual activity in the industrial, scientific, literary or artistic field and any application or right to apply for registration of any of these rights and any right to protect or enforce any of these rights, as further specified in clause 5.
1.5 “Party” means a person or business entity who has executed this Agreement; details of the Parties are specified in Item 2 of the Schedule.
1.6 “Term” means the term of this Agreement commencing on the Commencement Date as specified in Item 4 of the Schedule and expiring on the Expiry Date specified in Item 5 of the Schedule.
2. License Grant
2.1 Licensor grants to the Licensee a non-exclusive, non-transferable License for the Term to use the Asset for the specific purpose specified in this Agreement, subject to the terms and conditions set out in this Agreement.
3. Charges
3.1 In consideration of the Licensor providing the License under clause 2 of this License Agreement, the Licensee agrees to pay Licensor the amount of the License Charge as specified in Item 9 of the Schedule.
4. Licensee’s Obligations
4.1 The Licensee cannot use the Asset, for purposes other than as specified in this Agreement and in Item 8 of the Schedule.
4.2 The Licensee may permit its employees to use the Asset for the purposes described in Item 8, provided that the Licensee takes all necessary steps and imposes the necessary conditions to ensure that all employees using the Asset do not commercialise or disclose the contents of it to any third person, or use it other than in accordance with the terms of this Agreement.
4.3 The Licensee will not distribute, sell, License or sub-License, let, trade or expose for sale the Asset to a third party.
4.4 No copies of the Asset are to be made other than as expressly approved by Licensor.
4.5 No changes to the Asset or its content may be made by Licensee.
4.6 The Licensee will provide technological and security measures to ensure that the Asset which the Licensee is responsible for is physically and electronically secure from unauthorised use or access.
4.7 Licensee shall ensure that the Asset retains all Licensor copyright notices and other proprietary legends and all trademarks or service marks of Licensor.
5. Intellectual Property Rights
5.1 All Intellectual Property Rights over and in respect of the Asset are owned by Licensor. The Licensee does not acquire any rights of ownership in the Asset.
6. Limitation of Liability
6.1 The Licensee acknowledges and agrees that neither Licensor nor its board members, officers, employees or agents, will be liable for any loss or damage arising out of or resulting from Licensor’s provision of the Asset under this Agreement, or any use of the Asset by the Licensee or its employees; and Licensee hereby releases Licensor to the fullest extent from any such liability, loss, damage or claim.
7. Confidentiality
7.1 Neither Party may use, disclose or make available to any third party the other Party’s Confidential Information, unless such use or disclosure is done in accordance with the terms of this Agreement.
7.2 Each Party must hold the other Party’s Confidential Information secure and in confidence, except to the extent that such Confidential Information:
a. is required to be disclosed according to the requirements of any law, judicial or legislative body or government agency; or
b. was approved for release in writing by the other Party, but only to the extent of and subject to such conditions as may be imposed in such written authorisation.
7.3 This clause 7 will survive termination of this Agreement.
8. Disclaimers & Release
8.1 To the extent permitted by law, Licensor will in no way be liable to the Licensee or any third party for any loss or damage, however caused (including through negligence) which may be directly or indirectly suffered in connection with any use of the Asset.
8.2 The Asset is provided by Licensor on an “as is” basis.
8.3 Licensor will not be held liable by the Licensee in any way, for any loss, damage or injury suffered by the Licensee or by any other person related to any use of the Asset or any part thereof.
8.4 Notwithstanding anything contained in this Agreement, in no event shall Licensor be liable for any claims, damages or loss which may arise from the modification, combination, operation or use of the Asset with Licensee computer programs.
8.5 Licensor does not warrant that the Asset will function in any environment.
8.6 The Licensee acknowledges that: a. The Asset has not been prepared to meet any specific requirements of any party, including any requirements of Licensee; and b. it is therefore the responsibility of the Licensee to ensure that the Asset meets its own individual requirements.
8.7 To the extent permitted by law, no express or implied warranty, term, condition or undertaking is given or assumed by Licensor, including any implied warranty of merchantability or fitness for a particular purpose.
9. Indemnification
9.1 The Licensee must indemnify, defend and hold harmless Licensor, its board members, officers, employees and agents from and against any and all claims (including third party claims), demands, actions, suits, expenses (including attorney’s fees) and damages (including indirect or consequential loss) resulting in any way from:
a. Licensee’s and Licensee’s employee’s use or reliance on the Asset,
b. any breach of the terms of this License Agreement by the Licensee or any Licensee employee, and
c. any other act of Licensee.
9.2 This clause 9 will survive termination of this Agreement.
10. Waiver
10.1 Any failure or delay by either Party to exercise any right, power or privilege hereunder or to insist upon observance or performance by the other of the provisions of this License Agreement shall not operate or be construed as a waiver thereof.
11. Governing Law
11.1 This Agreement will be construed by and governed in accordance with the laws of Spain. The Parties submit to exclusive jurisdiction of the courts of Spain.
12. Termination
12.1 This Agreement and the License granted herein commences upon the Commencement Date and is granted for the Term, unless otherwise terminated by Licensor in the event of any of the following:
a. if the Licensee is in breach of any term of this License Agreement and has not corrected such breach to Licensor’s reasonable satisfaction within 7 days of Licensor’s notice of the same;
b. if the Licensee becomes insolvent, or institutes (or there is instituted against it) proceedings in bankruptcy, insolvency, reorganization or dissolution, or makes an assignment for the benefit of creditors; or
c. the Licensee is in breach of clause 5 or 7 of this Agreement.
12.2 Termination under this clause shall not affect any other rights or remedies Licensor may have.
14. Assignment
14.1 Licensee shall not assign any rights of this License Agreement, without the prior written consent of Licensor.
15. Notices
15.1 All notices required under this Agreement shall be in writing and shall be deemed given (i) when delivered personally; (ii) five (5) days after mailing, when sent certified mail, return receipt requested and postage prepaid; or (iii) one (1) business day after dispatch, when sent via a commercial overnight carrier, fees prepaid. All notices given by either Party must be sent to the address of the other as first written above (unless otherwise changed by written notice).
15.2 Autodesk username, Autodesk Internal ID number and unique identifiers of hardware in your computer are stored in a speciliazed third party cloud server for licensing purposes. This information is neccessary for using NonicaTab PRO. The licensee maintains its full right to delete/remove such information if declining the renewal of the software. NonicaTab PRO will not shared that information with any third party company unless it is required judicially by law. Please contact hello@nonica.io with any further doubt/request.
16. Counterparts
16.1 This Agreement may be executed in any number of counterparts, each of which shall be deemed to be an original and all of which taken together shall constitute one instrument.
17. Severability
17.1 The Parties recognize the uncertainty of the law with respect to certain provisions of this Agreement and expressly stipulate that this Agreement will be construed in a manner that renders its provisions valid and enforceable to the maximum extent possible under applicable law. To the extent that any provisions of this Agreement are determined by a court of competent jurisdiction to be invalid or unenforceable, such provisions will be deleted from this Agreement or modified so as to make them enforceable and the validity and enforceability of the remainder of such provisions and of this Agreement will be unaffected.
18. Entire Agreement
18.1 This Agreement contains the entire agreement between the Parties and supersedes any previous understanding, commitments or agreements, oral or written. Further, this Agreement may not be modified, changed, or otherwise altered in any respect except by a written agreement signed by both Parties.
IN WITNESS WHEREOF, this Agreement, including the attached Schedule, was signed by the Parties under the hands of their duly authorized representatives and made effective as of the current date.
Nonica by Nonica Enterprise SL,
Signature
02/05/2021
Jaime Alonso Candau
Please contact hello@nonica.io with any further doubt/request.
Your signatureby using and accessing this script.
Signed by accepting these terms.
Current date.
"""
# ----------------------------------------
