# Dynamo graph Duplicator.dyn (Dynamo 2.6.2.15705)

default_prefix = StringInput("")
default_suffix = StringInput("")
duplicator = Python(IN[0]=default_prefix, IN[1]=default_suffix)
# ---------- duplicator.python (2174 lines) ----------
import sys
import clr

clr.AddReference('ProtoGeometry')
from Autodesk.DesignScript.Geometry import *

import os.path

from random import randint

import inspect
import random
import string

import unicodedata 

clr.AddReference("RevitServices")
import RevitServices
from RevitServices.Persistence import DocumentManager
from RevitServices.Transactions import TransactionManager
from System.Collections.Generic import*

clr.AddReference("RevitAPIUI")
import Autodesk 
from Autodesk.Revit.UI import TaskDialog, IExternalEventHandler, ExternalEvent, DockablePanes, DockablePane

clr.AddReference('RevitAPI')
import Autodesk
from Autodesk.Revit.DB import *
from Autodesk.Revit.DB import BuiltInCategory

clr.AddReference('System.Drawing')
clr.AddReference('System.Windows.Forms')
import System.Drawing
import System.Windows.Forms

from System.Drawing import *
from System.Reflection import Assembly
from System.Windows.Forms import *

clr.AddReference('System.Data')
from System.Data import *

from System import Array
from System.Collections.Generic import *

class UnsubcribeDocChange(IExternalEventHandler):
	def __init__(self):
		pass
		
	def Execute(self, uiapp):
		try:
			uiapp.ViewActivated -= new_sub
		except Exception as e:
			pass
			
	def GetName(self):
		return "Unsubscribe Document Changed Event"

class FormWithProgresBar(Form):
	def __init__(self):
		self.Font = Font("Arial", 15, FontStyle.Regular, GraphicsUnit.Pixel)
		self.interrupt = False
		self.numberItems = 5
		self.TopMost = True
		self.Closing += self.closingevent
		self.InitializeComponent()
		
	def InitializeComponent(self):
		self._spr_top     = System.Windows.Forms.Label()
		self._progressBar = System.Windows.Forms.ProgressBar()
		self._button1     = System.Windows.Forms.Button()
		self._txtBlock2   = System.Windows.Forms.Label()
		self.SuspendLayout()
		# 
		# Separator Top
		# 
		self._spr_top.Anchor     = System.Windows.Forms.AnchorStyles.Top | System.Windows.Forms.AnchorStyles.Left | System.Windows.Forms.AnchorStyles.Right
		self._spr_top.Location   = System.Drawing.Point(0, 0)
		self._spr_top.Name       = "spr_top"
		self._spr_top.Size       = System.Drawing.Size(2000, 2)
		self._spr_top.BackColor  = Color.FromArgb(82, 53, 239)
		# 
		# TextBlock2
		# 
		self._txtBlock2.Anchor = System.Windows.Forms.AnchorStyles.Top | System.Windows.Forms.AnchorStyles.Left
		self._txtBlock2.TextAlign = ContentAlignment.MiddleCenter
		self._txtBlock2.Location = System.Drawing.Point(0, 5)
		self._txtBlock2.Name = "txtBlock2"
		self._txtBlock2.Size = System.Drawing.Size(250, 20)
		self._txtBlock2.TabIndex = 1
		self._txtBlock2.Text = "0 / 0 Elements Processed"
		# 
		# ProgressBar
		# 
		self._progressBar.Anchor = System.Windows.Forms.AnchorStyles.Bottom | System.Windows.Forms.AnchorStyles.Left
		self._progressBar.Location = System.Drawing.Point(15, 30)
		self._progressBar.Name = "progressBar"
		self._progressBar.Size = System.Drawing.Size(220, 15)
		self._progressBar.Value = 0
		self._progressBar.TabIndex = 1
		# 
		# button1
		# 
		self._button1.Anchor = System.Windows.Forms.AnchorStyles.Bottom | System.Windows.Forms.AnchorStyles.Right
		self._button1.Location = System.Drawing.Point(14, 50)
		self._button1.Name = "button1"
		self._button1.Size = System.Drawing.Size(222, 20)
		self._button1.TabIndex = 2
		self._button1.Text = "Interrupt / Cancel"
		self._button1.UseVisualStyleBackColor = True
		self._button1.Click += self.Button1Click
		# 
		# Form24
		# 
		self.ClientSize = System.Drawing.Size(250, 85)
		self.MaximizeBox = 0
		self.MinimizeBox = 0
		self.CenterToScreen() 
		self.FormBorderStyle = FormBorderStyle.FixedSingle
		self.Controls.Add(self._spr_top)
		self.Controls.Add(self._txtBlock2)
		self.Controls.Add(self._button1)
		self.Controls.Add(self._progressBar)
		self.Name = "Duplicating..."
		self.Text = "Duplicating..."
		iconFilename = 'C:\\NONICAPRO\\OtherFiles\\System\\Nonicafavicon.ICO'
		if not os.path.exists(iconFilename):
			iconFilename = 'C:\\NONICA\\OtherFiles\\System\\Nonicafavicon.ICO'
		icon = Icon(iconFilename)
		self.Icon = icon
		self.ResumeLayout(False)
		
	def Button1Click(self, sender, e):
		self.interrupt = True
		
	def closingevent(self, sender, e):
		self.interrupt = True

class Duplicating(IExternalEventHandler):
	def __init__(self):
		pass
		
	def Execute(self, uiapp):
		try:
			progressForm = FormWithProgresBar()
			progressForm._progressBar.Maximum = len(wndw._listBox1.CheckedItems)
			progressForm._progressBar.Minimum = 0
			progressForm._progressBar.Step = 1
			wndw.Hide()
			progressForm.Show()
			doc = uiapp.ActiveUIDocument.Document
			t = Transaction(doc, "Duplicator")
			t.Start()
			counter = 0
			items = wndw._listBox1.CheckedItems
			category_action = wndw._categories.Text
			show_mess = True
			for item_rw in items:
				progressForm._txtBlock2.Text = str(counter) + " / " + str(len(items)) + " "+ category_action + " Processed"
				progressForm._progressBar.PerformStep()
				progressForm.Refresh()
				Application.DoEvents()
				if progressForm.interrupt == True:
					break
				counter +=1
				item = item_rw['Value']
				ele = item._view
				i=1
				if wndw._categories.SelectedItem['Value'] == BuiltInCategory.OST_Sheets:
					self.duplicateSheets(ele)
				elif isinstance(wndw._categories.SelectedItem['Value'], list):
					while True:
						result_str = ''.join(random.choice(string.ascii_lowercase) for i in range(6))
						try:
							new_group = ele.Duplicate(result_str)
							self.updateName(ele, new_group)
							break
						except:
							i+=1
							if i > 50:
								break
				elif isinstance(ele, Autodesk.Revit.DB.View) or wndw._categories.SelectedItem['Value'] == BuiltInCategory.OST_Views:
					new_view = 0
					if ele.CanViewBeDuplicated(wndw.option_duplicate):
						new_view_id = ele.Duplicate(wndw.option_duplicate)
						new_view = doc.GetElement(new_view_id)
					elif ele.CanViewBeDuplicated(ViewDuplicateOption.WithDetailing):
						new_view_id = ele.Duplicate(ViewDuplicateOption.WithDetailing)
						new_view = doc.GetElement(new_view_id)
					elif ele.CanViewBeDuplicated(ViewDuplicateOption.Duplicate):
						new_view_id = ele.Duplicate(ViewDuplicateOption.Duplicate)
						new_view = doc.GetElement(new_view_id)
					elif ele.IsTemplate:
						copiedIds = ElementTransformUtils.CopyElement(doc, ele.Id, XYZ(0,0,0))
						new_view = doc.GetElement(copiedIds[0])
					if new_view:
						self.updateName(ele, new_view)
						result_vw_temp = self.reassignViewTemplate(new_view, show_mess)
						if result_vw_temp == False:
							show_mess = False
			if progressForm.interrupt == True:
				t.RollBack()
				progressForm.Close()
				Autodesk.Revit.UI.TaskDialog.Show("Process Cancelled","The process has been interrupted. Any processed action has been undone.")
			else:
				t.Commit()
				progressForm.Close()
		except Exception as e:
			if t:
				t.RollBack()
			progressForm.Close()
			Autodesk.Revit.UI.TaskDialog.Show("Error", str(e))
		wndw.ActDeaItems(True)
		wndw.Show()
		wndw.refreshViews()
			
	def GetName(self):
		return "Duplicator"
		
	def reassignViewTemplate(self, new_view, show_mess):
		int_id_vw_tmp = wndw._comboTemplate.SelectedItem["Value"]
		if int_id_vw_tmp != -1 and wndw._comboTemplate.Enabled and not new_view.IsTemplate:
			id_temp = int_id_vw_tmp
			if new_view.IsValidViewTemplate(id_temp):
				new_view.ViewTemplateId = id_temp
				return True
			elif show_mess:
				#Notify not valid
				Autodesk.Revit.UI.TaskDialog.Show("Invalid View Template", "The Selected View Temp. isn´t valid for one or more views.")
				return False
		return True
		
	def duplicateSheets(self, sheet):
		title = self.getTitleBlockSheet(sheet)
		if title != ElementId.InvalidElementId:
			new_sheet = ViewSheet.Create(doc, title.GetTypeId())
		else:
			new_sheet = ViewSheet.Create(doc, ElementId.InvalidElementId)
		#Get name for sheet
		self.updateSheetName(sheet, new_sheet)
		#Get number for sheet
		self.updateNumber(sheet, new_sheet)
		#Options to copy
		if wndw._views_chkBox.Checked ==1:
			self.duplicateViewsInSheets(sheet, new_sheet)
		if wndw._legends_chkBox.Checked ==1:
			self.duplicateLegendsInSheets(sheet, new_sheet)
		if wndw._schedules_chkBox.Checked ==1:
			self.duplicateSchedulesInSheets(sheet, new_sheet)
		if wndw._images_chkBox.Checked ==1:
			self.duplicateImagesandDWGInSheets(sheet, new_sheet)
		if wndw._lines_chkBox.Checked ==1:
			self.duplicateLinesInSheets(sheet, new_sheet)
		if wndw._text_chkBox.Checked ==1:
			self.duplicateTextInSheets(sheet, new_sheet)
		if wndw._clouds_chkBox.Checked ==1:
			self.duplicateCloudsInSheets(sheet, new_sheet)
		if wndw._symbols_chkBox.Checked ==1:
			self.duplicateSymbolsInSheets(sheet, new_sheet)
		if wndw._dimensions_chkBox.Checked ==1:
			self.duplicateDimensionsInSheets(sheet, new_sheet)
		if wndw._revisions_chkBox.Checked ==1:
			self.duplicateRevisionsInSheets(sheet, new_sheet)					
	
	def getTitleBlockSheet(self, sheet):
		all_TitleBlocks = FilteredElementCollector(doc, sheet.Id).OfCategory(BuiltInCategory.OST_TitleBlocks).WhereElementIsNotElementType().ToElements()
		for title in all_TitleBlocks:
			return title
		return ElementId.InvalidElementId
		
	def updateNumber(self, old_item, item):
		prefix = str(wndw._txtBox_pre.Text)
		suffix = str(wndw._txtBox_suf.Text)
		tx_from = str(wndw._txtBox_rplFr.Text)
		tx_to = str(wndw._txtBox_rplTo.Text)
		existing_name = old_item.SheetNumber
		if tx_from != "":
			existing_name = existing_name.Replace(tx_from, tx_to)
		#Compose
		finalname = prefix + existing_name + suffix
		i=0
		while True:
			try:
				item.SheetNumber =  finalname
				break
			except:
				finalname += "*"
				i +=1
				if i == 50:
					break
					
	def updateName(self, old_item, item):
		prefix = str(wndw._txtBox_pre3.Text)
		suffix = str(wndw._txtBox_suf3.Text)
		tx_from = str(wndw._txtBox_rplFr3.Text)
		tx_to = str(wndw._txtBox_rplTo3.Text)
		initial_name = Element.Name.__get__(old_item)
		existing_name = initial_name.Replace("{", "").Replace("}", "")
		if tx_from != "":
			existing_name = existing_name.Replace(tx_from, tx_to)
		#Compose
		finalname = prefix + existing_name + suffix
		if finalname == initial_name:
			finalname += "*"
		i=0
		while True:
			try:
				item.Name =  finalname
				break
			except:
				finalname += "*"
				i +=1
				if i == 50:
					break
					
	def updateSheetName(self, old_item, item):
		prefix = str(wndw._txtBox_pre2.Text)
		suffix = str(wndw._txtBox_suf2.Text)
		tx_from = str(wndw._txtBox_rplFr2.Text)
		tx_to = str(wndw._txtBox_rplTo2.Text)
		initial_name = Element.Name.__get__(old_item)
		existing_name = initial_name.Replace("{", "").Replace("}", "")
		if tx_from != "":
			existing_name = existing_name.Replace(tx_from, tx_to)
		#Compose
		finalname = prefix + existing_name + suffix
		i=0
		while True:
			try:
				item.Name =  finalname
				break
			except:
				finalname += "*"
				i +=1
				if i == 50:
					break
	
	def duplicateElementsBetweenViews(self, initial_view, ids, final_view):
		all_ids = List[ElementId](ids)
		if len(all_ids) > 0:
			ElementTransformUtils.CopyElements(initial_view, all_ids, final_view, None, CopyPasteOptions())
					
	def duplicateViewsInSheets(self, old_sheet, sheet):
		all_vwportsId = old_sheet.GetAllViewports()
		for id in all_vwportsId:
			vwport = doc.GetElement(id)
			vwport_typeId = vwport.GetTypeId()
			vwport_center = vwport.GetBoxCenter()
			view_id = vwport.ViewId
			view = doc.GetElement(view_id)
			new_view = None
			if view.ViewType != ViewType.Legend:
				if view.CanViewBeDuplicated(wndw.option_duplicate):
					new_view_id = view.Duplicate(wndw.option_duplicate)
					new_view = doc.GetElement(new_view_id)
				elif view.CanViewBeDuplicated(ViewDuplicateOption.WithDetailing):
					new_view_id = view.Duplicate(ViewDuplicateOption.WithDetailing)
					new_view = doc.GetElement(new_view_id)
				elif view.CanViewBeDuplicated(ViewDuplicateOption.Duplicate):
					new_view_id = view.Duplicate(ViewDuplicateOption.Duplicate)
					new_view = doc.GetElement(new_view_id)
				if new_view != None:
					self.updateName(view, new_view)
					try:
						#Create viewport and place 
						new_vwport = Viewport.Create(doc, sheet.Id, new_view_id, vwport_center)
						if new_vwport:
							new_vwprt_typeId = new_vwport.GetTypeId()
							if new_vwprt_typeId != vwport_typeId:
								new_vwport.ChangeTypeId(vwport_typeId)
							if version > 2021:
								#Assign position and length label
								new_vwport.LabelOffset = vwport.LabelOffset
								new_vwport.LabelLineLength = vwport.LabelLineLength
					except Exception as ex:
						pass
								
	def duplicateLegendsInSheets(self, old_sheet, sheet):
		all_vwportsId = old_sheet.GetAllViewports()
		for id in all_vwportsId:
			vwport = doc.GetElement(id)
			vwport_typeId = vwport.GetTypeId()
			vwport_center = vwport.GetBoxCenter()
			view_id = vwport.ViewId
			view = doc.GetElement(view_id)
			new_view = None
			if view.ViewType == ViewType.Legend:
				legend_to_use = view
				if wndw._legdep_chkBox.Checked ==1:
					if view.CanViewBeDuplicated(wndw.option_duplicate):	
						legend_to_use_id = view.Duplicate(wndw.option_duplicate)
						legend_to_use = doc.GetElement(legend_to_use_id)
					elif view.CanViewBeDuplicated(ViewDuplicateOption.WithDetailing):
						legend_to_use_id = view.Duplicate(ViewDuplicateOption.WithDetailing)
						legend_to_use = doc.GetElement(legend_to_use_id)
					elif view.CanViewBeDuplicated(ViewDuplicateOption.Duplicate):
						legend_to_use_id = view.Duplicate(ViewDuplicateOption.Duplicate)
						legend_to_use = doc.GetElement(legend_to_use_id)
					self.updateName(view, legend_to_use)
				if legend_to_use != None:	
					try:
						#Create viewport and place 
						new_vwport = Viewport.Create(doc, sheet.Id, legend_to_use.Id, vwport_center)
						if new_vwport:
							new_vwprt_typeId = new_vwport.GetTypeId()
							if new_vwprt_typeId != vwport_typeId:
								new_vwport.ChangeTypeId(new_vwprt_typeId)
					except Exception as e:
						pass
						
	def duplicateSchedulesInSheets(self, old_sheet, sheet):
		all_sche = FilteredElementCollector(doc, old_sheet.Id).OfCategory(BuiltInCategory.OST_ScheduleGraphics).ToElements()
		for schedule in all_sche:
			if not schedule.IsTitleblockRevisionSchedule:
				loc_point = schedule.Point
				scheduleId = schedule.ScheduleId
				if wndw._viewdep_chkBox.Checked ==1:
					#Duplicate
					if scheduleId == ElementId.InvalidElementId:
						continue
					viewSchedule = doc.GetElement(scheduleId)
					schedule_view_id = viewSchedule.Duplicate(ViewDuplicateOption.Duplicate)
					self.updateName(schedule, doc.GetElement(schedule_view_id))
				else:
					schedule_view_id = schedule.ScheduleId
					
				ScheduleSheetInstance.Create(doc, sheet.Id, schedule_view_id, loc_point)
				
	def duplicateLinesInSheets(self, old_sheet, sheet):
		all_lines_Ids = FilteredElementCollector(doc, old_sheet.Id).OfCategory(BuiltInCategory.OST_Lines).ToElementIds()
		self.duplicateElementsBetweenViews(old_sheet, all_lines_Ids, sheet)
	
	def duplicateCloudsInSheets(self, old_sheet, sheet):
		categories = List[BuiltInCategory]([BuiltInCategory.OST_RevisionClouds, BuiltInCategory.OST_RevisionCloudTags])
		filter_cat = ElementMulticategoryFilter(categories)
		clouds_ids = FilteredElementCollector(doc, old_sheet.Id).WherePasses(filter_cat).ToElementIds()
		self.duplicateElementsBetweenViews(old_sheet, clouds_ids, sheet)
		
	def duplicateImagesandDWGInSheets(self, old_sheet, sheet):
		all_images_Ids = FilteredElementCollector(doc, old_sheet.Id).OfCategory(BuiltInCategory.OST_RasterImages).ToElementIds()
		self.duplicateElementsBetweenViews(old_sheet, all_images_Ids, sheet)
		all_dwgs_Ids = FilteredElementCollector(doc, old_sheet.Id).OfClass(ImportInstance).ToElementIds()
		self.duplicateElementsBetweenViews(old_sheet, all_dwgs_Ids, sheet)
		
	def duplicateTextInSheets(self, old_sheet, sheet):
		all_text_Ids = FilteredElementCollector(doc, old_sheet.Id).OfCategory(BuiltInCategory.OST_TextNotes).ToElementIds()
		self.duplicateElementsBetweenViews(old_sheet, all_text_Ids, sheet)
	
	def duplicateDimensionsInSheets(self, old_sheet, sheet):
		all_dimensions_Ids = FilteredElementCollector(doc, old_sheet.Id).OfCategory(BuiltInCategory.OST_Dimensions).ToElementIds()
		self.duplicateElementsBetweenViews(old_sheet, all_dimensions_Ids, sheet)
		
	def duplicateSymbolsInSheets(self, old_sheet, sheet):
		all_symbols_Ids = FilteredElementCollector(doc, old_sheet.Id).OfCategory(BuiltInCategory.OST_GenericAnnotation).ToElementIds()
		self.duplicateElementsBetweenViews(old_sheet, all_symbols_Ids, sheet)
	
	def duplicateRevisionsInSheets(self, old_sheet, sheet):
		all_revisionsIds =	old_sheet.GetAdditionalRevisionIds()
		if all_revisionsIds:
			sheet.SetAdditionalRevisionIds(all_revisionsIds)


class view_info():
	def __init__(self, view):
		self._view = view
		self._id = view.Id
		self._name = strip_accents(Element.Name.__get__(view))
		#Get complete name for rooms ...			
		if isinstance(view, GroupType):
			pretitle = "Model Group: "
			if view.Category.Id == ElementId(BuiltInCategory.OST_IOSDetailGroups):
				pretitle = "Detail Group: "
			self._title = pretitle + self._name
		elif hasattr(view, 'Title'):
			self._title = strip_accents(view.Title)
			if view.IsTemplate:
				self._title = "View Template: " + strip_accents(view.Title)
			elif hasattr(view, 'SheetNumber'):
				self._number = view.SheetNumber
				self._title = "(" + self._number + ") " + self._name
		else:
			self._title = self._name

def strip_accents(text):
	return ''.join(char for char in unicodedata.normalize('NFKD', text) if unicodedata.category(char) != 'Mn')

class MyCheckedListBox(CheckedListBox):
	@property
	def ItemHeight(self):
		return 20
	
	@ItemHeight.setter
	def ItemHeight(self, value):
		self._item_height = value

class Form_cats(Form):
	def __init__(self, ext_ev, doc_sub, sorted_views, sorted_schedules):
		self.Font = Font(self.Font.FontFamily, 15, FontStyle.Regular, GraphicsUnit.Pixel)
		self.Load += self.form_load
		self.doc_sub_eve = doc_sub
		self.selectionhistory = []
		self.event = ext_ev
		self.name_cat = ["Groups", "Schedules", "Sheets", "Views & Legends"]
		self.categs = [[BuiltInCategory.OST_IOSDetailGroups, BuiltInCategory.OST_IOSModelGroups], BuiltInCategory.OST_Schedules, BuiltInCategory.OST_Sheets, BuiltInCategory.OST_Views]
		self._tableData = DataTable("Data")
		self._tableData.Columns.Add("Key", System.String)
		self._tableData.Columns.Add("Value", System.Object)
		[self._tableData.Rows.Add(key_, value_ ) for key_, value_ in zip(self.name_cat, self.categs)]
		
		self._tab_vw_temp = DataTable("Data")
		self._tab_vw_temp.Columns.Add("Key", System.String)
		self._tab_vw_temp.Columns.Add("Value", System.Object)
		self._tab_vw_temp.Rows.Add("Assign View Template from Original View", -1)
		[self._tab_vw_temp.Rows.Add(key_, value_ ) for key_, value_ in sorted_views]
		
		self._tab_sch_temp = DataTable("Data")
		self._tab_sch_temp.Columns.Add("Key", System.String)
		self._tab_sch_temp.Columns.Add("Value", System.Object)
		self._tab_sch_temp.Rows.Add("Assign View Template from Original Schedule", -1)
		[self._tab_sch_temp.Rows.Add(key_, value_ ) for key_, value_ in sorted_schedules]
		
		self.InitializeComponent()
		
	def form_load(self, sender, e):	
		try:
			if uidoc.Selection.GetElementIds().Count > 1:
				list_cat = []
				ids = uidoc.Selection.GetElementIds()
				ele = doc.GetElement(ids[0])
				if isinstance(ele, Autodesk.Revit.DB.View):
					if ele.ViewType == ViewType.Schedule:
						self.setCategoriesAndViews(self.categs[1])
						self._categories.SelectedIndex = 1
						self.selIdsWindow(ids)
					elif ele.ViewType == ViewType.DrawingSheet:
						self.setCategoriesAndViews(self.categs[2])
						self._categories.SelectedIndex = 2	
						self.selIdsWindow(ids)
					else:
						self.setCategoriesAndViews(self.categs[3])
						self._categories.SelectedIndex = 3
						self.selIdsWindow(ids)
				elif isinstance(ele, Autodesk.Revit.DB.GroupType):
					#Update Window First
					self.setCategoriesAndViews(self.categs[1])
					self._categories.SelectedIndex = 1
					self.selIdsWindow(ids)
					#
					self.setCategoriesAndViews(self.categs[0])
					self._categories.SelectedIndex = 0
					self.selIdsWindow(ids)
				else:
					self.setCategoriesAndViews(BuiltInCategory.OST_Sheets)
					self._categories.SelectedIndex = 2
			else:
				self.setCategoriesAndViews(BuiltInCategory.OST_Sheets)
				self._categories.SelectedIndex = 2
		except Exception as e:
			self.setCategoriesAndViews(BuiltInCategory.OST_Sheets)
			self._categories.SelectedIndex = 2
			
	def selIdsWindow(self, ids):
		for id in ids:
			for indx in range(0,len(self._listBox1.Items)):
				if self._listBox1.Items[indx]['Value']._id == id:
					self._listBox1.SetItemChecked(indx, True)
					self._listBox1.SelectedIndex = indx
					break
		
	def InitializeComponent(self):
		self._spr_top       = System.Windows.Forms.Label()
		self._categories    = System.Windows.Forms.ComboBox()
		self._listBox1      = MyCheckedListBox()
		self._button1       = System.Windows.Forms.Button()
		self._txtBlock2     = System.Windows.Forms.Label()
		self._txtBlock3     = System.Windows.Forms.Label()
		self._txtBlock4     = System.Windows.Forms.Label()
		self._txtBox_rplTo  = System.Windows.Forms.TextBox()
		self._txtBox_rplFr  = System.Windows.Forms.TextBox()
		self._txtBox_pre    = System.Windows.Forms.TextBox()
		self._txtBox_suf    = System.Windows.Forms.TextBox()
		self._txtBox_rplTo2 = System.Windows.Forms.TextBox()
		self._txtBox_rplFr2 = System.Windows.Forms.TextBox()
		self._txtBox_pre2   = System.Windows.Forms.TextBox()
		self._txtBox_suf2   = System.Windows.Forms.TextBox()
		self._txtBox_rplTo3 = System.Windows.Forms.TextBox()
		self._txtBox_rplFr3 = System.Windows.Forms.TextBox()
		self._txtBox_pre3   = System.Windows.Forms.TextBox()
		self._txtBox_suf3   = System.Windows.Forms.TextBox()
		self._txtBlock5     = System.Windows.Forms.Label()
		self._txtBlock6     = System.Windows.Forms.Label()
		self._txtBlock7     = System.Windows.Forms.Label()
		self._txtBlock8     = System.Windows.Forms.Label()
		self._comboTemplate = System.Windows.Forms.ComboBox()
		self._expander      = System.Windows.Forms.Button()
		self._rdButton1     = System.Windows.Forms.RadioButton()
		self._rdButton2     = System.Windows.Forms.RadioButton()
		self._rdButton3     = System.Windows.Forms.RadioButton()
		self._views_chkBox  = System.Windows.Forms.CheckBox()
		self._legends_chkBox = System.Windows.Forms.CheckBox()
		self._schedules_chkBox = System.Windows.Forms.CheckBox()
		self._images_chkBox = System.Windows.Forms.CheckBox()
		self._lines_chkBox = System.Windows.Forms.CheckBox()
		self._text_chkBox = System.Windows.Forms.CheckBox()
		self._clouds_chkBox = System.Windows.Forms.CheckBox()
		self._symbols_chkBox = System.Windows.Forms.CheckBox()
		self._dimensions_chkBox = System.Windows.Forms.CheckBox()
		self._revisions_chkBox = System.Windows.Forms.CheckBox()
		self._viewdep_chkBox = System.Windows.Forms.CheckBox()
		self._legdep_chkBox = System.Windows.Forms.CheckBox()
		self._group1 = System.Windows.Forms.GroupBox()
		self._group2 = System.Windows.Forms.GroupBox()
		self._group3 = System.Windows.Forms.GroupBox()
		self.SuspendLayout()
		# 
		# Panel Duplicate
		# 
		self.mainPanel = FlowLayoutPanel()
		self.mainPanel.Size      = System.Drawing.Size(570, 25)
		self.mainPanel.Location  = System.Drawing.Point(12, 350)
		self.mainPanel.Anchor    = System.Windows.Forms.AnchorStyles.Left | System.Windows.Forms.AnchorStyles.Bottom
		# 
		# Panel Row 1
		# 
		self.panel_row1 = FlowLayoutPanel()
		self.panel_row1.Size      = System.Drawing.Size(570, 23)
		self.panel_row1.Location  = System.Drawing.Point(15, 315)
		self.panel_row1.Anchor    = System.Windows.Forms.AnchorStyles.Left | System.Windows.Forms.AnchorStyles.Bottom
		# 
		# Panel Row 2
		# 
		self.panel_row2 = FlowLayoutPanel()
		self.panel_row2.Size      = System.Drawing.Size(570, 23)
		self.panel_row2.Location  = System.Drawing.Point(15, 335)
		self.panel_row2.Anchor    = System.Windows.Forms.AnchorStyles.Left | System.Windows.Forms.AnchorStyles.Bottom
		# 
		# Panel Row 3
		# 
		self.panel_row3 = FlowLayoutPanel()
		self.panel_row3.Size      = System.Drawing.Size(570, 23)
		self.panel_row3.Location  = System.Drawing.Point(15, 355)
		self.panel_row3.Anchor    = System.Windows.Forms.AnchorStyles.Left | System.Windows.Forms.AnchorStyles.Bottom
		# 
		# Panel Row 4
		# 
		self.panel_row4 = FlowLayoutPanel()
		self.panel_row4.Size      = System.Drawing.Size(570, 23)
		self.panel_row4.Location  = System.Drawing.Point(15, 375)
		self.panel_row4.Anchor    = System.Windows.Forms.AnchorStyles.Left | System.Windows.Forms.AnchorStyles.Bottom
		# 
		# Separator Top
		# 
		self._spr_top.Anchor     = System.Windows.Forms.AnchorStyles.Top | System.Windows.Forms.AnchorStyles.Left | System.Windows.Forms.AnchorStyles.Right
		self._spr_top.Location   = System.Drawing.Point(0, 0)
		self._spr_top.Name       = "spr_top"
		self._spr_top.Size       = System.Drawing.Size(2000, 2)
		self._spr_top.BackColor  = Color.FromArgb(82, 53, 239)
		# 
		# Group Sheet Number
		# 
		self._group1.Anchor = System.Windows.Forms.AnchorStyles.Bottom | System.Windows.Forms.AnchorStyles.Left
		self._group1.Location = System.Drawing.Point(131, 405)
		self._group1.Name = "grp1"
		self._group1.Size = System.Drawing.Size(130, 142)
		self._group1.Text = "Sheet Numbers"
		# 
		# Group Sheet Name
		# 
		self._group2.Anchor = System.Windows.Forms.AnchorStyles.Bottom | System.Windows.Forms.AnchorStyles.Left | System.Windows.Forms.AnchorStyles.Right
		self._group2.Location = System.Drawing.Point(262, 405)
		self._group2.Name = "grp2"
		self._group2.Size = System.Drawing.Size(130, 142)
		self._group2.Text = "Sheet Names"
		# 
		# Group View Names
		# 
		self._group3.Anchor = System.Windows.Forms.AnchorStyles.Bottom | System.Windows.Forms.AnchorStyles.Right
		self._group3.Location = System.Drawing.Point(393, 405)
		self._group3.Name = "grp3"
		self._group3.Size = System.Drawing.Size(130, 142)
		self._group3.Text = "View Names"
		# 
		# TextBlock2
		# 
		self._txtBlock2.Anchor = System.Windows.Forms.AnchorStyles.Top | System.Windows.Forms.AnchorStyles.Left
		self._txtBlock2.Location = System.Drawing.Point(12, 10)
		self._txtBlock2.Name = "txtBlock2"
		self._txtBlock2.Size = System.Drawing.Size(120, 20)
		self._txtBlock2.Text = "Category:"
		# 
		# comboBox1 Cat
		# 
		self._categories.Anchor = System.Windows.Forms.AnchorStyles.Top | System.Windows.Forms.AnchorStyles.Left | System.Windows.Forms.AnchorStyles.Right
		self._categories.Location = System.Drawing.Point(12, 30)
		self._categories.Name = "dropDown"
		self._categories.DataSource = self._tableData 
		self._categories.DisplayMember = "Key"
		self._categories.Size = System.Drawing.Size(510, 244)
		self._categories.DropDownWidth = 150
		self._categories.DropDownStyle = ComboBoxStyle.DropDownList
		self._categories.SelectedIndexChanged += self.UpdateFilter
		# 
		# TextBlock3
		# 
		self._txtBlock3.Anchor = System.Windows.Forms.AnchorStyles.Top | System.Windows.Forms.AnchorStyles.Left
		self._txtBlock3.Location = System.Drawing.Point(12, 58)
		self._txtBlock3.Name = "txtBlock3"
		self._txtBlock3.Size = System.Drawing.Size(170, 20)
		self._txtBlock3.Text = "Elements Of Category:"
		# 
		# TextBlock4
		# 
		self._txtBlock4.Anchor = System.Windows.Forms.AnchorStyles.Bottom | System.Windows.Forms.AnchorStyles.Left
		self._txtBlock4.Location = System.Drawing.Point(12, 428)
		self._txtBlock4.Name = "txtBlock4"
		self._txtBlock4.Size = System.Drawing.Size(110, 20)
		self._txtBlock4.Text = "Replace From:"
		# 
		# TextBox Replace From
		# 
		self._txtBox_rplFr.Anchor = System.Windows.Forms.AnchorStyles.Bottom | System.Windows.Forms.AnchorStyles.Left
		self._txtBox_rplFr.Location = System.Drawing.Point(135, 425)
		self._txtBox_rplFr.Name = "txt_box"
		self._txtBox_rplFr.Size = System.Drawing.Size(120, 294)
		self._txtBox_rplFr.KeyPress += self.previewPref
		# 
		# TextBox Replace From2
		# 
		self._txtBox_rplFr2.Anchor = System.Windows.Forms.AnchorStyles.Bottom | System.Windows.Forms.AnchorStyles.Left | System.Windows.Forms.AnchorStyles.Right
		self._txtBox_rplFr2.Location = System.Drawing.Point(263, 425)
		self._txtBox_rplFr2.Name = "txt_box2"
		self._txtBox_rplFr2.Size = System.Drawing.Size(123, 294)
		self._txtBox_rplFr2.KeyPress += self.previewPref
		# 
		# TextBox Replace From3
		# 
		self._txtBox_rplFr3.Anchor = System.Windows.Forms.AnchorStyles.Bottom | System.Windows.Forms.AnchorStyles.Right
		self._txtBox_rplFr3.Location = System.Drawing.Point(396, 425)
		self._txtBox_rplFr3.Name = "txt_box2"
		self._txtBox_rplFr3.Size = System.Drawing.Size(120, 294)
		self._txtBox_rplFr3.KeyPress += self.previewPref
		# 
		# TextBlock5
		# 
		self._txtBlock5.Anchor = System.Windows.Forms.AnchorStyles.Bottom | System.Windows.Forms.AnchorStyles.Left
		self._txtBlock5.Location = System.Drawing.Point(12, 458)
		self._txtBlock5.Name = "txtBlock5"
		self._txtBlock5.Size = System.Drawing.Size(110, 20)
		self._txtBlock5.Text = "Replace To:"
		# 
		# TextBox Replace To
		# 
		self._txtBox_rplTo.Anchor = System.Windows.Forms.AnchorStyles.Bottom | System.Windows.Forms.AnchorStyles.Left
		self._txtBox_rplTo.Location = System.Drawing.Point(135, 455)
		self._txtBox_rplTo.Name = "txt_box2"
		self._txtBox_rplTo.Size = System.Drawing.Size(120, 294)
		self._txtBox_rplTo.KeyPress += self.previewPref
		# 
		# TextBox Replace To2
		# 
		self._txtBox_rplTo2.Anchor = System.Windows.Forms.AnchorStyles.Bottom | System.Windows.Forms.AnchorStyles.Left | System.Windows.Forms.AnchorStyles.Right
		self._txtBox_rplTo2.Location = System.Drawing.Point(263, 455)
		self._txtBox_rplTo2.Name = "txt_box2"
		self._txtBox_rplTo2.Size = System.Drawing.Size(123, 294)
		self._txtBox_rplTo2.KeyPress += self.previewPref
		# 
		# TextBox Replace To3
		# 
		self._txtBox_rplTo3.Anchor = System.Windows.Forms.AnchorStyles.Bottom | System.Windows.Forms.AnchorStyles.Right
		self._txtBox_rplTo3.Location = System.Drawing.Point(396, 455)
		self._txtBox_rplTo3.Name = "txt_box2"
		self._txtBox_rplTo3.Size = System.Drawing.Size(120, 294)
		self._txtBox_rplTo3.KeyPress += self.previewPref
		# 
		# TextBlock6
		# 
		self._txtBlock6.Anchor = System.Windows.Forms.AnchorStyles.Bottom | System.Windows.Forms.AnchorStyles.Left
		self._txtBlock6.Location = System.Drawing.Point(12, 488)
		self._txtBlock6.Name = "txtBlock6"
		self._txtBlock6.Size = System.Drawing.Size(110, 20)
		self._txtBlock6.Text = "Add Prefix:"
		# 
		# TextBox Prefix
		# 
		self._txtBox_pre.Anchor = System.Windows.Forms.AnchorStyles.Bottom | System.Windows.Forms.AnchorStyles.Left
		self._txtBox_pre.Location = System.Drawing.Point(135, 485)
		self._txtBox_pre.Name = "txt_box3"
		self._txtBox_pre.Size = System.Drawing.Size(120, 294)
		self._txtBox_pre.Text = IN[0]
		self._txtBox_pre.KeyPress += self.previewPref
		# 
		# TextBox Prefix2
		# 
		self._txtBox_pre2.Anchor = System.Windows.Forms.AnchorStyles.Bottom | System.Windows.Forms.AnchorStyles.Left | System.Windows.Forms.AnchorStyles.Right
		self._txtBox_pre2.Location = System.Drawing.Point(263, 485)
		self._txtBox_pre2.Name = "txt_box3"
		self._txtBox_pre2.Size = System.Drawing.Size(123, 294)
		self._txtBox_pre2.Text = IN[0]
		self._txtBox_pre2.KeyPress += self.previewPref
		# 
		# TextBox Prefix3
		# 
		self._txtBox_pre3.Anchor = System.Windows.Forms.AnchorStyles.Bottom | System.Windows.Forms.AnchorStyles.Right
		self._txtBox_pre3.Location = System.Drawing.Point(396, 485)
		self._txtBox_pre3.Name = "txt_box3"
		self._txtBox_pre3.Size = System.Drawing.Size(120, 294)
		self._txtBox_pre3.Text = IN[0]
		self._txtBox_pre3.KeyPress += self.previewPref
		# 
		# TextBlock7
		# 
		self._txtBlock7.Anchor = System.Windows.Forms.AnchorStyles.Bottom | System.Windows.Forms.AnchorStyles.Left
		self._txtBlock7.Location = System.Drawing.Point(12, 518)
		self._txtBlock7.Name = "txtBlock7"
		self._txtBlock7.Size = System.Drawing.Size(110, 20)
		self._txtBlock7.Text = "Add Suffix:"
		# 
		# TextBox Suffix
		# 
		self._txtBox_suf.Anchor = System.Windows.Forms.AnchorStyles.Bottom | System.Windows.Forms.AnchorStyles.Left
		self._txtBox_suf.Location = System.Drawing.Point(135, 515)
		self._txtBox_suf.Name = "txt_box4"
		self._txtBox_suf.Size = System.Drawing.Size(120, 294)
		self._txtBox_suf.Text = IN[1]
		self._txtBox_suf.KeyPress += self.previewPref
		# 
		# TextBox Suffix2
		# 
		self._txtBox_suf2.Anchor = System.Windows.Forms.AnchorStyles.Bottom | System.Windows.Forms.AnchorStyles.Left | System.Windows.Forms.AnchorStyles.Right
		self._txtBox_suf2.Location = System.Drawing.Point(263, 515)
		self._txtBox_suf2.Name = "txt_box4"
		self._txtBox_suf2.Size = System.Drawing.Size(123, 294)
		self._txtBox_suf2.Text = IN[1]
		self._txtBox_suf2.KeyPress += self.previewPref
		# 
		# TextBox Suffix3
		# 
		self._txtBox_suf3.Anchor = System.Windows.Forms.AnchorStyles.Bottom | System.Windows.Forms.AnchorStyles.Right
		self._txtBox_suf3.Location = System.Drawing.Point(396, 515)
		self._txtBox_suf3.Name = "txt_box4"
		self._txtBox_suf3.Size = System.Drawing.Size(120, 294)
		self._txtBox_suf3.Text = IN[1]
		self._txtBox_suf3.KeyPress += self.previewPref
		# 
		# TextBlock8
		# 
		self._txtBlock8.Anchor = System.Windows.Forms.AnchorStyles.Bottom | System.Windows.Forms.AnchorStyles.Left
		self._txtBlock8.Location = System.Drawing.Point(12, 552)
		self._txtBlock8.Name = "txtBlock8"
		self._txtBlock8.Size = System.Drawing.Size(115, 20)
		self._txtBlock8.Text = "View Template:"
		self.toolTip1 = System.Windows.Forms.ToolTip()
		self.toolTip1.SetToolTip(self._txtBlock8, "Reassign a different View Template for the duplicated view or schedule.")
		self._txtBlock8.Enabled = False
		# 
		# TextBox Suffix3
		# 
		self._comboTemplate.Anchor = System.Windows.Forms.AnchorStyles.Bottom | System.Windows.Forms.AnchorStyles.Left | System.Windows.Forms.AnchorStyles.Right
		self._comboTemplate.Location = System.Drawing.Point(131, 550)
		self._comboTemplate.Name = "combo_template"
		self._comboTemplate.Size = System.Drawing.Size(392, 20)
		self._comboTemplate.DropDownStyle = ComboBoxStyle.DropDownList
		self._comboTemplate.DropDownWidth = 350
		self._comboTemplate.ItemHeight = 20
		self._comboTemplate.DataSource = self._tab_vw_temp 
		self._comboTemplate.DisplayMember = "Key"
		self._comboTemplate.Enabled = False
		# 
		# checkedListBox1
		# 
		self._listBox1.Anchor = System.Windows.Forms.AnchorStyles.Top |  System.Windows.Forms.AnchorStyles.Left | System.Windows.Forms.AnchorStyles.Right | System.Windows.Forms.AnchorStyles.Bottom
		self._listBox1.FormattingEnabled = True
		self._listBox1.CheckOnClick = True
		self._listBox1.HorizontalScrollbar = True
		self._listBox1.Location = System.Drawing.Point(12, 80)
		self._listBox1.Name = "checkedListBox1"
		self._listBox1.DisplayMember = "Key"
		self._listBox1.Size = System.Drawing.Size(510, 270)
		self._listBox1.SelectedIndexChanged += self.changeSelection
		# 
		# button1
		# 
		self._button1.Anchor = System.Windows.Forms.AnchorStyles.Bottom | System.Windows.Forms.AnchorStyles.Right | System.Windows.Forms.AnchorStyles.Left
		self._button1.Location = System.Drawing.Point(12, 582)
		self._button1.Name = "button1"
		self._button1.Size = System.Drawing.Size(512, 27)
		self._button1.Text = "Duplicate Selected"
		self._button1.UseVisualStyleBackColor = True
		self._button1.Click += self.Button1Click
		# 
		# exp
		# 
		self._expander.Anchor = System.Windows.Forms.AnchorStyles.Bottom | System.Windows.Forms.AnchorStyles.Left | System.Windows.Forms.AnchorStyles.Right
		self._expander.Location = System.Drawing.Point(11, 380)
		self._expander.Name = "button1"
		self._expander.Size = System.Drawing.Size(512, 25)
		self._expander.Text = "Sheet Options"
		self._expander.UseVisualStyleBackColor = True
		self._expander.Click += self.Button2Click
		# 
		# Radiobutton
		# 
		self._rdButton1.Anchor = System.Windows.Forms.AnchorStyles.Bottom | System.Windows.Forms.AnchorStyles.Left
		self._rdButton1.Location = System.Drawing.Point(20, 355)
		self._rdButton1.Name = "radiobutton1"
		self._rdButton1.Size = System.Drawing.Size(100, 25)
		self._rdButton1.Text = "Duplicate."
		self._rdButton1.CheckedChanged += self.radiobutton_updated
		self.toolTip1.SetToolTip(self._rdButton1, "Exact duplicate of the view is created, without the annotation and detailing items.")
		# 
		# Radiobutton2
		# 
		self._rdButton2.Anchor = System.Windows.Forms.AnchorStyles.Bottom | System.Windows.Forms.AnchorStyles.Left  | System.Windows.Forms.AnchorStyles.Right
		self._rdButton2.Location = System.Drawing.Point(125, 355)
		self._rdButton2.Name = "radiobutton2"
		self._rdButton2.Size = System.Drawing.Size(195, 25)
		self._rdButton2.Text = "Duplicate with Detailing."
		self._rdButton2.CheckedChanged += self.radiobutton_updated
		self._rdButton2.Checked = 1
		self.toolTip2 = System.Windows.Forms.ToolTip()
		self.toolTip2.SetToolTip(self._rdButton2, "The model geometry of the view is duplicated as well as the annotation and detailing elements.\nIf your element cannot be duplicated as such (for example with schedules), it will be duplicated \nwithout the annotation and detailing items.")
		# 
		# Radiobutton3
		# 
		self._rdButton3.Anchor = System.Windows.Forms.AnchorStyles.Bottom | System.Windows.Forms.AnchorStyles.Right
		self._rdButton3.Location = System.Drawing.Point(325, 355)
		self._rdButton3.Name = "radiobutton3"
		self._rdButton3.Size = System.Drawing.Size(220, 25)
		self._rdButton3.Text = "Duplicate as a Dependent."
		self._rdButton3.CheckedChanged += self.radiobutton_updated
		self.toolTip3 = System.Windows.Forms.ToolTip()
		self.toolTip3.SetToolTip(self._rdButton3, "Creates a duplicated view linked to the original view. \nChanges made to either the original or the duplicated view are reflected in both views.\nIf your element cannot be duplicated as such (for example with 3D views and Detail views), \nit will be duplicated with detailing.")
		# 
		# Views CheckBox
		# 
		self._views_chkBox.Anchor = System.Windows.Forms.AnchorStyles.Bottom | System.Windows.Forms.AnchorStyles.Left
		self._views_chkBox.Location = System.Drawing.Point(20, 408)
		self._views_chkBox.Name = "chck1"
		self._views_chkBox.Size = System.Drawing.Size(180, 20)
		self._views_chkBox.Text = "Include Views."
		self._views_chkBox.Checked = 1
		self._views_chkBox.Visible = 0
		# 
		# Legends CheckBox
		# 
		self._legends_chkBox.Anchor = System.Windows.Forms.AnchorStyles.Bottom | System.Windows.Forms.AnchorStyles.Left
		self._legends_chkBox.Location = System.Drawing.Point(20, 428)
		self._legends_chkBox.Name = "chck2"
		self._legends_chkBox.Size = System.Drawing.Size(180, 20)
		self._legends_chkBox.Text = "Include Legends."
		self._legends_chkBox.Visible = 0
		self._legends_chkBox.Checked = 1
		# 
		# Schedules CheckBox
		# 
		self._schedules_chkBox.Anchor = System.Windows.Forms.AnchorStyles.Bottom | System.Windows.Forms.AnchorStyles.Left
		self._schedules_chkBox.Location = System.Drawing.Point(20, 448)
		self._schedules_chkBox.Name = "chck3"
		self._schedules_chkBox.Size = System.Drawing.Size(180, 20)
		self._schedules_chkBox.Text = "Include Schedules."
		self._schedules_chkBox.Visible = 0
		self._schedules_chkBox.Checked = 1
		# 
		# Images CheckBox
		# 
		self._images_chkBox.Anchor = System.Windows.Forms.AnchorStyles.Bottom | System.Windows.Forms.AnchorStyles.Left
		self._images_chkBox.Location = System.Drawing.Point(20, 468)
		self._images_chkBox.Name = "chck4"
		self._images_chkBox.Size = System.Drawing.Size(180, 20)
		self._images_chkBox.Text = "Include Images/DWG."
		self._images_chkBox.Visible = 0
		self._images_chkBox.Checked = 1
		# 
		# Lines Checkbox
		# 
		self._lines_chkBox.Anchor = System.Windows.Forms.AnchorStyles.Bottom | System.Windows.Forms.AnchorStyles.Left
		self._lines_chkBox.Location = System.Drawing.Point(200, 408)
		self._lines_chkBox.Name = "chck5"
		self._lines_chkBox.Size = System.Drawing.Size(150, 20)
		self._lines_chkBox.Text = "Include Lines."
		self._lines_chkBox.Visible = 0
		self._lines_chkBox.Checked = 1
		# 
		# Text CheckBox
		# 
		self._text_chkBox.Anchor = System.Windows.Forms.AnchorStyles.Bottom | System.Windows.Forms.AnchorStyles.Left
		self._text_chkBox.Location = System.Drawing.Point(200, 428)
		self._text_chkBox.Name = "chck6"
		self._text_chkBox.Size = System.Drawing.Size(150, 20)
		self._text_chkBox.Text = "Include Texts."
		self._text_chkBox.Visible = 0
		self._text_chkBox.Checked = 1
		# 
		# Clouds CheckBox
		# 
		self._clouds_chkBox.Anchor = System.Windows.Forms.AnchorStyles.Bottom | System.Windows.Forms.AnchorStyles.Left
		self._clouds_chkBox.Location = System.Drawing.Point(200, 448)
		self._clouds_chkBox.Name = "chck7"
		self._clouds_chkBox.Size = System.Drawing.Size(150, 20)
		self._clouds_chkBox.Text = "Include Clouds."
		self._clouds_chkBox.Visible = 0
		self._clouds_chkBox.Checked = 1
		# 
		# Symbols CheckBox
		# 
		self._symbols_chkBox.Anchor = System.Windows.Forms.AnchorStyles.Bottom | System.Windows.Forms.AnchorStyles.Left
		self._symbols_chkBox.Location = System.Drawing.Point(200, 468)
		self._symbols_chkBox.Name = "chck8"
		self._symbols_chkBox.Size = System.Drawing.Size(150, 20)
		self._symbols_chkBox.Text = "Include Symbols."
		self._symbols_chkBox.Visible = 0
		self._symbols_chkBox.Checked = 1
		# 
		# Dimensions CheckBox
		# 
		self._dimensions_chkBox.Anchor = System.Windows.Forms.AnchorStyles.Bottom | System.Windows.Forms.AnchorStyles.Left
		self._dimensions_chkBox.Location = System.Drawing.Point(355, 408)
		self._dimensions_chkBox.Name = "chck9"
		self._dimensions_chkBox.Size = System.Drawing.Size(180, 20)
		self._dimensions_chkBox.Text = "Include Dimensions."
		self._dimensions_chkBox.Visible = 0
		self._dimensions_chkBox.Checked = 1
		# 
		# Revisions CheckBox
		# 
		self._revisions_chkBox.Anchor = System.Windows.Forms.AnchorStyles.Bottom | System.Windows.Forms.AnchorStyles.Left
		self._revisions_chkBox.Location = System.Drawing.Point(355, 428)
		self._revisions_chkBox.Name = "chck10"
		self._revisions_chkBox.Size = System.Drawing.Size(180, 20)
		self._revisions_chkBox.Text = "Include Revisions."
		self._revisions_chkBox.Visible = 0
		self._revisions_chkBox.Checked = 1
		# 
		# View Dependent
		# 
		self._viewdep_chkBox.Anchor = System.Windows.Forms.AnchorStyles.Bottom | System.Windows.Forms.AnchorStyles.Left
		self._viewdep_chkBox.Location = System.Drawing.Point(355, 448)
		self._viewdep_chkBox.Name = "chck11"
		self._viewdep_chkBox.Size = System.Drawing.Size(180, 20)
		self._viewdep_chkBox.Text = "Duplicate Schedules."
		self._viewdep_chkBox.Visible = 0
		self._viewdep_chkBox.Checked = 0
		# 
		# Legend Dependent
		# 
		self._legdep_chkBox.Anchor = System.Windows.Forms.AnchorStyles.Bottom | System.Windows.Forms.AnchorStyles.Left
		self._legdep_chkBox.Location = System.Drawing.Point(355, 468)
		self._legdep_chkBox.Name = "chck12"
		self._legdep_chkBox.Size = System.Drawing.Size(180, 20)
		self._legdep_chkBox.Text = "Duplicate Legends."
		self._legdep_chkBox.Visible = 0
		self._legdep_chkBox.Checked = 0
		# 
		# Tab switcher
		# 
		self._txtBox_rplFr.TabIndex  = 1
		self._txtBox_rplTo.TabIndex  = 2
		self._txtBox_pre.TabIndex    = 3
		self._txtBox_suf.TabIndex    = 4
		self._txtBox_rplFr2.TabIndex = 5
		self._txtBox_rplTo2.TabIndex = 6
		self._txtBox_pre2.TabIndex   = 7
		self._txtBox_suf2.TabIndex   = 8
		self._txtBox_rplFr3.TabIndex = 9
		self._txtBox_rplTo3.TabIndex = 10
		self._txtBox_pre3.TabIndex   = 11
		self._txtBox_suf3.TabIndex   = 12
		self._comboTemplate.TabIndex = 13
		self._button1.TabIndex       = 14
		self._txtBox_rplFr.TabStop  = True
		self._txtBox_rplTo.TabStop  = True
		self._txtBox_suf.TabStop    = True
		self._txtBox_pre.TabStop    = True
		self._txtBox_rplFr2.TabStop = True
		self._txtBox_rplTo2.TabStop = True
		self._txtBox_suf2.TabStop   = True
		self._txtBox_pre2.TabStop   = True
		self._txtBox_rplFr3.TabStop = True
		self._txtBox_rplTo3.TabStop = True
		self._txtBox_suf3.TabStop   = True
		self._txtBox_pre3.TabStop   = True
		self._comboTemplate.TabStop = True
		self._button1.TabStop       = True
		self._group1.TabStop        = False
		self._group2.TabStop        = False
		self._group3.TabStop        = False
		self._expander.TabStop      = False
		self._categories.TabStop    = False
		self._txtBlock2.TabStop     = False
		self._txtBlock3.TabStop     = False
		self._txtBlock4.TabStop     = False
		self._txtBlock5.TabStop     = False
		self._txtBlock6.TabStop     = False
		self._txtBlock7.TabStop     = False
		self._rdButton1.TabStop     = False
		self._rdButton2.TabStop     = False
		self._rdButton3.TabStop     = False
		self._listBox1.TabStop      = False
		self._views_chkBox.TabStop  = False
		self._legends_chkBox.TabStop = False
		self._schedules_chkBox.TabStop = False
		self._images_chkBox.TabStop = False
		self._lines_chkBox.TabStop = False
		self._text_chkBox.TabStop  = False
		self._clouds_chkBox.TabStop = False
		self._symbols_chkBox.TabStop = False
		self._dimensions_chkBox.TabStop = False
		self._revisions_chkBox.TabStop = False
		self._viewdep_chkBox.TabStop = False
		self._legdep_chkBox.TabStop = False
		self.KeyDown += self.MyOnKeyDown
		self.KeyPreview = True
		self.TabStop = False
		# 
		# Form24
		# 
		self.TopMost = True
		self.ClientSize = System.Drawing.Size(534, 620)
		self.MaximizeBox = 0
		self.MinimizeBox = 0
		self.CenterToScreen() 
		self.FormBorderStyle = FormBorderStyle.Sizable
		self.SizeGripStyle = SizeGripStyle.Show
		self.ShowInTaskbar = True
		self.MaximizeBox = True
		self.MinimizeBox = True
		self.mainPanel.Controls.Add(self._rdButton1)
		self.mainPanel.Controls.Add(self._rdButton2)
		self.mainPanel.Controls.Add(self._rdButton3)
		self.Controls.Add(self.mainPanel)
		self.Controls.Add(self._spr_top)
		self.Controls.Add(self._txtBox_rplFr)
		self.Controls.Add(self._txtBox_rplTo)
		self.Controls.Add(self._txtBox_suf)
		self.Controls.Add(self._txtBox_pre)
		self.Controls.Add(self._txtBox_rplFr2)
		self.Controls.Add(self._txtBox_rplTo2)
		self.Controls.Add(self._txtBox_suf2)
		self.Controls.Add(self._txtBox_pre2)
		self.Controls.Add(self._txtBox_rplFr3)
		self.Controls.Add(self._txtBox_rplTo3)
		self.Controls.Add(self._txtBox_suf3)
		self.Controls.Add(self._txtBox_pre3)
		self.Controls.Add(self._group1)
		self.Controls.Add(self._group2)
		self.Controls.Add(self._group3)
		self.Controls.Add(self._button1)
		self.Controls.Add(self._expander)
		self.Controls.Add(self._categories)
		self.Controls.Add(self._txtBlock2)
		self.Controls.Add(self._txtBlock3)
		self.Controls.Add(self._txtBlock4)
		self.Controls.Add(self._txtBlock5)
		self.Controls.Add(self._txtBlock6)
		self.Controls.Add(self._txtBlock7)
		self.Controls.Add(self._txtBlock8)
		self.Controls.Add(self._comboTemplate)
		self.Controls.Add(self._listBox1)
		self.panel_row1.Controls.Add(self._views_chkBox)
		self.panel_row1.Controls.Add(self._lines_chkBox)
		self.panel_row1.Controls.Add(self._dimensions_chkBox)
		self.Controls.Add(self.panel_row1)
		self.panel_row2.Controls.Add(self._legends_chkBox)
		self.panel_row2.Controls.Add(self._text_chkBox)
		self.panel_row2.Controls.Add(self._revisions_chkBox)
		self.Controls.Add(self.panel_row2)
		self.panel_row3.Controls.Add(self._schedules_chkBox)
		self.panel_row3.Controls.Add(self._clouds_chkBox)
		self.panel_row3.Controls.Add(self._viewdep_chkBox)
		self.Controls.Add(self.panel_row3)
		self.panel_row4.Controls.Add(self._images_chkBox)
		self.panel_row4.Controls.Add(self._symbols_chkBox)
		self.panel_row4.Controls.Add(self._legdep_chkBox)
		self.Controls.Add(self.panel_row4)
		self.Resize += self.on_resize
		self.Closing += self.closingEvent
		self.Name = "Duplicator"
		self.Text = "Duplicator"
		iconFilename = 'C:\\NONICAPRO\\OtherFiles\\System\\Nonicafavicon.ICO'
		if not os.path.exists(iconFilename):
			iconFilename = 'C:\\NONICA\\OtherFiles\\System\\Nonicafavicon.ICO'
		icon = Icon(iconFilename)
		self.Icon = icon
		self.ResumeLayout(False)
		
	def on_resize(self, sender, e):
		wd_client = self.ClientSize.Width
		#Duplicate panel.
		self.reLocatePanel(self.mainPanel, wd_client)
		#Row 1 Checkboxes.
		self.reLocatePanel(self.panel_row1, wd_client)	
		#Row 2 Checkboxes.
		self.reLocatePanel(self.panel_row2, wd_client)	
		#Row 3 Checkboxes.
		self.reLocatePanel(self.panel_row3, wd_client)
		#Row 4 Checkboxes.
		self.reLocatePanel(self.panel_row4, wd_client)		
		
	def reLocatePanel(self, control, wd_client):
		wd_row4  = control.Size.Width
		marg_row4 = (wd_client - wd_row4)/2
		marg_row4 += 18
		control.Location = System.Drawing.Point(marg_row4, control.Location.Y)
		
	def MyOnKeyDown(self, sender, e):
		try:
			if e.KeyCode == System.Windows.Forms.Keys.Tab:  # Check if the Tab key was pressed
				self.SwitchFocus(e.Shift)
				e.Handled = True 
				e.SuppressKeyPress = True
			elif Control.ModifierKeys == Keys.Shift and e.KeyCode == System.Windows.Forms.Keys.C:
				if isinstance(self.ActiveControl, TextBox):
					if self.ActiveControl.SelectionLength > 0:
						self.CopyValue()
						e.Handled = True  
						e.SuppressKeyPress = True
				else:
					self.CopyValue()
					e.Handled = True  
					e.SuppressKeyPress = True
			elif Control.ModifierKeys == Keys.Shift and e.KeyCode == System.Windows.Forms.Keys.V:
				if System.Windows.Forms.Clipboard.GetText() != "":
					self.PasteValue()
					e.Handled = True 
					e.SuppressKeyPress = True
			elif e.KeyCode == System.Windows.Forms.Keys.Enter and isinstance(self.ActiveControl, Button):
				self.ActiveControl.PerformClick()
				e.Handled = True 
				e.SuppressKeyPress = True
		except Exception as exc:
			pass
	
	def ActDeaItems(self, IsActive):
		self._categories.Enabled    = IsActive
		self._listBox1.Enabled      = IsActive
		self._button1.Enabled       = IsActive
		self._expander.Enabled      = IsActive
		self._rdButton1.Enabled     = IsActive
		self._rdButton2.Enabled     = IsActive
		self._rdButton3.Enabled     = IsActive
		if IsActive == True:
			self._button1.Text = "Duplicate Selected"
		else:
			self._button1.Text = "Revit is Blocked (Other command was being run). Press Esc"
	
	def SwitchFocus(self, shiftPressed):
		current_control = self.ActiveControl
		focusable_controls = [ctrl for ctrl in self.Controls if ctrl.TabStop and ctrl.Enabled and ctrl.Visible]
		focusable_controls.sort(key=lambda ctrl: ctrl.TabIndex)
		current_index = focusable_controls.index(current_control) if current_control in focusable_controls else -1
		if shiftPressed:
			next_index = (current_index - 1) % len(focusable_controls)
		else:
			next_index = (current_index + 1) % len(focusable_controls)
		next_control = focusable_controls[next_index]
		next_control.Focus()
	
	def CopyValue(self):
		current_control = self.ActiveControl
		if isinstance(current_control, System.Windows.Forms.NumericUpDown):
			System.Windows.Forms.Clipboard.SetText(str(current_control.Value))
		elif isinstance(current_control, System.Windows.Forms.TextBox):
			System.Windows.Forms.Clipboard.SetText(str(current_control.SelectedText))

	def PasteValue(self):
		current_control = self.ActiveControl
		if isinstance(current_control, System.Windows.Forms.NumericUpDown):
			clipboard_text = System.Windows.Forms.Clipboard.GetText()
			try:
				new_value = float(clipboard_text)
				current_control.Value = max(min(new_value, current_control.Maximum), current_control.Minimum)
			except:
				pass
		if isinstance(current_control, System.Windows.Forms.TextBox):
			clipboard_text = System.Windows.Forms.Clipboard.GetText()
			try:
				position_cursor = current_control.SelectionStart
				current_control.Text = current_control.Text.Insert(current_control.SelectionStart, clipboard_text)
				current_control.SelectionStart = position_cursor + len(clipboard_text)
			except:
				pass
	
	def closingEvent(self, sender, e):
		isActive = 0
		self.doc_sub_eve.Raise()
	
	def radiobutton_updated(self, sender, e):
		if sender.Checked:
			if sender.Name == "radiobutton1":
				self.option_duplicate = ViewDuplicateOption.Duplicate
			elif sender.Name == "radiobutton2":
				self.option_duplicate = ViewDuplicateOption.WithDetailing
			elif sender.Name == "radiobutton3":
				self.option_duplicate = ViewDuplicateOption.AsDependent
	
	def previewPref(self, sender, e):
		non_allow = ['[','{','}','[',']','|',';','<','>','`','~',']',"\\","?"]
		if e.KeyChar in non_allow:
			e.Handled = 1
		
	def changeSelection(self, sender, e):
		actualcount = len(self.selectionhistory)
		if actualcount > 0:
			if Control.ModifierKeys == Keys.Shift:
				lastindex = self.selectionhistory[0]
				currentIndex = self._listBox1.SelectedIndex
				step = 1
				if currentIndex < lastindex:
					step = -1
				for i in range(lastindex, currentIndex, step):
					if i != lastindex:
						if self._listBox1.GetItemCheckState(i) == CheckState.Checked:
							self._listBox1.SetItemCheckState(i, CheckState.Unchecked);
						else:
							self._listBox1.SetItemCheckState(i, CheckState.Checked);
			self.selectionhistory.Clear()
			self.selectionhistory.Add(self._listBox1.SelectedIndex) 
		else:
			self.selectionhistory.Clear()
			self.selectionhistory.Add(self._listBox1.SelectedIndex) 
			
	def previewPref(self, sender, e):
		non_allow = ['[','{','}','[',']','|',';','<','>','`','~',']',"\\","?",":"]
		if e.KeyChar in non_allow:
			e.Handled = 1
			
	def Button1Click(self, sender, e):
		if self._listBox1.Items.Count > 0:
			if self._listBox1.CheckedItems.Count > 0:
				self.ActDeaItems(False)
				self.event.Raise()
				
	def Button2Click(self, sender, e):
		if self._views_chkBox.Visible == 0:
			displacement = 90
			self._listBox1.Size = System.Drawing.Size(self._listBox1.Size.Width, self._listBox1.Size.Height - 82)
			self.mainPanel.Location = System.Drawing.Point(self.mainPanel.Location.X, self.mainPanel.Location.Y - displacement)		
			self._expander.Location = System.Drawing.Point(self._expander.Location.X, self._expander.Location.Y - displacement)
			self._views_chkBox.Location = System.Drawing.Point(self._views_chkBox.Location.X, self._views_chkBox.Location.Y - displacement)
			self._views_chkBox.Visible = 1
			self._legends_chkBox.Location = System.Drawing.Point(self._legends_chkBox.Location.X, self._legends_chkBox.Location.Y - displacement)
			self._legends_chkBox.Visible = 1
			self._schedules_chkBox.Location = System.Drawing.Point(self._schedules_chkBox.Location.X, self._schedules_chkBox.Location.Y - displacement)
			self._schedules_chkBox.Visible = 1
			self._images_chkBox.Location = System.Drawing.Point(self._images_chkBox.Location.X, self._images_chkBox.Location.Y - displacement)
			self._images_chkBox.Visible = 1
			self._lines_chkBox.Location = System.Drawing.Point(self._lines_chkBox.Location.X, self._lines_chkBox.Location.Y - displacement)
			self._lines_chkBox.Visible = 1
			self._text_chkBox.Location = System.Drawing.Point(self._text_chkBox.Location.X, self._text_chkBox.Location.Y - displacement)
			self._text_chkBox.Visible = 1
			self._clouds_chkBox.Location = System.Drawing.Point(self._clouds_chkBox.Location.X, self._clouds_chkBox.Location.Y - displacement)
			self._clouds_chkBox.Visible = 1
			self._symbols_chkBox.Location = System.Drawing.Point(self._symbols_chkBox.Location.X, self._symbols_chkBox.Location.Y - displacement)
			self._symbols_chkBox.Visible = 1
			self._dimensions_chkBox.Location = System.Drawing.Point(self._dimensions_chkBox.Location.X, self._dimensions_chkBox.Location.Y - displacement)
			self._dimensions_chkBox.Visible = 1
			self._revisions_chkBox.Location = System.Drawing.Point(self._revisions_chkBox.Location.X, self._revisions_chkBox.Location.Y - displacement)
			self._revisions_chkBox.Visible = 1
			self._legdep_chkBox.Location = System.Drawing.Point(self._legdep_chkBox.Location.X, self._legdep_chkBox.Location.Y - displacement)
			self._legdep_chkBox.Visible = 1
			self._viewdep_chkBox.Location = System.Drawing.Point(self._viewdep_chkBox.Location.X, self._viewdep_chkBox.Location.Y - displacement)
			self._viewdep_chkBox.Visible = 1
			
	def UpdateFilter(self, sender, e):
		sel_cat = sender.SelectedItem['Value']
		if sel_cat != BuiltInCategory.OST_Sheets:
			self._txtBox_rplFr.Enabled = 0
			self._txtBox_rplTo.Enabled = 0
			self._txtBox_suf.Enabled = 0
			self._txtBox_pre.Enabled = 0
			self._txtBox_rplFr2.Enabled = 0
			self._txtBox_rplTo2.Enabled = 0
			self._txtBox_suf2.Enabled = 0
			self._txtBox_pre2.Enabled = 0
			name = self._categories.SelectedItem['Key']
			if name.EndsWith("egends"):
				self._group3.Text = "View Names"
				self._comboTemplate.DataSource = self._tab_vw_temp
				self._comboTemplate.SelectedIndex = 0
				self._txtBlock8.Enabled = 1
				self._comboTemplate.Enabled = 1
			elif name.EndsWith("Schedules"):
				self._group3.Text = self._categories.SelectedItem['Key'][:-1] + " Names"
				self._comboTemplate.DataSource = self._tab_sch_temp
				self._comboTemplate.SelectedIndex = 0
				self._txtBlock8.Enabled = 1
				self._comboTemplate.Enabled = 1
			elif name.EndsWith("Groups"):
				self._group3.Text = self._categories.SelectedItem['Key'][:-1] + " Names"
				self._txtBlock8.Enabled = 0
				self._comboTemplate.Enabled = 0
				self._comboTemplate.SelectedIndex = 0
		else:
			self._txtBox_rplFr.Enabled = 1
			self._txtBox_rplTo.Enabled = 1
			self._txtBox_suf.Enabled = 1
			self._txtBox_pre.Enabled = 1
			self._txtBox_rplFr2.Enabled = 1
			self._txtBox_rplTo2.Enabled = 1
			self._txtBox_suf2.Enabled = 1
			self._txtBox_pre2.Enabled = 1
			self._txtBlock8.Enabled = 0
			self._comboTemplate.Enabled = 0
			self._comboTemplate.SelectedIndex = 0
			self._group3.Text = "View Names"
		self.setCategoriesAndViews(sel_cat)
			
	def refreshViews(self):
		self.setCategoriesAndViews(self._categories.SelectedItem['Value'])
		
	def setCategoriesAndViews(self, bic_category):
		list_views = []
		if isinstance(bic_category, list):
			collector = FilteredElementCollector(doc).OfCategory(bic_category[0]).WhereElementIsElementType().ToElements()
			collector.AddRange(FilteredElementCollector(doc).OfCategory(bic_category[1]).WhereElementIsElementType().ToElements())
		elif bic_category == BuiltInCategory.OST_Schedules:
			ini_collector = FilteredElementCollector(doc).OfCategory(bic_category).WhereElementIsNotElementType().ToElements()	
			collector = []
			for indx in range(len(ini_collector)):
				if not ini_collector[indx].IsTitleblockRevisionSchedule:
					collector.Add(ini_collector[indx])
		else:
			collector = FilteredElementCollector(doc).OfCategory(bic_category).WhereElementIsNotElementType().ToElements()	
		for ele in collector:
			list_views.Add(view_info(ele))
			
		list_views = sorted(list_views, key = lambda x: x._title.upper())
		names_views = [x._title for x in list_views]
			
		self._tableData2 = DataTable("Data")
		self._tableData2.Columns.Add("Key", System.String)
		self._tableData2.Columns.Add("Value", System.Object)
		[self._tableData2.Rows.Add(key_, value_ ) for key_, value_ in zip(names_views, list_views)]	
		self._listBox1.DataSource = self._tableData2
		self._listBox1.DisplayMember = "Key"
		#Delete old selections
		for indx in range(len(self._listBox1.Items)):
			self._listBox1.SetItemChecked(indx, False)

def OnViewActivated(sender, e):
	new_doc = e.CurrentActiveView.Document
	if new_doc:
		new_uiapp = new_doc.Application
		if isActive == 1:
			if wndw:
				if not new_doc.Equals(doc):
					wndw.Close()
				else:
					return

doc = DocumentManager.Instance.CurrentDBDocument
uidoc = DocumentManager.Instance.CurrentUIApplication.ActiveUIDocument
app = doc.Application
global version
version = int(app.VersionNumber)
uiapp = DocumentManager.Instance.CurrentUIApplication
#Window
isActive = 1
new_sub = System.EventHandler[Autodesk.Revit.UI.Events.ViewActivatedEventArgs](OnViewActivated)
uiapp.ViewActivated += new_sub
event_handler_doc = UnsubcribeDocChange()
ext_event_doc = ExternalEvent.Create(event_handler_doc)
#Get view templates
vw_tmp_collector = FilteredElementCollector(doc).OfCategory(BuiltInCategory.OST_Views).WhereElementIsNotElementType().ToElements()
vw_tm_name = []
vw_tm_id = []
for vw in vw_tmp_collector:
	if vw.IsTemplate:
		vw_tm_name.Add(vw.Title)
		vw_tm_id.Add(vw.Id)
#Get schedule templates
sch_tmp_collector = FilteredElementCollector(doc).OfCategory(BuiltInCategory.OST_Schedules).WhereElementIsNotElementType().ToElements()
sch_tm_name = []
sch_tm_id = []
for sch in sch_tmp_collector:
	if sch.IsTemplate:
		sch_tm_name.Add(sch.Title)
		sch_tm_id.Add(sch.Id)

sorted_views_tm     = sorted(zip(vw_tm_name,  vw_tm_id), key=lambda x: x[0])
sorted_schedules_tm = sorted(zip(sch_tm_name, sch_tm_id), key=lambda x: x[0])

event_handler = Duplicating()
ext_event = ExternalEvent.Create(event_handler)
wndw = Form_cats(ext_event, ext_event_doc, sorted_views_tm, sorted_schedules_tm)
wndw.Show()

OUT = 0

"""
Duplication of sheets in this script was based on EF-Tools Duplicate Sheets by ErikFrits. 

Changes and improvements included in this script on 01/10/2023:
	-Duplication of groups, schedules, views and legends.
	-Execution does not block Revit user interfaces.
	-Redevelopment of user interface and experience(selection) with Windows Forms.
	-Renaming of duplicated legends and schedules.

					 GNU GENERAL PUBLIC LICENSE
                       Version 3, 29 June 2007

 Copyright (C) 2007 Free Software Foundation, Inc. <https://fsf.org/>
 Everyone is permitted to copy and distribute verbatim copies
 of this license document, but changing it is not allowed.

                            Preamble

  The GNU General Public License is a free, copyleft license for
software and other kinds of works.

  The licenses for most software and other practical works are designed
to take away your freedom to share and change the works.  By contrast,
the GNU General Public License is intended to guarantee your freedom to
share and change all versions of a program--to make sure it remains free
software for all its users.  We, the Free Software Foundation, use the
GNU General Public License for most of our software; it applies also to
any other work released this way by its authors.  You can apply it to
your programs, too.

  When we speak of free software, we are referring to freedom, not
price.  Our General Public Licenses are designed to make sure that you
have the freedom to distribute copies of free software (and charge for
them if you wish), that you receive source code or can get it if you
want it, that you can change the software or use pieces of it in new
free programs, and that you know you can do these things.

  To protect your rights, we need to prevent others from denying you
these rights or asking you to surrender the rights.  Therefore, you have
certain responsibilities if you distribute copies of the software, or if
you modify it: responsibilities to respect the freedom of others.

  For example, if you distribute copies of such a program, whether
gratis or for a fee, you must pass on to the recipients the same
freedoms that you received.  You must make sure that they, too, receive
or can get the source code.  And you must show them these terms so they
know their rights.

  Developers that use the GNU GPL protect your rights with two steps:
(1) assert copyright on the software, and (2) offer you this License
giving you legal permission to copy, distribute and/or modify it.

  For the developers' and authors' protection, the GPL clearly explains
that there is no warranty for this free software.  For both users' and
authors' sake, the GPL requires that modified versions be marked as
changed, so that their problems will not be attributed erroneously to
authors of previous versions.

  Some devices are designed to deny users access to install or run
modified versions of the software inside them, although the manufacturer
can do so.  This is fundamentally incompatible with the aim of
protecting users' freedom to change the software.  The systematic
pattern of such abuse occurs in the area of products for individuals to
use, which is precisely where it is most unacceptable.  Therefore, we
have designed this version of the GPL to prohibit the practice for those
products.  If such problems arise substantially in other domains, we
stand ready to extend this provision to those domains in future versions
of the GPL, as needed to protect the freedom of users.

  Finally, every program is threatened constantly by software patents.
States should not allow patents to restrict development and use of
software on general-purpose computers, but in those that do, we wish to
avoid the special danger that patents applied to a free program could
make it effectively proprietary.  To prevent this, the GPL assures that
patents cannot be used to render the program non-free.

  The precise terms and conditions for copying, distribution and
modification follow.

                       TERMS AND CONDITIONS

  0. Definitions.

  "This License" refers to version 3 of the GNU General Public License.

  "Copyright" also means copyright-like laws that apply to other kinds of
works, such as semiconductor masks.

  "The Program" refers to any copyrightable work licensed under this
License.  Each licensee is addressed as "you".  "Licensees" and
"recipients" may be individuals or organizations.

  To "modify" a work means to copy from or adapt all or part of the work
in a fashion requiring copyright permission, other than the making of an
exact copy.  The resulting work is called a "modified version" of the
earlier work or a work "based on" the earlier work.

  A "covered work" means either the unmodified Program or a work based
on the Program.

  To "propagate" a work means to do anything with it that, without
permission, would make you directly or secondarily liable for
infringement under applicable copyright law, except executing it on a
computer or modifying a private copy.  Propagation includes copying,
distribution (with or without modification), making available to the
public, and in some countries other activities as well.

  To "convey" a work means any kind of propagation that enables other
parties to make or receive copies.  Mere interaction with a user through
a computer network, with no transfer of a copy, is not conveying.

  An interactive user interface displays "Appropriate Legal Notices"
to the extent that it includes a convenient and prominently visible
feature that (1) displays an appropriate copyright notice, and (2)
tells the user that there is no warranty for the work (except to the
extent that warranties are provided), that licensees may convey the
work under this License, and how to view a copy of this License.  If
the interface presents a list of user commands or options, such as a
menu, a prominent item in the list meets this criterion.

  1. Source Code.

  The "source code" for a work means the preferred form of the work
for making modifications to it.  "Object code" means any non-source
form of a work.

  A "Standard Interface" means an interface that either is an official
standard defined by a recognized standards body, or, in the case of
interfaces specified for a particular programming language, one that
is widely used among developers working in that language.

  The "System Libraries" of an executable work include anything, other
than the work as a whole, that (a) is included in the normal form of
packaging a Major Component, but which is not part of that Major
Component, and (b) serves only to enable use of the work with that
Major Component, or to implement a Standard Interface for which an
implementation is available to the public in source code form.  A
"Major Component", in this context, means a major essential component
(kernel, window system, and so on) of the specific operating system
(if any) on which the executable work runs, or a compiler used to
produce the work, or an object code interpreter used to run it.

  The "Corresponding Source" for a work in object code form means all
the source code needed to generate, install, and (for an executable
work) run the object code and to modify the work, including scripts to
control those activities.  However, it does not include the work's
System Libraries, or general-purpose tools or generally available free
programs which are used unmodified in performing those activities but
which are not part of the work.  For example, Corresponding Source
includes interface definition files associated with source files for
the work, and the source code for shared libraries and dynamically
linked subprograms that the work is specifically designed to require,
such as by intimate data communication or control flow between those
subprograms and other parts of the work.

  The Corresponding Source need not include anything that users
can regenerate automatically from other parts of the Corresponding
Source.

  The Corresponding Source for a work in source code form is that
same work.

  2. Basic Permissions.

  All rights granted under this License are granted for the term of
copyright on the Program, and are irrevocable provided the stated
conditions are met.  This License explicitly affirms your unlimited
permission to run the unmodified Program.  The output from running a
covered work is covered by this License only if the output, given its
content, constitutes a covered work.  This License acknowledges your
rights of fair use or other equivalent, as provided by copyright law.

  You may make, run and propagate covered works that you do not
convey, without conditions so long as your license otherwise remains
in force.  You may convey covered works to others for the sole purpose
of having them make modifications exclusively for you, or provide you
with facilities for running those works, provided that you comply with
the terms of this License in conveying all material for which you do
not control copyright.  Those thus making or running the covered works
for you must do so exclusively on your behalf, under your direction
and control, on terms that prohibit them from making any copies of
your copyrighted material outside their relationship with you.

  Conveying under any other circumstances is permitted solely under
the conditions stated below.  Sublicensing is not allowed; section 10
makes it unnecessary.

  3. Protecting Users' Legal Rights From Anti-Circumvention Law.

  No covered work shall be deemed part of an effective technological
measure under any applicable law fulfilling obligations under article
11 of the WIPO copyright treaty adopted on 20 December 1996, or
similar laws prohibiting or restricting circumvention of such
measures.

  When you convey a covered work, you waive any legal power to forbid
circumvention of technological measures to the extent such circumvention
is effected by exercising rights under this License with respect to
the covered work, and you disclaim any intention to limit operation or
modification of the work as a means of enforcing, against the work's
users, your or third parties' legal rights to forbid circumvention of
technological measures.

  4. Conveying Verbatim Copies.

  You may convey verbatim copies of the Program's source code as you
receive it, in any medium, provided that you conspicuously and
appropriately publish on each copy an appropriate copyright notice;
keep intact all notices stating that this License and any
non-permissive terms added in accord with section 7 apply to the code;
keep intact all notices of the absence of any warranty; and give all
recipients a copy of this License along with the Program.

  You may charge any price or no price for each copy that you convey,
and you may offer support or warranty protection for a fee.

  5. Conveying Modified Source Versions.

  You may convey a work based on the Program, or the modifications to
produce it from the Program, in the form of source code under the
terms of section 4, provided that you also meet all of these conditions:

    a) The work must carry prominent notices stating that you modified
    it, and giving a relevant date.

    b) The work must carry prominent notices stating that it is
    released under this License and any conditions added under section
    7.  This requirement modifies the requirement in section 4 to
    "keep intact all notices".

    c) You must license the entire work, as a whole, under this
    License to anyone who comes into possession of a copy.  This
    License will therefore apply, along with any applicable section 7
    additional terms, to the whole of the work, and all its parts,
    regardless of how they are packaged.  This License gives no
    permission to license the work in any other way, but it does not
    invalidate such permission if you have separately received it.

    d) If the work has interactive user interfaces, each must display
    Appropriate Legal Notices; however, if the Program has interactive
    interfaces that do not display Appropriate Legal Notices, your
    work need not make them do so.

  A compilation of a covered work with other separate and independent
works, which are not by their nature extensions of the covered work,
and which are not combined with it such as to form a larger program,
in or on a volume of a storage or distribution medium, is called an
"aggregate" if the compilation and its resulting copyright are not
used to limit the access or legal rights of the compilation's users
beyond what the individual works permit.  Inclusion of a covered work
in an aggregate does not cause this License to apply to the other
parts of the aggregate.

  6. Conveying Non-Source Forms.

  You may convey a covered work in object code form under the terms
of sections 4 and 5, provided that you also convey the
machine-readable Corresponding Source under the terms of this License,
in one of these ways:

    a) Convey the object code in, or embodied in, a physical product
    (including a physical distribution medium), accompanied by the
    Corresponding Source fixed on a durable physical medium
    customarily used for software interchange.

    b) Convey the object code in, or embodied in, a physical product
    (including a physical distribution medium), accompanied by a
    written offer, valid for at least three years and valid for as
    long as you offer spare parts or customer support for that product
    model, to give anyone who possesses the object code either (1) a
    copy of the Corresponding Source for all the software in the
    product that is covered by this License, on a durable physical
    medium customarily used for software interchange, for a price no
    more than your reasonable cost of physically performing this
    conveying of source, or (2) access to copy the
    Corresponding Source from a network server at no charge.

    c) Convey individual copies of the object code with a copy of the
    written offer to provide the Corresponding Source.  This
    alternative is allowed only occasionally and noncommercially, and
    only if you received the object code with such an offer, in accord
    with subsection 6b.

    d) Convey the object code by offering access from a designated
    place (gratis or for a charge), and offer equivalent access to the
    Corresponding Source in the same way through the same place at no
    further charge.  You need not require recipients to copy the
    Corresponding Source along with the object code.  If the place to
    copy the object code is a network server, the Corresponding Source
    may be on a different server (operated by you or a third party)
    that supports equivalent copying facilities, provided you maintain
    clear directions next to the object code saying where to find the
    Corresponding Source.  Regardless of what server hosts the
    Corresponding Source, you remain obligated to ensure that it is
    available for as long as needed to satisfy these requirements.

    e) Convey the object code using peer-to-peer transmission, provided
    you inform other peers where the object code and Corresponding
    Source of the work are being offered to the general public at no
    charge under subsection 6d.

  A separable portion of the object code, whose source code is excluded
from the Corresponding Source as a System Library, need not be
included in conveying the object code work.

  A "User Product" is either (1) a "consumer product", which means any
tangible personal property which is normally used for personal, family,
or household purposes, or (2) anything designed or sold for incorporation
into a dwelling.  In determining whether a product is a consumer product,
doubtful cases shall be resolved in favor of coverage.  For a particular
product received by a particular user, "normally used" refers to a
typical or common use of that class of product, regardless of the status
of the particular user or of the way in which the particular user
actually uses, or expects or is expected to use, the product.  A product
is a consumer product regardless of whether the product has substantial
commercial, industrial or non-consumer uses, unless such uses represent
the only significant mode of use of the product.

  "Installation Information" for a User Product means any methods,
procedures, authorization keys, or other information required to install
and execute modified versions of a covered work in that User Product from
a modified version of its Corresponding Source.  The information must
suffice to ensure that the continued functioning of the modified object
code is in no case prevented or interfered with solely because
modification has been made.

  If you convey an object code work under this section in, or with, or
specifically for use in, a User Product, and the conveying occurs as
part of a transaction in which the right of possession and use of the
User Product is transferred to the recipient in perpetuity or for a
fixed term (regardless of how the transaction is characterized), the
Corresponding Source conveyed under this section must be accompanied
by the Installation Information.  But this requirement does not apply
if neither you nor any third party retains the ability to install
modified object code on the User Product (for example, the work has
been installed in ROM).

  The requirement to provide Installation Information does not include a
requirement to continue to provide support service, warranty, or updates
for a work that has been modified or installed by the recipient, or for
the User Product in which it has been modified or installed.  Access to a
network may be denied when the modification itself materially and
adversely affects the operation of the network or violates the rules and
protocols for communication across the network.

  Corresponding Source conveyed, and Installation Information provided,
in accord with this section must be in a format that is publicly
documented (and with an implementation available to the public in
source code form), and must require no special password or key for
unpacking, reading or copying.

  7. Additional Terms.

  "Additional permissions" are terms that supplement the terms of this
License by making exceptions from one or more of its conditions.
Additional permissions that are applicable to the entire Program shall
be treated as though they were included in this License, to the extent
that they are valid under applicable law.  If additional permissions
apply only to part of the Program, that part may be used separately
under those permissions, but the entire Program remains governed by
this License without regard to the additional permissions.

  When you convey a copy of a covered work, you may at your option
remove any additional permissions from that copy, or from any part of
it.  (Additional permissions may be written to require their own
removal in certain cases when you modify the work.)  You may place
additional permissions on material, added by you to a covered work,
for which you have or can give appropriate copyright permission.

  Notwithstanding any other provision of this License, for material you
add to a covered work, you may (if authorized by the copyright holders of
that material) supplement the terms of this License with terms:

    a) Disclaiming warranty or limiting liability differently from the
    terms of sections 15 and 16 of this License; or

    b) Requiring preservation of specified reasonable legal notices or
    author attributions in that material or in the Appropriate Legal
    Notices displayed by works containing it; or

    c) Prohibiting misrepresentation of the origin of that material, or
    requiring that modified versions of such material be marked in
    reasonable ways as different from the original version; or

    d) Limiting the use for publicity purposes of names of licensors or
    authors of the material; or

    e) Declining to grant rights under trademark law for use of some
    trade names, trademarks, or service marks; or

    f) Requiring indemnification of licensors and authors of that
    material by anyone who conveys the material (or modified versions of
    it) with contractual assumptions of liability to the recipient, for
    any liability that these contractual assumptions directly impose on
    those licensors and authors.

  All other non-permissive additional terms are considered "further
restrictions" within the meaning of section 10.  If the Program as you
received it, or any part of it, contains a notice stating that it is
governed by this License along with a term that is a further
restriction, you may remove that term.  If a license document contains
a further restriction but permits relicensing or conveying under this
License, you may add to a covered work material governed by the terms
of that license document, provided that the further restriction does
not survive such relicensing or conveying.

  If you add terms to a covered work in accord with this section, you
must place, in the relevant source files, a statement of the
additional terms that apply to those files, or a notice indicating
where to find the applicable terms.

  Additional terms, permissive or non-permissive, may be stated in the
form of a separately written license, or stated as exceptions;
the above requirements apply either way.

  8. Termination.

  You may not propagate or modify a covered work except as expressly
provided under this License.  Any attempt otherwise to propagate or
modify it is void, and will automatically terminate your rights under
this License (including any patent licenses granted under the third
paragraph of section 11).

  However, if you cease all violation of this License, then your
license from a particular copyright holder is reinstated (a)
provisionally, unless and until the copyright holder explicitly and
finally terminates your license, and (b) permanently, if the copyright
holder fails to notify you of the violation by some reasonable means
prior to 60 days after the cessation.

  Moreover, your license from a particular copyright holder is
reinstated permanently if the copyright holder notifies you of the
violation by some reasonable means, this is the first time you have
received notice of violation of this License (for any work) from that
copyright holder, and you cure the violation prior to 30 days after
your receipt of the notice.

  Termination of your rights under this section does not terminate the
licenses of parties who have received copies or rights from you under
this License.  If your rights have been terminated and not permanently
reinstated, you do not qualify to receive new licenses for the same
material under section 10.

  9. Acceptance Not Required for Having Copies.

  You are not required to accept this License in order to receive or
run a copy of the Program.  Ancillary propagation of a covered work
occurring solely as a consequence of using peer-to-peer transmission
to receive a copy likewise does not require acceptance.  However,
nothing other than this License grants you permission to propagate or
modify any covered work.  These actions infringe copyright if you do
not accept this License.  Therefore, by modifying or propagating a
covered work, you indicate your acceptance of this License to do so.

  10. Automatic Licensing of Downstream Recipients.

  Each time you convey a covered work, the recipient automatically
receives a license from the original licensors, to run, modify and
propagate that work, subject to this License.  You are not responsible
for enforcing compliance by third parties with this License.

  An "entity transaction" is a transaction transferring control of an
organization, or substantially all assets of one, or subdividing an
organization, or merging organizations.  If propagation of a covered
work results from an entity transaction, each party to that
transaction who receives a copy of the work also receives whatever
licenses to the work the party's predecessor in interest had or could
give under the previous paragraph, plus a right to possession of the
Corresponding Source of the work from the predecessor in interest, if
the predecessor has it or can get it with reasonable efforts.

  You may not impose any further restrictions on the exercise of the
rights granted or affirmed under this License.  For example, you may
not impose a license fee, royalty, or other charge for exercise of
rights granted under this License, and you may not initiate litigation
(including a cross-claim or counterclaim in a lawsuit) alleging that
any patent claim is infringed by making, using, selling, offering for
sale, or importing the Program or any portion of it.

  11. Patents.

  A "contributor" is a copyright holder who authorizes use under this
License of the Program or a work on which the Program is based.  The
work thus licensed is called the contributor's "contributor version".

  A contributor's "essential patent claims" are all patent claims
owned or controlled by the contributor, whether already acquired or
hereafter acquired, that would be infringed by some manner, permitted
by this License, of making, using, or selling its contributor version,
but do not include claims that would be infringed only as a
consequence of further modification of the contributor version.  For
purposes of this definition, "control" includes the right to grant
patent sublicenses in a manner consistent with the requirements of
this License.

  Each contributor grants you a non-exclusive, worldwide, royalty-free
patent license under the contributor's essential patent claims, to
make, use, sell, offer for sale, import and otherwise run, modify and
propagate the contents of its contributor version.

  In the following three paragraphs, a "patent license" is any express
agreement or commitment, however denominated, not to enforce a patent
(such as an express permission to practice a patent or covenant not to
sue for patent infringement).  To "grant" such a patent license to a
party means to make such an agreement or commitment not to enforce a
patent against the party.

  If you convey a covered work, knowingly relying on a patent license,
and the Corresponding Source of the work is not available for anyone
to copy, free of charge and under the terms of this License, through a
publicly available network server or other readily accessible means,
then you must either (1) cause the Corresponding Source to be so
available, or (2) arrange to deprive yourself of the benefit of the
patent license for this particular work, or (3) arrange, in a manner
consistent with the requirements of this License, to extend the patent
license to downstream recipients.  "Knowingly relying" means you have
actual knowledge that, but for the patent license, your conveying the
covered work in a country, or your recipient's use of the covered work
in a country, would infringe one or more identifiable patents in that
country that you have reason to believe are valid.

  If, pursuant to or in connection with a single transaction or
arrangement, you convey, or propagate by procuring conveyance of, a
covered work, and grant a patent license to some of the parties
receiving the covered work authorizing them to use, propagate, modify
or convey a specific copy of the covered work, then the patent license
you grant is automatically extended to all recipients of the covered
work and works based on it.

  A patent license is "discriminatory" if it does not include within
the scope of its coverage, prohibits the exercise of, or is
conditioned on the non-exercise of one or more of the rights that are
specifically granted under this License.  You may not convey a covered
work if you are a party to an arrangement with a third party that is
in the business of distributing software, under which you make payment
to the third party based on the extent of your activity of conveying
the work, and under which the third party grants, to any of the
parties who would receive the covered work from you, a discriminatory
patent license (a) in connection with copies of the covered work
conveyed by you (or copies made from those copies), or (b) primarily
for and in connection with specific products or compilations that
contain the covered work, unless you entered into that arrangement,
or that patent license was granted, prior to 28 March 2007.

  Nothing in this License shall be construed as excluding or limiting
any implied license or other defenses to infringement that may
otherwise be available to you under applicable patent law.

  12. No Surrender of Others' Freedom.

  If conditions are imposed on you (whether by court order, agreement or
otherwise) that contradict the conditions of this License, they do not
excuse you from the conditions of this License.  If you cannot convey a
covered work so as to satisfy simultaneously your obligations under this
License and any other pertinent obligations, then as a consequence you may
not convey it at all.  For example, if you agree to terms that obligate you
to collect a royalty for further conveying from those to whom you convey
the Program, the only way you could satisfy both those terms and this
License would be to refrain entirely from conveying the Program.

  13. Use with the GNU Affero General Public License.

  Notwithstanding any other provision of this License, you have
permission to link or combine any covered work with a work licensed
under version 3 of the GNU Affero General Public License into a single
combined work, and to convey the resulting work.  The terms of this
License will continue to apply to the part which is the covered work,
but the special requirements of the GNU Affero General Public License,
section 13, concerning interaction through a network will apply to the
combination as such.

  14. Revised Versions of this License.

  The Free Software Foundation may publish revised and/or new versions of
the GNU General Public License from time to time.  Such new versions will
be similar in spirit to the present version, but may differ in detail to
address new problems or concerns.

  Each version is given a distinguishing version number.  If the
Program specifies that a certain numbered version of the GNU General
Public License "or any later version" applies to it, you have the
option of following the terms and conditions either of that numbered
version or of any later version published by the Free Software
Foundation.  If the Program does not specify a version number of the
GNU General Public License, you may choose any version ever published
by the Free Software Foundation.

  If the Program specifies that a proxy can decide which future
versions of the GNU General Public License can be used, that proxy's
public statement of acceptance of a version permanently authorizes you
to choose that version for the Program.

  Later license versions may give you additional or different
permissions.  However, no additional obligations are imposed on any
author or copyright holder as a result of your choosing to follow a
later version.

  15. Disclaimer of Warranty.

  THERE IS NO WARRANTY FOR THE PROGRAM, TO THE EXTENT PERMITTED BY
APPLICABLE LAW.  EXCEPT WHEN OTHERWISE STATED IN WRITING THE COPYRIGHT
HOLDERS AND/OR OTHER PARTIES PROVIDE THE PROGRAM "AS IS" WITHOUT WARRANTY
OF ANY KIND, EITHER EXPRESSED OR IMPLIED, INCLUDING, BUT NOT LIMITED TO,
THE IMPLIED WARRANTIES OF MERCHANTABILITY AND FITNESS FOR A PARTICULAR
PURPOSE.  THE ENTIRE RISK AS TO THE QUALITY AND PERFORMANCE OF THE PROGRAM
IS WITH YOU.  SHOULD THE PROGRAM PROVE DEFECTIVE, YOU ASSUME THE COST OF
ALL NECESSARY SERVICING, REPAIR OR CORRECTION.

  16. Limitation of Liability.

  IN NO EVENT UNLESS REQUIRED BY APPLICABLE LAW OR AGREED TO IN WRITING
WILL ANY COPYRIGHT HOLDER, OR ANY OTHER PARTY WHO MODIFIES AND/OR CONVEYS
THE PROGRAM AS PERMITTED ABOVE, BE LIABLE TO YOU FOR DAMAGES, INCLUDING ANY
GENERAL, SPECIAL, INCIDENTAL OR CONSEQUENTIAL DAMAGES ARISING OUT OF THE
USE OR INABILITY TO USE THE PROGRAM (INCLUDING BUT NOT LIMITED TO LOSS OF
DATA OR DATA BEING RENDERED INACCURATE OR LOSSES SUSTAINED BY YOU OR THIRD
PARTIES OR A FAILURE OF THE PROGRAM TO OPERATE WITH ANY OTHER PROGRAMS),
EVEN IF SUCH HOLDER OR OTHER PARTY HAS BEEN ADVISED OF THE POSSIBILITY OF
SUCH DAMAGES.

  17. Interpretation of Sections 15 and 16.

  If the disclaimer of warranty and limitation of liability provided
above cannot be given local legal effect according to their terms,
reviewing courts shall apply local law that most closely approximates
an absolute waiver of all civil liability in connection with the
Program, unless a warranty or assumption of liability accompanies a
copy of the Program in return for a fee.

                     END OF TERMS AND CONDITIONS

            How to Apply These Terms to Your New Programs

  If you develop a new program, and you want it to be of the greatest
possible use to the public, the best way to achieve this is to make it
free software which everyone can redistribute and change under these terms.

  To do so, attach the following notices to the program.  It is safest
to attach them to the start of each source file to most effectively
state the exclusion of warranty; and each file should have at least
the "copyright" line and a pointer to where the full notice is found.

    <one line to give the program's name and a brief idea of what it does.>
    Copyright (C) <year>  <name of author>

    This program is free software: you can redistribute it and/or modify
    it under the terms of the GNU General Public License as published by
    the Free Software Foundation, either version 3 of the License, or
    (at your option) any later version.

    This program is distributed in the hope that it will be useful,
    but WITHOUT ANY WARRANTY; without even the implied warranty of
    MERCHANTABILITY or FITNESS FOR A PARTICULAR PURPOSE.  See the
    GNU General Public License for more details.

    You should have received a copy of the GNU General Public License
    along with this program.  If not, see <https://www.gnu.org/licenses/>.

Also add information on how to contact you by electronic and paper mail.

  If the program does terminal interaction, make it output a short
notice like this when it starts in an interactive mode:

    <program>  Copyright (C) <year>  <name of author>
    This program comes with ABSOLUTELY NO WARRANTY; for details type `show w'.
    This is free software, and you are welcome to redistribute it
    under certain conditions; type `show c' for details.

The hypothetical commands `show w' and `show c' should show the appropriate
parts of the General Public License.  Of course, your program's commands
might be different; for a GUI interface, you would use an "about box".

  You should also get your employer (if you work as a programmer) or school,
if any, to sign a "copyright disclaimer" for the program, if necessary.
For more information on this, and how to apply and follow the GNU GPL, see
<https://www.gnu.org/licenses/>.

  The GNU General Public License does not permit incorporating your program
into proprietary programs.  If your program is a subroutine library, you
may consider it more useful to permit linking proprietary applications with
the library.  If this is what you want to do, use the GNU Lesser General
Public License instead of this License.  But first, please read
<https://www.gnu.org/licenses/why-not-lgpl.html>.
"""
# ----------------------------------------
