# Dynamo graph Color Tabs by Project.dyn "Color Tabs" (Dynamo 2.3.2.15696)

color_1 = ColorPalette({R: 82, G: 53, B: 239, A: 255})
color_2 = ColorPalette({R: 0, G: 0, B: 0, A: 255})
color_3 = ColorPalette({R: 178, G: 34, B: 34, A: 255})
color_4 = ColorPalette({R: 0, G: 206, B: 209, A: 255})
color_5 = ColorPalette({R: 0, G: 255, B: 127, A: 255})
color_6 = ColorPalette({R: 255, G: 0, B: 255, A: 255})
color_7 = ColorPalette({R: 255, G: 215, B: 0, A: 255})
color_8 = ColorPalette({R: 34, G: 139, B: 34, A: 255})
color_9 = ColorPalette({R: 255, G: 140, B: 0, A: 255})
color_10 = ColorPalette({R: 255, G: 218, B: 185, A: 255})
color_11 = ColorPalette({R: 216, G: 191, B: 216, A: 255})
color_12 = ColorPalette({R: 189, G: 183, B: 107, A: 255})
list_of_colors_ordered = List.Create(item0=color_1, item1=color_2, item2=color_3, item3=color_4, item4=color_5, item5=color_6, item6=color_7, item7=color_8, item8=color_9, item9=color_10, item10=color_11, item11=color_12)
assign_colors_to_tabs = Python(IN[0]=list_of_colors_ordered)
# ---------- assign_colors_to_tabs.python (262 lines) ----------
import sys
import clr
clr.AddReference('ProtoGeometry')
from Autodesk.DesignScript.Geometry import *

import random

clr.AddReference("RevitAPIUI")
import Autodesk 
from Autodesk.Revit.UI import TaskDialog, IExternalEventHandler, ExternalEvent

clr.AddReference('RevitAPI')
import Autodesk
from Autodesk.Revit.DB import *
from Autodesk.Revit.DB import BuiltInCategory

clr.AddReference('System.Drawing')
clr.AddReference('System.Windows.Forms')
import System.Drawing

clr.AddReference('UIFramework')
import UIFramework

clr.AddReference('PresentationCore')
from System.Windows.Media import *

clr.AddReference('PresentationFramework')
from System.Windows.Controls import *

from System import Array
from System.Collections.Generic import *

from System import Enum

clr.AddReference('AdWindows')
import Autodesk
from Autodesk.Windows import *

class ColorTabs(IExternalEventHandler):
	def __init__(self):
		pass

	def Execute(self, uiapp):
		try:
			docking_man = UIFramework.RevitRibbonControl.RibbonControl.Parent.Parent.Parent.Parent.Children[2]
			colorizeTabs(docking_man)
			child_frame = UIFramework.RevitRibbonControl.RibbonControl.Parent.Parent.Parent.Parent.Children[3]
			child_frame.Tag = "ColorTab"
		except Exception as e:
			pass
						
	def GetName(self):
		return "Color Tabs"

def FindVisualChildren(depObj):
	try:
		if not depObj:
			return None
		elif depObj.Name == "mDocumentText" and depObj.Tag != "1":
			if depObj.TextDecorations.Count == 0:
				return depObj
	except Exception as e:
		pass
	foundchild = None
	childrenCount = VisualTreeHelper.GetChildrenCount(depObj)
	for i in range(childrenCount):
		child = VisualTreeHelper.GetChild(depObj, i)
		foundchild = FindVisualChildren(child)
		if foundchild:
			break
	return foundchild
 
def getAllTextBlocks(window):
	all_blocks = List[System.Windows.Controls.TextBlock]()
	try:	
		while True:
			textfound = FindVisualChildren(window)
			if textfound:
				textfound.Tag = "1"
				all_blocks.Add(textfound)
			else:
				break
		for bl in all_blocks:
			bl.Tag = "0"
	except Exception as e:
		pass
	return all_blocks
 
def assignOverlineColor(txtBlock, brushToApply):
	if txtBlock.TextDecorations.Count == 0:	
		myUnderline = System.Windows.TextDecoration()
		if ".rfa" in txtBlock.DataContext.ToolTip:
			myUnderline.Location = System.Windows.TextDecorationLocation()
		else:
			myUnderline.Location = getattr(System.Windows.TextDecorationLocation, 'OverLine')
		myPen = Pen()
		myPen.Brush = brushToApply
		myPen.Thickness = 4
		myUnderline.Pen = myPen
		myUnderline.PenThicknessUnit = System.Windows.TextDecorationUnit.FontRecommended
		myCollection = System.Windows.TextDecorationCollection()
		myCollection.Add(myUnderline)
		txtBlock.TextDecorations = myCollection

def getColor(index_get):
	len_items = len(list_colors)
 	if index_get < len_items:
		dynamo_color = 	list_colors[index_get]
  		return SolidColorBrush(System.Windows.Media.Color.FromArgb(dynamo_color.Alpha, dynamo_color.Red, dynamo_color.Green, dynamo_color.Blue))
	else:
		rand_inde = random.randrange(0,140,1)
		rand_key = dir(System.Windows.Media.Brushes)[rand_inde]
		ran_vl = getattr(System.Windows.Media.Brushes, rand_key)
		if isinstance(ran_vl, System.Windows.Media.Brush) and ran_vl != System.Windows.Media.Brushes.Transparent:
			return ran_vl
		else:
			return getColor(50)

def getDictDocsandColors(all_Blocks, counter):
	for txt_bl in all_Blocks:
		doc_id = txt_bl.Parent.DataContext.Content.Content.document.ToInt64().ToString()
		if not dict_docs.ContainsKey(doc_id):
			dict_docs.Add(doc_id, getColor(counter))
			counter +=1
   
def colorizeTabs(ui_revit, color_active=1):
	try:
		all_txtBlocks = getAllTextBlocks(ui_revit)
		counter = dict_docs.Keys.Count
		getDictDocsandColors(all_txtBlocks, counter)
		#Assign color per document
		for txt_bl in all_txtBlocks:
			try:
				doc_id = txt_bl.Parent.DataContext.Content.Content.document.ToInt64().ToString()
				assignOverlineColor(txt_bl, dict_docs[doc_id])
			except Exception as e:
				pass
	except Exception as e:
		pass
  
def dockingChanged(sender, e):
	try:
		child_frame = UIFramework.RevitRibbonControl.RibbonControl.Parent.Parent.Parent.Parent.Children[3]
		if child_frame.Tag == "ColorTab":
			child_frame.Tag == "running"
			ext_event_uns.Raise()
	except Exception as e:
		pass
global list_colors
list_colors = IN[0]
child_frame = UIFramework.RevitRibbonControl.RibbonControl.Parent.Parent.Parent.Parent.Children[3]
#Color or Clean Lines

if child_frame.Tag == "ColorTab":
	pass
else:
	child_frame.Tag = "ColorTab"
	docking_man = UIFramework.RevitRibbonControl.RibbonControl.Parent.Parent.Parent.Parent.Children[2]
	#Create dic for unique docs
	global dict_docs
	dict_docs = {}
	counter   = 0
	#Crear evento
 	event_handler_uns = ColorTabs()
	ext_event_uns = ExternalEvent.Create(event_handler_uns)
	#Add Color	
	colorizeTabs(docking_man)
	#Subscribe to changes when drag and drop and so on.
	if docking_man.Tag != 1:
		docking_man.GotFocus += dockingChanged
		docking_man.LayoutUpdated += dockingChanged
		docking_man.Tag = 1

OUT = 0

"""
You agreed to the following license terms and conditions. They are also applicable to obtaining and using this script:
License Agreement
For use of NonicaTab PRO.
This License Agreement (this “Agreement” of this “License Agreement”) is made and effective as of the current date (the “Commencement Date”) by and between Nonica by Estudio Alonso Candau SLP a company organized and existing in Spain with a registered address at Avd.Chafarinas 16 Puerto Rey Vera, Almeria (“Licensor”) and yourself (“Licensee”).
WHEREAS:
1.    Licensee wishes to obtain access and use this script (hereinafter, the “Asset”), and
2.    Licensor is willing to grant to the Licensee a non-exclusive, non-transferable License to use the Asset for the term and specific purpose set forth in this Agreement,
NOW, THEREFORE, your access to and use of the Service is conditioned on your acceptance of and compliance with these Terms and Conditions. These Terms and Conditions apply to all visitors, users and others who access or use NonicaTab PRO and its derivative files and scripts.
1. Definitions
1.1 “Agreement” means this License Agreement including the attached Schedule.
1.2 “Confidential Information” means information that:
a. is by its nature confidential;
b. is designated in writing by Licensor as confidential;
c. the Licensee knows or reasonably ought to know is confidential;
d. Information comprised in or relating to any Intellectual Property Rights of Licensor.
1.3 “Asset” means the Asset provided by Licensor as specified in Item 6 of the Schedule in the form as stated in Item 7 of the Schedule.
1.4 “Intellectual Property Rights” means all rights in and to any copyright, trademark, trading name, design, patent, know how (trade secrets) and all other rights resulting from intellectual activity in the industrial, scientific, literary or artistic field and any application or right to apply for registration of any of these rights and any right to protect or enforce any of these rights, as further specified in clause 5.
1.5 “Party” means a person or business entity who has executed this Agreement; details of the Parties are specified in Item 2 of the Schedule.
1.6 “Term” means the term of this Agreement commencing on the Commencement Date as specified in Item 4 of the Schedule and expiring on the Expiry Date specified in Item 5 of the Schedule.
2. License Grant
2.1 Licensor grants to the Licensee a non-exclusive, non-transferable License for the Term to use the Asset for the specific purpose specified in this Agreement, subject to the terms and conditions set out in this Agreement.
3. Charges
3.1 In consideration of the Licensor providing the License under clause 2 of this License Agreement, the Licensee agrees to pay Licensor the amount of the License Charge as specified in Item 9 of the Schedule.
4. Licensee’s Obligations
4.1 The Licensee cannot use the Asset, for purposes other than as specified in this Agreement and in Item 8 of the Schedule.
4.2 The Licensee may permit its employees to use the Asset for the purposes described in Item 8, provided that the Licensee takes all necessary steps and imposes the necessary conditions to ensure that all employees using the Asset do not commercialise or disclose the contents of it to any third person, or use it other than in accordance with the terms of this Agreement.
4.3 The Licensee will not distribute, sell, License or sub-License, let, trade or expose for sale the Asset to a third party.
4.4 No copies of the Asset are to be made other than as expressly approved by Licensor.
4.5 No changes to the Asset or its content may be made by Licensee.
4.6 The Licensee will provide technological and security measures to ensure that the Asset which the Licensee is responsible for is physically and electronically secure from unauthorised use or access.
4.7 Licensee shall ensure that the Asset retains all Licensor copyright notices and other proprietary legends and all trademarks or service marks of Licensor.
5. Intellectual Property Rights
5.1 All Intellectual Property Rights over and in respect of the Asset are owned by Licensor. The Licensee does not acquire any rights of ownership in the Asset.
6. Limitation of Liability
6.1 The Licensee acknowledges and agrees that neither Licensor nor its board members, officers, employees or agents, will be liable for any loss or damage arising out of or resulting from Licensor’s provision of the Asset under this Agreement, or any use of the Asset by the Licensee or its employees; and Licensee hereby releases Licensor to the fullest extent from any such liability, loss, damage or claim.
7. Confidentiality
7.1 Neither Party may use, disclose or make available to any third party the other Party’s Confidential Information, unless such use or disclosure is done in accordance with the terms of this Agreement.
7.2 Each Party must hold the other Party’s Confidential Information secure and in confidence, except to the extent that such Confidential Information:
a. is required to be disclosed according to the requirements of any law, judicial or legislative body or government agency; or
b. was approved for release in writing by the other Party, but only to the extent of and subject to such conditions as may be imposed in such written authorisation.
7.3 This clause 7 will survive termination of this Agreement.
8. Disclaimers & Release
8.1 To the extent permitted by law, Licensor will in no way be liable to the Licensee or any third party for any loss or damage, however caused (including through negligence) which may be directly or indirectly suffered in connection with any use of the Asset.
8.2 The Asset is provided by Licensor on an “as is” basis.
8.3 Licensor will not be held liable by the Licensee in any way, for any loss, damage or injury suffered by the Licensee or by any other person related to any use of the Asset or any part thereof.
8.4 Notwithstanding anything contained in this Agreement, in no event shall Licensor be liable for any claims, damages or loss which may arise from the modification, combination, operation or use of the Asset with Licensee computer programs.
8.5 Licensor does not warrant that the Asset will function in any environment.
8.6 The Licensee acknowledges that: a. The Asset has not been prepared to meet any specific requirements of any party, including any requirements of Licensee; and b. it is therefore the responsibility of the Licensee to ensure that the Asset meets its own individual requirements.
8.7 To the extent permitted by law, no express or implied warranty, term, condition or undertaking is given or assumed by Licensor, including any implied warranty of merchantability or fitness for a particular purpose.
9. Indemnification
9.1 The Licensee must indemnify, defend and hold harmless Licensor, its board members, officers, employees and agents from and against any and all claims (including third party claims), demands, actions, suits, expenses (including attorney’s fees) and damages (including indirect or consequential loss) resulting in any way from:
a. Licensee’s and Licensee’s employee’s use or reliance on the Asset,
b. any breach of the terms of this License Agreement by the Licensee or any Licensee employee, and
c. any other act of Licensee.
9.2 This clause 9 will survive termination of this Agreement.
10. Waiver
10.1 Any failure or delay by either Party to exercise any right, power or privilege hereunder or to insist upon observance or performance by the other of the provisions of this License Agreement shall not operate or be construed as a waiver thereof.
11. Governing Law
11.1 This Agreement will be construed by and governed in accordance with the laws of Spain. The Parties submit to exclusive jurisdiction of the courts of Spain.
12. Termination
12.1 This Agreement and the License granted herein commences upon the Commencement Date and is granted for the Term, unless otherwise terminated by Licensor in the event of any of the following:
a. if the Licensee is in breach of any term of this License Agreement and has not corrected such breach to Licensor’s reasonable satisfaction within 7 days of Licensor’s notice of the same;
b. if the Licensee becomes insolvent, or institutes (or there is instituted against it) proceedings in bankruptcy, insolvency, reorganization or dissolution, or makes an assignment for the benefit of creditors; or
c. the Licensee is in breach of clause 5 or 7 of this Agreement.
12.2 Termination under this clause shall not affect any other rights or remedies Licensor may have.
14. Assignment
14.1 Licensee shall not assign any rights of this License Agreement, without the prior written consent of Licensor.
15. Notices
15.1 All notices required under this Agreement shall be in writing and shall be deemed given (i) when delivered personally; (ii) five (5) days after mailing, when sent certified mail, return receipt requested and postage prepaid; or (iii) one (1) business day after dispatch, when sent via a commercial overnight carrier, fees prepaid. All notices given by either Party must be sent to the address of the other as first written above (unless otherwise changed by written notice).
15.2 Autodesk username, Autodesk Internal ID number and unique identifiers of hardware in your computer are stored in a speciliazed third party cloud server for licensing purposes. This information is neccessary for using NonicaTab PRO. The licensee maintains its full right to delete/remove such information if declining the renewal of the software. NonicaTab PRO will not shared that information with any third party company unless it is required judicially by law. Please contact hello@nonica.io with any further doubt/request.
16. Counterparts
16.1 This Agreement may be executed in any number of counterparts, each of which shall be deemed to be an original and all of which taken together shall constitute one instrument.
17. Severability
17.1 The Parties recognize the uncertainty of the law with respect to certain provisions of this Agreement and expressly stipulate that this Agreement will be construed in a manner that renders its provisions valid and enforceable to the maximum extent possible under applicable law. To the extent that any provisions of this Agreement are determined by a court of competent jurisdiction to be invalid or unenforceable, such provisions will be deleted from this Agreement or modified so as to make them enforceable and the validity and enforceability of the remainder of such provisions and of this Agreement will be unaffected.
18. Entire Agreement
18.1 This Agreement contains the entire agreement between the Parties and supersedes any previous understanding, commitments or agreements, oral or written. Further, this Agreement may not be modified, changed, or otherwise altered in any respect except by a written agreement signed by both Parties.
IN WITNESS WHEREOF, this Agreement, including the attached Schedule, was signed by the Parties under the hands of their duly authorized representatives and made effective as of the current date.
Nonica by Estudio Alonso Candau SLP,
Signature
02/05/2021
Jaime Alonso Candau
Please contact hello@nonica.io with any further doubt/request.
Your signatureby using and accessing this script.
Signed by accepting these terms.
Current date.
"""
# ----------------------------------------
